# Grasshopper definition mysterious_file.gh (Grasshopper 1.0.7)
# plug-ins: LiveCodingGH, Caribou, ClipperComponents

livepy = LiveCodingControllerPython()  # -> Status, LastCommand, DebugLog
panel = Panel(livepy.Status)
panel_2 = Panel(livepy.LastCommand)
panel_3 = Panel(livepy.DebugLog)

osm_file_path_right_click_select_one_fil = FilePath("C:\Users\hellg\OneDrive\240320 Lviv Network Map\erfurt_osm.osm")  # "osm file path (right click->select one file)"
ways = ExtractWays(OSMFilePath=osm_file_path_right_click_select_one_fil, OSMFeatures="building")  # -> Ways, Tags, Report, Bounds
ways_2 = ExtractWays(OSMFilePath=osm_file_path_right_click_select_one_fil, OSMFeatures="highway")  # -> Ways, Tags, Report, Bounds
osm_filter = FilterTags(Items=ways_2.Ways, Tags=ways_2.Tags, selectionHidesObscure=True)  # -> Items, Tags, Report

buildings = Data(ways.Ways)
streets = Data(osm_filter.Items)

drawn_streets = Curve([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])
boundary = Curve(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)
buildings_2 = Data(Tree({0;0}: [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], {0;1}: [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], {0;2}: [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], {0;3}: [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], {0;4}: [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], {0;5}: [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]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))
streets_2 = Data(Tree({0;0}: [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], {0;1}: [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], {0;2}: [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], {0;3}: [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], {0;4}: [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], {0;5}: [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]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))

trim = TrimWithRegion(Curve=buildings, Region=boundary)  # -> Inside, Outside
trim_2 = TrimWithRegion(Curve=streets, Region=boundary)  # -> Inside, Outside
buildings_outside_boundary = Data(trim.Outside)
streets_outside_boundary = Data(trim_2.Outside)
preview = CustomPreview(Geometry=buildings_outside_boundary, Material=ColourSwatch(SwatchColor=RGB(99, 99, 99)))
preview_2 = CustomPreview(Geometry=streets_outside_boundary, Material=ColourSwatch(SwatchColor=RGB(0, 146, 199)))

drawn_streets_2 = Curve(drawn_streets)
boundary_2 = Curve(boundary)
srfsplit = SurfaceSplit(Surface=boundary_2, Curves=drawn_streets_2)
city_blocks = Curve(srfsplit)
offset = OffsetCurve(Curve=city_blocks, Distance=Slider(-4, range=-6..0), Corners=1)  # -> flatten(Curve)
city_blocks_2 = Curve(offset)

min_parcel_area = Slider(500, range=0..1000)

number_slider = Slider(73, range=0..160)
number_slider_2 = Slider(82, range=0..160)
city_blocks_3 = Curve(city_blocks_2)

gen_parcels_v_1 = GenParcelsV1(boundary=city_blocks_3, X=number_slider, Y=number_slider_2)
parcels = Curve(gen_parcels_v_1)

gen_parcels_v_2 = GenParcelsV2(boundary=city_blocks_3, X=number_slider, Y=number_slider_2)
parcels_2 = Curve(gen_parcels_v_2)

voronoi_parcellation = VoronoiParcellation(city_blocks=city_blocks_3, parcel_length=Slider(100, range=5..100))
parcels_3 = Curve(voronoi_parcellation)

gen_parcels_two_rows = GenParcelsTwoRows(boundary=city_blocks_3, X=Slider(65, range=0..160), Y=Slider(99, range=0..160))
parcels_4 = Curve(gen_parcels_two_rows)

parcels_5 = Curve(parcels_2)

number_slider_3 = Slider(-4, range=-6..0)
number_slider_4 = Slider(-12, range=-18..0)
gen_buildings = GenBuildings(boundaries=parcels_5, offset=number_slider_3, depth=number_slider_4)  # disabled
gen_buildings_v_2 = GenBuildingsV2(boundaries=parcels_5, offset=number_slider_3, depth=number_slider_4)  # disabled
buidings = Surface(gen_buildings_v_2)
preview_3 = CustomPreview(Geometry=buidings, Material=ColourSwatch(SwatchColor=RGB(122, 138, 153)))

building_massing_depth = Slider(10, range=0..16)
# We wil come to multi-factor a bit later and it will get funkier there!
attractor = Point(Point(552.9704841, 811.723069, 0))
parcels_6 = Data(parcels_5)

# ----
# Here we generate offset from
# the parcel outline
number_slider_5 = Slider(6, range=0..12)
polyoffset = PolylineOffset(
    Polylines=parcels_6,
    Distance=number_slider_5,
    Plane=Plane(origin=(0, 0, 0), x=(0, 0, 0), y=(0, 0, 0)),
    Tolerance=0.01,
    ClosedFillet=1,
    OpenFillet=1,
    Miter=2)  # -> Contour, Holes

# ----
# Curve Simplification to avoid incorrect
# shapes (always a good idea)
# I tweaked our previously created cluster
# to have another input: Min Area. You can
# create new inputs/outputs of a cluster by
# nagivating inside the cluster and creating
# new "Cluster Input"/"Cluster Output" component.
simplifyplot = SimplifyPlot_4(polyline=polyoffset.Holes, min_area=min_parcel_area)

# ----
# We again use Polyline Offset to get
# inner outline of closed block building.
building_depth = Panel(building_massing_depth)
parcels_7 = Data(flatten(simplifyplot))
polyoffset_2 = PolylineOffset(
    Polylines=graft(parcels_7),
    Distance=building_depth,
    Plane=Plane(origin=(0, 0, 0), x=(0, 0, 0), y=(0, 0, 0)),
    Tolerance=0.01,
    ClosedFillet=2,
    OpenFillet=1,
    Miter=5)  # -> Contour, Holes
item = ListItem(List=polyoffset_2.Holes, Index=0, Wrap=True)

# ----
# Ensure all curves are rotated the same way
# (counterclockwise)
# Have you ever noticed that while using
# normal Offset Curve some curves get
# offseted inwards and some outwards?
# 
# This trick helps make it consistent: we
# use Flip Curve component and provide
# a simple dummy Rectangle as guide for
# direction. Now all closed curves will be
# offseted in the same direction.
rectangle = Rectangle(Plane=PlaneXY(0, 0, 0), XSize=Domain(-1, 1), YSize=Domain(-2, 2), Radius=0)  # -> Rectangle, Length
flip = FlipCurve(Curve=item, Guide=rectangle.Rectangle)  # -> Curve, Flag
closed_block_inner_outline = Data(flatten(flip.Curve))

# ----
# Iteration 3:
# We introduce parametrization here: depending on
# how far from attractor each segment is, we manipulate
# lengths of dashes and gaps in the Dash Pattern.
# We want to convert relative distance to the attractor into lengths of
# dashes and gaps. The closer segment is to the attractor, the smaller
# gaps should be created, and the lengthier our dashes should become.
explode = Explode(Curve=closed_block_inner_outline, Recursive=True)  # -> flatten(Segments), Vertices
# Curve Closest Point provides
# us with the distance from
# each segment to the attractor.
attractor_2 = Point(attractor)
crv_cp = CurveClosestPoint(Point=attractor_2, Curve=explode.Segments)  # -> Point, Parameter, Distance
bnd = Bounds(Numbers=crv_cp.Distance)
max_and_min_dash_size = Panel("40 to 10")
max_and_min_gap_size = Panel("5 to 15")
remap = RemapNumbers(Value=crv_cp.Distance, Source=bnd, Target=max_and_min_dash_size)  # -> Mapped, Clipped
remap_2 = RemapNumbers(Value=crv_cp.Distance, Source=bnd, Target=max_and_min_gap_size)  # -> Mapped, Clipped
merge = Merge(Data1=graft(remap.Mapped), Data2=graft(remap_2.Mapped))
dash = DashPattern(Curve=graft(explode.Segments), Pattern=merge)  # -> flatten(Dashes), Gaps

viewer = ParamViewer(merge)

# ---- group: Join Curves
join = JoinCurves(Curves=dash.Dashes, Preserve=False)  # -> simplify(Curves)
dashes = Data(join)

# ----
inner_facades = Data(dashes)

building_depth_2 = Panel(building_massing_depth)
offset_2 = OffsetCurve(Curve=inner_facades, Distance=building_depth_2, Corners=1)
trim_3 = TrimTree(Tree=offset_2, Depth=1)
outer_facades = Data(trim_3)
inner_facades_2 = Data(inner_facades)

end = EndPoints(Curve=inner_facades_2)  # -> Start, End
end_2 = EndPoints(Curve=outer_facades)  # -> Start, End
ln = Line(StartPoint=end.Start, EndPoint=end_2.Start)
ln_2 = Line(StartPoint=end.End, EndPoint=end_2.End)
merge_2 = Merge(Data1=graft(inner_facades_2), Data2=graft(outer_facades), Data3=graft(ln), Data4=graft(ln_2))
boundary_3 = BoundarySurfaces(Edges=merge_2)

# ----
# 230811
# Single-Factor Attractor Based Building Placement
building_outlines = Data(boundary_3)

# ----
# Iteration 1:
# We use Dash Pattern to transform each
# curve into dashes and gaps. A simple list
# of two numbers serves as our pattern.
number_slider_6 = Slider(20, range=20..80)
merge_3 = Merge(Data1=number_slider_6, Data2=Slider(26, range=0..40))
dash_2 = DashPattern(Curve=flatten(closed_block_inner_outline), Pattern=merge_3)  # -> Dashes, Gaps
join_2 = JoinCurves(Curves=dash_2.Dashes, Preserve=False)  # -> simplify(Curves)

dashes_2 = Data(join_2)

dashes_3 = Data(dashes_2)

# ----
# Iteration 2:
# Let's try to apply Dash Pattern to each segment
# of a curve separately. It might provide more
# straight buildings.
explode_2 = Explode(Curve=closed_block_inner_outline, Recursive=True)  # -> Segments, Vertices

# ---- group: Join Curves
dash_3 = DashPattern(Curve=flatten(explode_2.Segments), Pattern=merge_3)  # -> flatten(Dashes), Gaps
join_3 = JoinCurves(Curves=dash_3.Dashes, Preserve=False)  # -> simplify(Curves)
dashes_4 = Data(join_3)

# ----
dashes_5 = Data(dashes_4)

# ==== cluster GenBuildings
boundaries = ClusterInput()
offset = ClusterInput()
depth = ClusterInput()
boundaries_2 = Curve(boundaries)
offset_2 = Number(offset)
depth_2 = Number(depth)
offset_3 = OffsetCurve(Curve=boundaries_2, Distance=offset_2, Corners=1)
# To generate buildings we simply take the
# parcel outline and offset it inwards twice: first
# time to create some space in front of the facade
# and the second time to give our building some
# depth.
offset_4 = OffsetCurve(Curve=offset_3, Distance=depth_2, Corners=1)
merge = Merge(Data1=simplify(offset_3), Data2=simplify(offset_4))
# After that we need to feed both curves (inner and
# outer outline of the closed city block) into the
# Boundary Surfaces component, which generates
# a new surface enclosed by those two curves.
boundary = BoundarySurfaces(Edges=merge)
buidings = Surface(boundary)
buidings_2 = ClusterOutput(buidings)

# ==== cluster GenParcelsV1
boundary = ClusterInput()
X = ClusterInput()
Y = ClusterInput()
boundary_2 = Surface(boundary)
X_2 = Number(X)
Y_2 = Number(Y)
# For this algorithm we need to find
# bounding boxes of each city block
# independently...
bbox = BoundingBox(Content=graft(boundary_2), Plane=PlaneXY(0, 0, 0))  # -> Box, Box_2
# ...then take its dimension in meters
# (U and V)
dim = Dimensions(Surface=bbox.Box)  # -> UDimension, VDimension
division = Division(A=dim.UDimension, B=X_2)
# ...find out how many parcels would fit on the
# city block in each dimension...
# 
# (if we specify that one parcel must not exceed
# 80m vertically and the given city block is, let's say,
# 210m, it means that we can subdivide it in ca. 3
# parts vertically. We then do the same calculation for
# horizontal dimension)
division_2 = Division(A=dim.VDimension, B=Y_2)
dom² = ConstructDomain²(DomainU=dim.UDimension, DomainV=dim.VDimension)
# ... construct a numerical 2D dimensions and
# subdivide it in equal parts...
# 
# Attach a panel to the output of Construct Domain² to view them. 2D Domain object
# is as simple as a line "0 to 9 horizontally and 0 to 24 vertically", as one example.
# 
# It carries information about measurement in the beginning and in
# the end of some 2D rectangular surface, in our case the bounding surface
# of a city block.
# 
# By subdividing a 2D Domain we can easily get domains of the needed parcels,
# in our case.
divide = DivideDomain²(Domain=dom², UCount=division, VCount=division_2)

# ----
# Example of subdividing a 2D Domain
# Original
# dimensions (m)
# column 1
# column 2
# column 3
# Number of
# segments
# resulting sub-domains
panel = Panel("9")
dom²_2 = ConstructDomain²(DomainU=panel, DomainV="24")
panel_2 = Panel(dom²_2)
divide_2 = DivideDomain²(Domain=dom²_2, UCount="3", VCount="2")
panel_3 = Panel(divide_2)

# ----
# ...get pieces of bouding box inside
# each sub-domain we just created...
# 
# That's why we needed to do it! Isotrim
# component comes really handy here and
# allows us to break a bounding rectangle
# into sub-rectangles by providing their
# measurements (sub-domains).
subsrf = Isotrim(Surface=graft(bbox.Box), Domain=divide)
# ...trim those sub-rectangles by the original
# curve...
# 
# We now only need to go back to our city block
# outlines somehow. Easiest way would be to
# intersect sub-rectangles with original curves.
rint = RegionIntersection(CurvesA=subsrf, CurvesB=graft(boundary_2))
streets = Curve(rint)
streets_2 = ClusterOutput(streets)

# ==== cluster GenParcelsV2
boundary = ClusterInput()
X = ClusterInput()
Y = ClusterInput()
boundary_2 = Surface(boundary)
X_2 = Number(X)
Y_2 = Number(Y)
simplifyplot = SimplifyPlot(polyline=boundary_2)
alignedbbox = AlignedBBox(boundary=simplifyplot)
dim = Dimensions(Surface=alignedbbox)  # -> UDimension, VDimension
dom² = ConstructDomain²(DomainU=dim.UDimension, DomainV=dim.VDimension)
division = Division(A=dim.UDimension, B=X_2)
division_2 = Division(A=dim.VDimension, B=Y_2)
divide = DivideDomain²(Domain=dom², UCount=division, VCount=division_2)
subsrf = Isotrim(Surface=graft(alignedbbox), Domain=divide)
rint = RegionIntersection(CurvesA=subsrf, CurvesB=graft(simplifyplot))
simplifyplot_2 = SimplifyPlot(polyline=rint)
streets = Curve(flatten(simplifyplot_2))
streets_2 = ClusterOutput(streets)

# ==== cluster VoronoiParcellation
parcel_length = ClusterInput()
city_blocks = ClusterInput()
city_blocks_2 = Curve(city_blocks)
parcel_length_2 = Data(parcel_length)
simplifyplot = SimplifyPlot_2(polyline=city_blocks_2)
offset = OffsetCurve(Curve=simplifyplot, Distance=Slider(-7, range=-20..10), Corners=1)  # -> flatten(Curve)
divdist = DivideDistance(Curve=offset, Distance=parcel_length_2)  # -> Points, Tangents, Parameters
voronoi = Voronoi(Points=divdist.Points, BruteForceOverride=False)
rint = RegionIntersection(CurvesA=voronoi, CurvesB=graft(simplifyplot))
explode = Explode(Curve=rint, Recursive=True)  # -> Segments, Vertices
trim = TrimTree(Tree=explode.Vertices, Depth=1)
cullpt = CullDuplicates(Points=trim, Tolerance=Slider(35, range=0..50), CullMode=3)  # -> Points, Indices, Valence
cp = ClosestPoint(Point=explode.Vertices, Cloud=flatten(cullpt.Points))  # -> ClosestPoint, CPIndex, Distance
pline = PolyLine(Vertices=cp.ClosestPoint, Closed=False)
trim_2 = TrimTree(Tree=pline, Depth=1)
parcels = Curve(flatten(trim_2))
parcels_2 = ClusterOutput(parcels)

# ==== cluster GenBuildingsV2
boundaries = ClusterInput()
offset = ClusterInput()
depth = ClusterInput()
# Polyline Offset can work with multiple inputs
# at a time. To avoid mixing up inputs, let's GRAFT
# the boundary input. Now each input curve
# is isolated in its own branch.
boundaries_2 = Curve(graft(boundaries))
offset_2 = Number(offset)
depth_2 = Number(depth)
# One important difference from Curve Offset:
# Polyline Offset only takes *positive* numbers
# as distance, so we put a small Absolute
# component here. It converts any negative
# number into a positive one.
abs = Absolute(Value=offset_2)
# Polyline Offset is much more reliable
# than the built-in Curve Offset. Moreover,
# it offsets the curve in both direction simultaniously:
# inwards (Holes output) and outwards (Contour
# output)
polyoffset = PolylineOffset(
    Polylines=boundaries_2,
    Distance=abs,
    Plane=Plane(origin=(0, 0, 0), x=(0, 0, 0), y=(0, 0, 0)),
    Tolerance=0.01,
    ClosedFillet=1,
    OpenFillet=1,
    Miter=2)  # -> Contour, Holes
outer_facade = Data(polyoffset.Holes)
# We put Absolute here as well. All
# other parts of the script remain
# unchanged.
abs_2 = Absolute(Value=depth_2)
polyoffset_2 = PolylineOffset(
    Polylines=outer_facade,
    Distance=abs_2,
    Plane=Plane(origin=(0, 0, 0), x=(0, 0, 0), y=(0, 0, 0)),
    Tolerance=0.01,
    ClosedFillet=1,
    OpenFillet=1,
    Miter=2)  # -> Contour, Holes
inner_facade = Data(polyoffset_2.Holes)
merge = Merge(Data1=simplify(outer_facade), Data2=simplify(inner_facade))
boundary = BoundarySurfaces(Edges=merge)
buidings = Surface(boundary)
buidings_2 = ClusterOutput(buidings)

# ==== cluster GenParcelsTwoRows
boundary = ClusterInput()
X = ClusterInput()
Y = ClusterInput()
boundary_2 = Surface(boundary)
X_2 = Number(X)
Y_2 = Number(Y)
simplifyplot = SimplifyPlot_3(polyline=boundary_2)
alignedbbox = AlignedBBox(boundary=simplifyplot)
dim = Dimensions(Surface=alignedbbox)  # -> UDimension, VDimension
dom² = ConstructDomain²(DomainU=dim.UDimension, DomainV=dim.VDimension)
division = Division(A=dim.UDimension, B=X_2)
division_2 = Division(A=dim.VDimension, B=Y_2)

min = Minimum(A=division, B="2")

divide = DivideDomain²(Domain=dom², UCount=min, VCount=division_2)
subsrf = Isotrim(Surface=graft(alignedbbox), Domain=divide)
rint = RegionIntersection(CurvesA=subsrf, CurvesB=graft(simplifyplot))
simplifyplot_2 = SimplifyPlot_3(polyline=rint)
streets = Curve(flatten(simplifyplot_2))
streets_2 = ClusterOutput(streets)

# ==== cluster SimplifyPlot_4
polyline = ClusterInput()
min_area = ClusterInput()
polyline_2 = Curve(polyline)
min_area_2 = Data(min_area)
explode = Explode(Curve=polyline_2, Recursive=True)  # -> Segments, Vertices
# To get rid of annoying tiny parts of parcells
# we can break input polyline into edges and
# extend them all by 10-40 meters. Then we can
# cut the original polyline by those edges.
panel = Panel("30")
ext = ExtendCurve(Curve=explode.Segments, Type=0, Start=panel, End=panel)
srfsplit = SurfaceSplit(Surface=graft(polyline_2), Curves=ext)
min_area_3 = Data(min_area_2)
# Now we filter parcels which are
# too small for placing a building.
area = Area(Geometry=srfsplit)  # -> Area, Centroid
larger = LargerThan(FirstNumber=area.Area, SecondNumber=min_area_3)  # -> LargerThan, OrEqualTo
cull = CullPattern(List=srfsplit, CullPattern=larger.LargerThan)  # -> flatten(List)
simplify = SimplifyCurve(Curve=cull)  # -> Curve, Simplified
explode_2 = Explode(Curve=simplify.Curve, Recursive=True)  # -> Segments, Vertices
# As our final touch we can remove vertices
# (points) situated too close to each other
# within one polyline.
panel_2 = Panel("10")
cullpt = CullDuplicates(Points=explode_2.Vertices, Tolerance=panel_2, CullMode=3)  # -> Points, Indices, Valence
pline = PolyLine(Vertices=cullpt.Points, Closed=True)
simplify_2 = SimplifyCurve(Curve=pline)  # -> Curve, Simplified
polyline_3 = Data(flatten(simplify_2.Curve))
polyline_4 = ClusterOutput(polyline_3)

# ==== cluster AlignedBBox
boundary = ClusterInput()
# Usually the bounding box provides good
# approximation of a plot only if aligned with
# its main "direction" or "axis"
boundary_2 = Data(boundary)
# To achieve that we can align it to the curve's longest edge.
# 
# We break the input polyline into all its
# segments, sort them according to their
# length and pick the last one from the
# list (the list is sorted ascending)
explode = Explode(Curve=boundary_2, Recursive=True)  # -> Segments, Vertices
len = Length(Curve=explode.Segments)
sort = SortList(Keys=len, ValuesA=explode.Segments)  # -> Keys, ValuesA
# List item will give us the first item if
# we don't specify any index (i). But notice
# this small arrow icon to the left of (L) input.
# It reverses the list, so the last element
# becomes the first.
# You can reverse the list by right-clicking
# any list input on any component
item = ListItem(List=reverse(sort.ValuesA), Index=0, Wrap=True)
pln = Plane(item)
# Now we use the longest edge as reference
# plane input for the Bounding Box. Remember
# how Grasshopper can implicitly transform a
# point into a plane? Well, it can do the same
# with lines, apparently. You can try it yourself
# by connecting line output to the Plane component
# and looking at the results in 3D
bbox = BoundingBox(Content=graft(boundary_2), Plane=item)  # -> Box, Box_2
alignedbbox = Data(bbox.Box)
alignedbbox_2 = ClusterOutput(alignedbbox)

# ==== cluster SimplifyPlot
polyline = ClusterInput()
polyline_2 = Curve(polyline)
explode = Explode(Curve=polyline_2, Recursive=True)  # -> Segments, Vertices
# To get rid of annoying tiny parts of parcells
# we can break input polyline into edges and
# extend them all by 10-40 meters. Then we can
# cut the original polyline by those edges.
panel = Panel("30")
ext = ExtendCurve(Curve=explode.Segments, Type=0, Start=panel, End=panel)
srfsplit = SurfaceSplit(Surface=graft(polyline_2), Curves=ext)
# Now we filter parcels which are
# too small for placing a building.
area = Area(Geometry=srfsplit)  # -> Area, Centroid
larger = LargerThan(FirstNumber=area.Area, SecondNumber="2000")  # -> LargerThan, OrEqualTo
cull = CullPattern(List=srfsplit, CullPattern=larger.LargerThan)  # -> flatten(List)
simplify = SimplifyCurve(Curve=cull)  # -> Curve, Simplified
explode_2 = Explode(Curve=simplify.Curve, Recursive=True)  # -> Segments, Vertices
# As our final touch we can remove vertices
# (points) situated too close to each other
# within one polyline.
panel_2 = Panel("10")
cullpt = CullDuplicates(Points=explode_2.Vertices, Tolerance=panel_2, CullMode=3)  # -> Points, Indices, Valence
pline = PolyLine(Vertices=cullpt.Points, Closed=True)
simplify_2 = SimplifyCurve(Curve=pline)  # -> Curve, Simplified
polyline_3 = Data(flatten(simplify_2.Curve))
polyline_4 = ClusterOutput(polyline_3)

# ==== cluster SimplifyPlot_2
polyline = ClusterInput()
polyline_2 = Curve(polyline)
explode = Explode(Curve=polyline_2, Recursive=True)  # -> Segments, Vertices
# To get rid of annoying tiny parts of parcells
# we can break input polyline into edges and
# extend them all by 10-40 meters. Then we can
# cut the original polyline by those edges.
panel = Panel("30")
ext = ExtendCurve(Curve=explode.Segments, Type=0, Start=panel, End=panel)
srfsplit = SurfaceSplit(Surface=polyline_2, Curves=flatten(ext))
# Now we filter parcels which are
# too small for placing a building.
area = Area(Geometry=srfsplit)  # -> Area, Centroid
larger = LargerThan(FirstNumber=area.Area, SecondNumber="1000")  # -> LargerThan, OrEqualTo
cull = CullPattern(List=srfsplit, CullPattern=larger.LargerThan)  # -> flatten(List)
simplify = SimplifyCurve(Curve=cull)  # -> Curve, Simplified
explode_2 = Explode(Curve=simplify.Curve, Recursive=True)  # -> Segments, Vertices
# As our final touch we can remove vertices
# (points) situated too close to each other
# within one polyline.
panel_2 = Panel("10")
cullpt = CullDuplicates(Points=explode_2.Vertices, Tolerance=panel_2, CullMode=3)  # -> Points, Indices, Valence
pline = PolyLine(Vertices=cullpt.Points, Closed=True)
simplify_2 = SimplifyCurve(Curve=pline)  # -> Curve, Simplified
polyline_3 = Data(flatten(simplify_2.Curve))
polyline_4 = ClusterOutput(polyline_3)

# ==== cluster SimplifyPlot_3
polyline = ClusterInput()
polyline_2 = Curve(polyline)
explode = Explode(Curve=polyline_2, Recursive=True)  # -> Segments, Vertices
# To get rid of annoying tiny parts of parcells
# we can break input polyline into edges and
# extend them all by 10-40 meters. Then we can
# cut the original polyline by those edges.
panel = Panel("30")
ext = ExtendCurve(Curve=explode.Segments, Type=0, Start=panel, End=panel)
srfsplit = SurfaceSplit(Surface=graft(polyline_2), Curves=ext)
# Now we filter parcels which are
# too small for placing a building.
area = Area(Geometry=srfsplit)  # -> Area, Centroid
larger = LargerThan(FirstNumber=area.Area, SecondNumber="500")  # -> LargerThan, OrEqualTo
cull = CullPattern(List=srfsplit, CullPattern=larger.LargerThan)  # -> flatten(List)
simplify = SimplifyCurve(Curve=cull)  # -> Curve, Simplified
explode_2 = Explode(Curve=simplify.Curve, Recursive=True)  # -> Segments, Vertices
# As our final touch we can remove vertices
# (points) situated too close to each other
# within one polyline.
panel_2 = Panel("10")
cullpt = CullDuplicates(Points=explode_2.Vertices, Tolerance=panel_2, CullMode=3)  # -> Points, Indices, Valence
pline = PolyLine(Vertices=cullpt.Points, Closed=True)
simplify_2 = SimplifyCurve(Curve=pline)  # -> Curve, Simplified
polyline_3 = Data(flatten(simplify_2.Curve))
polyline_4 = ClusterOutput(polyline_3)
