# Grasshopper definition furniteter_plus_dump.gh (Grasshopper 1.0.8)
# plug-ins: ClipperComponents, Human, Tree8, MetaHopper, Wombat

panel = Panel("Geometry Inputs")
apartment_contour = Curve(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)
staircase = Surface([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])
corridor = Curve(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)
children = Curve(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)
livingroom = Curve(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)
kitchen = Curve(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)
bedroom = Curve(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)
bathroom = Curve(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)

furnisher = Furnisher(
    apartment_contour=apartment_contour,
    bedroom=bedroom,
    children=children,
    living_room=livingroom,
    kitchen=kitchen,
    bathroom=bathroom,
    corridor=corridor,
    staircase=staircase)  # -> importance_furniture_2, score_max_2, score_min_11, scores
panel_2 = Panel(furnisher.scores)

apartment_contour_2 = Curve(apartment_contour)
corridor_2 = Curve(corridor)
living_room = Curve(livingroom)
bedroom_2 = Curve(bedroom)
bathroom_2 = Curve(bathroom)
children_2 = Curve(children)
kitchen_2 = Curve(kitchen)

staircase_2 = Curve(staircase)
simplify = Simplify(crv=bedroom_2)

merge = Merge(Data1=bedroom_2, Data2=children_2, Data4=living_room)
flatten = FlattenTree(Tree=merge, Path="{0}")
lng = ListLength(List=flatten)
wohnungstyp = Panel(lng)

merge_2 = Merge(Data1=merge, Data2=bathroom_2, Data3=kitchen_2)

# ---- group: to rooms
kitchen_3 = Curve(kitchen_2)
children_3 = Curve(children_2)
working = Curve()
bedroom_3 = Curve(bedroom_2)
bathroom_3 = Curve(bathroom_2)
merge_3 = Merge(Data1=children_3, Data2=working, Data3=bedroom_3, Data4=kitchen_3, Data5=bathroom_3)  # -> flatten(Result)
corridor_3 = Curve(corridor_2)
living_room_2 = Curve(living_room)
graft = GraftTree(Tree=merge_3, IncludeEmptyLists=True, IncludeNullItems=True)
crvprox = CurveProximity(CurveA=graft, CurveB=corridor_3)  # -> PointA, PointB, Distance
crvprox_2 = CurveProximity(CurveA=graft, CurveB=living_room_2)  # -> PointA, PointB, Distance
smaller = SmallerThan(FirstNumber=crvprox.Distance, SecondNumber=0.25)  # -> SmallerThan, OrEqualTo
smaller_2 = SmallerThan(FirstNumber=crvprox_2.Distance, SecondNumber=0.25)  # -> SmallerThan, OrEqualTo
cull = CullPattern(List=corridor_3, CullPattern=smaller.SmallerThan)
cull_2 = CullPattern(List=living_room_2, CullPattern=smaller_2.SmallerThan)
null = NullItem(Item=cull)  # -> NullFlags, InvalidFlags, Description
dispatch = Dispatch(List=cull_2, DispatchPattern=null.NullFlags)  # -> ListA, ListB
dispatch_2 = Dispatch(List=cull, DispatchPattern=null.NullFlags)  # -> ListA, ListB
panel_3 = Panel(null.NullFlags)
merge_4 = Merge(Data1=dispatch_2.ListB, Data2=dispatch.ListA)

living = Curve(living_room)
merge_5 = Merge(Data1=living)  # -> flatten(Result)
corridor_4 = Curve(corridor_2)
staircase_3 = Curve(living_room)
graft_2 = GraftTree(Tree=merge_5, IncludeEmptyLists=True, IncludeNullItems=True)
crvprox_3 = CurveProximity(CurveA=graft_2, CurveB=corridor_4)  # -> PointA, PointB, Distance
crvprox_4 = CurveProximity(CurveA=graft_2, CurveB=staircase_3)  # -> PointA, PointB, Distance
smaller_3 = SmallerThan(FirstNumber=crvprox_3.Distance, SecondNumber=0.25)  # -> SmallerThan, OrEqualTo
smaller_4 = SmallerThan(FirstNumber=crvprox_4.Distance, SecondNumber=0.25)  # -> SmallerThan, OrEqualTo
cull_3 = CullPattern(List=corridor_4, CullPattern=smaller_3.SmallerThan)
cull_4 = CullPattern(List=staircase_3, CullPattern=smaller_4.SmallerThan)
null_2 = NullItem(Item=cull_3)  # -> NullFlags, InvalidFlags, Description
dispatch_3 = Dispatch(List=cull_4, DispatchPattern=null_2.NullFlags)  # -> ListA, ListB
dispatch_4 = Dispatch(List=cull_3, DispatchPattern=null_2.NullFlags)  # -> ListA, ListB
panel_4 = Panel(null_2.NullFlags)
merge_6 = Merge(Data1=dispatch_4.ListB, Data2=dispatch_3.ListA)

# ----
door_to = Curve(graft)
door_from = Curve(merge_4)
door_to_2 = Curve(graft_2)
door_from_2 = Curve(merge_6)
entwine = Entwine(Branch00=door_from, Branch01=door_from_2, FlattenInputs=True)  # -> flatten(Result)
entwine_2 = Entwine(Branch00=door_to, Branch01=door_to_2, FlattenInputs=True)  # -> flatten(Result)
graft_3 = GraftTree(Tree=entwine_2, IncludeEmptyLists=True, IncludeNullItems=True)
graft_4 = GraftTree(Tree=entwine, IncludeEmptyLists=True, IncludeNullItems=True)
door_from_3 = Curve(graft_4)
door_to_3 = Curve(graft_3)

bedroo_data = Data(Tree({0;0}: ["Bed", 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, 1, 20, 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], {0;1}: ["Bed", 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, 1, 20, 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], {0;2}: ["Bed", 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, 1, 20, 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], {1;0}: ["Bed_StorageThree", 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, 2, 3, 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], {1;1}: ["Bed_StorageTwo", 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, 2, 2, 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], {1;2}: ["Bed_StorageOne", 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, 2, 1, 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]))
wrap = WrapList(Data=bedroo_data)
trim = TrimTree(Tree=wrap, Depth=1)
lng_2 = ListLength(List=trim)
lng_3 = ListLength(List=flatten(lng_2))
nr_of_blocks_to_place = Panel(lng_3)
bang = ExplodeTree(Data=trim)  # -> Branch0, Branch1, Branch2
block_0 = UnwrapList(WrappedData=bang.Branch0)
block_1 = UnwrapList(WrappedData=bang.Branch1)
block_2 = UnwrapList(WrappedData=bang.Branch2)

explode = Explode(Curve=door_to_3, Recursive=True)  # -> Segments, Vertices
crv_cp = CurveClosestPoint(Point=explode.Vertices, Curve=door_to_3)  # -> Point, Parameter, Distance
eval = EvaluateCurve(Curve=door_to_3, Parameter=crv_cp.Parameter)  # -> Point, Tangent, Angle
deg = Degrees(Radians=eval.Angle)
smaller_5 = SmallerThan(FirstNumber=deg, SecondNumber="45")  # -> SmallerThan, OrEqualTo
panel_5 = Panel(deg)
dispatch_5 = Dispatch(List=explode.Vertices, DispatchPattern=smaller_5.SmallerThan)  # -> ListA, ListB
# DOORS
pline = PolyLine(Vertices=dispatch_5.ListB, Closed=False)

explode_2 = Explode(Curve=door_from_3, Recursive=True)  # -> Segments, Vertices
crv_cp_2 = CurveClosestPoint(Point=explode_2.Vertices, Curve=door_from_3)  # -> Point, Parameter, Distance
eval_2 = EvaluateCurve(Curve=door_from_3, Parameter=crv_cp_2.Parameter)  # -> Point, Tangent, Angle
deg_2 = Degrees(Radians=eval_2.Angle)
smaller_6 = SmallerThan(FirstNumber=deg_2, SecondNumber="45")  # -> SmallerThan, OrEqualTo
panel_6 = Panel(deg_2)
dispatch_6 = Dispatch(List=explode_2.Vertices, DispatchPattern=smaller_6.SmallerThan)  # -> ListA, ListB
pline_2 = PolyLine(Vertices=dispatch_6.ListB, Closed=True)

door_from_4 = Curve(pline_2)
door_to_4 = Curve(pline)
explode_3 = Explode(Curve=door_to_4, Recursive=True)  # -> Segments, Vertices
ext = ExtendCurve(Curve=explode_3.Segments, Type=0, Start="-0.3", End="-0.3")
crvprox_5 = CurveProximity(CurveA=ext, CurveB=door_from_4)  # -> PointA, PointB, Distance
abs = Absolute(Value=Slider(0.2, range=0..1))
smaller_7 = SmallerThan(FirstNumber=crvprox_5.Distance, SecondNumber=abs)  # -> SmallerThan, OrEqualTo
cull_5 = CullPattern(List=explode_3.Segments, CullPattern=smaller_7.SmallerThan)
segment_possible = Curve(simplify(cull_5))
join = JoinCurves(Curves=segment_possible, Preserve=False)
sort = SortList(Keys=join, ValuesA=join)  # -> Keys, reverse(ValuesA)
explode_4 = Explode(Curve=door_from_4, Recursive=True)  # -> Segments, Vertices
item = ListItem(List=sort.ValuesA, Index=0, Wrap=True)
crv_cp_3 = CurveClosestPoint(Point=explode_4.Vertices, Curve=item)  # -> Point, Parameter, Distance
shatter = Shatter(Curve=item, Parameters=crv_cp_3.Parameter)
curvepoint = PointOnCurve(shatter, parameter=0.5)
crv_cp_4 = CurveClosestPoint(Point=curvepoint, Curve=door_from_4)  # -> Point, Parameter, Distance
smaller_8 = SmallerThan(FirstNumber=crv_cp_4.Distance, SecondNumber="0.1")  # -> SmallerThan, OrEqualTo
cull_6 = CullPattern(List=shatter, CullPattern=smaller_8.SmallerThan)
intersection_segment_to_place_the_door_a = Curve(cull_6)  # "intersection segment to place the door at"

door_to_5 = Curve(door_to_4)
intersection_segment_to_place_the_door_a_2 = Curve(intersection_segment_to_place_the_door_a)  # "intersection segment to place the door at"
sort_2 = SortList(Keys=intersection_segment_to_place_the_door_a_2, ValuesA=intersection_segment_to_place_the_door_a_2)  # -> Keys, reverse(ValuesA)
item_2 = ListItem(List=sort_2.ValuesA, Index=0, Wrap=True)
explode_5 = Explode(Curve=door_to_5, Recursive=True)  # -> Segments, Vertices
end = EndPoints(Curve=item_2)  # -> simplify(Start), simplify(End)
panel_7 = Panel(explode_5.Vertices)
dist = Distance(PointA=end.End, PointB=explode_5.Vertices)  # -> simplify(Distance)
dist_2 = Distance(PointA=end.Start, PointB=explode_5.Vertices)  # -> simplify(Distance)
sort_3 = SortList(Keys=dist_2)  # -> Keys, ValuesA
sort_4 = SortList(Keys=dist)  # -> Keys, ValuesA
item_3 = ListItem(List=sort_3.Keys, Index=0, Wrap=True)
item_4 = ListItem(List=sort_4.Keys, Index=0, Wrap=True)
merge_7 = Merge(Data1=item_3, Data2=item_4)
merge_8 = Merge(Data1=end.Start, Data2=end.End)
sort_5 = SortList(Keys=merge_7, ValuesA=merge_8)  # -> Keys, ValuesA
item_5 = ListItem(List=sort_5.ValuesA, Index=0, Wrap=True)  # -> Item, Item1
pt = Point(item_5.Item)
pt_2 = Point(item_5.Item1)
vec2pt = Vector2Pt(PointA=pt, PointB=pt_2, Unitize=False)  # -> Vector, Length
amp = Amplitude(Vector=vec2pt.Vector, Amplitude=Slider(0.5, range=0..1))
move = Move(Geometry=pt, Motion=amp)  # -> Geometry, Transform
pt_3 = Point(move.Geometry)

room = Curve(simplify)
polyoffset = PolylineOffset(
    Polylines=room,
    Distance="0.05",
    Plane=Plane(origin=(0, 0, 0), x=(0, 0, 0), y=(0, 0, 0)),
    Tolerance=0.01,
    ClosedFillet=1,
    OpenFillet=1,
    Miter=2)  # -> Contour, Holes
inner_walls_contour = Curve(graft(polyoffset.Holes))
doors = Point(pt_3)
pt_door = Point(doors)
room_2 = Curve(inner_walls_contour)
flatten_2 = FlattenTree(Tree=pt_door, Path="{0}")
crv_cp_5 = CurveClosestPoint(Point=flatten_2, Curve=room_2)  # -> Point, Parameter, Distance
explode_6 = Explode(Curve=room_2, Recursive=True)  # -> Segments, Vertices
panel_8 = Panel("-0.4 To 0.4")
smaller_9 = SmallerThan(FirstNumber=crv_cp_5.Distance, SecondNumber=0.12)  # -> SmallerThan, OrEqualTo
cull_7 = CullPattern(List=flatten_2, CullPattern=smaller_9.SmallerThan)
crv_cp_6 = CurveClosestPoint(Point=cull_7, Curve=explode_6.Segments)  # -> Point, Parameter, Distance
area = Area(Geometry=room_2)  # -> Area, Centroid
sort_6 = SortList(Keys=crv_cp_6.Distance, ValuesA=explode_6.Segments)  # -> Keys, ValuesA
item_6 = ListItem(List=sort_6.ValuesA, Index=0, Wrap=True)
crv_cp_7 = CurveClosestPoint(Point=area.Centroid, Curve=item_6)  # -> Point, Parameter, Distance
ln = Line(StartPoint=area.Centroid, EndPoint=crv_cp_7.Point)
amp_2 = Amplitude(Vector=ln, Amplitude=Slider(0.45, range=0..1))
rev = Reverse(Vector=amp_2)
pl = ConstructPlane(Origin=cull_7, XAxis=item_6, YAxis=rev)
door_width_2 = Number("0.45")
neg = Negative(Value=door_width_2)
dom = ConstructDomain(DomainStart=neg, DomainEnd=door_width_2)
rectangle = Rectangle(Plane=pl, XSize=dom, YSize=dom, Radius=0)  # -> Rectangle, Length
move_2 = Move(Geometry=rectangle.Rectangle, Motion=rev)  # -> Geometry, Transform
door_area = Curve(move_2.Geometry)
cluster = Cluster(room=inner_walls_contour, pt_door=doors, door_width="0.45")
door_area_2 = Curve(door_area)
rdiff = RegionDifference(CurvesA=inner_walls_contour, CurvesB=door_area_2)
room_3 = Curve(inner_walls_contour)
room_diff = Curve(rdiff)

lng_4 = ListLength(List=flatten(room_3))
nr_of_rooms_of_this_type = Number(lng_4)

walls = Curve(room_3)
room_full = Curve(room_3)
room_rdc = Curve(room_diff)

subdivs_count = Slider(14, range=0..20)
number_slider = Slider(0.1, range=0..0.1)

# ---- group: 0
c_script = CSharpScript()  # -> out, A
# ---------- c_script: C# ----------
/*
 * HOW TO USE THIS SCRIPT:
 * 1. Open Grasshopper in Rhino 8.
 * 2. Add a "C# Script" component to your canvas (found under Math > Script).
 * 3. Zoom in on the C# component until a black bar with "..." appears. Click it to open the script editor.
 * 4. In the script editor, replace all the existing code with the code below.
 * 5. Click "OK" to compile and close the editor.
 * 6. The component will have one output, 'A', which will contain the JSON string
 * representing the entire Grasshopper definition.
 * 7. Connect a "Panel" component to the 'A' output to view the JSON.
 *
 * This script requires no inputs. It automatically analyzes the document it belongs to.
 */

using System;
using System.Collections.Generic;
using System.Text.Json;
using Grasshopper.Kernel;
using Rhino.Geometry;

public class Script_Instance : GH_ScriptInstance
{
  private void RunScript(ref object A)
  {
    // Attempt to get the current Grasshopper document.
    // FIX 1: Access OnPingDocument() via the parent Component.
    var doc = this.Component.OnPingDocument();
    if (doc == null)
    {
      AddRuntimeMessage(GH_RuntimeMessageLevel.Warning, "Cannot access the Grasshopper document.");
      return;
    }

    var definition = new GhDefinition();

    // Iterate over every object on the canvas (components, sliders, panels, etc.).
    foreach (var obj in doc.Objects)
    {
      // Case 1: The object is a standard component (e.g., "Addition", "Extrude").
      if (obj is IGH_Component ghComponent)
      {
        var myComponent = new GhComponent
        {
          Uuid = ghComponent.InstanceGuid,
          Name = ghComponent.Name,
          NickName = ghComponent.NickName,
          Description = ghComponent.Description,
          IsComponent = true
        };

        // Process all input parameters for the component.
        foreach (var inputParam in ghComponent.Params.Input)
        {
          var myInput = new GhParameter
          {
            Uuid = inputParam.InstanceGuid,
            Name = inputParam.Name,
            NickName = inputParam.NickName,
            TypeName = inputParam.TypeName
          };

          // Find all sources connected to this input.
          foreach (var source in inputParam.Sources)
          {
            // FIX 2: Get the owner via Attributes, which is more reliable than the .Owner property.
            var sourceOwner = source.Attributes.GetTopLevel.DocObject as IGH_DocumentObject;
            if (sourceOwner != null)
            {
              myInput.Sources.Add(new GhConnection
              {
                SourceComponentUuid = sourceOwner.InstanceGuid,
                SourceParamUuid = source.InstanceGuid
              });
            }
          }
          myComponent.Inputs.Add(myInput);
        }

        // Process all output parameters for the component.
        foreach (var outputParam in ghComponent.Params.Output)
        {
          var myOutput = new GhParameter
          {
            Uuid = outputParam.InstanceGuid,
            Name = outputParam.Name,
            NickName = outputParam.NickName,
            TypeName = outputParam.TypeName
            // The 'Sources' list remains empty for outputs.
          };
          myComponent.Outputs.Add(myOutput);
        }
        definition.Components.Add(myComponent);
      }
      // Case 2: The object is a floating parameter (e.g., a Number Slider, Panel, etc.).
      else if (obj is IGH_Param ghParam)
      {
        // We treat floating parameters as components with one output and a special input
        // to show their own connections.
        var floatingParamAsComponent = new GhComponent
        {
          Uuid = ghParam.InstanceGuid,
          Name = ghParam.Name,
          NickName = ghParam.NickName,
          Description = ghParam.Description,
          IsComponent = false // Mark this as a floating parameter.
        };

        // The single "output" of a floating parameter is the parameter itself.
        floatingParamAsComponent.Outputs.Add(new GhParameter
        {
          Uuid = ghParam.InstanceGuid,
          Name = ghParam.Name,
          NickName = ghParam.NickName,
          TypeName = ghParam.TypeName
        });

        // If the floating parameter is receiving input (e.g., from a wireless connection),
        // we represent this with a single, conceptual "Input" parameter.
        if (ghParam.Sources.Count > 0)
        {
          var inputForFloatingParam = new GhParameter
          {
            Uuid = ghParam.InstanceGuid, // Re-use the GUID for its conceptual input.
            Name = "Input",
            NickName = "Input",
            TypeName = ghParam.TypeName
          };

          foreach (var source in ghParam.Sources)
          {
            // FIX 2 (Applied here as well): Get the owner via Attributes.
            var sourceOwner = source.Attributes.GetTopLevel.DocObject as IGH_DocumentObject;
            if (sourceOwner != null)
            {
              inputForFloatingParam.Sources.Add(new GhConnection
              {
                SourceComponentUuid = sourceOwner.InstanceGuid,
                SourceParamUuid = source.InstanceGuid
              });
            }
          }
          floatingParamAsComponent.Inputs.Add(inputForFloatingParam);
        }

        definition.Components.Add(floatingParamAsComponent);
      }
    }

    // Configure JSON serialization options for clean, readable output.
    var options = new JsonSerializerOptions
    {
      WriteIndented = true
    };

    // Serialize the collected data into a JSON string.
    string jsonString = JsonSerializer.Serialize(definition, options);

    // Assign the final JSON string to the component's output.
    A = jsonString;
  }

  // <Custom additional code>
  // Define the data structures that will be serialized into JSON.
  // These classes represent the hierarchical structure of a Grasshopper definition.

  /// <summary>
  /// Represents the entire Grasshopper definition, containing a list of all components.
  /// </summary>
  public class GhDefinition
  {
    public List<GhComponent> Components { get; set; } = new List<GhComponent>();
  }

  /// <summary>
  /// Represents a single object on the canvas, which can be a standard component
  /// or a floating parameter (like a slider or panel).
  /// </summary>
  public class GhComponent
  {
    public Guid Uuid { get; set; }
    public string Name { get; set; }
    public string NickName { get; set; }
    public string Description { get; set; }
    public bool IsComponent { get; set; } // True for multi-param components, false for floating params.
    public List<GhParameter> Inputs { get; set; } = new List<GhParameter>();
    public List<GhParameter> Outputs { get; set; } = new List<GhParameter>();
  }

  /// <summary>
  /// Represents an input or output parameter of a component.
  /// </summary>
  public class GhParameter
  {
    public Guid Uuid { get; set; }
    public string Name { get; set; }
    public string NickName { get; set; }
    public string TypeName { get; set; }
    public List<GhConnection> Sources { get; set; } = new List<GhConnection>();
  }

  /// <summary>
  /// Represents a connection from a source parameter to an input parameter.
  /// </summary>
  public class GhConnection
  {
    public Guid SourceComponentUuid { get; set; }
    public Guid SourceParamUuid { get; set; }
  }
  // </Custom additional code>
}
# ---------- end c_script ----------
path = FilePath("C:\Users\hellg\Documents\Projects\250823_GrassSpecsel\viewer-app\temp\gh_dump_0.json")
writetxt = WriteToTextFile(Run=Button(), TextToWrite=c_script.A, FilePath=path, Append=False, NewOnly=False)

# ---- group: 3
c_script_2 = CSharpScript()  # -> out, A
# ---------- c_script_2: C# ----------
/*
 * HOW TO USE THIS SCRIPT:
 * 1. Open Grasshopper in Rhino 8.
 * 2. Add a "C# Script" component to your canvas (found under Math > Script).
 * 3. Zoom in on the C# component until a black bar with "..." appears. Click it to open the script editor.
 * 4. In the script editor, replace all the existing code with the code below.
 * 5. Click "OK" to compile and close the editor.
 * 6. The component will have one output, 'A', which will contain the compact JSON string
 * representing the entire Grasshopper definition.
 * 7. Connect a "Panel" component to the 'A' output to view the JSON.
 *
 * This script requires no inputs. It automatically analyzes the document it belongs to.
 */

using System;
using System.Collections.Generic;
using System.Linq;
using System.Text;
using System.Text.Json;
using Grasshopper.Kernel;
using Rhino.Geometry;

public class Script_Instance : GH_ScriptInstance
{
	private void RunScript(ref object A)
	{
		var doc = this.Component.OnPingDocument();
		if (doc == null) { AddRuntimeMessage(GH_RuntimeMessageLevel.Warning, "Cannot access the Grasshopper document."); return; }

		var definition = new CompactGhDefinition();
		var docObjects = doc.Objects.ToList();
		var guidToIndexMap = docObjects.Select((obj, i) => new { obj.InstanceGuid, i }).ToDictionary(x => x.InstanceGuid, x => x.i);

		for (int i = 0; i < docObjects.Count; i++)
		{
			var obj = docObjects[i];
			var myComponent = new CompactGhComponent { Id = i };

			if (obj is IGH_Component ghComponent)
			{
				myComponent.Name = ghComponent.Name;
				myComponent.NickName = ghComponent.NickName;
				myComponent.Description = ghComponent.Description;
				myComponent.IsComponent = true;
				foreach (var inputParam in ghComponent.Params.Input)
				{
					var connections = new List<int[]>();
					foreach (var source in inputParam.Sources)
					{
						var sourceOwnerObj = source.Attributes.GetTopLevel.DocObject;
						if (sourceOwnerObj != null && guidToIndexMap.TryGetValue(sourceOwnerObj.InstanceGuid, out int sourceId))
						{
							int sourceParamIndex = (sourceOwnerObj is IGH_Component sourceComp) ? sourceComp.Params.Output.IndexOf(source) : 0;
							if(sourceParamIndex > -1) connections.Add(new int[] { sourceId, sourceParamIndex });
						}
					}
					myComponent.Inputs.Add(new GhInputParameter { Name = inputParam.Name, TypeName = inputParam.TypeName, Connections = connections });
				}
				myComponent.Outputs = ghComponent.Params.Output.Select(p => {
					string dataPreview = string.Join(", ", p.VolatileData.AllData(true).Select(d => d.ToString()));
					if (dataPreview.Length > 20) dataPreview = dataPreview.Substring(0, 20);
					return new GhOutputParameter { Name = p.Name, TypeName = p.TypeName, DataPreview = dataPreview };
				}).ToList();
			}
			else if (obj is IGH_Param ghParam)
			{
				myComponent.Name = ghParam.Name;
				myComponent.NickName = ghParam.NickName;
				myComponent.Description = ghParam.Description;
				myComponent.IsComponent = false;
				string dataPreview = string.Join(", ", ghParam.VolatileData.AllData(true).Select(d => d.ToString()));
				if (dataPreview.Length > 20) dataPreview = dataPreview.Substring(0, 20);
				myComponent.Outputs.Add(new GhOutputParameter { Name = ghParam.Name, TypeName = ghParam.TypeName, DataPreview = dataPreview });

				if (ghParam.Sources.Any())
				{
					var connections = new List<int[]>();
					foreach(var source in ghParam.Sources)
					{
						var sourceOwnerObj = source.Attributes.GetTopLevel.DocObject;
						if (sourceOwnerObj != null && guidToIndexMap.TryGetValue(sourceOwnerObj.InstanceGuid, out int sourceId))
						{
							int sourceParamIndex = (sourceOwnerObj is IGH_Component sourceComp) ? sourceComp.Params.Output.IndexOf(source) : 0;
							if(sourceParamIndex > -1) connections.Add(new int[] { sourceId, sourceParamIndex });
						}
					}
					myComponent.Inputs.Add(new GhInputParameter { Name = "Input", TypeName = ghParam.TypeName, Connections = connections });
				}
			}
			definition.Components.Add(myComponent);
		}

		// Serialize with standard indentation first.
		string indentedJson = JsonSerializer.Serialize(definition, new JsonSerializerOptions { WriteIndented = true });

		// Post-process the string to replace 2-space indents with 1-space indents.
		var lines = indentedJson.Split(new[] { Environment.NewLine }, StringSplitOptions.None);
		var resultBuilder = new StringBuilder();
		foreach (var line in lines)
		{
			var trimmedLine = line.TrimStart();
			// Default indent is 2 spaces, so we divide by 2 to get the nesting level.
			int indentLevel = (line.Length - trimmedLine.Length) / 2;
			resultBuilder.Append(new string(' ', indentLevel));
			resultBuilder.AppendLine(trimmedLine);
		}

		// Assign the re-formatted string to the output.
		A = resultBuilder.ToString().TrimEnd();
	}

	// <Custom additional code>
	public class CompactGhDefinition { public List<CompactGhComponent> Components { get; set; } = new List<CompactGhComponent>(); }
	public class GhInputParameter { public string Name { get; set; } public string TypeName { get; set; } public List<int[]> Connections { get; set; } = new List<int[]>(); }
	public class GhOutputParameter { public string Name { get; set; } public string TypeName { get; set; } public string DataPreview { get; set; } }
	public class CompactGhComponent
	{
		public int Id { get; set; }
		public string Name { get; set; }
		public string NickName { get; set; }
		public string Description { get; set; }
		public bool IsComponent { get; set; }
		public List<GhInputParameter> Inputs { get; set; } = new List<GhInputParameter>();
		public List<GhOutputParameter> Outputs { get; set; } = new List<GhOutputParameter>();
	}
	// </Custom additional code>
}
# ---------- end c_script_2 ----------
path_2 = FilePath("C:\Users\hellg\Documents\Projects\250823_GrassSpecsel\viewer-app\temp\gh_dump_3.json")
writetxt_2 = WriteToTextFile(Run=Button(), TextToWrite=c_script_2.A, FilePath=path_2, Append=False, NewOnly=False)

# ---- group: 6
c_script_3 = CSharpScript()  # -> out, A
# ---------- c_script_3: C# ----------
/*
 * HOW TO USE THIS SCRIPT:
 * 1. Open Grasshopper in Rhino 8.
 * 2. Add a "C# Script" component to your canvas (found under Math > Script).
 * 3. Zoom in on the C# component until a black bar with "..." appears. Click it to open the script editor.
 * 4. In the script editor, replace all the existing code with the code below.
 * 5. Click "OK" to compile and close the editor.
 * 6. The component will have one output, 'A', which will contain the compact JSON string
 * representing the entire Grasshopper definition.
 * 7. Connect a "Panel" component to the 'A' output to view the JSON.
 *
 * This script requires no inputs. It automatically analyzes the document it belongs to.
 */

using System;
using System.Collections.Generic;
using System.Linq;
using System.Text;
using System.Text.Json;
using Grasshopper.Kernel;
using Grasshopper.Kernel.Types;
using Rhino.Geometry;

public class Script_Instance : GH_ScriptInstance
{
	// Define character limits for data previews.
	private const int PREVIEW_CHAR_LIMIT = 20;
	private const int FULL_DATA_CHAR_LIMIT = 10000;

	/// <summary>
	/// Generates a descriptive string for a given data object (IGH_Goo).
	/// </summary>
	private string GetDataPreviewString(IGH_Goo goo)
	{
		if (goo == null) return "null";

		// Use pattern matching on the underlying data to provide more detail.
		switch (goo.ScriptVariable())
		{
			case Point3d pt:
				return $"Pt({pt.X:F2},{pt.Y:F2},{pt.Z:F2})";

			case Line line:
				return $"Line[({line.From.X:F2},{line.From.Y:F2},{line.From.Z:F2})->({line.To.X:F2},{line.To.Y:F2},{line.To.Z:F2})]";

			case Curve curve when curve.IsLinear():
				return $"Line[({curve.PointAtStart.X:F2},{curve.PointAtStart.Y:F2},{curve.PointAtStart.Z:F2})->({curve.PointAtEnd.X:F2},{curve.PointAtEnd.Y:F2},{curve.PointAtEnd.Z:F2})]";

			case Curve curve:
				var nurbsCurve = curve.ToNurbsCurve();
				if (nurbsCurve != null)
				{
					string pointsStr = string.Join(";", nurbsCurve.Points.Select(p => $"({p.Location.X:F2},{p.Location.Y:F2},{p.Location.Z:F2})"));
					return $"CurvePts[{pointsStr}]";
				}
				return $"Curve(L={curve.GetLength():F2})"; // Fallback

			case Brep brep:
				return $"Brep(V={brep.Vertices.Count},F={brep.Faces.Count})";

			default:
				return goo.ToString(); // Fallback to the default for other types.
		}
	}

	private void RunScript(ref object A)
	{
		var doc = this.Component.OnPingDocument();
		if (doc == null) { AddRuntimeMessage(GH_RuntimeMessageLevel.Warning, "Cannot access the Grasshopper document."); return; }

		var definition = new CompactGhDefinition();
		var docObjects = doc.Objects.ToList();
		var guidToIndexMap = docObjects.Select((obj, i) => new { obj.InstanceGuid, i }).ToDictionary(x => x.InstanceGuid, x => x.i);

		for (int i = 0; i < docObjects.Count; i++)
		{
			var obj = docObjects[i];
			var myComponent = new CompactGhComponent { Id = i };

			if (obj is IGH_Component ghComponent)
			{
				myComponent.Name = ghComponent.Name;
				myComponent.NickName = ghComponent.NickName;
				myComponent.Description = ghComponent.Description;
				myComponent.IsComponent = true;
				foreach (var inputParam in ghComponent.Params.Input)
				{
					var connections = new List<int[]>();
					foreach (var source in inputParam.Sources)
					{
						var sourceOwnerObj = source.Attributes.GetTopLevel.DocObject;
						if (sourceOwnerObj != null && guidToIndexMap.TryGetValue(sourceOwnerObj.InstanceGuid, out int sourceId))
						{
							int sourceParamIndex = (sourceOwnerObj is IGH_Component sourceComp) ? sourceComp.Params.Output.IndexOf(source) : 0;
							if(sourceParamIndex > -1) connections.Add(new int[] { sourceId, sourceParamIndex });
						}
					}
					myComponent.Inputs.Add(new GhInputParameter { Name = inputParam.Name, TypeName = inputParam.TypeName, Connections = connections });
				}

				// A component is considered a "source" if it has no connected inputs.
				bool isSourceComponent = !ghComponent.Params.Input.Any(p => p.Sources.Any());
				myComponent.Outputs = ghComponent.Params.Output.Select(p => {
					bool isUnconnectedOutput = p.Recipients.Count == 0;
					bool showFullData = isSourceComponent || isUnconnectedOutput;

					var data = p.VolatileData.AllData(true);
					var sb = new StringBuilder();
					foreach (var goo in data)
					{
						if (sb.Length > 0) sb.Append(", ");
						sb.Append(GetDataPreviewString(goo));
						if (!showFullData && sb.Length > PREVIEW_CHAR_LIMIT)
						{
							sb.Length = PREVIEW_CHAR_LIMIT;
							sb.Append("...");
							break;
						}
					}
					string dataPreview = sb.ToString();
					if (showFullData && dataPreview.Length > FULL_DATA_CHAR_LIMIT)
					{
						dataPreview = dataPreview.Substring(0, FULL_DATA_CHAR_LIMIT) + "...";
					}

					return new GhOutputParameter { Name = p.Name, TypeName = p.TypeName, DataPreview = dataPreview };
				}).ToList();
			}
			else if (obj is IGH_Param ghParam)
			{
				myComponent.Name = ghParam.Name;
				myComponent.NickName = ghParam.NickName;
				myComponent.Description = ghParam.Description;
				myComponent.IsComponent = false;

				// A floating parameter is a "source" if it has no inputs. Its output is unconnected if it has no recipients.
				bool isSourceParam = ghParam.Sources.Count == 0;
				bool isUnconnectedOutput = ghParam.Recipients.Count == 0;
				bool showFullData = isSourceParam || isUnconnectedOutput;

				var data = ghParam.VolatileData.AllData(true);
				var sb = new StringBuilder();
				foreach (var goo in data)
				{
					if (sb.Length > 0) sb.Append(", ");
					sb.Append(GetDataPreviewString(goo));
					if (!showFullData && sb.Length > PREVIEW_CHAR_LIMIT)
					{
						sb.Length = PREVIEW_CHAR_LIMIT;
						sb.Append("...");
						break;
					}
				}
				string dataPreview = sb.ToString();
				if (showFullData && dataPreview.Length > FULL_DATA_CHAR_LIMIT)
				{
					dataPreview = dataPreview.Substring(0, FULL_DATA_CHAR_LIMIT) + "...";
				}

				myComponent.Outputs.Add(new GhOutputParameter { Name = ghParam.Name, TypeName = ghParam.TypeName, DataPreview = dataPreview });

				if (ghParam.Sources.Any())
				{
					var connections = new List<int[]>();
					foreach(var source in ghParam.Sources)
					{
						var sourceOwnerObj = source.Attributes.GetTopLevel.DocObject;
						if (sourceOwnerObj != null && guidToIndexMap.TryGetValue(sourceOwnerObj.InstanceGuid, out int sourceId))
						{
							int sourceParamIndex = (sourceOwnerObj is IGH_Component sourceComp) ? sourceComp.Params.Output.IndexOf(source) : 0;
							if(sourceParamIndex > -1) connections.Add(new int[] { sourceId, sourceParamIndex });
						}
					}
					myComponent.Inputs.Add(new GhInputParameter { Name = "Input", TypeName = ghParam.TypeName, Connections = connections });
				}
			}
			definition.Components.Add(myComponent);
		}

		// Serialize with standard indentation first.
		string indentedJson = JsonSerializer.Serialize(definition, new JsonSerializerOptions { WriteIndented = true });

		// Post-process the string to replace 2-space indents with 1-space indents.
		var lines = indentedJson.Split(new[] { Environment.NewLine }, StringSplitOptions.None);
		var resultBuilder = new StringBuilder();
		foreach (var line in lines)
		{
			var trimmedLine = line.TrimStart();
			// Default indent is 2 spaces, so we divide by 2 to get the nesting level.
			int indentLevel = (line.Length - trimmedLine.Length) / 2;
			resultBuilder.Append(new string(' ', indentLevel));
			resultBuilder.AppendLine(trimmedLine);
		}

		// Assign the re-formatted string to the output.
		A = resultBuilder.ToString().TrimEnd();
	}

	// <Custom additional code>
	public class CompactGhDefinition { public List<CompactGhComponent> Components { get; set; } = new List<CompactGhComponent>(); }
	public class GhInputParameter { public string Name { get; set; } public string TypeName { get; set; } public List<int[]> Connections { get; set; } = new List<int[]>(); }
	public class GhOutputParameter { public string Name { get; set; } public string TypeName { get; set; } public string DataPreview { get; set; } }
	public class CompactGhComponent
	{
		public int Id { get; set; }
		public string Name { get; set; }
		public string NickName { get; set; }
		public string Description { get; set; }
		public bool IsComponent { get; set; }
		public List<GhInputParameter> Inputs { get; set; } = new List<GhInputParameter>();
		public List<GhOutputParameter> Outputs { get; set; } = new List<GhOutputParameter>();
	}
	// </Custom additional code>
}
# ---------- end c_script_3 ----------
path_3 = FilePath("C:\Users\hellg\Documents\Projects\250823_GrassSpecsel\viewer-app\temp\gh_dump_6.json")
writetxt_3 = WriteToTextFile(Run=Button(), TextToWrite=c_script_3.A, FilePath=path_3, Append=False, NewOnly=False)

# ---- group: 1
c_script_4 = CSharpScript()  # -> out, A
# ---------- c_script_4: C# ----------
/*
 * HOW TO USE THIS SCRIPT:
 * 1. Open Grasshopper in Rhino 8.
 * 2. Add a "C# Script" component to your canvas (found under Math > Script).
 * 3. Zoom in on the C# component until a black bar with "..." appears. Click it to open the script editor.
 * 4. In the script editor, replace all the existing code with the code below.
 * 5. Click "OK" to compile and close the editor.
 * 6. The component will have one output, 'A', which will contain the compact JSON string
 * representing the entire Grasshopper definition.
 * 7. Connect a "Panel" component to the 'A' output to view the JSON.
 *
 * This script requires no inputs. It automatically analyzes the document it belongs to.
 */

using System;
using System.Collections.Generic;
using System.Linq;
using System.Text.Json;
using Grasshopper.Kernel;
using Rhino.Geometry;

public class Script_Instance : GH_ScriptInstance
{
  private void RunScript(ref object A)
  {
    // Attempt to get the current Grasshopper document.
    var doc = this.Component.OnPingDocument();
    if (doc == null)
    {
      AddRuntimeMessage(GH_RuntimeMessageLevel.Warning, "Cannot access the Grasshopper document.");
      return;
    }

    var definition = new CompactGhDefinition();
    var docObjects = doc.Objects.ToList(); // Get a stable list of all objects.

    // First Pass: Create a map from component GUIDs to integer indices for stable referencing.
    var guidToIndexMap = new Dictionary<Guid, int>();
    for (int i = 0; i < docObjects.Count; i++)
    {
      guidToIndexMap[docObjects[i].InstanceGuid] = i;
    }

    // Second Pass: Process each object to build the compact representation.
    for (int i = 0; i < docObjects.Count; i++)
    {
      var obj = docObjects[i];
      var myComponent = new CompactGhComponent { Id = i };

      // Case 1: The object is a standard component (e.g., "Addition", "Extrude").
      if (obj is IGH_Component ghComponent)
      {
        myComponent.Name = ghComponent.Name;
        myComponent.NickName = ghComponent.NickName;
        myComponent.Description = ghComponent.Description;
        myComponent.IsComponent = true;

        // Process all input parameters for the component.
        foreach (var inputParam in ghComponent.Params.Input)
        {
          var connections = new List<int[]>();
          foreach (var source in inputParam.Sources)
          {
            var sourceOwnerObj = source.Attributes.GetTopLevel.DocObject;
            if (sourceOwnerObj != null && guidToIndexMap.ContainsKey(sourceOwnerObj.InstanceGuid))
            {
              int sourceComponentId = guidToIndexMap[sourceOwnerObj.InstanceGuid];
              int sourceParamIndex = 0; // Default for floating params.

              // If the source is a full component, find the specific output index.
              if (sourceOwnerObj is IGH_Component sourceOwnerComponent)
              {
                sourceParamIndex = sourceOwnerComponent.Params.Output.IndexOf(source);
              }
              // For floating params, the output index is implicitly 0.

              if(sourceParamIndex > -1)
              {
                connections.Add(new int[] { sourceComponentId, sourceParamIndex });
              }
            }
          }
          myComponent.Inputs.Add(connections);
        }

        // Process all output parameters.
        myComponent.OutputNames = ghComponent.Params.Output.Select(p => p.NickName).ToList();
      }
      // Case 2: The object is a floating parameter (e.g., a Number Slider, Panel, etc.).
      else if (obj is IGH_Param ghParam)
      {
        myComponent.Name = ghParam.Name;
        myComponent.NickName = ghParam.NickName;
        myComponent.Description = ghParam.Description;
        myComponent.IsComponent = false;

        // A floating parameter has one implicit output, which is itself.
        myComponent.OutputNames.Add(ghParam.NickName);

        // Check for incoming connections (e.g., from wireless senders).
        if (ghParam.Sources.Any())
        {
          var connections = new List<int[]>();
          foreach(var source in ghParam.Sources)
          {
            var sourceOwnerObj = source.Attributes.GetTopLevel.DocObject;
            if (sourceOwnerObj != null && guidToIndexMap.ContainsKey(sourceOwnerObj.InstanceGuid))
            {
              int sourceComponentId = guidToIndexMap[sourceOwnerObj.InstanceGuid];
              int sourceParamIndex = 0; // Default for floating params

              if (sourceOwnerObj is IGH_Component sourceOwnerComponent)
              {
                sourceParamIndex = sourceOwnerComponent.Params.Output.IndexOf(source);
              }
              if(sourceParamIndex > -1)
              {
                connections.Add(new int[] { sourceComponentId, sourceParamIndex });
              }
            }
          }
          myComponent.Inputs.Add(connections);
        }
      }
      definition.Components.Add(myComponent);
    }

    // Configure JSON serialization options for clean, readable output.
    var options = new JsonSerializerOptions { WriteIndented = true };
    string jsonString = JsonSerializer.Serialize(definition, options);

    // Assign the final JSON string to the component's output.
    A = jsonString;
  }

  // <Custom additional code>
  // Define the compact data structures that will be serialized into JSON.

  /// <summary>
  /// Represents the entire Grasshopper definition.
  /// </summary>
  public class CompactGhDefinition
  {
    public List<CompactGhComponent> Components { get; set; } = new List<CompactGhComponent>();
  }

  /// <summary>
  /// Represents a single object on the canvas in a compact format.
  /// </summary>
  public class CompactGhComponent
  {
    public int Id { get; set; }
    public string Name { get; set; }
    public string NickName { get; set; }
    public string Description { get; set; }
    public bool IsComponent { get; set; }
    // Each inner list represents an input parameter.
    // Each int[] represents a connection as [source_component_id, source_output_id].
    public List<List<int[]>> Inputs { get; set; } = new List<List<int[]>>();
    public List<string> OutputNames { get; set; } = new List<string>();
  }
  // </Custom additional code>
}
# ---------- end c_script_4 ----------
path_4 = FilePath("C:\Users\hellg\Documents\Projects\250823_GrassSpecsel\viewer-app\temp\gh_dump_1.json")
writetxt_4 = WriteToTextFile(Run=Button(), TextToWrite=c_script_4.A, FilePath=path_4, Append=False, NewOnly=False)

# ---- group: 4
c_script_5 = CSharpScript()  # -> out, A
# ---------- c_script_5: C# ----------
/*
 * HOW TO USE THIS SCRIPT:
 * 1. Open Grasshopper in Rhino 8.
 * 2. Add a "C# Script" component to your canvas (found under Math > Script).
 * 3. Zoom in on the C# component until a black bar with "..." appears. Click it to open the script editor.
 * 4. In the script editor, replace all the existing code with the code below.
 * 5. Click "OK" to compile and close the editor.
 * 6. The component will have one output, 'A', which will contain the compact JSON string
 * representing the entire Grasshopper definition.
 * 7. Connect a "Panel" component to the 'A' output to view the JSON.
 *
 * This script requires no inputs. It automatically analyzes the document it belongs to.
 */

using System;
using System.Collections.Generic;
using System.Linq;
using System.Text;
using System.Text.Json;
using Grasshopper.Kernel;
using Rhino.Geometry;

public class Script_Instance : GH_ScriptInstance
{
	private void RunScript(ref object A)
	{
		var doc = this.Component.OnPingDocument();
		if (doc == null) { AddRuntimeMessage(GH_RuntimeMessageLevel.Warning, "Cannot access the Grasshopper document."); return; }

		var definition = new CompactGhDefinition();
		var docObjects = doc.Objects.ToList();
		var guidToIndexMap = docObjects.Select((obj, i) => new { obj.InstanceGuid, i }).ToDictionary(x => x.InstanceGuid, x => x.i);

		for (int i = 0; i < docObjects.Count; i++)
		{
			var obj = docObjects[i];
			var myComponent = new CompactGhComponent { Id = i };

			if (obj is IGH_Component ghComponent)
			{
				myComponent.Name = ghComponent.Name;
				myComponent.NickName = ghComponent.NickName;
				myComponent.Description = ghComponent.Description;
				myComponent.IsComponent = true;
				foreach (var inputParam in ghComponent.Params.Input)
				{
					var connections = new List<int[]>();
					foreach (var source in inputParam.Sources)
					{
						var sourceOwnerObj = source.Attributes.GetTopLevel.DocObject;
						if (sourceOwnerObj != null && guidToIndexMap.TryGetValue(sourceOwnerObj.InstanceGuid, out int sourceId))
						{
							int sourceParamIndex = (sourceOwnerObj is IGH_Component sourceComp) ? sourceComp.Params.Output.IndexOf(source) : 0;
							if(sourceParamIndex > -1) connections.Add(new int[] { sourceId, sourceParamIndex });
						}
					}
					myComponent.Inputs.Add(new GhInputParameter { Name = inputParam.Name, TypeName = inputParam.TypeName, Connections = connections });
				}
				myComponent.Outputs = ghComponent.Params.Output.Select(p => {
					string dataPreview = string.Join(", ", p.VolatileData.AllData(true).Select(d => d.ToString()));
					if (dataPreview.Length > 100) dataPreview = dataPreview.Substring(0, 100);
					return new GhOutputParameter { Name = p.Name, TypeName = p.TypeName, DataPreview = dataPreview };
				}).ToList();
			}
			else if (obj is IGH_Param ghParam)
			{
				myComponent.Name = ghParam.Name;
				myComponent.NickName = ghParam.NickName;
				myComponent.Description = ghParam.Description;
				myComponent.IsComponent = false;
				string dataPreview = string.Join(", ", ghParam.VolatileData.AllData(true).Select(d => d.ToString()));
				if (dataPreview.Length > 100) dataPreview = dataPreview.Substring(0, 100);
				myComponent.Outputs.Add(new GhOutputParameter { Name = ghParam.Name, TypeName = ghParam.TypeName, DataPreview = dataPreview });

				if (ghParam.Sources.Any())
				{
					var connections = new List<int[]>();
					foreach(var source in ghParam.Sources)
					{
						var sourceOwnerObj = source.Attributes.GetTopLevel.DocObject;
						if (sourceOwnerObj != null && guidToIndexMap.TryGetValue(sourceOwnerObj.InstanceGuid, out int sourceId))
						{
							int sourceParamIndex = (sourceOwnerObj is IGH_Component sourceComp) ? sourceComp.Params.Output.IndexOf(source) : 0;
							if(sourceParamIndex > -1) connections.Add(new int[] { sourceId, sourceParamIndex });
						}
					}
					myComponent.Inputs.Add(new GhInputParameter { Name = "Input", TypeName = ghParam.TypeName, Connections = connections });
				}
			}
			definition.Components.Add(myComponent);
		}

		// Serialize with standard indentation first.
		string indentedJson = JsonSerializer.Serialize(definition, new JsonSerializerOptions { WriteIndented = true });

		// Post-process the string to replace 2-space indents with 1-space indents.
		var lines = indentedJson.Split(new[] { Environment.NewLine }, StringSplitOptions.None);
		var resultBuilder = new StringBuilder();
		foreach (var line in lines)
		{
			var trimmedLine = line.TrimStart();
			// Default indent is 2 spaces, so we divide by 2 to get the nesting level.
			int indentLevel = (line.Length - trimmedLine.Length) / 2;
			resultBuilder.Append(new string(' ', indentLevel));
			resultBuilder.AppendLine(trimmedLine);
		}

		// Assign the re-formatted string to the output.
		A = resultBuilder.ToString().TrimEnd();
	}

	// <Custom additional code>
	public class CompactGhDefinition { public List<CompactGhComponent> Components { get; set; } = new List<CompactGhComponent>(); }
	public class GhInputParameter { public string Name { get; set; } public string TypeName { get; set; } public List<int[]> Connections { get; set; } = new List<int[]>(); }
	public class GhOutputParameter { public string Name { get; set; } public string TypeName { get; set; } public string DataPreview { get; set; } }
	public class CompactGhComponent
	{
		public int Id { get; set; }
		public string Name { get; set; }
		public string NickName { get; set; }
		public string Description { get; set; }
		public bool IsComponent { get; set; }
		public List<GhInputParameter> Inputs { get; set; } = new List<GhInputParameter>();
		public List<GhOutputParameter> Outputs { get; set; } = new List<GhOutputParameter>();
	}
	// </Custom additional code>
}
# ---------- end c_script_5 ----------
path_5 = FilePath("C:\Users\hellg\Documents\Projects\250823_GrassSpecsel\viewer-app\temp\gh_dump_4.json")
writetxt_5 = WriteToTextFile(Run=Button(), TextToWrite=c_script_5.A, FilePath=path_5, Append=False, NewOnly=False)

# ---- group: 7_pseudocode
c_script_6 = CSharpScript()  # -> out, A
# ---------- c_script_6: C# ----------
/*
 * HOW TO USE THIS SCRIPT:
 * 1. Open Grasshopper in Rhino 8.
 * 2. Add a "C# Script" component to your canvas (found under Math > Script).
 * 3. Zoom in on the C# component until a black bar with "..." appears. Click it to open the script editor.
 * 4. In the script editor, replace all the existing code with the code below.
 * 5. Click "OK" to compile and close the editor.
 * 6. The component will have one output, 'A', which will contain the Python-like pseudocode string
 * representing the entire Grasshopper definition.
 * 7. Connect a "Panel" component to the 'A' output to view the pseudocode.
 *
 * This script requires no inputs. It automatically analyzes the document it belongs to.
 */

using System;
using System.Collections.Generic;
using System.Linq;
using System.Text;
using Grasshopper.Kernel;
using Grasshopper.Kernel.Types;
using Rhino.Geometry;

public class Script_Instance : GH_ScriptInstance
{
	private const bool INCLUDE_DATA_PREVIEWS = false; // Set to false to disable inline comments with data previews
	private const int DATA_PREVIEW_LIMIT = 100;
	private const int UUID_LENGTH = 8; // First 8 chars of UUID

	/// <summary>
	/// Generates a compact data preview string (max 100 chars).
	/// </summary>
	private string GetCompactDataPreview(IGH_Goo goo)
	{
		if (goo == null) return "null";

		string preview = "";
		switch (goo.ScriptVariable())
		{
			case Point3d pt:
				preview = $"Pt({pt.X:F2},{pt.Y:F2},{pt.Z:F2})";
				break;

			case Line line:
				preview = $"Line[({line.From.X:F2},{line.From.Y:F2},{line.From.Z:F2})->({line.To.X:F2},{line.To.Y:F2},{line.To.Z:F2})]";
				break;

			case Curve curve when curve.IsLinear():
				preview = $"Line[({curve.PointAtStart.X:F2},{curve.PointAtStart.Y:F2},{curve.PointAtStart.Z:F2})->({curve.PointAtEnd.X:F2},{curve.PointAtEnd.Y:F2},{curve.PointAtEnd.Z:F2})]";
				break;

			case Curve curve:
				var nurbsCurve = curve.ToNurbsCurve();
				if (nurbsCurve != null)
				{
					string pointsStr = string.Join(";", nurbsCurve.Points.Select(p => $"({p.Location.X:F2},{p.Location.Y:F2},{p.Location.Z:F2})"));
					preview = $"CurvePts[{pointsStr}]";
				}
				else
				{
					preview = $"Curve(L={curve.GetLength():F2})";
				}
				break;

			case Brep brep:
				preview = $"Brep(V={brep.Vertices.Count},F={brep.Faces.Count})";
				break;

			default:
				preview = goo.ToString();
				break;
		}

		// Truncate to 100 characters
		if (preview.Length > DATA_PREVIEW_LIMIT)
		{
			preview = preview.Substring(0, DATA_PREVIEW_LIMIT - 3) + "...";
		}

		return preview;
	}

	/// <summary>
	/// Truncates UUID to specified length and handles collisions.
	/// </summary>
	private string GetShortUuid(Guid guid, HashSet<string> usedUuids)
	{
		string uuidStr = guid.ToString("N"); // No hyphens
		for (int len = 4; len <= UUID_LENGTH; len += 2)
		{
			string shortUuid = uuidStr.Substring(0, len);
			if (!usedUuids.Contains(shortUuid))
			{
				usedUuids.Add(shortUuid);
				return shortUuid;
			}
		}
		// Fallback if all lengths are taken (very unlikely)
		usedUuids.Add(uuidStr.Substring(0, UUID_LENGTH));
		return uuidStr.Substring(0, UUID_LENGTH);
	}

	/// <summary>
	/// Generates a meaningful variable name from component info.
	/// </summary>
	private string GenerateVariableName(PseudocodeComponent comp, HashSet<string> usedUuids)
	{
		string baseName = "";

		// Priority: NickName > Name > ComponentType
		if (!string.IsNullOrEmpty(comp.NickName))
		{
			baseName = comp.NickName.ToLower().Replace(" ", "_").Replace("-", "_");
		}
		else if (!string.IsNullOrEmpty(comp.Name))
		{
			baseName = comp.Name.ToLower().Replace(" ", "_").Replace("-", "_");
		}
		else
		{
			baseName = "component";
		}

		// Remove invalid characters for Python variable names
		baseName = System.Text.RegularExpressions.Regex.Replace(baseName, @"[^a-z0-9_]", "");
		if (string.IsNullOrEmpty(baseName) || char.IsDigit(baseName[0]))
		{
			baseName = "comp_" + baseName;
		}

		string shortUuid = GetShortUuid(comp.Guid, usedUuids);
		return $"{baseName}_{shortUuid}";
	}

	/// <summary>
	/// Performs topological sort on components based on their dependencies.
	/// </summary>
	private List<PseudocodeComponent> TopologicalSort(List<PseudocodeComponent> components)
	{
		var sorted = new List<PseudocodeComponent>();
		var visited = new HashSet<int>();
		var visiting = new HashSet<int>();
		var compById = components.ToDictionary(c => c.Id, c => c);

		void Visit(int compId)
		{
			if (visiting.Contains(compId))
			{
				// Cycle detected - just add it anyway
				return;
			}
			if (visited.Contains(compId)) return;

			visiting.Add(compId);

			if (compById.TryGetValue(compId, out var comp))
			{
				// Visit all dependencies first
				foreach (var input in comp.Inputs)
				{
					foreach (var connection in input.Connections)
					{
						Visit(connection[0]); // Visit source component
					}
				}

				visited.Add(compId);
				sorted.Add(comp);
			}

			visiting.Remove(compId);
		}

		// Visit all components
		foreach (var comp in components)
		{
			if (!visited.Contains(comp.Id))
			{
				Visit(comp.Id);
			}
		}

		return sorted;
	}

	private void RunScript(ref object A)
	{
		var doc = this.Component.OnPingDocument();
		if (doc == null)
		{
			AddRuntimeMessage(GH_RuntimeMessageLevel.Warning, "Cannot access the Grasshopper document.");
			return;
		}

		var components = new List<PseudocodeComponent>();
		var docObjects = doc.Objects.ToList();
		var guidToIndexMap = docObjects.Select((obj, i) => new { obj.InstanceGuid, i }).ToDictionary(x => x.InstanceGuid, x => x.i);
		var usedUuids = new HashSet<string>();

		// Parse all components
		for (int i = 0; i < docObjects.Count; i++)
		{
			var obj = docObjects[i];
			var comp = new PseudocodeComponent
			{
				Id = i,
				Guid = obj.InstanceGuid
			};

			if (obj is IGH_Component ghComponent)
			{
				comp.Name = ghComponent.Name;
				comp.NickName = ghComponent.NickName;
				comp.Description = ghComponent.Description;
				comp.IsComponent = true;

				// Parse inputs
				foreach (var inputParam in ghComponent.Params.Input)
				{
					var connections = new List<int[]>();
					foreach (var source in inputParam.Sources)
					{
						var sourceOwnerObj = source.Attributes.GetTopLevel.DocObject;
						if (sourceOwnerObj != null && guidToIndexMap.TryGetValue(sourceOwnerObj.InstanceGuid, out int sourceId))
						{
							int sourceParamIndex = (sourceOwnerObj is IGH_Component sourceComp) ? sourceComp.Params.Output.IndexOf(source) : 0;
							if (sourceParamIndex > -1) connections.Add(new int[] { sourceId, sourceParamIndex });
						}
					}
					comp.Inputs.Add(new PseudocodeInput { Name = inputParam.Name, TypeName = inputParam.TypeName, Connections = connections });
				}

				// Parse outputs
				comp.Outputs = ghComponent.Params.Output.Select(p => {
					var data = p.VolatileData.AllData(true);
					var dataPreview = data.Any() ? string.Join(", ", data.Select(GetCompactDataPreview)) : "null";

					return new PseudocodeOutput { Name = p.Name, TypeName = p.TypeName, DataPreview = dataPreview, HasRecipients = p.Recipients.Count > 0 };
				}).ToList();
			}
			else if (obj is IGH_Param ghParam)
			{
				comp.Name = ghParam.Name;
				comp.NickName = ghParam.NickName;
				comp.Description = ghParam.Description;
				comp.IsComponent = false;

				var data = ghParam.VolatileData.AllData(true);
				var dataPreview = data.Any() ? string.Join(", ", data.Select(GetCompactDataPreview)) : "null";

				comp.Outputs.Add(new PseudocodeOutput { Name = ghParam.Name, TypeName = ghParam.TypeName, DataPreview = dataPreview, HasRecipients = ghParam.Recipients.Count > 0 });

				if (ghParam.Sources.Any())
				{
					var connections = new List<int[]>();
					foreach (var source in ghParam.Sources)
					{
						var sourceOwnerObj = source.Attributes.GetTopLevel.DocObject;
						if (sourceOwnerObj != null && guidToIndexMap.TryGetValue(sourceOwnerObj.InstanceGuid, out int sourceId))
						{
							int sourceParamIndex = (sourceOwnerObj is IGH_Component sourceComp) ? sourceComp.Params.Output.IndexOf(source) : 0;
							if (sourceParamIndex > -1) connections.Add(new int[] { sourceId, sourceParamIndex });
						}
					}
					comp.Inputs.Add(new PseudocodeInput { Name = "Input", TypeName = ghParam.TypeName, Connections = connections });
				}
			}

			components.Add(comp);
		}

		// Generate variable names for all components
		foreach (var comp in components)
		{
			comp.VariableName = GenerateVariableName(comp, usedUuids);
		}

		// Sort components topologically
		var sortedComponents = TopologicalSort(components);

		// Generate pseudocode
		var output = new StringBuilder();

		// Header
		output.AppendLine("# === GRASSHOPPER DEFINITION PSEUDOCODE ===");
		output.AppendLine($"# Generated: {DateTime.Now:yyyy-MM-dd HH:mm:ss}");

		var sourceCount = sortedComponents.Count(c => !c.Inputs.Any());
		var sinkCount = sortedComponents.Count(c => !c.Outputs.Any(o => o.HasRecipients));
		var totalConnections = sortedComponents.Sum(c => c.Inputs.Sum(i => i.Connections.Count));

		output.AppendLine($"# Components: {sortedComponents.Count} | Connections: {totalConnections} | Sources: {sourceCount} | Sinks: {sinkCount}");
		output.AppendLine();

		// Source components (no inputs)
		var sources = sortedComponents.Where(c => !c.Inputs.Any()).ToList();
		if (sources.Any())
		{
			output.AppendLine("# === SOURCE DATA (No inputs) ===");
			foreach (var comp in sources)
			{
				var mainOutput = comp.Outputs.FirstOrDefault();
				if (mainOutput != null)
				{
					string typeName = mainOutput.TypeName ?? "Object";
					string preview = INCLUDE_DATA_PREVIEWS ? $"  # {mainOutput.DataPreview}" : "";
					output.AppendLine($"{comp.VariableName}: {typeName} = {comp.Name ?? "Component"}(){preview}");
				}
			}
			output.AppendLine();
		}

		// Main processing chain (components with inputs and outputs)
		var processors = sortedComponents.Where(c => c.Inputs.Any() && c.Outputs.Any(o => o.HasRecipients)).ToList();
		if (processors.Any())
		{
			output.AppendLine("# === MAIN PROCESSING CHAIN ===");
			foreach (var comp in processors)
			{
				var mainOutput = comp.Outputs.FirstOrDefault();
				if (mainOutput != null)
				{
					string typeName = mainOutput.TypeName ?? "Object";
					if (comp.Outputs.Count > 1)
						typeName = $"Tuple[{string.Join(", ", comp.Outputs.Select(o => o.TypeName ?? "Object"))}]";

					// Generate function call
					var functionName = comp.Name ?? "Process";
					var args = new List<string>();

					foreach (var input in comp.Inputs)
					{
						foreach (var connection in input.Connections)
						{
							var sourceComp = sortedComponents.FirstOrDefault(c => c.Id == connection[0]);
							if (sourceComp != null)
							{
								args.Add(sourceComp.VariableName);
							}
						}
					}

					if (comp.Outputs.Count == 1)
					{
						string preview = INCLUDE_DATA_PREVIEWS ? $"  # {mainOutput.DataPreview}" : "";
						output.AppendLine($"{comp.VariableName}: {typeName} = {functionName}({string.Join(", ", args)}){preview}");
					}
					else
					{
						// Multiple outputs
						var outputNames = string.Join(", ", comp.Outputs.Select(o => $"{comp.VariableName}_{o.Name?.ToLower() ?? "out"}"));
						output.AppendLine($"{outputNames}: {typeName} = {functionName}({string.Join(", ", args)})");
					}
				}
			}
			output.AppendLine();
		}

		// Disconnected/Display components (sinks)
		var sinks = sortedComponents.Where(c => c.Outputs.Any() && !c.Outputs.Any(o => o.HasRecipients) && c.Inputs.Any()).ToList();
		if (sinks.Any())
		{
			output.AppendLine("# === DISCONNECTED/DISPLAY COMPONENTS ===");
			foreach (var comp in sinks)
			{
				var mainOutput = comp.Outputs.FirstOrDefault();
				if (mainOutput != null)
				{
					string typeName = mainOutput.TypeName ?? "Object";
					var functionName = comp.Name ?? "Display";
					var args = new List<string>();

					foreach (var input in comp.Inputs)
					{
						foreach (var connection in input.Connections)
						{
							var sourceComp = sortedComponents.FirstOrDefault(c => c.Id == connection[0]);
							if (sourceComp != null)
							{
								args.Add(sourceComp.VariableName);
							}
						}
					}

					string preview = INCLUDE_DATA_PREVIEWS ? $"  # {mainOutput.DataPreview}" : "";
					output.AppendLine($"{comp.VariableName}: {typeName} = {functionName}({string.Join(", ", args)}){preview}");
				}
			}
		}

		A = output.ToString();
	}

	// <Custom additional code>
	public class PseudocodeComponent
	{
		public int Id { get; set; }
		public Guid Guid { get; set; }
		public string Name { get; set; }
		public string NickName { get; set; }
		public string Description { get; set; }
		public bool IsComponent { get; set; }
		public string VariableName { get; set; }
		public List<PseudocodeInput> Inputs { get; set; } = new List<PseudocodeInput>();
		public List<PseudocodeOutput> Outputs { get; set; } = new List<PseudocodeOutput>();
	}

	public class PseudocodeInput
	{
		public string Name { get; set; }
		public string TypeName { get; set; }
		public List<int[]> Connections { get; set; } = new List<int[]>();
	}

	public class PseudocodeOutput
	{
		public string Name { get; set; }
		public string TypeName { get; set; }
		public string DataPreview { get; set; }
		public bool HasRecipients { get; set; }
	}
	// </Custom additional code>
}
# ---------- end c_script_6 ----------
path_6 = FilePath("C:\Users\hellg\Documents\Projects\grasshopper_live_bridge\misc\gh2json_converter\furniturer_pseudocode.py")
writetxt_6 = WriteToTextFile(Run=Button(), TextToWrite=c_script_6.A, FilePath=path_6, Append=False, NewOnly=False)

# ---- group: 2
c_script_7 = CSharpScript()  # -> out, A
# ---------- c_script_7: C# ----------
/*
 * HOW TO USE THIS SCRIPT:
 * 1. Open Grasshopper in Rhino 8.
 * 2. Add a "C# Script" component to your canvas (found under Math > Script).
 * 3. Zoom in on the C# component until a black bar with "..." appears. Click it to open the script editor.
 * 4. In the script editor, replace all the existing code with the code below.
 * 5. Click "OK" to compile and close the editor.
 * 6. The component will have one output, 'A', which will contain the compact JSON string
 * representing the entire Grasshopper definition.
 * 7. Connect a "Panel" component to the 'A' output to view the JSON.
 *
 * This script requires no inputs. It automatically analyzes the document it belongs to.
 */

using System;
using System.Collections.Generic;
using System.Linq;
using System.Text;
using System.Text.Json;
using Grasshopper.Kernel;
using Rhino.Geometry;

public class Script_Instance : GH_ScriptInstance
{
	private void RunScript(ref object A)
	{
		var doc = this.Component.OnPingDocument();
		if (doc == null) { AddRuntimeMessage(GH_RuntimeMessageLevel.Warning, "Cannot access the Grasshopper document."); return; }

		var definition = new CompactGhDefinition();
		var docObjects = doc.Objects.ToList();
		var guidToIndexMap = docObjects.Select((obj, i) => new { obj.InstanceGuid, i }).ToDictionary(x => x.InstanceGuid, x => x.i);

		for (int i = 0; i < docObjects.Count; i++)
		{
			var obj = docObjects[i];
			var myComponent = new CompactGhComponent { Id = i };

			if (obj is IGH_Component ghComponent)
			{
				myComponent.Name = ghComponent.Name;
				myComponent.NickName = ghComponent.NickName;
				myComponent.Description = ghComponent.Description;
				myComponent.IsComponent = true;
				foreach (var inputParam in ghComponent.Params.Input)
				{
					myComponent.InputParams.Add(new CompactGhParameter { NickName = inputParam.NickName, TypeName = inputParam.TypeName });
					var connections = new List<int[]>();
					foreach (var source in inputParam.Sources)
					{
						var sourceOwnerObj = source.Attributes.GetTopLevel.DocObject;
						if (sourceOwnerObj != null && guidToIndexMap.TryGetValue(sourceOwnerObj.InstanceGuid, out int sourceId))
						{
							int sourceParamIndex = (sourceOwnerObj is IGH_Component sourceComp) ? sourceComp.Params.Output.IndexOf(source) : 0;
							if(sourceParamIndex > -1) connections.Add(new int[] { sourceId, sourceParamIndex });
						}
					}
					myComponent.Inputs.Add(connections);
				}
				myComponent.Outputs = ghComponent.Params.Output.Select(p => new CompactGhParameter { NickName = p.NickName, TypeName = p.TypeName }).ToList();
			}
			else if (obj is IGH_Param ghParam)
			{
				myComponent.Name = ghParam.Name;
				myComponent.NickName = ghParam.NickName;
				myComponent.Description = ghParam.Description;
				myComponent.IsComponent = false;
				myComponent.Outputs.Add(new CompactGhParameter { NickName = ghParam.NickName, TypeName = ghParam.TypeName });
				if (ghParam.Sources.Any())
				{
					myComponent.InputParams.Add(new CompactGhParameter { NickName = "Input", TypeName = ghParam.TypeName });
					var connections = new List<int[]>();
					foreach(var source in ghParam.Sources)
					{
						var sourceOwnerObj = source.Attributes.GetTopLevel.DocObject;
						if (sourceOwnerObj != null && guidToIndexMap.TryGetValue(sourceOwnerObj.InstanceGuid, out int sourceId))
						{
							int sourceParamIndex = (sourceOwnerObj is IGH_Component sourceComp) ? sourceComp.Params.Output.IndexOf(source) : 0;
							if(sourceParamIndex > -1) connections.Add(new int[] { sourceId, sourceParamIndex });
						}
					}
					myComponent.Inputs.Add(connections);
				}
			}
			definition.Components.Add(myComponent);
		}

		// Serialize with standard indentation first.
		string indentedJson = JsonSerializer.Serialize(definition, new JsonSerializerOptions { WriteIndented = true });

		// Post-process the string to replace 2-space indents with 1-space indents.
		var lines = indentedJson.Split(new[] { Environment.NewLine }, StringSplitOptions.None);
		var resultBuilder = new StringBuilder();
		foreach (var line in lines)
		{
			var trimmedLine = line.TrimStart();
			// Default indent is 2 spaces, so we divide by 2 to get the nesting level.
			int indentLevel = (line.Length - trimmedLine.Length) / 2;
			resultBuilder.Append(new string(' ', indentLevel));
			resultBuilder.AppendLine(trimmedLine);
		}

		// Assign the re-formatted string to the output.
		A = resultBuilder.ToString().TrimEnd();
	}

	// <Custom additional code>
	public class CompactGhDefinition { public List<CompactGhComponent> Components { get; set; } = new List<CompactGhComponent>(); }
	public class CompactGhParameter { public string NickName { get; set; } public string TypeName { get; set; } }
	public class CompactGhComponent
	{
		public int Id { get; set; }
		public string Name { get; set; }
		public string NickName { get; set; }
		public string Description { get; set; }
		public bool IsComponent { get; set; }
		public List<List<int[]>> Inputs { get; set; } = new List<List<int[]>>();
		public List<CompactGhParameter> InputParams { get; set; } = new List<CompactGhParameter>();
		public List<CompactGhParameter> Outputs { get; set; } = new List<CompactGhParameter>();
	}
	// </Custom additional code>
}
# ---------- end c_script_7 ----------
path_7 = FilePath("C:\Users\hellg\Documents\Projects\250823_GrassSpecsel\viewer-app\temp\gh_dump_2.json")
writetxt_7 = WriteToTextFile(Run=Button(), TextToWrite=c_script_7.A, FilePath=path_7, Append=False, NewOnly=False)

# ---- group: 5
c_script_8 = CSharpScript()  # -> out, A
# ---------- c_script_8: C# ----------
/*
 * HOW TO USE THIS SCRIPT:
 * 1. Open Grasshopper in Rhino 8.
 * 2. Add a "C# Script" component to your canvas (found under Math > Script).
 * 3. Zoom in on the C# component until a black bar with "..." appears. Click it to open the script editor.
 * 4. In the script editor, replace all the existing code with the code below.
 * 5. Click "OK" to compile and close the editor.
 * 6. The component will have one output, 'A', which will contain the compact JSON string
 * representing the entire Grasshopper definition.
 * 7. Connect a "Panel" component to the 'A' output to view the JSON.
 *
 * This script requires no inputs. It automatically analyzes the document it belongs to.
 */

using System;
using System.Collections.Generic;
using System.Linq;
using System.Text;
using System.Text.Json;
using Grasshopper.Kernel;
using Rhino.Geometry;

public class Script_Instance : GH_ScriptInstance
{
	// Define character limits for data previews.
	private const int PREVIEW_CHAR_LIMIT = 100;
	private const int FULL_DATA_CHAR_LIMIT = 10000;

	private void RunScript(ref object A)
	{
		var doc = this.Component.OnPingDocument();
		if (doc == null) { AddRuntimeMessage(GH_RuntimeMessageLevel.Warning, "Cannot access the Grasshopper document."); return; }

		var definition = new CompactGhDefinition();
		var docObjects = doc.Objects.ToList();
		var guidToIndexMap = docObjects.Select((obj, i) => new { obj.InstanceGuid, i }).ToDictionary(x => x.InstanceGuid, x => x.i);

		for (int i = 0; i < docObjects.Count; i++)
		{
			var obj = docObjects[i];
			var myComponent = new CompactGhComponent { Id = i };

			if (obj is IGH_Component ghComponent)
			{
				myComponent.Name = ghComponent.Name;
				myComponent.NickName = ghComponent.NickName;
				myComponent.Description = ghComponent.Description;
				myComponent.IsComponent = true;
				foreach (var inputParam in ghComponent.Params.Input)
				{
					var connections = new List<int[]>();
					foreach (var source in inputParam.Sources)
					{
						var sourceOwnerObj = source.Attributes.GetTopLevel.DocObject;
						if (sourceOwnerObj != null && guidToIndexMap.TryGetValue(sourceOwnerObj.InstanceGuid, out int sourceId))
						{
							int sourceParamIndex = (sourceOwnerObj is IGH_Component sourceComp) ? sourceComp.Params.Output.IndexOf(source) : 0;
							if(sourceParamIndex > -1) connections.Add(new int[] { sourceId, sourceParamIndex });
						}
					}
					myComponent.Inputs.Add(new GhInputParameter { Name = inputParam.Name, TypeName = inputParam.TypeName, Connections = connections });
				}

				// A component is considered a "source" if it has no connected inputs.
				bool isSourceComponent = !ghComponent.Params.Input.Any(p => p.Sources.Any());
				myComponent.Outputs = ghComponent.Params.Output.Select(p => {
					bool isUnconnectedOutput = p.Recipients.Count == 0;
					bool showFullData = isSourceComponent || isUnconnectedOutput;

					string dataPreview = string.Join(", ", p.VolatileData.AllData(true).Select(d => d.ToString()));
					if (showFullData && dataPreview.Length > FULL_DATA_CHAR_LIMIT)
					{
						dataPreview = dataPreview.Substring(0, FULL_DATA_CHAR_LIMIT);
					}
					else if (!showFullData && dataPreview.Length > PREVIEW_CHAR_LIMIT)
					{
						dataPreview = dataPreview.Substring(0, PREVIEW_CHAR_LIMIT);
					}

					return new GhOutputParameter { Name = p.Name, TypeName = p.TypeName, DataPreview = dataPreview };
				}).ToList();
			}
			else if (obj is IGH_Param ghParam)
			{
				myComponent.Name = ghParam.Name;
				myComponent.NickName = ghParam.NickName;
				myComponent.Description = ghParam.Description;
				myComponent.IsComponent = false;

				// A floating parameter is a "source" if it has no inputs. Its output is unconnected if it has no recipients.
				bool isSourceParam = ghParam.Sources.Count == 0;
				bool isUnconnectedOutput = ghParam.Recipients.Count == 0;
				bool showFullData = isSourceParam || isUnconnectedOutput;

				string dataPreview = string.Join(", ", ghParam.VolatileData.AllData(true).Select(d => d.ToString()));
				if (showFullData && dataPreview.Length > FULL_DATA_CHAR_LIMIT)
				{
					dataPreview = dataPreview.Substring(0, FULL_DATA_CHAR_LIMIT);
				}
				else if (!showFullData && dataPreview.Length > PREVIEW_CHAR_LIMIT)
				{
					dataPreview = dataPreview.Substring(0, PREVIEW_CHAR_LIMIT);
				}
				myComponent.Outputs.Add(new GhOutputParameter { Name = ghParam.Name, TypeName = ghParam.TypeName, DataPreview = dataPreview });

				if (ghParam.Sources.Any())
				{
					var connections = new List<int[]>();
					foreach(var source in ghParam.Sources)
					{
						var sourceOwnerObj = source.Attributes.GetTopLevel.DocObject;
						if (sourceOwnerObj != null && guidToIndexMap.TryGetValue(sourceOwnerObj.InstanceGuid, out int sourceId))
						{
							int sourceParamIndex = (sourceOwnerObj is IGH_Component sourceComp) ? sourceComp.Params.Output.IndexOf(source) : 0;
							if(sourceParamIndex > -1) connections.Add(new int[] { sourceId, sourceParamIndex });
						}
					}
					myComponent.Inputs.Add(new GhInputParameter { Name = "Input", TypeName = ghParam.TypeName, Connections = connections });
				}
			}
			definition.Components.Add(myComponent);
		}

		// Serialize with standard indentation first.
		string indentedJson = JsonSerializer.Serialize(definition, new JsonSerializerOptions { WriteIndented = true });

		// Post-process the string to replace 2-space indents with 1-space indents.
		var lines = indentedJson.Split(new[] { Environment.NewLine }, StringSplitOptions.None);
		var resultBuilder = new StringBuilder();
		foreach (var line in lines)
		{
			var trimmedLine = line.TrimStart();
			// Default indent is 2 spaces, so we divide by 2 to get the nesting level.
			int indentLevel = (line.Length - trimmedLine.Length) / 2;
			resultBuilder.Append(new string(' ', indentLevel));
			resultBuilder.AppendLine(trimmedLine);
		}

		// Assign the re-formatted string to the output.
		A = resultBuilder.ToString().TrimEnd();
	}

	// <Custom additional code>
	public class CompactGhDefinition { public List<CompactGhComponent> Components { get; set; } = new List<CompactGhComponent>(); }
	public class GhInputParameter { public string Name { get; set; } public string TypeName { get; set; } public List<int[]> Connections { get; set; } = new List<int[]>(); }
	public class GhOutputParameter { public string Name { get; set; } public string TypeName { get; set; } public string DataPreview { get; set; } }
	public class CompactGhComponent
	{
		public int Id { get; set; }
		public string Name { get; set; }
		public string NickName { get; set; }
		public string Description { get; set; }
		public bool IsComponent { get; set; }
		public List<GhInputParameter> Inputs { get; set; } = new List<GhInputParameter>();
		public List<GhOutputParameter> Outputs { get; set; } = new List<GhOutputParameter>();
	}
	// </Custom additional code>
}
# ---------- end c_script_8 ----------
path_8 = FilePath("C:\Users\hellg\Documents\Projects\250823_GrassSpecsel\viewer-app\temp\gh_dump_5.json")
writetxt_8 = WriteToTextFile(Run=Button(), TextToWrite=c_script_8.A, FilePath=path_8, Append=False, NewOnly=False)

# ----
# BEDROOM
# here a wall may fail
pre_setting_select_edge = Panel("""2
1
1""")
wall_index = Data(pre_setting_select_edge)
flatten_3 = FlattenTree(Tree=room_full, Path="{0}")
lng_5 = ListLength(List=room_rdc)
larger = LargerThan(FirstNumber=lng_5, SecondNumber=1)  # -> LargerThan, OrEqualTo
ma = MassAddition(Input=flatten(larger.LargerThan))  # -> Result, PartialResults
larger_2 = LargerThan(FirstNumber=ma.Result, SecondNumber=0)  # -> LargerThan, OrEqualTo
panel_9 = Panel(room_rdc)
merge_9 = Merge(Data1=Slider(0, range=0..3), Data2=Slider(0, range=0..3), Data3=Slider(0, range=0..3))
merge_10 = Merge(Data1=Slider(1, range=0..3), Data2=Slider(2, range=0..3), Data3=Slider(2, range=0..3))
graft_5 = GraftTree(Tree=merge_9, IncludeEmptyLists=True, IncludeNullItems=True)
graft_6 = GraftTree(Tree=merge_10, IncludeEmptyLists=True, IncludeNullItems=True)
division = Division(A=1, B=subdivs_count)
number_slider_2 = Slider(1, range=0..5)
rooms_cnt = ListLength(List=flatten_3)
larger_3 = LargerThan(FirstNumber=rooms_cnt, SecondNumber=1)  # -> LargerThan, OrEqualTo
number_slider_3 = Slider(0, range=0..7)
number_slider_4 = Slider(1, range=0..10)
larger_4 = LargerThan(SecondNumber=0)  # -> LargerThan, OrEqualTo
number_slider_5 = Slider(5, range=0..6)  # disabled
swatch = ColourSwatch(SwatchColor=RGB(196, 196, 196))  # disabled

# ----
# Furniture Data
furniture_piece = Data(block_0)
xy = XYPlane(Origin=Point(0, 0, 0))
rectangle_2 = Rectangle(Plane=xy, XSize=Domain(-1, 1), YSize=Domain(-2, 2), Radius=0)  # -> Rectangle, Length
small_rectangle = ListItem(List=furniture_piece, Index=Slider(5, range=0..10), Wrap=True)
details = ListItem(List=furniture_piece, Index=Slider(6, range=0..10), Wrap=True)
guideline = ListItem(List=furniture_piece, Index=Slider(1, range=0..1), Wrap=True)
big_rectangle = ListItem(List=furniture_piece, Index=Slider(4, range=0..10), Wrap=True)
importance = ListItem(List=furniture_piece, Index=Slider(2, range=0..10), Wrap=True)
wall_crv = Curve(guideline)
big_bb = Curve(big_rectangle)
small_bb = Curve(small_rectangle)
detsils = Geometry(details)
wall_crv_2 = Curve(wall_crv)
big_bb_2 = Curve(big_bb)
small_bb_2 = Curve(small_bb)
flip = FlipCurve(Curve=big_bb_2, Guide=rectangle_2.Rectangle)  # -> Curve, Flag
flip_2 = FlipCurve(Curve=small_bb_2, Guide=rectangle_2.Rectangle)  # -> Curve, Flag
area_2 = Area(Geometry=big_bb_2)  # -> Area, Centroid
explode_7 = Explode(Curve=big_bb, Recursive=True)  # -> Segments, Vertices
explode_8 = Explode(Curve=flip.Curve, Recursive=True)  # -> Segments, Vertices
explode_9 = Explode(Curve=flip_2.Curve, Recursive=True)  # -> Segments, Vertices
graft_7 = GraftTree(Tree=wall_index, IncludeEmptyLists=True, IncludeNullItems=True)
lng_6 = ListLength(List=explode_8.Segments)
curvepoint_2 = PointOnCurve(explode_9.Segments, parameter=0.5)
curvepoint_3 = PointOnCurve(explode_8.Segments, parameter=0.5)
item_7 = ListItem(List=explode_7.Segments, Index=graft_7, Wrap=True)
series = Series(Start=0, Step=1, Count=lng_6)
crv_cp_8 = CurveClosestPoint(Point=curvepoint_3, Curve=item_7)  # -> Point, Parameter, Distance
crv_cp_9 = CurveClosestPoint(Point=curvepoint_2, Curve=item_7)  # -> Point, Parameter, Distance
sort_7 = SortList(Keys=crv_cp_9.Distance, ValuesA=explode_9.Segments, ValuesB=series)  # -> Keys, ValuesA, ValuesB
sort_8 = SortList(Keys=crv_cp_8.Distance, ValuesA=explode_8.Segments, ValuesB=series)  # -> Keys, ValuesA, ValuesB
item_8 = ListItem(List=sort_7.ValuesB, Index=0, Wrap=True)  # -> Item, Item1
item_9 = ListItem(List=sort_8.ValuesB, Index=0, Wrap=True)  # -> Item, Item1
item_10 = ListItem(List=explode_9.Segments, Index=item_8.Item, Wrap=True)  # -> Item1, Item
item_11 = ListItem(List=explode_8.Segments, Index=item_9.Item, Wrap=True)  # -> Item1, Item
crv_cp_10 = CurveClosestPoint(Point=area_2.Centroid, Curve=item_11.Item)  # -> Point, Parameter, Distance
vec2pt_2 = Vector2Pt(PointA=crv_cp_10.Point, PointB=area_2.Centroid, Unitize=False)  # -> Vector, Length
flatten_4 = FlattenTree(Tree=item_10.Item, Path="{0}")
flatten_5 = FlattenTree(Tree=item_10.Item1, Path="{0}")
end_2 = EndPoints(Curve=item_11.Item)  # -> Start, End
rev_2 = Reverse(Vector=item_11.Item)
flatten_6 = FlattenTree(Tree=item_11.Item, Path="{0}")
flatten_7 = FlattenTree(Tree=item_11.Item1, Path="{0}")
crv_width_full = Curve(flatten_6)
crv_depth_full = Curve(flatten_7)
crv_width_rdc = Curve(flatten_4)
crv_depth_rdc = Curve(flatten_5)
pl_2 = ConstructPlane(Origin=end_2.Start, XAxis=item_11.Item, YAxis=vec2pt_2.Vector)
pl_3 = ConstructPlane(Origin=end_2.End, XAxis=rev_2, YAxis=vec2pt_2.Vector)
len = Length(Curve=crv_width_full)
flatten_8 = FlattenTree(Tree=detsils, Path="{0}")
flatten_9 = FlattenTree(Tree=pl_2, Path="{0}")
flatten_10 = FlattenTree(Tree=pl_3, Path="{0}")
flatten_11 = FlattenTree(Tree=importance, Path="{0}")
detsils_2 = Geometry(flatten_8)
len_2 = Length(Curve=crv_depth_full)
len_3 = Length(Curve=crv_width_rdc)
len_4 = Length(Curve=flatten_5)
plane_ending_point = Data(flatten_10)
plane_starting_point = Data(flatten_9)
importance_furniture = Data(flatten_11)
flatten_12 = FlattenTree(Tree=flip.Curve, Path="{0}")
flatten_13 = FlattenTree(Tree=flip_2.Curve, Path="{0}")
depth_full = Number(len_2)
width_rdc = Number(len_3)
depth_rdc = Number(len_4)

lng_7 = ListLength(List=furniture_piece)  # -> flatten(Length)
walls_must = BooleanToggle(True)
lng_8 = ListLength(List=lng_7)
panel_10 = Panel(lng_8)

# ---- group: guiding edge length
flatten_14 = FlattenTree(Tree=item_7, Path="{0}")
len_5 = Length(Curve=flatten_14)
width = Number(len_5)

# ----
score = ListItem(List=furniture_piece, Index=Slider(3, range=0..10), Wrap=True)
panel_11 = Panel(importance)
panel_12 = Panel(score)
equals = Equality(FirstNumber=importance, SecondNumber=1)  # -> Equality, Inequality
multiplication = Multiplication(A=equals.Equality, B=score)
flatten_15 = FlattenTree(Tree=multiplication, Path="{0}")
sort_9 = SortList(Keys=flatten_15)  # -> Keys, ValuesA
panel_13 = Panel(sort_9.Keys)
item_12 = ListItem(List=sort_9.Keys, Index=0, Wrap=True)
panel_14 = Panel(item_12)
lng_9 = ListLength(List=furniture_piece)  # -> flatten(Length)
lng_10 = ListLength(List=lng_9)
panel_15 = Panel(sort_8.ValuesB)
flatten_16 = FlattenTree(Tree=score, Path="{0}")
score_furniture = Data(flatten_16)
sort_10 = SortList(Keys=score_furniture, ValuesA=score_furniture)  # -> reverse(Keys), ValuesA
item_13 = ListItem(List=sort_10.Keys, Index=0, Wrap=True)
importance_furniture_2 = Data(importance_furniture)
panel_16 = Panel(item_13)
larger_5 = LargerThan(FirstNumber=importance_furniture, SecondNumber=Slider(1, range=0..1))  # -> LargerThan, OrEqualTo
dispatch_7 = Dispatch(List=item_13, DispatchPattern=larger_5.LargerThan)  # -> ListA, ListB
score_min = Data(dispatch_7.ListB)
score_max = Data(item_13)
score_max_2 = Data(score_max)
score_min_2 = Data(score_min)
detsils_3 = Geometry(detsils_2)
result_score = Data(score_furniture)
importance_2 = Data(importance_furniture)
sort_11 = SortList(Keys=result_score)  # -> reverse(Keys), ValuesA
item_14 = ListItem(List=sort_11.Keys, Index=0, Wrap=True)
result_details = Geometry(detsils_3)
result_score_2 = Data(score_furniture)

# ----
# check with walls are wide enough to fit this one furniture at all
# if needed, leave only edges that are actually walls (for most furniture you better place stuff along the wall)
rectangle_3 = Rectangle(Plane=PlaneXY(0, 0, 0), XSize=Domain(-1, 1), YSize=Domain(-2, 2), Radius=0)  # -> Rectangle, Length
flip_3 = FlipCurve(Curve=room_rdc, Guide=rectangle_3.Rectangle)  # -> simplify(Curve), Flag
lng_11 = ListLength(List=room_full)
explode_10 = Explode(Curve=flip_3.Curve, Recursive=True)  # -> Segments, Vertices
larger_6 = LargerThan(FirstNumber=lng_11, SecondNumber=1)  # -> LargerThan, OrEqualTo
trim_2 = TrimTree(Tree=explode_10.Segments, Depth=1)
ma_2 = MassAddition(Input=flatten(larger_6.LargerThan))  # -> Result, PartialResults
larger_7 = LargerThan(FirstNumber=ma_2.Result, SecondNumber=0)  # -> LargerThan, OrEqualTo
width_2 = Number(width)
lng_12 = ListLength(List=width_2)

or = GateOr(A=larger_7.LargerThan, B=larger_2.LargerThan)

filter = StreamFilter(Gate=or, Stream0=explode_10.Segments, Stream1=trim_2)
curvepoint_4 = PointOnCurve(filter, parameter=0.5)
crv_cp_11 = CurveClosestPoint(Point=curvepoint_4, Curve=walls)  # -> Point, Parameter, Distance
smaller_10 = SmallerThan(FirstNumber=crv_cp_11.Distance, SecondNumber=0.01)  # -> SmallerThan, OrEqualTo
cull_8 = CullPattern(List=filter, CullPattern=smaller_10.SmallerThan)
filter_2 = StreamFilter(Gate=walls_must, Stream0=filter, Stream1=cull_8)
lng_13 = ListLength(List=filter_2)
repeat = RepeatData(Data=room_full, Length=lng_13)
edges_for_checking = Curve(simplify(filter_2))
repeat_2 = RepeatData(Data=walls, Length=lng_13)
repeat_3 = RepeatData(Data=flip_3.Curve, Length=lng_13)
graft_8 = GraftTree(Tree=repeat, IncludeEmptyLists=True, IncludeNullItems=True)
graft_9 = GraftTree(Tree=edges_for_checking, IncludeEmptyLists=True, IncludeNullItems=True)
graft_10 = GraftTree(Tree=repeat_2, IncludeEmptyLists=True, IncludeNullItems=True)
graft_11 = GraftTree(Tree=repeat_3, IncludeEmptyLists=True, IncludeNullItems=True)
repeat_4 = RepeatData(Data=graft_9, Length=lng_10)
repeat_5 = RepeatData(Data=graft_8, Length=lng_10)
repeat_6 = RepeatData(Data=graft_10, Length=lng_10)
repeat_7 = RepeatData(Data=graft_11, Length=lng_10)
len_6 = Length(Curve=repeat_4)
larger_8 = LargerThan(FirstNumber=len_6, SecondNumber=width_2)  # -> LargerThan, OrEqualTo
cull_9 = CullPattern(List=repeat_5, CullPattern=larger_8.LargerThan)
cull_10 = CullPattern(List=repeat_6, CullPattern=larger_8.LargerThan)
cull_11 = CullPattern(List=repeat_4, CullPattern=larger_8.LargerThan)
cull_12 = CullPattern(List=repeat_7, CullPattern=larger_8.LargerThan)
room_rdc_2 = Curve(simplify(cull_12))
trim_3 = TrimTree(Tree=room_rdc_2, Depth=1)

# ---- group: filter funtiture index for later
series_2 = Series(Start=0, Step=1, Count=lng_8)
cull_13 = CullPattern(List=series_2, CullPattern=larger_8.LargerThan)
indexes_furniture_var = Data(simplify(cull_13))

# ----
initial = Curve(simplify(cull_10))
room_full_2 = Curve(simplify(cull_9))
walls_long_enough = Curve(simplify(cull_11))

trim_4 = TrimTree(Tree=initial, Depth=1)
trim_5 = TrimTree(Tree=room_full_2, Depth=1)
trim_6 = TrimTree(Tree=walls_long_enough, Depth=1)
null_3 = NullItem(Item=flatten(trim_5))  # -> NullFlags, InvalidFlags, Description
trim_7 = TrimTree(Tree=indexes_furniture_var, Depth=1)
item_15 = ListItem(List=null_3.NullFlags, Index=0, Wrap=True)
filter_3 = StreamFilter(Gate=item_15, Stream0=trim_3, Stream1=flatten(room_rdc_2))  # -> simplify(graft(Stream))
filter_4 = StreamFilter(Gate=item_15, Stream0=trim_4, Stream1=flatten(initial))  # -> simplify(graft(Stream))
filter_5 = StreamFilter(Gate=item_15, Stream0=trim_5, Stream1=flatten(room_full_2))  # -> simplify(graft(Stream))
filter_6 = StreamFilter(Gate=item_15, Stream0=trim_6, Stream1=flatten(walls_long_enough))  # -> simplify(graft(Stream))
filter_7 = StreamFilter(Gate=item_15, Stream0=trim_7, Stream1=flatten(indexes_furniture_var))  # -> simplify(graft(Stream))

room_rdc_3 = Curve(filter_3)
room_full_3 = Curve(filter_5)
walls_long_enough_2 = Curve(filter_6)
indexes_furniture_var_2 = Data(filter_7)
initial_2 = Curve(filter_4)

crv_depth_full_2 = Curve(crv_depth_full)
room_rdc_4 = Curve(room_rdc_3)
big_bb_3 = Curve(flatten_12)
room_full_4 = Curve(room_full_3)
walls_long_enough_3 = Curve(walls_long_enough_2)
indexes_furniture_var_3 = Data(indexes_furniture_var_2)
detsils_4 = Geometry(flatten_8)
plane_starting_point_2 = Data(flatten_9)
plane_ending_point_2 = Data(flatten_10)
small_bb_3 = Curve(flatten_13)
crv_width_rdc_2 = Curve(crv_width_rdc)
crv_depth_rdc_2 = Curve(crv_depth_rdc)
crv_width_full_2 = Curve(crv_width_full)

panel_17 = Panel(initial)
panel_18 = Panel(filter_4)
panel_19 = Panel(indexes_furniture_var_3)
explode_11 = Explode(Curve=room_full_4, Recursive=True)  # -> Segments, Vertices
len_7 = Length(Curve=explode_11.Segments)
panel_20 = Panel(len_7)
initial_3 = Curve(initial_2)

# ----
# make rays from a wall (with length of full object and reduced object).
# Then check which part of the wall has enough "free depth" in front of it.
item_16 = ListItem(List=crv_depth_full_2, Index=indexes_furniture_var_3, Wrap=True)
item_17 = ListItem(List=crv_depth_rdc_2, Index=indexes_furniture_var_3, Wrap=True)
item_18 = ListItem(List=crv_width_rdc_2, Index=indexes_furniture_var_3, Wrap=True)
item_19 = ListItem(List=detsils_4, Index=indexes_furniture_var_3, Wrap=True)
item_20 = ListItem(List=plane_starting_point_2, Index=indexes_furniture_var_3, Wrap=True)
item_21 = ListItem(List=plane_ending_point_2, Index=indexes_furniture_var_3, Wrap=True)
item_22 = ListItem(List=crv_width_full_2, Index=indexes_furniture_var_3, Wrap=True)
item_23 = ListItem(List=big_bb_3, Index=indexes_furniture_var_3, Wrap=True)
item_24 = ListItem(List=small_bb_3, Index=indexes_furniture_var_3, Wrap=True)
number_slider_6 = Slider(0.03, range=0..0.1)
curvepoint_5 = PointOnCurve(walls_long_enough_3, parameter=0.5)
len_8 = Length(Curve=item_16)
len_9 = Length(Curve=item_17)
offset = OffsetCurve(Curve=walls_long_enough_3, Distance=expr("-x", number_slider_6), Corners=1)
big_bb_4 = Curve(item_23)
plane_starting_point_3 = Data(item_20)
plane_ending_point_3 = Data(item_21)
small_bb_4 = Curve(item_24)
multiplication_2 = Multiplication(A=number_slider_6, B=Slider(1, range=0..2))
ext_2 = ExtendCurve(Curve=offset, Type=0, Start=expr("-x", multiplication_2), End=expr("-x", multiplication_2))
crv_cp_12 = CurveClosestPoint(Point=curvepoint_5, Curve=offset)  # -> Point, Parameter, Distance
vec2pt_3 = Vector2Pt(PointA=curvepoint_5, PointB=crv_cp_12.Point, Unitize=False)  # -> Vector, Length
series_3 = Series(Start=0, Step=division, Count=subdivs_count)
shatter_2 = Shatter(Curve=reparameterize(ext_2), Parameters=series_3)
curvepoint_6 = PointOnCurve(shatter_2, parameter=0.5)
len_10 = Length(Curve=shatter_2)
room_full_5 = Curve(room_full_4)

depth_full_2 = Number(len_8)
depth_rdc_2 = Number(len_9)
room_rdc_5 = Curve(room_rdc_4)

line = LineSDL(Start=curvepoint_6, Direction=vec2pt_3.Vector, Length=depth_full_2)
line_2 = LineSDL(Start=curvepoint_6, Direction=vec2pt_3.Vector, Length=depth_rdc_2)
colom = CollisionOneMany(Collider=line_2, Obstacles=room_rdc_5)  # -> Collision, Index
colom_2 = CollisionOneMany(Collider=line, Obstacles=room_full_5)  # -> Collision, Index
not = GateNot(A=colom_2.Collision)
not_2 = GateNot(A=colom.Collision)
cull_14 = CullPattern(List=shatter_2, CullPattern=not)
cull_15 = CullPattern(List=shatter_2, CullPattern=not_2)

fitting_wall_full = Curve(simplify(cull_14))
vec = Vector(simplify(vec2pt_3.Vector))
fitting_wall_reduced = Curve(simplify(cull_15))

fitting_wall_reduced_2 = Curve(fitting_wall_reduced)
crv_width_full_3 = Curve(item_22)
crv_width_rdc_3 = Curve(item_18)
fitting_wall_full_2 = Curve(fitting_wall_full)

# ----
# check from where the placement can actually start
join_2 = JoinCurves(Curves=fitting_wall_reduced_2, Preserve=False)
join_3 = JoinCurves(Curves=fitting_wall_full_2, Preserve=False)
len_11 = Length(Curve=crv_width_full_3)
flip_4 = FlipCurve(Curve=crv_width_full_3, Guide=rectangle_3.Rectangle)  # -> Curve, Flag
flip_5 = FlipCurve(Curve=crv_width_rdc_3, Guide=rectangle_3.Rectangle)  # -> Curve, Flag
sort_12 = SortList(Keys=join_2, ValuesA=join_2)  # -> Keys, reverse(ValuesA)
sort_13 = SortList(Keys=join_3, ValuesA=join_3)  # -> Keys, reverse(ValuesA)
item_25 = ListItem(List=sort_12.ValuesA, Index=0, Wrap=True)
item_26 = ListItem(List=sort_13.ValuesA, Index=0, Wrap=True)
end_3 = EndPoints(Curve=flip_4.Curve)  # -> Start, End
end_4 = EndPoints(Curve=item_26)  # -> Start, End
crv_cp_13 = CurveClosestPoint(Point=end_3.Start, Curve=flip_5.Curve)  # -> Point, Parameter, Distance
crv_cp_14 = CurveClosestPoint(Point=end_3.End, Curve=flip_5.Curve)  # -> Point, Parameter, Distance
crv_cp_15 = CurveClosestPoint(Point=end_4.Start, Curve=item_25)  # -> Point, Parameter, Distance
crv_cp_16 = CurveClosestPoint(Point=end_4.End, Curve=item_25)  # -> Point, Parameter, Distance
subtraction = Subtraction(A=crv_cp_15.Distance, B=crv_cp_13.Distance)
subtraction_2 = Subtraction(A=crv_cp_16.Distance, B=crv_cp_14.Distance)
larger_9 = LargerThan(FirstNumber=subtraction, SecondNumber="0")  # -> LargerThan, OrEqualTo
larger_10 = LargerThan(FirstNumber=subtraction_2, SecondNumber="0")  # -> LargerThan, OrEqualTo
dispatch_8 = Dispatch(List=subtraction, DispatchPattern=larger_9.LargerThan)  # -> ListA, ListB
dispatch_9 = Dispatch(List="0", DispatchPattern=larger_9.LargerThan)  # -> ListA, ListB
dispatch_10 = Dispatch(List=subtraction_2, DispatchPattern=larger_10.LargerThan)  # -> ListA, ListB
dispatch_11 = Dispatch(List="0", DispatchPattern=larger_10.LargerThan)  # -> ListA, ListB
merge_11 = Merge(Data1=simplify(dispatch_8.ListA), Data2=simplify(dispatch_9.ListB))
merge_12 = Merge(Data1=simplify(dispatch_10.ListA), Data2=simplify(dispatch_11.ListB))
multiplication_3 = Multiplication(A=merge_12, B=-1)
multiplication_4 = Multiplication(A=merge_11, B=-1)
panel_21 = Panel(dispatch_8.ListA)
ext_3 = ExtendCurve(Curve=item_26, Type=0, Start=multiplication_4, End=multiplication_3)
final_fitting_curve = Curve(ext_3)

room_rdc_6 = Curve(room_rdc_5)
factor_to_include_alternative_positionin = Slider(1.4, range=0..10)  # "factor to include alternative positioning"
plane_ending_point_4 = Data(plane_ending_point_3)
big_bb_5 = Curve(big_bb_4)
final_fitting_curve_2 = Curve(final_fitting_curve)
vec_2 = Vector(vec)
width_3 = Number(len_11)
indexes_furniture_var_4 = Data(indexes_furniture_var_3)
plane_starting_point_4 = Data(plane_starting_point_3)
small_bb_5 = Curve(small_bb_4)
room_full_6 = Curve(room_full_4)
len_12 = Length(Curve=final_fitting_curve_2)
larger_11 = LargerThan(FirstNumber=len_12, SecondNumber=width_3)  # -> LargerThan, OrEqualTo
panel_22 = Panel(larger_11.LargerThan)
division_2 = Division(A=len_12, B=width_3)
cull_16 = CullPattern(List=indexes_furniture_var_4, CullPattern=larger_11.LargerThan)
cull_17 = CullPattern(List=plane_starting_point_4, CullPattern=larger_11.LargerThan)
cull_18 = CullPattern(List=plane_ending_point_4, CullPattern=larger_11.LargerThan)
cull_19 = CullPattern(List=big_bb_5, CullPattern=larger_11.LargerThan)
cull_20 = CullPattern(List=small_bb_5, CullPattern=larger_11.LargerThan)
cull_21 = CullPattern(List=final_fitting_curve_2, CullPattern=larger_11.LargerThan)
larger_12 = LargerThan(FirstNumber=division_2, SecondNumber=factor_to_include_alternative_positionin)  # -> LargerThan, OrEqualTo
cull_22 = CullPattern(List=vec_2, CullPattern=larger_11.LargerThan)
cull_23 = CullPattern(List=room_full_6, CullPattern=larger_11.LargerThan)
cull_24 = CullPattern(List=room_rdc_6, CullPattern=larger_11.LargerThan)
room_rdc_7 = Curve(cull_24)
room_full_7 = Curve(cull_23)
walls_long_enough_4 = Curve(cull_21)
vec_3 = Vector(cull_22)
include_end_plane = Boolean(larger_12.LargerThan)
plane_ending_point_5 = Data(cull_18)
plane_starting_point_5 = Data(cull_17)
big_bb_6 = Curve(cull_19)
small_bb_6 = Curve(cull_20)

room_full_8 = Curve(room_full_7)
indexes_furniture_var_5 = Data(cull_16)
plane_starting_point_6 = Data(plane_starting_point_5)
plane_ending_point_6 = Data(plane_ending_point_5)
big_bb_7 = Curve(big_bb_6)
small_bb_7 = Curve(small_bb_6)

panel_23 = Panel(len_8)
panel_24 = Panel(len_9)
panel_25 = Panel(depth_full_2)
tbranch = TreeBranch(Tree=simplify(ext_2), Path=number_slider_2, MaintainPaths=True, SplitTree=False)
panel_26 = Panel(item_18)
tbranch_2 = TreeBranch(Tree=simplify(line), Path=number_slider_2, MaintainPaths=True, SplitTree=False)
tbranch_3 = TreeBranch(Tree=room_full_5, Path=number_slider_2, MaintainPaths=True, SplitTree=False)
colom_3 = CollisionOneMany(Collider=tbranch_2, Obstacles=tbranch_3)  # -> Collision, Index
panel_27 = Panel(colom_2.Collision)
len_13 = Length(Curve=item_26)
panel_28 = Panel(len_13)
panel_29 = Panel(multiplication_4)
panel_30 = Panel(final_fitting_curve)
cull_25 = CullPattern(List=initial_3, CullPattern=larger_11.LargerThan)
initial_4 = Curve(cull_25)
trim_8 = TrimTree(Tree=simplify(indexes_furniture_var_5), Depth=1)
trim_9 = TrimTree(Tree=simplify(room_full_8), Depth=1)
filter_8 = StreamFilter(Gate=larger_3.LargerThan, Stream0=flatten(room_full_8), Stream1=trim_9)
filter_9 = StreamFilter(Gate=larger_3.LargerThan, Stream0=flatten(indexes_furniture_var_5), Stream1=trim_8)

# ----
# **
# if the line is not reallz long, just make one placement option
final_fitting_curve_3 = Curve(walls_long_enough_4)
include_end_plane_2 = Boolean(include_end_plane)
vec_4 = Vector(vec_3)
rev_3 = Reverse(Vector=vec_4)
num = Number(number_slider_6)
amp_3 = Amplitude(Vector=rev_3, Amplitude=num)
move_3 = Move(Geometry=final_fitting_curve_3, Motion=amp_3)  # -> Geometry, Transform
rev_4 = Reverse(Vector=move_3.Geometry)
end_5 = EndPoints(Curve=move_3.Geometry)  # -> Start, End
pl_4 = ConstructPlane(Origin=end_5.Start, XAxis=move_3.Geometry, YAxis=vec_4)
pl_5 = ConstructPlane(Origin=end_5.End, XAxis=rev_4, YAxis=vec_4)
big_bb_8 = Orient(Geometry=big_bb_7, Source=plane_starting_point_6, Target=pl_4)  # -> Geometry, Transform
big_bb_9 = Orient(Geometry=big_bb_7, Source=plane_ending_point_6, Target=pl_5)  # -> Geometry, Transform
cull_26 = CullPattern(List=big_bb_9.Geometry, CullPattern=include_end_plane_2)
small_bb_8 = Orient(Geometry=small_bb_7, Source=plane_starting_point_6, Target=pl_4)  # -> Geometry, Transform
small_bb_9 = Orient(Geometry=small_bb_7, Source=plane_ending_point_6, Target=pl_5)  # -> Geometry, Transform
cull_27 = CullPattern(List=small_bb_9.Geometry, CullPattern=include_end_plane_2)
cull_28 = CullPattern(List=small_bb_9.Transform, CullPattern=include_end_plane_2)
cull_29 = CullPattern(List=room_rdc_7, CullPattern=include_end_plane_2)
cull_30 = CullPattern(List=initial_4, CullPattern=include_end_plane_2)
initial_5 = Curve(initial_4)
room_rdc_8 = Curve(room_rdc_7)
room_rdc_9 = Curve(cull_29)
initial_6 = Curve(cull_30)
transformation_data_1 = Data(big_bb_8.Transform)
transformation_data_2 = Data(cull_28)

panel_31 = Panel(final_fitting_curve_3)
cull_31 = CullPattern(List=room_full_8, CullPattern=include_end_plane_2)
cull_32 = CullPattern(List=indexes_furniture_var_5, CullPattern=include_end_plane_2)
trim_10 = TrimTree(Tree=simplify(cull_31), Depth=1)
trim_11 = TrimTree(Tree=simplify(cull_32), Depth=1)
trim_12 = TrimTree(Tree=simplify(transformation_data_1), Depth=1)
trim_13 = TrimTree(Tree=simplify(transformation_data_2), Depth=1)
trim_14 = TrimTree(Tree=simplify(big_bb_8.Geometry), Depth=1)
trim_15 = TrimTree(Tree=simplify(cull_26), Depth=1)
trim_16 = TrimTree(Tree=simplify(small_bb_8.Geometry), Depth=1)
trim_17 = TrimTree(Tree=simplify(cull_27), Depth=1)
trim_18 = TrimTree(Tree=simplify(room_rdc_8), Depth=1)
trim_19 = TrimTree(Tree=simplify(room_rdc_9), Depth=1)
trim_20 = TrimTree(Tree=simplify(initial_5), Depth=1)
trim_21 = TrimTree(Tree=simplify(initial_6), Depth=1)
filter_10 = StreamFilter(Gate=larger_3.LargerThan, Stream0=flatten(cull_31), Stream1=trim_10)
filter_11 = StreamFilter(Gate=larger_3.LargerThan, Stream0=flatten(cull_32), Stream1=trim_11)
filter_12 = StreamFilter(Gate=larger_3.LargerThan, Stream0=flatten(transformation_data_1), Stream1=trim_12)
filter_13 = StreamFilter(Gate=larger_3.LargerThan, Stream0=flatten(transformation_data_2), Stream1=trim_13)
filter_14 = StreamFilter(Gate=larger_3.LargerThan, Stream0=flatten(big_bb_8.Geometry), Stream1=trim_14)
filter_15 = StreamFilter(Gate=larger_3.LargerThan, Stream0=flatten(cull_26), Stream1=trim_15)
filter_16 = StreamFilter(Gate=larger_3.LargerThan, Stream0=flatten(small_bb_8.Geometry), Stream1=trim_16)
filter_17 = StreamFilter(Gate=larger_3.LargerThan, Stream0=flatten(cull_27), Stream1=trim_17)
filter_18 = StreamFilter(Gate=larger_3.LargerThan, Stream0=flatten(room_rdc_8), Stream1=trim_18)
filter_19 = StreamFilter(Gate=larger_3.LargerThan, Stream0=flatten(room_rdc_9), Stream1=trim_19)
filter_20 = StreamFilter(Gate=larger_3.LargerThan, Stream0=flatten(initial_5), Stream1=trim_20)
filter_21 = StreamFilter(Gate=larger_3.LargerThan, Stream0=flatten(initial_6), Stream1=trim_21)
merge_13 = Merge(Data1=filter_8, Data2=filter_10)
merge_14 = Merge(Data1=filter_9, Data2=filter_11)
merge_15 = Merge(Data1=filter_12, Data2=filter_13)
merge_16 = Merge(Data1=filter_14, Data2=filter_15)
merge_17 = Merge(Data1=filter_16, Data2=filter_17)
merge_18 = Merge(Data1=filter_18, Data2=filter_19)
merge_19 = Merge(Data1=filter_20, Data2=filter_21)
indexes_furniture_var_6 = Data(merge_14)
transformation_data = Data(merge_15)
bb_full = Data(merge_16)
bb_reduced = Data(merge_17)
room_reduced = Curve(merge_18)
room_full_9 = Curve(merge_13)
initial_7 = Curve(merge_19)

graft_12 = GraftTree(Tree=room_full_9, IncludeEmptyLists=True, IncludeNullItems=True)
graft_13 = GraftTree(Tree=bb_reduced, IncludeEmptyLists=True, IncludeNullItems=True)
graft_14 = GraftTree(Tree=room_reduced, IncludeEmptyLists=True, IncludeNullItems=True)
graft_15 = GraftTree(Tree=bb_full, IncludeEmptyLists=True, IncludeNullItems=True)
graft_16 = GraftTree(Tree=initial_7, IncludeEmptyLists=True, IncludeNullItems=True)
graft_17 = GraftTree(Tree=indexes_furniture_var_6, IncludeEmptyLists=True, IncludeNullItems=True)
graft_18 = GraftTree(Tree=transformation_data, IncludeEmptyLists=True, IncludeNullItems=True)
room_full_10 = Curve(graft_12)
bb_rdc = Curve(graft_13)
room_rdc_10 = Curve(graft_14)
bb_full_2 = Data(graft_15)
rdiff_2 = RegionDifference(CurvesA=room_rdc_10, CurvesB=bb_full_2)
rdiff_3 = RegionDifference(CurvesA=room_full_10, CurvesB=bb_rdc)

room_full_11 = Curve(simplify(rdiff_3))
room_rdc_11 = Curve(simplify(rdiff_2))
initial_8 = Curve(simplify(graft_16))
indexes_furniture_var_7 = Data(graft_17)
transformation_data_3 = Data(graft_18)

tbranch_4 = TreeBranch(Tree=room_full_11, Path=number_slider_3, MaintainPaths=True, SplitTree=False)
tbranch_5 = TreeBranch(Tree=room_rdc_11, Path=number_slider_3, MaintainPaths=True, SplitTree=False)
transformation_data_4 = Data(transformation_data_3)
indexes_furniture_var_8 = Data(indexes_furniture_var_7)
results_1_indexes_furniture_var = Data(indexes_furniture_var_8)
results_1_transformation_data = Data(transformation_data_4)
nulls_in_empty = NullsInEmptyBranches(DataWithEmptyBranches=results_1_indexes_furniture_var)  # -> simplify(DataWithNulls)
nulls_in_empty_2 = NullsInEmptyBranches(DataWithEmptyBranches=results_1_transformation_data)  # -> simplify(DataWithNulls)
results_1_indexes_furniture_var_2 = Data(nulls_in_empty)
results_transformation_data = Data(nulls_in_empty_2)
result_initial = Curve(initial_8)

boundary = BoundarySurfaces(Edges=room_rdc_11)
boundary_2 = BoundarySurfaces(Edges=room_full_11)
graft_19 = GraftTree(IncludeEmptyLists=True, IncludeNullItems=True)
area_3 = Area(Geometry=boundary)  # -> Area, Centroid
area_4 = Area(Geometry=boundary_2)  # -> Area, Centroid
larger_13 = LargerThan(FirstNumber=area_3.Area, SecondNumber=Slider(2, range=0..10))  # -> LargerThan, OrEqualTo
larger_14 = LargerThan(FirstNumber=area_4.Area, SecondNumber=Slider(2, range=0..10))  # -> LargerThan, OrEqualTo
cull_33 = CullPattern(List=boundary, CullPattern=larger_13.LargerThan)
cull_34 = CullPattern(List=boundary_2, CullPattern=larger_14.LargerThan)
lng_14 = ListLength(List=cull_34)
lng_15 = ListLength(List=cull_33)
larger_15 = LargerThan(FirstNumber=lng_14, SecondNumber="1")  # -> LargerThan, OrEqualTo
larger_16 = LargerThan(FirstNumber=lng_15, SecondNumber="1")  # -> LargerThan, OrEqualTo
ma_3 = MassAddition(Input=flatten(larger_15.LargerThan))  # -> Result, PartialResults
ma_4 = MassAddition(Input=flatten(larger_16.LargerThan))  # -> Result, PartialResults
graft_20 = GraftTree(Tree=cull_33, IncludeEmptyLists=True, IncludeNullItems=True)
larger_17 = LargerThan(FirstNumber=ma_3.Result, SecondNumber=0)  # -> LargerThan, OrEqualTo
graft_21 = GraftTree(Tree=cull_34, IncludeEmptyLists=True, IncludeNullItems=True)
larger_18 = LargerThan(FirstNumber=ma_4.Result, SecondNumber=0)  # -> LargerThan, OrEqualTo

clean = CleanTree(RemoveNulls=True, RemoveInvalid=True, RemoveEmpty=False, Tree=graft_20)
wires = BrepWireframe(Brep=clean, Density=-1)
number_slider_7 = Slider(2, range=0..10)
number_slider_8 = Slider(0.3, range=0..10)
join_4 = JoinCurves(Curves=wires, Preserve=False)
polyoffset_2 = PolylineOffset(
    Polylines=join_4,
    Distance=number_slider_8,
    Plane=Plane(origin=(0, 0, 0), x=(0, 0, 0), y=(0, 0, 0)),
    Tolerance=0.01,
    ClosedFillet=number_slider_7,
    OpenFillet=number_slider_7,
    Miter=2)  # -> Contour, Holes
area_5 = Area(Geometry=polyoffset_2.Holes)  # -> Area, Centroid
sort_14 = SortList(Keys=area_5.Area, ValuesA=polyoffset_2.Holes)  # -> Keys, ValuesA
item_27 = ListItem(List=reverse(sort_14.ValuesA), Index=0, Wrap=True)
clean_2 = CleanTree(RemoveNulls=True, RemoveInvalid=True, RemoveEmpty=False, Tree=item_27)
polyoffset_3 = PolylineOffset(
    Polylines=clean_2,
    Distance=number_slider_8,
    Plane=Plane(origin=(0, 0, 0), x=(0, 0, 0), y=(0, 0, 0)),
    Tolerance=0.01,
    ClosedFillet=number_slider_7,
    OpenFillet=number_slider_7,
    Miter=2)  # -> Contour, Holes
data = Data(simplify(polyoffset_3.Contour))

flatten_17 = FlattenTree(Tree=graft_20, Path="{0}")
item_28 = ListItem(List=flatten(graft_20), Index=number_slider_4, Wrap=True)
item_29 = ListItem(List=flatten(graft_21), Index=number_slider_4, Wrap=True)
item_30 = ListItem(List=flatten_17, Index=Slider(0, range=0..10), Wrap=True)

clean_3 = CleanTree(RemoveNulls=True, RemoveInvalid=True, RemoveEmpty=False, Tree=graft_21)
wires_2 = BrepWireframe(Brep=clean_3, Density=-1)
number_slider_9 = Slider(2, range=0..10)
number_slider_10 = Slider(0.3, range=0..10)
join_5 = JoinCurves(Curves=wires_2, Preserve=False)
polyoffset_4 = PolylineOffset(
    Polylines=join_5,
    Distance=number_slider_10,
    Plane=Plane(origin=(0, 0, 0), x=(0, 0, 0), y=(0, 0, 0)),
    Tolerance=0.01,
    ClosedFillet=number_slider_9,
    OpenFillet=number_slider_9,
    Miter=2)  # -> Contour, Holes
area_6 = Area(Geometry=polyoffset_4.Holes)  # -> Area, Centroid
sort_15 = SortList(Keys=area_6.Area, ValuesA=polyoffset_4.Holes)  # -> Keys, ValuesA
item_31 = ListItem(List=reverse(sort_15.ValuesA), Index=0, Wrap=True)

trim_22 = TrimTree(Tree=data, Depth=1)
filter_22 = StreamFilter(Gate=larger_18.LargerThan, Stream0=data, Stream1=trim_22)

clean_4 = CleanTree(RemoveNulls=True, RemoveInvalid=True, RemoveEmpty=False, Tree=item_31)
panel_32 = Panel(wires_2)
result_room_rdc = Curve(filter_22)

polyoffset_5 = PolylineOffset(
    Polylines=clean_4,
    Distance=number_slider_10,
    Plane=Plane(origin=(0, 0, 0), x=(0, 0, 0), y=(0, 0, 0)),
    Tolerance=0.01,
    ClosedFillet=number_slider_9,
    OpenFillet=number_slider_9,
    Miter=2)  # -> Contour, Holes
data_2 = Data(simplify(polyoffset_5.Contour))

trim_23 = TrimTree(Tree=data_2, Depth=1)
filter_23 = StreamFilter(Gate=larger_17.LargerThan, Stream0=data_2, Stream1=trim_23)

boundary_3 = BoundarySurfaces(Edges=data_2)  # disabled
item_32 = ListItem(List=flatten(boundary_3), Index=number_slider_5, Wrap=True)  # disabled
preview = CustomPreview(Geometry=item_32, Material=swatch)  # disabled
result_room_full = Curve(filter_23)

# ----
# VIZU
trim_24 = TrimTree(Depth=1)
list_length_options_tree = ListLength(List=trim_24)
nr_of_rooms_of_this_type_2 = Number(lng_3)
result_1_details = Geometry(result_details)
addition = Addition(A=nr_of_rooms_of_this_type_2, B=Slider(0, range=0..1))
score_2 = Data(result_score_2)
number_slider_11 = Slider(12, range=0..25)
score_3 = Data(result_score_2)
detsils_5 = Geometry(result_1_details)

# ---- group: repeat data step1
data_3 = Data(list_length_options_tree)
flatten_18 = FlattenTree(Tree=data_3, Path="{0}")
clean_5 = CleanTree(RemoveNulls=True, RemoveInvalid=True, RemoveEmpty=False, Tree=flatten_18)
null_4 = NullItem(Item=clean_5)  # -> NullFlags, InvalidFlags, Description
repeat_8 = RepeatData(Data=results_1_indexes_furniture_var_2, Length=data_3)
repeat_9 = RepeatData(Data=results_transformation_data, Length=data_3)
filter_24 = StreamFilter(Gate=null_4.NullFlags, Stream0=repeat_8, Stream1=results_1_indexes_furniture_var_2)
filter_25 = StreamFilter(Gate=null_4.NullFlags, Stream0=repeat_9, Stream1=results_transformation_data)
graft_22 = GraftTree(Tree=filter_24, IncludeEmptyLists=True, IncludeNullItems=True)  # -> simplify(Tree)
graft_23 = GraftTree(Tree=filter_25, IncludeEmptyLists=True, IncludeNullItems=True)  # -> simplify(Tree)

# ---- group: repeat data step2
data_4 = Data()
flatten_19 = FlattenTree(Tree=data_4, Path="{0}")
clean_6 = CleanTree(RemoveNulls=True, RemoveInvalid=True, RemoveEmpty=False, Tree=flatten_19)
null_5 = NullItem(Item=clean_6)  # -> NullFlags, InvalidFlags, Description
repeat_10 = RepeatData(Data=graft_22, Length=data_4)
repeat_11 = RepeatData(Data=graft_23, Length=data_4)
filter_26 = StreamFilter(Gate=null_5.NullFlags, Stream0=repeat_10, Stream1=graft_22)
filter_27 = StreamFilter(Gate=null_5.NullFlags, Stream0=repeat_11, Stream1=graft_23)
graft_24 = GraftTree(Tree=filter_26, IncludeEmptyLists=True, IncludeNullItems=True)  # -> simplify(Tree)
graft_25 = GraftTree(Tree=filter_27, IncludeEmptyLists=True, IncludeNullItems=True)  # -> simplify(Tree)

# ----
trim_25 = TrimTree(Tree=graft_24, Depth=addition)
trim_26 = TrimTree(Tree=graft_25, Depth=addition)
clean_7 = CleanTree(RemoveNulls=True, RemoveInvalid=True, RemoveEmpty=False, Tree=flatten(trim_26))
clean_8 = CleanTree(RemoveNulls=True, RemoveInvalid=True, RemoveEmpty=False, Tree=flatten(trim_25))
null_6 = NullItem(Item=flatten(clean_8))  # -> NullFlags, InvalidFlags, Description
null_7 = NullItem(Item=flatten(clean_7))  # -> NullFlags, InvalidFlags, Description
filter_28 = StreamFilter(Gate=null_6.NullFlags, Stream0=trim_25, Stream1=flatten(graft_24))
filter_29 = StreamFilter(Gate=null_7.NullFlags, Stream0=trim_26, Stream1=flatten(graft_25))
indexes_furniture_var_9 = Data(filter_28)
item_33 = ListItem(List=score_2, Index=indexes_furniture_var_9, Wrap=True)
panel_33 = Panel(item_33)
all_scores = Data(item_33)
graft_26 = GraftTree(Tree=all_scores, IncludeEmptyLists=True, IncludeNullItems=True)  # -> simplify(Tree)
merge_20 = Merge(Data1=graft_26)
clean_9 = CleanTree(RemoveNulls=True, RemoveInvalid=True, RemoveEmpty=False, Tree=merge_20)
ma_5 = MassAddition(Input=clean_9)  # -> Result, PartialResults
trim_27 = TrimTree(Tree=ma_5.Result, Depth=1)
clean_10 = CleanTree(RemoveNulls=True, RemoveInvalid=True, RemoveEmpty=False, Tree=flatten(trim_27))
panel_34 = Panel(ma_5.Result)
null_8 = NullItem(Item=clean_10)  # -> NullFlags, InvalidFlags, Description
filter_30 = StreamFilter(Gate=null_8.NullFlags, Stream0=trim_27, Stream1=flatten(ma_5.Result))
sort_16 = SortList(Keys=filter_30, ValuesA=filter_29)  # -> Keys, reverse(ValuesA)
sort_17 = SortList(Keys=filter_30, ValuesA=filter_28)  # -> reverse(Keys), reverse(ValuesA)
panel_35 = Panel(sort_17.Keys)
transformation_data_5 = Data(sort_16.ValuesA)
indexes_furniture_var_10 = Data(sort_17.ValuesA)
item_34 = ListItem(List=indexes_furniture_var_10, Index=0, Wrap=True)
item_35 = ListItem(List=transformation_data_5, Index=0, Wrap=True)
score_4 = ListItem(List=score_3, Index=item_34, Wrap=True)
item_36 = ListItem(List=detsils_5, Index=item_34, Wrap=True)
panel_36 = Panel(score_4)
transform = Transform(Geometry=item_36, Transform=item_35)
panel_37 = Panel(item_34)
panel_38 = Panel(transform)
merge_21 = Merge(Data1=transform)
previewlw = CustomPreviewLineweights(
    Geometry=merge_21,
    Shader=ColourSwatch(SwatchColor=RGB(255, 255, 255)),
    Thickness=Slider(5.4, range=0..10),
    Absolute=False)

# ==== cluster Furnisher
staircase = ClusterInput()
children = ClusterInput()
apartment_contour = ClusterInput()
living_room = ClusterInput()
kitchen = ClusterInput()
bedroom = ClusterInput()
bathroom = ClusterInput()
corridor = ClusterInput()

apartment_contour_2 = Curve(apartment_contour)
corridor_2 = Curve(corridor)
living_room_2 = Curve(living_room)
bathroom_2 = Curve(bathroom)
bedroom_2 = Curve(bedroom)
children_2 = Curve(children)
working = Curve()
kitchen_2 = Curve(kitchen)

staircase_2 = Curve(staircase)
simplify = Simplify(crv=bedroom_2)

# ----
# Define Apartment Type
merge = Merge(Data1=bedroom_2, Data2=children_2, Data3=working, Data4=living_room_2)
flatten = FlattenTree(Tree=merge, Path="{0}")
lng = ListLength(List=flatten)
# Lets say we only process
# one apartment at a time
wohnungstyp = Panel(lng)

merge_2 = Merge(Data1=merge, Data2=bathroom_2, Data3=kitchen_2)
apartment_contour_3 = Curve(apartment_contour_2)
# Door options:
# 
# * to rooms from corridor OR from living room
# * to kitchen from living room OR from corridor
# * to bath from Corridor OR from living room OR from a room
rdiff = RegionDifference(CurvesA=apartment_contour_3, CurvesB=merge_2)

# ---- group: to rooms
kitchen_3 = Curve(kitchen_2)
working_2 = Curve(working)
children_3 = Curve(children_2)
bedroom_3 = Curve(bedroom_2)
bathroom_3 = Curve(bathroom_2)
merge_3 = Merge(Data1=children_3, Data2=working_2, Data3=bedroom_3, Data4=kitchen_3, Data5=bathroom_3)  # -> flatten(Result)
corridor_3 = Curve(corridor_2)
living_room_3 = Curve(living_room_2)
graft = GraftTree(Tree=merge_3, IncludeEmptyLists=True, IncludeNullItems=True)
crvprox = CurveProximity(CurveA=graft, CurveB=corridor_3)  # -> PointA, PointB, Distance
crvprox_2 = CurveProximity(CurveA=graft, CurveB=living_room_3)  # -> PointA, PointB, Distance
smaller = SmallerThan(FirstNumber=crvprox.Distance, SecondNumber=0.25)  # -> SmallerThan, OrEqualTo
smaller_2 = SmallerThan(FirstNumber=crvprox_2.Distance, SecondNumber=0.25)  # -> SmallerThan, OrEqualTo
cull = CullPattern(List=corridor_3, CullPattern=smaller.SmallerThan)
cull_2 = CullPattern(List=living_room_3, CullPattern=smaller_2.SmallerThan)
null = NullItem(Item=cull)  # -> NullFlags, InvalidFlags, Description
dispatch = Dispatch(List=cull_2, DispatchPattern=null.NullFlags)  # -> ListA, ListB
dispatch_2 = Dispatch(List=cull, DispatchPattern=null.NullFlags)  # -> ListA, ListB
panel = Panel(null.NullFlags)
merge_4 = Merge(Data1=dispatch_2.ListB, Data2=dispatch.ListA)

living = Curve(living_room_2)
merge_5 = Merge(Data1=living)  # -> flatten(Result)
corridor_4 = Curve(corridor_2)
staircase_3 = Curve(living_room_2)
graft_2 = GraftTree(Tree=merge_5, IncludeEmptyLists=True, IncludeNullItems=True)
crvprox_3 = CurveProximity(CurveA=graft_2, CurveB=corridor_4)  # -> PointA, PointB, Distance
crvprox_4 = CurveProximity(CurveA=graft_2, CurveB=staircase_3)  # -> PointA, PointB, Distance
smaller_3 = SmallerThan(FirstNumber=crvprox_3.Distance, SecondNumber=0.25)  # -> SmallerThan, OrEqualTo
smaller_4 = SmallerThan(FirstNumber=crvprox_4.Distance, SecondNumber=0.25)  # -> SmallerThan, OrEqualTo
cull_3 = CullPattern(List=corridor_4, CullPattern=smaller_3.SmallerThan)
cull_4 = CullPattern(List=staircase_3, CullPattern=smaller_4.SmallerThan)
null_2 = NullItem(Item=cull_3)  # -> NullFlags, InvalidFlags, Description
dispatch_3 = Dispatch(List=cull_4, DispatchPattern=null_2.NullFlags)  # -> ListA, ListB
dispatch_4 = Dispatch(List=cull_3, DispatchPattern=null_2.NullFlags)  # -> ListA, ListB
panel_2 = Panel(null_2.NullFlags)
merge_6 = Merge(Data1=dispatch_4.ListB, Data2=dispatch_3.ListA)

# ----
door_to = Curve()
door_from_3 = Curve()
door_from_1 = Curve()
door_from_2 = Curve()
furniture_cluster = FurnitureCluster(apartment_type=lng)  # -> bedroom_2, children_2, living_2, kitchen_2, simplify(bath_2), wc_2

wrap = WrapList(Data=furniture_cluster.bath_2)
trim = TrimTree(Tree=wrap, Depth=1)
null_3 = NullItem(Item=flatten(trim))  # -> NullFlags, InvalidFlags, Description
filter = StreamFilter(Gate=null_3.NullFlags, Stream0=trim, Stream1=wrap)
lng_2 = ListLength(List=filter)
lng_3 = ListLength(List=flatten(lng_2))
nr_of_blocks_to_place = Panel(lng_3)
bang = ExplodeTree(Data=filter)  # -> Branch0, Branch1, Branch2
block_0 = UnwrapList(WrappedData=bang.Branch0)
block_1 = UnwrapList(WrappedData=bang.Branch1)
block_2 = UnwrapList(WrappedData=bang.Branch2)

# ----
# Bedroom
wrap_2 = WrapList(Data=furniture_cluster.bedroom_2)
trim_2 = TrimTree(Tree=wrap_2, Depth=1)
lng_4 = ListLength(List=trim_2)
lng_5 = ListLength(List=flatten(lng_4))
nr_of_blocks_to_place_2 = Panel(lng_5)
bang_2 = ExplodeTree(Data=trim_2)  # -> Branch0, Branch1, Branch2
block_0_2 = UnwrapList(WrappedData=bang_2.Branch0)
block_1_2 = UnwrapList(WrappedData=bang_2.Branch1)
block_2_2 = UnwrapList(WrappedData=bang_2.Branch2)

c_bake = ContextBake(Content=bedroom_2)

# ----
# spaces sorted as "TO" and "FROM" accordingly
door_to_2 = Curve(graft)
door_from = Curve(merge_4)
door_to_3 = Curve(graft_2)
door_from_4 = Curve(merge_6)
entwine = Entwine(Branch00=door_from, Branch01=door_from_4, FlattenInputs=True)  # -> flatten(Result)
entwine_2 = Entwine(Branch00=door_to_2, Branch01=door_to_3, FlattenInputs=True)  # -> flatten(Result)
graft_3 = GraftTree(Tree=entwine_2, IncludeEmptyLists=True, IncludeNullItems=True)
graft_4 = GraftTree(Tree=entwine, IncludeEmptyLists=True, IncludeNullItems=True)
door_to_4 = Curve(graft_3)
door_from_5 = Curve(graft_4)

# ----
# Simplify
explode = Explode(Curve=door_to_4, Recursive=True)  # -> Segments, Vertices
crv_cp = CurveClosestPoint(Point=explode.Vertices, Curve=door_to_4)  # -> Point, Parameter, Distance
eval = EvaluateCurve(Curve=door_to_4, Parameter=crv_cp.Parameter)  # -> Point, Tangent, Angle
deg = Degrees(Radians=eval.Angle)
smaller_5 = SmallerThan(FirstNumber=deg, SecondNumber="45")  # -> SmallerThan, OrEqualTo
panel_3 = Panel(deg)
dispatch_5 = Dispatch(List=explode.Vertices, DispatchPattern=smaller_5.SmallerThan)  # -> ListA, ListB
# DOORS
pline = PolyLine(Vertices=dispatch_5.ListB, Closed=False)

# ----
# Simplify
explode_2 = Explode(Curve=door_from_5, Recursive=True)  # -> Segments, Vertices
crv_cp_2 = CurveClosestPoint(Point=explode_2.Vertices, Curve=door_from_5)  # -> Point, Parameter, Distance
eval_2 = EvaluateCurve(Curve=door_from_5, Parameter=crv_cp_2.Parameter)  # -> Point, Tangent, Angle
deg_2 = Degrees(Radians=eval_2.Angle)
smaller_6 = SmallerThan(FirstNumber=deg_2, SecondNumber="45")  # -> SmallerThan, OrEqualTo
panel_4 = Panel(deg_2)
dispatch_6 = Dispatch(List=explode_2.Vertices, DispatchPattern=smaller_6.SmallerThan)  # -> ListA, ListB
pline_2 = PolyLine(Vertices=dispatch_6.ListB, Closed=True)

pre_setting_select_edge = Panel("0")
pre_setting_select_edge_2 = Panel("0")
pre_setting_select_edge_3 = Panel("0")

door_from_6 = Curve(pline_2)
door_to_5 = Curve(pline)
explode_3 = Explode(Curve=door_to_5, Recursive=True)  # -> Segments, Vertices
ext = ExtendCurve(Curve=explode_3.Segments, Type=0, Start="-0.3", End="-0.3")
crvprox_5 = CurveProximity(CurveA=ext, CurveB=door_from_6)  # -> PointA, PointB, Distance
abs = Absolute(Value=Slider(0.2, range=0..1))
smaller_7 = SmallerThan(FirstNumber=crvprox_5.Distance, SecondNumber=abs)  # -> SmallerThan, OrEqualTo
cull_5 = CullPattern(List=explode_3.Segments, CullPattern=smaller_7.SmallerThan)
segment_possible = Curve(simplify(cull_5))
join = JoinCurves(Curves=segment_possible, Preserve=False)
sort = SortList(Keys=join, ValuesA=join)  # -> Keys, reverse(ValuesA)
explode_4 = Explode(Curve=door_from_6, Recursive=True)  # -> Segments, Vertices
item = ListItem(List=sort.ValuesA, Index=0, Wrap=True)
crv_cp_3 = CurveClosestPoint(Point=explode_4.Vertices, Curve=item)  # -> Point, Parameter, Distance
shatter = Shatter(Curve=item, Parameters=crv_cp_3.Parameter)
curvepoint = PointOnCurve(shatter, parameter=0.5)
crv_cp_4 = CurveClosestPoint(Point=curvepoint, Curve=door_from_6)  # -> Point, Parameter, Distance
smaller_8 = SmallerThan(FirstNumber=crv_cp_4.Distance, SecondNumber="0.1")  # -> SmallerThan, OrEqualTo
cull_6 = CullPattern(List=shatter, CullPattern=smaller_8.SmallerThan)
intersection_segment_to_place_the_door_a = Curve(cull_6)  # "intersection segment to place the door at"

pre_setting_select_edge_4 = Panel("""0
0""")
pre_setting_select_edge_5 = Panel("""0
0
0""")
pre_setting_select_edge_6 = Panel("""0
0
0""")
pre_setting_select_edge_7 = Panel("""0
0
0""")
pre_setting_select_edge_8 = Panel("""2
1
1""")
pre_setting_select_edge_9 = Panel("""0
0
0""")

merge_7 = Merge(Data1=Slider(0, range=0..2), Data2=Slider(0, range=0..10), Data3=Slider(0, range=0..10))
join_2 = TextJoin(Text=merge_7, Join=";")
branch = TreeBranch(Path=join_2, MaintainPaths=True)

door_to_6 = Curve(door_to_5)
intersection_segment_to_place_the_door_a_2 = Curve(intersection_segment_to_place_the_door_a)  # "intersection segment to place the door at"
sort_2 = SortList(Keys=intersection_segment_to_place_the_door_a_2, ValuesA=intersection_segment_to_place_the_door_a_2)  # -> Keys, reverse(ValuesA)
item_2 = ListItem(List=sort_2.ValuesA, Index=0, Wrap=True)
explode_5 = Explode(Curve=door_to_6, Recursive=True)  # -> Segments, Vertices
end = EndPoints(Curve=item_2)  # -> simplify(Start), simplify(End)
panel_5 = Panel(explode_5.Vertices)
dist = Distance(PointA=end.End, PointB=explode_5.Vertices)  # -> simplify(Distance)
dist_2 = Distance(PointA=end.Start, PointB=explode_5.Vertices)  # -> simplify(Distance)
sort_3 = SortList(Keys=dist_2)  # -> Keys, ValuesA
sort_4 = SortList(Keys=dist)  # -> Keys, ValuesA
item_3 = ListItem(List=sort_3.Keys, Index=0, Wrap=True)
item_4 = ListItem(List=sort_4.Keys, Index=0, Wrap=True)
merge_8 = Merge(Data1=item_3, Data2=item_4)
merge_9 = Merge(Data1=end.Start, Data2=end.End)
sort_5 = SortList(Keys=merge_8, ValuesA=merge_9)  # -> Keys, ValuesA
item_5 = ListItem(List=sort_5.ValuesA, Index=0, Wrap=True)  # -> Item, Item1
pt = Point(item_5.Item)
pt_2 = Point(item_5.Item1)
vec2pt = Vector2Pt(PointA=pt, PointB=pt_2, Unitize=False)  # -> Vector, Length
amp = Amplitude(Vector=vec2pt.Vector, Amplitude=Slider(0.5, range=0..1))
move = Move(Geometry=pt, Motion=amp)  # -> Geometry, Transform
pt_3 = Point(move.Geometry)

doors = Point(pt_3)

room = Curve(bathroom_2)
polyoffset = PolylineOffset(
    Polylines=room,
    Distance="0.05",
    Plane=Plane(origin=(0, 0, 0), x=(0, 0, 0), y=(0, 0, 0)),
    Tolerance=0.01,
    ClosedFillet=1,
    OpenFillet=1,
    Miter=2)  # -> Contour, Holes
inner_walls_contour = Curve(graft(polyoffset.Holes))
cluster = Cluster(room=inner_walls_contour, pt_door=doors, door_width="0.45")
door_area = Curve(cluster)
rdiff_2 = RegionDifference(CurvesA=inner_walls_contour, CurvesB=door_area)
room_2 = Curve(inner_walls_contour)
room_diff = Curve(rdiff_2)

# ----
# Prepare inputs for furniture placing
room_3 = Curve(simplify)
polyoffset_2 = PolylineOffset(
    Polylines=room_3,
    Distance="0.05",
    Plane=Plane(origin=(0, 0, 0), x=(0, 0, 0), y=(0, 0, 0)),
    Tolerance=0.01,
    ClosedFillet=1,
    OpenFillet=1,
    Miter=2)  # -> Contour, Holes
inner_walls_contour_2 = Curve(graft(polyoffset_2.Holes))
cluster_2 = Cluster(room=inner_walls_contour_2, pt_door=doors, door_width="0.45")
door_area_2 = Curve(cluster_2)
rdiff_3 = RegionDifference(CurvesA=inner_walls_contour_2, CurvesB=door_area_2)
room_4 = Curve(inner_walls_contour_2)
room_diff_2 = Curve(rdiff_3)

room_5 = Curve(living_room_2)
polyoffset_3 = PolylineOffset(
    Polylines=room_5,
    Distance="0.05",
    Plane=Plane(origin=(0, 0, 0), x=(0, 0, 0), y=(0, 0, 0)),
    Tolerance=0.01,
    ClosedFillet=1,
    OpenFillet=1,
    Miter=2)  # -> Contour, Holes
inner_walls_contour_3 = Curve(graft(polyoffset_3.Holes))
cluster_3 = Cluster(room=inner_walls_contour_3, pt_door=doors, door_width="0.45")
door_area_3 = Curve(cluster_3)
rdiff_4 = RegionDifference(CurvesA=inner_walls_contour_3, CurvesB=door_area_3)
room_6 = Curve(inner_walls_contour_3)
room_diff_3 = Curve(rdiff_4)

lng_6 = ListLength(List=flatten(room_4))
nr_of_rooms_of_this_type = Number(lng_6)
_1_furniture_piece = _1FurniturePiece(room_full=room_2, room_rdc=room_diff, walls=room_2, wall_index=pre_setting_select_edge_3, furniture_piece=block_0)  # -> result_room_full_2, result_room_rdc_2, result_initial_2, results_1_indexes_furniture_var_3, results_transformation_data_2, result_details_2, result_score_3, importance_furniture_2, score_max_2, score_min_2
room_full = Curve(_1_furniture_piece.result_room_full_2)
initial = Curve(_1_furniture_piece.result_initial_2)
room_rdc = Curve(_1_furniture_piece.result_room_rdc_2)
_1_furniture_piece_2 = _1FurniturePiece(room_full=room_full, room_rdc=room_rdc, walls=initial, wall_index=pre_setting_select_edge, furniture_piece=block_1)  # -> result_room_full_2, result_room_rdc_2, result_initial_2, results_1_indexes_furniture_var_3, results_transformation_data_2, result_details_2, result_score_3, importance_furniture_2, score_max_2, score_min_2
initial_2 = Curve(_1_furniture_piece_2.result_initial_2)
room_full_2 = Curve(_1_furniture_piece_2.result_room_full_2)
room_rdc_2 = Curve(_1_furniture_piece_2.result_room_rdc_2)
_1_furniture_piece_3 = _1FurniturePiece(
    room_full=room_full_2,
    room_rdc=room_rdc_2,
    walls=initial_2,
    wall_index=pre_setting_select_edge_2,
    furniture_piece=block_2)  # -> result_room_full_2, result_room_rdc_2, result_initial_2, results_1_indexes_furniture_var_3, results_transformation_data_2, result_details_2, result_score_3, importance_furniture_2, score_max_2, score_min_2
result_score = Data(_1_furniture_piece_2.result_score_3)
result_score_2 = Data(_1_furniture_piece.result_score_3)
result_details = Geometry(_1_furniture_piece_2.result_details_2)
result_details_2 = Geometry(_1_furniture_piece.result_details_2)
initial_3 = Curve(_1_furniture_piece_3.result_initial_2)
room_full_3 = Curve(_1_furniture_piece_3.result_room_full_2)
room_rdc_3 = Curve(_1_furniture_piece_3.result_room_rdc_2)
result_score_3 = Data(_1_furniture_piece_3.result_score_3)
result_details_3 = Geometry(_1_furniture_piece_3.result_details_2)
results_transformation_data = Data(_1_furniture_piece_2.results_transformation_data_2)
results_transformation_data_2 = Data(_1_furniture_piece.results_transformation_data_2)
results_1_indexes_furniture_var = Data(_1_furniture_piece_2.results_1_indexes_furniture_var_3)
results_1_indexes_furniture_var_2 = Data(_1_furniture_piece.results_1_indexes_furniture_var_3)
results_transformation_data_3 = Data(_1_furniture_piece_3.results_transformation_data_2)
results_1_indexes_furniture_var_3 = Data(_1_furniture_piece_3.results_1_indexes_furniture_var_3)
viewer = ParamViewer(room_full_3)

num = Number([_1_furniture_piece.score_max_2, _1_furniture_piece_2.score_max_2, _1_furniture_piece_3.score_max_2])
num_2 = Number([_1_furniture_piece.score_min_2, _1_furniture_piece_2.score_min_2, _1_furniture_piece_3.score_min_2])
ma = MassAddition(Input=num)  # -> Result, PartialResults
ma_2 = MassAddition(Input=num_2)  # -> Result, PartialResults
score_wish = Number(ma.Result)
score_min = Number(ma_2.Result)

_1_furniture_piece_4 = _1FurniturePiece(room_full=room_4, room_rdc=room_diff_2, walls=room_4, wall_index=pre_setting_select_edge_8, furniture_piece=block_0_2)  # -> result_room_full_2, result_room_rdc_2, result_initial_2, results_1_indexes_furniture_var_3, results_transformation_data_2, result_details_2, result_score_3, importance_furniture_2, score_max_2, score_min_2
initial_4 = Curve(_1_furniture_piece_4.result_initial_2)
room_full_4 = Curve(_1_furniture_piece_4.result_room_full_2)
room_rdc_4 = Curve(_1_furniture_piece_4.result_room_rdc_2)
_1_furniture_piece_5 = _1FurniturePiece(
    room_full=room_full_4,
    room_rdc=room_rdc_4,
    walls=initial_4,
    wall_index=pre_setting_select_edge_7,
    furniture_piece=block_1_2)  # -> result_room_full_2, result_room_rdc_2, result_initial_2, results_1_indexes_furniture_var_3, results_transformation_data_2, result_details_2, result_score_3, importance_furniture_2, score_max_2, score_min_2
room_full_5 = Curve(_1_furniture_piece_5.result_room_full_2)
initial_5 = Curve(_1_furniture_piece_5.result_initial_2)
room_rdc_5 = Curve(_1_furniture_piece_5.result_room_rdc_2)
_1_furniture_piece_6 = _1FurniturePiece(
    room_full=room_full_5,
    room_rdc=room_rdc_5,
    walls=initial_5,
    wall_index=pre_setting_select_edge_9,
    furniture_piece=block_2_2)  # -> result_room_full_2, result_room_rdc_2, result_initial_2, results_1_indexes_furniture_var_3, results_transformation_data_2, result_details_2, result_score_3, importance_furniture_2, score_max_2, score_min_2
result_score_4 = Data(_1_furniture_piece_5.result_score_3)
result_details_4 = Geometry(_1_furniture_piece_5.result_details_2)
result_score_5 = Data(_1_furniture_piece_4.result_score_3)
result_details_5 = Geometry(_1_furniture_piece_4.result_details_2)
room_full_6 = Curve(_1_furniture_piece_6.result_room_full_2)
room_rdc_6 = Curve(_1_furniture_piece_6.result_room_rdc_2)
initial_6 = Curve(_1_furniture_piece_6.result_initial_2)
result_score_6 = Data(_1_furniture_piece_6.result_score_3)
result_details_6 = Geometry(_1_furniture_piece_6.result_details_2)
results_transformation_data_4 = Data(_1_furniture_piece_5.results_transformation_data_2)
results_transformation_data_5 = Data(_1_furniture_piece_4.results_transformation_data_2)
results_1_indexes_furniture_var_4 = Data(_1_furniture_piece_5.results_1_indexes_furniture_var_3)
results_1_indexes_furniture_var_5 = Data(_1_furniture_piece_4.results_1_indexes_furniture_var_3)
results_transformation_data_6 = Data(_1_furniture_piece_6.results_transformation_data_2)
results_1_indexes_furniture_var_6 = Data(_1_furniture_piece_6.results_1_indexes_furniture_var_3)
trim_3 = TrimTree(Tree=results_1_indexes_furniture_var, Depth=1)

num_3 = Number([_1_furniture_piece_4.score_max_2, _1_furniture_piece_5.score_max_2, _1_furniture_piece_6.score_max_2])
num_4 = Number([_1_furniture_piece_4.score_min_2, _1_furniture_piece_5.score_min_2, _1_furniture_piece_6.score_min_2])
ma_3 = MassAddition(Input=num_3)  # -> Result, PartialResults
ma_4 = MassAddition(Input=num_4)  # -> Result, PartialResults
score_wish_2 = Number(ma_3.Result)
score_min_2 = Number(ma_4.Result)

list_length_options_tree = ListLength(List=trim_3)
trim_4 = TrimTree(Tree=results_1_indexes_furniture_var_4, Depth=1)
trim_5 = TrimTree(Tree=results_1_indexes_furniture_var_3, Depth=1)
list_length_options_tree_2 = ListLength(List=trim_4)
list_length_options_tree_3 = ListLength(List=trim_5)
trim_6 = TrimTree(Tree=results_1_indexes_furniture_var_6, Depth=1)
list_length_options_tree_4 = ListLength(List=trim_6)

# ---- group: repeat data step1
data = Data(list_length_options_tree_2)
flatten_2 = FlattenTree(Tree=data, Path="{0}")
clean = CleanTree(RemoveNulls=True, RemoveInvalid=True, RemoveEmpty=False, Tree=flatten_2)
null_4 = NullItem(Item=clean)  # -> NullFlags, InvalidFlags, Description
repeat = RepeatData(Data=results_1_indexes_furniture_var_5, Length=data)
repeat_2 = RepeatData(Data=results_transformation_data_5, Length=data)
filter_2 = StreamFilter(Gate=null_4.NullFlags, Stream0=repeat, Stream1=results_1_indexes_furniture_var_5)
filter_3 = StreamFilter(Gate=null_4.NullFlags, Stream0=repeat_2, Stream1=results_transformation_data_5)
graft_5 = GraftTree(Tree=filter_2, IncludeEmptyLists=True, IncludeNullItems=True)  # -> simplify(Tree)
graft_6 = GraftTree(Tree=filter_3, IncludeEmptyLists=True, IncludeNullItems=True)  # -> simplify(Tree)

# ----
panel_6 = Panel(repeat)

# ---- group: repeat data step1
data_2 = Data(list_length_options_tree_4)
flatten_3 = FlattenTree(Tree=data_2, Path="{0}")
clean_2 = CleanTree(RemoveNulls=True, RemoveInvalid=True, RemoveEmpty=False, Tree=flatten_3)
null_5 = NullItem(Item=clean_2)  # -> NullFlags, InvalidFlags, Description
repeat_3 = RepeatData(Data=results_1_indexes_furniture_var_4, Length=data_2)
repeat_4 = RepeatData(Data=results_transformation_data_4, Length=data_2)
filter_4 = StreamFilter(Gate=null_5.NullFlags, Stream0=repeat_3, Stream1=results_1_indexes_furniture_var_4)
filter_5 = StreamFilter(Gate=null_5.NullFlags, Stream0=repeat_4, Stream1=results_transformation_data_4)
graft_7 = GraftTree(Tree=filter_4, IncludeEmptyLists=True, IncludeNullItems=True)  # -> simplify(Tree)
graft_8 = GraftTree(Tree=filter_5, IncludeEmptyLists=True, IncludeNullItems=True)  # -> simplify(Tree)

data_3 = Data(list_length_options_tree)
flatten_4 = FlattenTree(Tree=data_3, Path="{0}")
clean_3 = CleanTree(RemoveNulls=True, RemoveInvalid=True, RemoveEmpty=False, Tree=flatten_4)
null_6 = NullItem(Item=clean_3)  # -> NullFlags, InvalidFlags, Description
repeat_5 = RepeatData(Data=results_1_indexes_furniture_var_2, Length=data_3)
repeat_6 = RepeatData(Data=results_transformation_data_2, Length=data_3)
filter_6 = StreamFilter(Gate=null_6.NullFlags, Stream0=repeat_5, Stream1=results_1_indexes_furniture_var_2)
filter_7 = StreamFilter(Gate=null_6.NullFlags, Stream0=repeat_6, Stream1=results_transformation_data_2)
graft_9 = GraftTree(Tree=filter_6, IncludeEmptyLists=True, IncludeNullItems=True)  # -> simplify(Tree)
graft_10 = GraftTree(Tree=filter_7, IncludeEmptyLists=True, IncludeNullItems=True)  # -> simplify(Tree)

# ----
panel_7 = Panel(repeat_5)

# ---- group: repeat data step1
data_4 = Data(list_length_options_tree_3)
flatten_5 = FlattenTree(Tree=data_4, Path="{0}")
clean_4 = CleanTree(RemoveNulls=True, RemoveInvalid=True, RemoveEmpty=False, Tree=flatten_5)
null_7 = NullItem(Item=clean_4)  # -> NullFlags, InvalidFlags, Description
repeat_7 = RepeatData(Data=results_1_indexes_furniture_var, Length=data_4)
repeat_8 = RepeatData(Data=results_transformation_data, Length=data_4)
filter_8 = StreamFilter(Gate=null_7.NullFlags, Stream0=repeat_7, Stream1=results_1_indexes_furniture_var)
filter_9 = StreamFilter(Gate=null_7.NullFlags, Stream0=repeat_8, Stream1=results_transformation_data)
graft_11 = GraftTree(Tree=filter_8, IncludeEmptyLists=True, IncludeNullItems=True)  # -> simplify(Tree)
graft_12 = GraftTree(Tree=filter_9, IncludeEmptyLists=True, IncludeNullItems=True)  # -> simplify(Tree)

# ---- group: repeat data step2
data_5 = Data(list_length_options_tree_4)
flatten_6 = FlattenTree(Tree=data_5, Path="{0}")
clean_5 = CleanTree(RemoveNulls=True, RemoveInvalid=True, RemoveEmpty=False, Tree=flatten_6)
null_8 = NullItem(Item=clean_5)  # -> NullFlags, InvalidFlags, Description
repeat_9 = RepeatData(Data=graft_5, Length=data_5)
repeat_10 = RepeatData(Data=graft_6, Length=data_5)
filter_10 = StreamFilter(Gate=null_8.NullFlags, Stream0=repeat_9, Stream1=graft_5)
filter_11 = StreamFilter(Gate=null_8.NullFlags, Stream0=repeat_10, Stream1=graft_6)
graft_13 = GraftTree(Tree=filter_10, IncludeEmptyLists=True, IncludeNullItems=True)  # -> simplify(Tree)
graft_14 = GraftTree(Tree=filter_11, IncludeEmptyLists=True, IncludeNullItems=True)  # -> simplify(Tree)

data_6 = Data(list_length_options_tree_3)
flatten_7 = FlattenTree(Tree=data_6, Path="{0}")
clean_6 = CleanTree(RemoveNulls=True, RemoveInvalid=True, RemoveEmpty=False, Tree=flatten_7)
null_9 = NullItem(Item=clean_6)  # -> NullFlags, InvalidFlags, Description
repeat_11 = RepeatData(Data=graft_9, Length=data_6)
repeat_12 = RepeatData(Data=graft_10, Length=data_6)
filter_12 = StreamFilter(Gate=null_9.NullFlags, Stream0=repeat_11, Stream1=graft_9)
filter_13 = StreamFilter(Gate=null_9.NullFlags, Stream0=repeat_12, Stream1=graft_10)
graft_15 = GraftTree(Tree=filter_12, IncludeEmptyLists=True, IncludeNullItems=True)  # -> simplify(Tree)
graft_16 = GraftTree(Tree=filter_13, IncludeEmptyLists=True, IncludeNullItems=True)  # -> simplify(Tree)

# ----
python = GhPythonScript()  # -> Out, A
python_2 = GhPythonScript()  # -> Out, A
python_3 = GhPythonScript()  # -> Out, A
repeat_13 = RepeatData(Data=graft_5, Length=data_5)  # -> simplify(graft(Data))
repeat_14 = RepeatData(Data=graft_6, Length=data_5)  # -> simplify(graft(Data))
null_10 = NullItem(Item=data_5)  # -> NullFlags, InvalidFlags, Description
repeat_15 = RepeatData(Data=graft_9, Length=data_6)  # -> simplify(graft(Data))
repeat_16 = RepeatData(Data=graft_10, Length=data_6)  # -> simplify(graft(Data))
nr_of_rooms_of_this_type_2 = Number(lng_5)
addition = Addition(A=nr_of_rooms_of_this_type_2, B=Slider(0, range=0..1))
filter_14 = StreamFilter(Gate=null_10.NullFlags, Stream0=repeat_13, Stream1=graft_5)
filter_15 = StreamFilter(Gate=null_10.NullFlags, Stream0=repeat_14, Stream1=graft_6)
null_11 = NullItem(Item=data_6)  # -> NullFlags, InvalidFlags, Description
importance = Data(_1_furniture_piece_5.importance_furniture_2)
importance_2 = Data(_1_furniture_piece_6.importance_furniture_2)
result_1_details = Geometry(result_details_4)
results_1_indexes_furniture_var_7 = Data(results_1_indexes_furniture_var_6)
result_1_details_2 = Geometry(result_details_6)
results_1_transformation_data = Data(results_transformation_data_6)
nr_of_rooms_of_this_type_3 = Number(lng_5)
importance_3 = Data(_1_furniture_piece_4.importance_furniture_2)
result_1_details_3 = Geometry(result_details_5)
panel_8 = Panel(filter_14)
filter_16 = StreamFilter(Gate=null_11.NullFlags, Stream0=repeat_15, Stream1=graft_9)
addition_2 = Addition(A=nr_of_rooms_of_this_type_3, B=Slider(0, range=0..1))
filter_17 = StreamFilter(Gate=null_11.NullFlags, Stream0=repeat_16, Stream1=graft_10)
importance_4 = Data(_1_furniture_piece_3.importance_furniture_2)
importance_5 = Data(_1_furniture_piece_2.importance_furniture_2)
result_1_details_4 = Geometry(result_details)
results_1_indexes_furniture_var_8 = Data(results_1_indexes_furniture_var_3)
result_1_details_5 = Geometry(result_details_3)
results_1_transformation_data_2 = Data(results_transformation_data_3)
trim_7 = TrimTree(Tree=results_1_indexes_furniture_var_7, Depth=addition_2)
trim_8 = TrimTree(Tree=results_1_transformation_data, Depth=addition_2)
nr_of_rooms_of_this_type_4 = Number(lng_3)
result_1_details_6 = Geometry(result_details_2)
importance_6 = Data(_1_furniture_piece.importance_furniture_2)
panel_9 = Panel(filter_16)
addition_3 = Addition(A=nr_of_rooms_of_this_type_4, B=Slider(0, range=0..1))
trim_9 = TrimTree(Tree=graft_7, Depth=addition_2)
trim_10 = TrimTree(Tree=graft_8, Depth=addition_2)
clean_7 = CleanTree(RemoveNulls=True, RemoveInvalid=True, RemoveEmpty=False, Tree=flatten(trim_9))
clean_8 = CleanTree(RemoveNulls=True, RemoveInvalid=True, RemoveEmpty=False, Tree=flatten(trim_10))
clean_9 = CleanTree(RemoveNulls=True, RemoveInvalid=True, RemoveEmpty=False, Tree=flatten(trim_8))
trim_11 = TrimTree(Tree=graft_13, Depth=addition_2)
trim_12 = TrimTree(Tree=graft_14, Depth=addition_2)
clean_10 = CleanTree(RemoveNulls=True, RemoveInvalid=True, RemoveEmpty=False, Tree=flatten(trim_12))
clean_11 = CleanTree(RemoveNulls=True, RemoveInvalid=True, RemoveEmpty=False, Tree=flatten(trim_11))
clean_12 = CleanTree(RemoveNulls=True, RemoveInvalid=True, RemoveEmpty=False, Tree=flatten(trim_7))
null_12 = NullItem(Item=flatten(clean_9))  # -> NullFlags, InvalidFlags, Description
null_13 = NullItem(Item=flatten(clean_12))  # -> NullFlags, InvalidFlags, Description
trim_13 = TrimTree(Tree=results_1_indexes_furniture_var_8, Depth=addition_3)
null_14 = NullItem(Item=flatten(clean_8))  # -> NullFlags, InvalidFlags, Description
trim_14 = TrimTree(Tree=results_1_transformation_data_2, Depth=addition_3)
null_15 = NullItem(Item=flatten(clean_7))  # -> NullFlags, InvalidFlags, Description
null_16 = NullItem(Item=flatten(clean_11))  # -> NullFlags, InvalidFlags, Description
null_17 = NullItem(Item=flatten(clean_10))  # -> NullFlags, InvalidFlags, Description
trim_15 = TrimTree(Tree=graft_11, Depth=addition_3)
trim_16 = TrimTree(Tree=graft_12, Depth=addition_3)
filter_18 = StreamFilter(Gate=null_12.NullFlags, Stream0=trim_8, Stream1=flatten(results_1_transformation_data))
clean_13 = CleanTree(RemoveNulls=True, RemoveInvalid=True, RemoveEmpty=False, Tree=flatten(trim_15))
clean_14 = CleanTree(RemoveNulls=True, RemoveInvalid=True, RemoveEmpty=False, Tree=flatten(trim_16))
filter_19 = StreamFilter(Gate=null_13.NullFlags, Stream0=trim_7, Stream1=flatten(results_1_indexes_furniture_var_7))
clean_15 = CleanTree(RemoveNulls=True, RemoveInvalid=True, RemoveEmpty=False, Tree=flatten(trim_14))
trim_17 = TrimTree(Tree=graft_15, Depth=addition_3)
trim_18 = TrimTree(Tree=graft_16, Depth=addition_3)
clean_16 = CleanTree(RemoveNulls=True, RemoveInvalid=True, RemoveEmpty=False, Tree=flatten(trim_18))
filter_20 = StreamFilter(Gate=null_14.NullFlags, Stream0=trim_10, Stream1=flatten(graft_8))
clean_17 = CleanTree(RemoveNulls=True, RemoveInvalid=True, RemoveEmpty=False, Tree=flatten(trim_17))
clean_18 = CleanTree(RemoveNulls=True, RemoveInvalid=True, RemoveEmpty=False, Tree=flatten(trim_13))
filter_21 = StreamFilter(Gate=null_15.NullFlags, Stream0=trim_9, Stream1=flatten(graft_7))
filter_22 = StreamFilter(Gate=null_16.NullFlags, Stream0=trim_11, Stream1=flatten(graft_13))
null_18 = NullItem(Item=flatten(clean_15))  # -> NullFlags, InvalidFlags, Description
null_19 = NullItem(Item=flatten(clean_18))  # -> NullFlags, InvalidFlags, Description
filter_23 = StreamFilter(Gate=null_17.NullFlags, Stream0=trim_12, Stream1=flatten(graft_14))
score = Data(result_score_5)
score_2 = Data(result_score_4)
score_3 = Data(result_score_6)
null_20 = NullItem(Item=flatten(clean_14))  # -> NullFlags, InvalidFlags, Description
null_21 = NullItem(Item=flatten(clean_13))  # -> NullFlags, InvalidFlags, Description
null_22 = NullItem(Item=flatten(clean_17))  # -> NullFlags, InvalidFlags, Description
null_23 = NullItem(Item=flatten(clean_16))  # -> NullFlags, InvalidFlags, Description
filter_24 = StreamFilter(Gate=null_18.NullFlags, Stream0=trim_14, Stream1=flatten(results_1_transformation_data_2))
filter_25 = StreamFilter(Gate=null_19.NullFlags, Stream0=trim_13, Stream1=flatten(results_1_indexes_furniture_var_8))
item_6 = ListItem(List=score_2, Index=filter_21, Wrap=True)
item_7 = ListItem(List=score_3, Index=filter_19, Wrap=True)
filter_26 = StreamFilter(Gate=null_20.NullFlags, Stream0=trim_16, Stream1=flatten(graft_12))
filter_27 = StreamFilter(Gate=null_21.NullFlags, Stream0=trim_15, Stream1=flatten(graft_11))
indexes_furniture_var = Data(filter_22)
item_8 = ListItem(List=score, Index=indexes_furniture_var, Wrap=True)
panel_10 = Panel(item_8)
filter_28 = StreamFilter(Gate=null_22.NullFlags, Stream0=trim_17, Stream1=flatten(graft_15))
filter_29 = StreamFilter(Gate=null_23.NullFlags, Stream0=trim_18, Stream1=flatten(graft_16))
score_4 = Data(result_score_2)
score_5 = Data(result_score)
score_6 = Data(result_score_3)
all_scores = Data(item_8)
all_scores_2 = Data(item_6)
all_scores_3 = Data(item_7)
graft_17 = GraftTree(Tree=all_scores, IncludeEmptyLists=True, IncludeNullItems=True)  # -> simplify(Tree)
graft_18 = GraftTree(Tree=all_scores_2, IncludeEmptyLists=True, IncludeNullItems=True)  # -> simplify(Tree)
item_9 = ListItem(List=score_5, Index=filter_27, Wrap=True)
item_10 = ListItem(List=score_6, Index=filter_25, Wrap=True)
graft_19 = GraftTree(Tree=all_scores_3, IncludeEmptyLists=True, IncludeNullItems=True)  # -> simplify(Tree)
indexes_furniture_var_2 = Data(filter_28)
item_11 = ListItem(List=score_4, Index=indexes_furniture_var_2, Wrap=True)
panel_11 = Panel(item_11)
all_scores_4 = Data(item_11)
all_scores_5 = Data(item_9)
all_scores_6 = Data(item_10)
graft_20 = GraftTree(Tree=all_scores_4, IncludeEmptyLists=True, IncludeNullItems=True)  # -> simplify(Tree)
graft_21 = GraftTree(Tree=all_scores_5, IncludeEmptyLists=True, IncludeNullItems=True)  # -> simplify(Tree)
graft_22 = GraftTree(Tree=all_scores_6, IncludeEmptyLists=True, IncludeNullItems=True)  # -> simplify(Tree)
panel_12 = Panel(indexes_furniture_var)
merge_10 = Merge(Data1=graft_17, Data2=graft_18, Data3=graft_19)
clean_19 = CleanTree(RemoveNulls=True, RemoveInvalid=True, RemoveEmpty=False, Tree=merge_10)
panel_13 = Panel(indexes_furniture_var_2)
ma_5 = MassAddition(Input=clean_19)  # -> Result, PartialResults
merge_11 = Merge(Data1=graft_20, Data2=graft_21, Data3=graft_22)
trim_19 = TrimTree(Tree=ma_5.Result, Depth=1)
clean_20 = CleanTree(RemoveNulls=True, RemoveInvalid=True, RemoveEmpty=False, Tree=merge_11)
clean_21 = CleanTree(RemoveNulls=True, RemoveInvalid=True, RemoveEmpty=False, Tree=flatten(trim_19))
panel_14 = Panel(all_scores_3)
ma_6 = MassAddition(Input=clean_20)  # -> Result, PartialResults
number_slider = Slider(12, range=0..25)
number_slider_2 = Slider(4, range=0..19)
score_min_3 = Panel("20")
panel_15 = Panel(ma_5.Result)
trim_20 = TrimTree(Tree=ma_6.Result, Depth=1)
number_slider_3 = Slider(0, range=0..25)
null_24 = NullItem(Item=clean_21)  # -> NullFlags, InvalidFlags, Description
filter_30 = StreamFilter(Gate=null_24.NullFlags, Stream0=trim_19, Stream1=flatten(ma_5.Result))
sort_6 = SortList(Keys=filter_30, ValuesA=filter_19)  # -> Keys, reverse(ValuesA)
sort_7 = SortList(Keys=filter_30, ValuesA=filter_18)  # -> Keys, reverse(ValuesA)
sort_8 = SortList(Keys=filter_30, ValuesA=filter_23)  # -> Keys, reverse(ValuesA)
sort_9 = SortList(Keys=filter_30, ValuesA=filter_21)  # -> reverse(Keys), reverse(ValuesA)
sort_10 = SortList(Keys=filter_30, ValuesA=filter_20)  # -> reverse(simplify(Keys)), reverse(ValuesA)
sort_11 = SortList(Keys=filter_30, ValuesA=filter_22)  # -> reverse(Keys), reverse(ValuesA)
panel_16 = Panel(sort_11.Keys)
panel_17 = Panel(all_scores_6)
clean_22 = CleanTree(RemoveNulls=True, RemoveInvalid=True, RemoveEmpty=False, Tree=flatten(trim_20))
number_slider_4 = Slider(12, range=0..25)
number_slider_5 = Slider(4, range=0..19)
results_1_indexes_furniture_var_9 = Data(graft_7)
results_1_transformation_data_3 = Data(graft_8)
number_slider_6 = Slider(0, range=0..25)
null_25 = NullItem(Item=clean_22)  # -> NullFlags, InvalidFlags, Description
indexes_furniture_var_3 = Data(sort_11.ValuesA)
transformation_data = Data(sort_8.ValuesA)
filter_31 = StreamFilter(Gate=null_25.NullFlags, Stream0=trim_20, Stream1=flatten(ma_6.Result))
sort_12 = SortList(Keys=filter_31, ValuesA=filter_25)  # -> Keys, reverse(ValuesA)
sort_13 = SortList(Keys=filter_31, ValuesA=filter_24)  # -> Keys, reverse(ValuesA)
sort_14 = SortList(Keys=filter_31, ValuesA=filter_29)  # -> Keys, reverse(ValuesA)
sort_15 = SortList(Keys=filter_31, ValuesA=filter_27)  # -> reverse(Keys), reverse(ValuesA)
sort_16 = SortList(Keys=filter_31, ValuesA=filter_26)  # -> reverse(simplify(Keys)), reverse(ValuesA)
sort_17 = SortList(Keys=filter_31, ValuesA=filter_28)  # -> reverse(Keys), reverse(ValuesA)
panel_18 = Panel(sort_17.Keys)
indexes_furniture_var_4 = Data(sort_9.ValuesA)
transformation_data_2 = Data(sort_10.ValuesA)
transformation_data_3 = Data(sort_7.ValuesA)
indexes_furniture_var_5 = Data(sort_6.ValuesA)
number_slider_7 = Slider(12, range=0..25)
number_slider_8 = Slider(4, range=0..19)

merge_12 = Merge(Data1=Slider(1, range=0..2), Data2=Slider(1, range=0..10), Data3=Slider(0, range=0..10), Data4=Slider(0, range=0..10))
join_3 = TextJoin(Text=merge_12, Join=";")
branch_2 = TreeBranch(Tree=simplify(results_1_indexes_furniture_var_9), Path=join_3, MaintainPaths=True)

panel_19 = Panel(importance_3)
item_12 = ListItem(List=indexes_furniture_var_3, Index=number_slider_5, Wrap=True)
item_13 = ListItem(List=transformation_data, Index=number_slider_5, Wrap=True)
number_slider_9 = Slider(0, range=0..25)
score_7 = Data(result_score_5)
item_14 = ListItem(List=indexes_furniture_var_4, Index=number_slider_5, Wrap=True)
item_15 = ListItem(List=transformation_data_2, Index=number_slider_5, Wrap=True)
detsils = Geometry(result_1_details_3)
item_16 = ListItem(List=indexes_furniture_var_5, Index=number_slider_5, Wrap=True)
item_17 = ListItem(List=transformation_data_3, Index=number_slider_5, Wrap=True)
detsils_2 = Geometry(result_1_details)
data_7 = Data(detsils_2)
indexes_furniture_var_6 = Data(sort_17.ValuesA)
detsils_3 = Geometry(result_1_details_2)
transformation_data_4 = Data(sort_14.ValuesA)
indexes_furniture_var_7 = Data(sort_15.ValuesA)
transformation_data_5 = Data(sort_16.ValuesA)
indexes_furniture_var_8 = Data(sort_12.ValuesA)
transformation_data_6 = Data(sort_13.ValuesA)
score_8 = ListItem(List=score_7, Index=item_12, Wrap=True)
detsils_4 = Geometry(result_1_details_4)
panel_20 = Panel(filter_31)
item_18 = ListItem(List=importance_3, Index=item_12, Wrap=True)
item_19 = ListItem(List=detsils, Index=item_12, Wrap=True)
item_20 = ListItem(List=detsils_2, Index=item_14, Wrap=True)
panel_21 = Panel(importance_6)
item_21 = ListItem(List=detsils_3, Index=item_16, Wrap=True)
item_22 = ListItem(List=sort_9.Keys, Index=number_slider_5, Wrap=True)
item_23 = ListItem(List=indexes_furniture_var_6, Index=number_slider_8, Wrap=True)
item_24 = ListItem(List=transformation_data_4, Index=number_slider_8, Wrap=True)
item_25 = ListItem(List=indexes_furniture_var_7, Index=number_slider_8, Wrap=True)
item_26 = ListItem(List=transformation_data_5, Index=number_slider_8, Wrap=True)
item_27 = ListItem(List=indexes_furniture_var_8, Index=number_slider_8, Wrap=True)
item_28 = ListItem(List=transformation_data_6, Index=number_slider_8, Wrap=True)
score_9 = Data(result_score_2)
detsils_5 = Geometry(result_1_details_6)
detsils_6 = Geometry(result_1_details_5)
panel_22 = Panel(score_8)
transform = Transform(Geometry=item_19, Transform=item_13)

score_wish_3 = Number(score_wish_2)
is_score = Number(filter_30)
score_min_4 = Number(score_min_2)
larger = LargerThan(FirstNumber=is_score, SecondNumber=score_min_4)  # -> LargerThan, OrEqualTo
larger_2 = LargerThan(FirstNumber=is_score, SecondNumber=score_wish_3)  # -> LargerThan, OrEqualTo
ma_7 = MassAddition(Input=larger_2.OrEqualTo)  # -> Result, PartialResults
ma_8 = MassAddition(Input=larger.LargerThan)  # -> Result, PartialResults
larger_3 = LargerThan(FirstNumber=ma_7.Result, SecondNumber=0)  # -> LargerThan, OrEqualTo
larger_4 = LargerThan(FirstNumber=ma_7.Result, SecondNumber=Slider(1, range=0..1))  # -> LargerThan, OrEqualTo
larger_5 = LargerThan(FirstNumber=ma_8.Result, SecondNumber=0)  # -> LargerThan, OrEqualTo
cull_7 = CullPattern(List=Slider(10, range=0..10), CullPattern=larger_4.LargerThan)
cull_8 = CullPattern(List=Slider(10, range=0..10), CullPattern=larger_3.LargerThan)
cull_9 = CullPattern(List=Slider(80, range=0..100), CullPattern=larger_5.LargerThan)
merge_13 = Merge(Data1=cull_7, Data2=cull_8, Data3=cull_9)
ma_9 = MassAddition(Input=merge_13)  # -> Result, PartialResults
score_10 = Panel(ma_9.Result)

transform_2 = Transform(Geometry=item_20, Transform=item_15)
score_11 = ListItem(List=score_9, Index=item_23, Wrap=True)
transform_3 = Transform(Geometry=item_21, Transform=item_17)
item_29 = ListItem(List=importance_6, Index=item_23, Wrap=True)
item_30 = ListItem(List=detsils_5, Index=item_23, Wrap=True)
item_31 = ListItem(List=detsils_4, Index=item_25, Wrap=True)
item_32 = ListItem(List=detsils_6, Index=item_27, Wrap=True)
panel_23 = Panel(item_22)
item_33 = ListItem(List=sort_15.Keys, Index=number_slider_8, Wrap=True)
panel_24 = Panel(score_11)

is_score_2 = Number(filter_31)
score_min_5 = Number(score_min)
score_wish_4 = Number(score_wish)
larger_6 = LargerThan(FirstNumber=is_score_2, SecondNumber=score_min_5)  # -> LargerThan, OrEqualTo
larger_7 = LargerThan(FirstNumber=is_score_2, SecondNumber=score_wish_4)  # -> LargerThan, OrEqualTo
ma_10 = MassAddition(Input=larger_7.OrEqualTo)  # -> Result, PartialResults
ma_11 = MassAddition(Input=larger_6.LargerThan)  # -> Result, PartialResults
larger_8 = LargerThan(FirstNumber=ma_10.Result, SecondNumber=0)  # -> LargerThan, OrEqualTo
larger_9 = LargerThan(FirstNumber=ma_10.Result, SecondNumber=Slider(1, range=0..1))  # -> LargerThan, OrEqualTo
larger_10 = LargerThan(FirstNumber=ma_11.Result, SecondNumber=0)  # -> LargerThan, OrEqualTo
cull_10 = CullPattern(List=Slider(10, range=0..10), CullPattern=larger_9.LargerThan)
cull_11 = CullPattern(List=Slider(10, range=0..10), CullPattern=larger_8.LargerThan)
cull_12 = CullPattern(List=Slider(80, range=0..100), CullPattern=larger_10.LargerThan)
merge_14 = Merge(Data1=cull_10, Data2=cull_11, Data3=cull_12)
ma_12 = MassAddition(Input=merge_14)  # -> Result, PartialResults
score_12 = Panel(ma_12.Result)

panel_25 = Panel(item_12)
transform_4 = Transform(Geometry=item_30, Transform=item_24)
transform_5 = Transform(Geometry=item_31, Transform=item_26)
panel_26 = Panel(item_33)
transform_6 = Transform(Geometry=item_32, Transform=item_28)
branch_3 = TreeBranch(Tree=simplify(results_1_transformation_data_3), Path=join_3, MaintainPaths=True)
panel_27 = Panel(transform)
item_34 = ListItem(List=data_7, Index=branch_2, Wrap=True)
panel_28 = Panel(item_23)
panel_29 = Panel(transform_4)
transform_7 = Transform(Geometry=item_34, Transform=branch_3)
panel_30 = Panel(item_20)
merge_15 = Merge(Data1=transform, Data2=transform_2, Data3=transform_3)
merge_16 = Merge(Data1=transform_4, Data2=transform_5, Data3=transform_6)
previewlw = CustomPreviewLineweights(
    Geometry=merge_15,
    Shader=ColourSwatch(SwatchColor=RGB(255, 255, 255)),
    Thickness=Slider(5.4, range=0..10),
    Absolute=False)
previewlw_2 = CustomPreviewLineweights(
    Geometry=merge_16,
    Shader=ColourSwatch(SwatchColor=RGB(255, 255, 255)),
    Thickness=Slider(5.4, range=0..10),
    Absolute=False)

wrap_3 = WrapList(Data=furniture_cluster.kitchen_2)
trim_21 = TrimTree(Tree=wrap_3, Depth=1)
lng_7 = ListLength(List=trim_21)
lng_8 = ListLength(List=flatten(lng_7))
nr_of_blocks_to_place_3 = Panel(lng_8)
bang_3 = ExplodeTree(Data=trim_21)  # -> Branch0, Branch1, Branch2
block_0_3 = UnwrapList(WrappedData=bang_3.Branch0)
block_1_3 = UnwrapList(WrappedData=bang_3.Branch1)
block_2_3 = UnwrapList(WrappedData=bang_3.Branch2)

wrap_4 = WrapList(Data=furniture_cluster.children_2)
trim_22 = TrimTree(Tree=wrap_4, Depth=1)
lng_9 = ListLength(List=trim_22)
lng_10 = ListLength(List=flatten(lng_9))
nr_of_blocks_to_place_4 = Panel(lng_10)
bang_4 = ExplodeTree(Data=trim_22)  # -> Branch0, Branch1, Branch2
block_0_4 = UnwrapList(WrappedData=bang_4.Branch0)
block_1_4 = UnwrapList(WrappedData=bang_4.Branch1)
block_2_4 = UnwrapList(WrappedData=bang_4.Branch2)

room_7 = Curve(children_2)
polyoffset_4 = PolylineOffset(
    Polylines=room_7,
    Distance="0.05",
    Plane=Plane(origin=(0, 0, 0), x=(0, 0, 0), y=(0, 0, 0)),
    Tolerance=0.01,
    ClosedFillet=1,
    OpenFillet=1,
    Miter=2)  # -> Contour, Holes
inner_walls_contour_4 = Curve(graft(polyoffset_4.Holes))
cluster_4 = Cluster(room=inner_walls_contour_4, pt_door=doors, door_width="0.45")
door_area_4 = Curve(cluster_4)
rdiff_5 = RegionDifference(CurvesA=inner_walls_contour_4, CurvesB=door_area_4)
room_8 = Curve(inner_walls_contour_4)
room_diff_4 = Curve(rdiff_5)

room_9 = Curve(kitchen_2)
polyoffset_5 = PolylineOffset(
    Polylines=room_9,
    Distance="0.05",
    Plane=Plane(origin=(0, 0, 0), x=(0, 0, 0), y=(0, 0, 0)),
    Tolerance=0.01,
    ClosedFillet=1,
    OpenFillet=1,
    Miter=2)  # -> Contour, Holes
inner_walls_contour_5 = Curve(graft(polyoffset_5.Holes))
cluster_5 = Cluster(room=inner_walls_contour_5, pt_door=doors, door_width="0.45")
door_area_5 = Curve(cluster_5)
rdiff_6 = RegionDifference(CurvesA=inner_walls_contour_5, CurvesB=door_area_5)
room_10 = Curve(inner_walls_contour_5)
room_diff_5 = Curve(rdiff_6)

lng_11 = ListLength(List=flatten(room_10))
nr_of_rooms_of_this_type_5 = Number(lng_11)
pre_setting_select_edge_10 = Panel("""0
0
0""")
pre_setting_select_edge_11 = Panel("""0
0
0""")
pre_setting_select_edge_12 = Panel("""0
0
0""")
_1_furniture_piece_7 = _1FurniturePiece(room_full=room_8, room_rdc=room_diff_4, walls=room_8, wall_index=pre_setting_select_edge_11, furniture_piece=block_0_4)  # -> result_room_full_2, result_room_rdc_2, result_initial_2, results_1_indexes_furniture_var_3, results_transformation_data_2, result_details_2, result_score_3, importance_furniture_2, score_max_2, score_min_2
pre_setting_select_edge_13 = Panel("""0
0""")
pre_setting_select_edge_14 = Panel("""0
0
0""")
pre_setting_select_edge_15 = Panel("""0
0
0""")
_1_furniture_piece_8 = _1FurniturePiece(room_full=room_10, room_rdc=room_diff_5, walls=room_10, wall_index=pre_setting_select_edge_15, furniture_piece=block_0_3)  # -> result_room_full_2, result_room_rdc_2, result_initial_2, results_1_indexes_furniture_var_3, results_transformation_data_2, result_details_2, result_score_3, importance_furniture_2, score_max_2, score_min_2
initial_7 = Curve(_1_furniture_piece_7.result_initial_2)
room_full_7 = Curve(_1_furniture_piece_7.result_room_full_2)
room_rdc_7 = Curve(_1_furniture_piece_7.result_room_rdc_2)
_1_furniture_piece_9 = _1FurniturePiece(
    room_full=room_full_7,
    room_rdc=room_rdc_7,
    walls=initial_7,
    wall_index=pre_setting_select_edge_10,
    furniture_piece=block_1_4)  # -> result_room_full_2, result_room_rdc_2, result_initial_2, results_1_indexes_furniture_var_3, results_transformation_data_2, result_details_2, result_score_3, importance_furniture_2, score_max_2, score_min_2
room_full_8 = Curve(_1_furniture_piece_9.result_room_full_2)
room_rdc_8 = Curve(_1_furniture_piece_9.result_room_rdc_2)
initial_8 = Curve(_1_furniture_piece_9.result_initial_2)
_1_furniture_piece_10 = _1FurniturePiece(
    room_full=room_full_8,
    room_rdc=room_rdc_8,
    walls=initial_8,
    wall_index=pre_setting_select_edge_12,
    furniture_piece=block_2_4)  # -> result_room_full_2, result_room_rdc_2, result_initial_2, results_1_indexes_furniture_var_3, results_transformation_data_2, result_details_2, result_score_3, importance_furniture_2, score_max_2, score_min_2
result_score_7 = Data(_1_furniture_piece_9.result_score_3)
result_details_7 = Geometry(_1_furniture_piece_9.result_details_2)
result_score_8 = Data(_1_furniture_piece_7.result_score_3)
result_details_8 = Geometry(_1_furniture_piece_7.result_details_2)
room_full_9 = Curve(_1_furniture_piece_10.result_room_full_2)
room_rdc_9 = Curve(_1_furniture_piece_10.result_room_rdc_2)
initial_9 = Curve(_1_furniture_piece_10.result_initial_2)
result_score_9 = Data(_1_furniture_piece_10.result_score_3)
result_details_9 = Geometry(_1_furniture_piece_10.result_details_2)
results_transformation_data_7 = Data(_1_furniture_piece_9.results_transformation_data_2)
results_transformation_data_8 = Data(_1_furniture_piece_7.results_transformation_data_2)
results_1_indexes_furniture_var_10 = Data(_1_furniture_piece_9.results_1_indexes_furniture_var_3)
results_1_indexes_furniture_var_11 = Data(_1_furniture_piece_7.results_1_indexes_furniture_var_3)
results_transformation_data_9 = Data(_1_furniture_piece_10.results_transformation_data_2)
results_1_indexes_furniture_var_12 = Data(_1_furniture_piece_10.results_1_indexes_furniture_var_3)

num_5 = Number([_1_furniture_piece_7.score_max_2, _1_furniture_piece_9.score_max_2, _1_furniture_piece_10.score_max_2])
num_6 = Number([_1_furniture_piece_7.score_min_2, _1_furniture_piece_9.score_min_2, _1_furniture_piece_10.score_min_2])
ma_13 = MassAddition(Input=num_5)  # -> Result, PartialResults
ma_14 = MassAddition(Input=num_6)  # -> Result, PartialResults
score_wish_5 = Number(ma_13.Result)
score_min_6 = Number(ma_14.Result)

room_full_10 = Curve(_1_furniture_piece_8.result_room_full_2)
initial_10 = Curve(_1_furniture_piece_8.result_initial_2)
room_rdc_10 = Curve(_1_furniture_piece_8.result_room_rdc_2)
_1_furniture_piece_11 = _1FurniturePiece(
    room_full=room_full_10,
    room_rdc=room_rdc_10,
    walls=initial_10,
    wall_index=pre_setting_select_edge_13,
    furniture_piece=block_1_3)  # -> result_room_full_2, result_room_rdc_2, result_initial_2, results_1_indexes_furniture_var_3, results_transformation_data_2, result_details_2, result_score_3, importance_furniture_2, score_max_2, score_min_2
initial_11 = Curve(_1_furniture_piece_11.result_initial_2)
room_full_11 = Curve(_1_furniture_piece_11.result_room_full_2)
room_rdc_11 = Curve(_1_furniture_piece_11.result_room_rdc_2)
_1_furniture_piece_12 = _1FurniturePiece(
    room_full=room_full_11,
    room_rdc=room_rdc_11,
    walls=initial_11,
    wall_index=pre_setting_select_edge_14,
    furniture_piece=block_2_3)  # -> result_room_full_2, result_room_rdc_2, result_initial_2, results_1_indexes_furniture_var_3, results_transformation_data_2, result_details_2, result_score_3, importance_furniture_2, score_max_2, score_min_2
result_score_10 = Data(_1_furniture_piece_11.result_score_3)
result_score_11 = Data(_1_furniture_piece_8.result_score_3)
result_details_10 = Geometry(_1_furniture_piece_11.result_details_2)
result_details_11 = Geometry(_1_furniture_piece_8.result_details_2)
room_full_12 = Curve(_1_furniture_piece_12.result_room_full_2)
initial_12 = Curve(_1_furniture_piece_12.result_initial_2)
room_rdc_12 = Curve(_1_furniture_piece_12.result_room_rdc_2)
result_score_12 = Data(_1_furniture_piece_12.result_score_3)
result_details_12 = Geometry(_1_furniture_piece_12.result_details_2)
results_transformation_data_10 = Data(_1_furniture_piece_11.results_transformation_data_2)
results_transformation_data_11 = Data(_1_furniture_piece_8.results_transformation_data_2)
results_1_indexes_furniture_var_13 = Data(_1_furniture_piece_11.results_1_indexes_furniture_var_3)
results_1_indexes_furniture_var_14 = Data(_1_furniture_piece_8.results_1_indexes_furniture_var_3)
results_transformation_data_12 = Data(_1_furniture_piece_12.results_transformation_data_2)
results_1_indexes_furniture_var_15 = Data(_1_furniture_piece_12.results_1_indexes_furniture_var_3)
trim_23 = TrimTree(Tree=results_1_indexes_furniture_var_10, Depth=1)

score_wish_6 = Number(_1_furniture_piece_8.score_max_2)
score_min_7 = Number(_1_furniture_piece_8.score_min_2)

list_length_options_tree_5 = ListLength(List=trim_23)
trim_24 = TrimTree(Tree=results_1_indexes_furniture_var_12, Depth=1)
list_length_options_tree_6 = ListLength(List=trim_24)

# ---- group: repeat data step1
data_8 = Data(list_length_options_tree_5)
flatten_8 = FlattenTree(Tree=data_8, Path="{0}")
clean_23 = CleanTree(RemoveNulls=True, RemoveInvalid=True, RemoveEmpty=False, Tree=flatten_8)
null_26 = NullItem(Item=clean_23)  # -> NullFlags, InvalidFlags, Description
repeat_17 = RepeatData(Data=results_1_indexes_furniture_var_11, Length=data_8)
repeat_18 = RepeatData(Data=results_transformation_data_8, Length=data_8)
filter_32 = StreamFilter(Gate=null_26.NullFlags, Stream0=repeat_17, Stream1=results_1_indexes_furniture_var_11)
filter_33 = StreamFilter(Gate=null_26.NullFlags, Stream0=repeat_18, Stream1=results_transformation_data_8)
graft_23 = GraftTree(Tree=filter_32, IncludeEmptyLists=True, IncludeNullItems=True)  # -> simplify(Tree)
graft_24 = GraftTree(Tree=filter_33, IncludeEmptyLists=True, IncludeNullItems=True)  # -> simplify(Tree)

# ----
panel_31 = Panel(repeat_17)
trim_25 = TrimTree(Tree=results_1_indexes_furniture_var_13, Depth=1)

# ---- group: repeat data step1
data_9 = Data(list_length_options_tree_6)
flatten_9 = FlattenTree(Tree=data_9, Path="{0}")
clean_24 = CleanTree(RemoveNulls=True, RemoveInvalid=True, RemoveEmpty=False, Tree=flatten_9)
null_27 = NullItem(Item=clean_24)  # -> NullFlags, InvalidFlags, Description
repeat_19 = RepeatData(Data=results_1_indexes_furniture_var_10, Length=data_9)
repeat_20 = RepeatData(Data=results_transformation_data_7, Length=data_9)
filter_34 = StreamFilter(Gate=null_27.NullFlags, Stream0=repeat_19, Stream1=results_1_indexes_furniture_var_10)
filter_35 = StreamFilter(Gate=null_27.NullFlags, Stream0=repeat_20, Stream1=results_transformation_data_7)
graft_25 = GraftTree(Tree=filter_34, IncludeEmptyLists=True, IncludeNullItems=True)  # -> simplify(Tree)
graft_26 = GraftTree(Tree=filter_35, IncludeEmptyLists=True, IncludeNullItems=True)  # -> simplify(Tree)

# ----
list_length_options_tree_7 = ListLength(List=trim_25)
trim_26 = TrimTree(Tree=results_1_indexes_furniture_var_15, Depth=1)
# KITCHEN
list_length_options_tree_8 = ListLength(List=trim_26)

# ---- group: repeat data step1
data_10 = Data(list_length_options_tree_7)
flatten_10 = FlattenTree(Tree=data_10, Path="{0}")
clean_25 = CleanTree(RemoveNulls=True, RemoveInvalid=True, RemoveEmpty=False, Tree=flatten_10)
null_28 = NullItem(Item=clean_25)  # -> NullFlags, InvalidFlags, Description
repeat_21 = RepeatData(Data=results_1_indexes_furniture_var_14, Length=data_10)
repeat_22 = RepeatData(Data=results_transformation_data_11, Length=data_10)
filter_36 = StreamFilter(Gate=null_28.NullFlags, Stream0=repeat_21, Stream1=results_1_indexes_furniture_var_14)
filter_37 = StreamFilter(Gate=null_28.NullFlags, Stream0=repeat_22, Stream1=results_transformation_data_11)
graft_27 = GraftTree(Tree=filter_36, IncludeEmptyLists=True, IncludeNullItems=True)  # -> simplify(Tree)
graft_28 = GraftTree(Tree=filter_37, IncludeEmptyLists=True, IncludeNullItems=True)  # -> simplify(Tree)

# ----
panel_32 = Panel(repeat_21)

# ---- group: repeat data step2
data_11 = Data(list_length_options_tree_6)
flatten_11 = FlattenTree(Tree=data_11, Path="{0}")
clean_26 = CleanTree(RemoveNulls=True, RemoveInvalid=True, RemoveEmpty=False, Tree=flatten_11)
null_29 = NullItem(Item=clean_26)  # -> NullFlags, InvalidFlags, Description
repeat_23 = RepeatData(Data=graft_23, Length=data_11)
repeat_24 = RepeatData(Data=graft_24, Length=data_11)
filter_38 = StreamFilter(Gate=null_29.NullFlags, Stream0=repeat_23, Stream1=graft_23)
filter_39 = StreamFilter(Gate=null_29.NullFlags, Stream0=repeat_24, Stream1=graft_24)
graft_29 = GraftTree(Tree=filter_38, IncludeEmptyLists=True, IncludeNullItems=True)  # -> simplify(Tree)
graft_30 = GraftTree(Tree=filter_39, IncludeEmptyLists=True, IncludeNullItems=True)  # -> simplify(Tree)

# ---- group: repeat data step1
data_12 = Data(list_length_options_tree_8)
flatten_12 = FlattenTree(Tree=data_12, Path="{0}")
clean_27 = CleanTree(RemoveNulls=True, RemoveInvalid=True, RemoveEmpty=False, Tree=flatten_12)
null_30 = NullItem(Item=clean_27)  # -> NullFlags, InvalidFlags, Description
repeat_25 = RepeatData(Data=results_1_indexes_furniture_var_13, Length=data_12)
repeat_26 = RepeatData(Data=results_transformation_data_10, Length=data_12)
filter_40 = StreamFilter(Gate=null_30.NullFlags, Stream0=repeat_25, Stream1=results_1_indexes_furniture_var_13)
filter_41 = StreamFilter(Gate=null_30.NullFlags, Stream0=repeat_26, Stream1=results_transformation_data_10)
graft_31 = GraftTree(Tree=filter_40, IncludeEmptyLists=True, IncludeNullItems=True)  # -> simplify(Tree)
graft_32 = GraftTree(Tree=filter_41, IncludeEmptyLists=True, IncludeNullItems=True)  # -> simplify(Tree)

# ---- group: repeat data step2
data_13 = Data(list_length_options_tree_8)
flatten_13 = FlattenTree(Tree=data_13, Path="{0}")
clean_28 = CleanTree(RemoveNulls=True, RemoveInvalid=True, RemoveEmpty=False, Tree=flatten_13)
null_31 = NullItem(Item=clean_28)  # -> NullFlags, InvalidFlags, Description
repeat_27 = RepeatData(Data=graft_27, Length=data_13)
repeat_28 = RepeatData(Data=graft_28, Length=data_13)
filter_42 = StreamFilter(Gate=null_31.NullFlags, Stream0=repeat_27, Stream1=graft_27)
filter_43 = StreamFilter(Gate=null_31.NullFlags, Stream0=repeat_28, Stream1=graft_28)
graft_33 = GraftTree(Tree=filter_42, IncludeEmptyLists=True, IncludeNullItems=True)  # -> simplify(Tree)
graft_34 = GraftTree(Tree=filter_43, IncludeEmptyLists=True, IncludeNullItems=True)  # -> simplify(Tree)

# ----
python_4 = GhPythonScript()  # -> Out, A
repeat_29 = RepeatData(Data=graft_23, Length=data_11)  # -> simplify(graft(Data))
repeat_30 = RepeatData(Data=graft_24, Length=data_11)  # -> simplify(graft(Data))
null_32 = NullItem(Item=data_11)  # -> NullFlags, InvalidFlags, Description
python_5 = GhPythonScript()  # -> Out, A
filter_44 = StreamFilter(Gate=null_32.NullFlags, Stream0=repeat_29, Stream1=graft_23)
filter_45 = StreamFilter(Gate=null_32.NullFlags, Stream0=repeat_30, Stream1=graft_24)
repeat_31 = RepeatData(Data=graft_27, Length=data_13)  # -> simplify(graft(Data))
repeat_32 = RepeatData(Data=graft_28, Length=data_13)  # -> simplify(graft(Data))
importance_7 = Data(_1_furniture_piece_9.importance_furniture_2)
importance_8 = Data(_1_furniture_piece_10.importance_furniture_2)
result_1_details_7 = Geometry(result_details_7)
results_1_indexes_furniture_var_16 = Data(results_1_indexes_furniture_var_12)
result_1_details_8 = Geometry(result_details_9)
results_1_transformation_data_4 = Data(results_transformation_data_9)
nr_of_rooms_of_this_type_6 = Number(lng_5)
importance_9 = Data(_1_furniture_piece_7.importance_furniture_2)
result_1_details_9 = Geometry(result_details_8)
panel_33 = Panel(filter_44)
addition_4 = Addition(A=nr_of_rooms_of_this_type_6, B=Slider(0, range=0..1))
null_33 = NullItem(Item=data_13)  # -> NullFlags, InvalidFlags, Description
trim_27 = TrimTree(Tree=results_1_indexes_furniture_var_16, Depth=addition_4)
trim_28 = TrimTree(Tree=results_1_transformation_data_4, Depth=addition_4)
trim_29 = TrimTree(Tree=graft_25, Depth=addition_4)
trim_30 = TrimTree(Tree=graft_26, Depth=addition_4)
clean_29 = CleanTree(RemoveNulls=True, RemoveInvalid=True, RemoveEmpty=False, Tree=flatten(trim_29))
clean_30 = CleanTree(RemoveNulls=True, RemoveInvalid=True, RemoveEmpty=False, Tree=flatten(trim_30))
filter_46 = StreamFilter(Gate=null_33.NullFlags, Stream0=repeat_31, Stream1=graft_27)
clean_31 = CleanTree(RemoveNulls=True, RemoveInvalid=True, RemoveEmpty=False, Tree=flatten(trim_28))
filter_47 = StreamFilter(Gate=null_33.NullFlags, Stream0=repeat_32, Stream1=graft_28)
trim_31 = TrimTree(Tree=graft_29, Depth=addition_4)
trim_32 = TrimTree(Tree=graft_30, Depth=addition_4)
clean_32 = CleanTree(RemoveNulls=True, RemoveInvalid=True, RemoveEmpty=False, Tree=flatten(trim_32))
clean_33 = CleanTree(RemoveNulls=True, RemoveInvalid=True, RemoveEmpty=False, Tree=flatten(trim_31))
clean_34 = CleanTree(RemoveNulls=True, RemoveInvalid=True, RemoveEmpty=False, Tree=flatten(trim_27))
null_34 = NullItem(Item=flatten(clean_31))  # -> NullFlags, InvalidFlags, Description
null_35 = NullItem(Item=flatten(clean_34))  # -> NullFlags, InvalidFlags, Description
importance_10 = Data(_1_furniture_piece_11.importance_furniture_2)
importance_11 = Data(_1_furniture_piece_12.importance_furniture_2)
null_36 = NullItem(Item=flatten(clean_30))  # -> NullFlags, InvalidFlags, Description
result_1_details_10 = Geometry(result_details_10)
results_1_indexes_furniture_var_17 = Data(results_1_indexes_furniture_var_15)
result_1_details_11 = Geometry(result_details_12)
results_1_transformation_data_5 = Data(results_transformation_data_12)
null_37 = NullItem(Item=flatten(clean_29))  # -> NullFlags, InvalidFlags, Description
nr_of_rooms_of_this_type_7 = Number(lng_5)
null_38 = NullItem(Item=flatten(clean_33))  # -> NullFlags, InvalidFlags, Description
null_39 = NullItem(Item=flatten(clean_32))  # -> NullFlags, InvalidFlags, Description
importance_12 = Data(_1_furniture_piece_8.importance_furniture_2)
result_1_details_12 = Geometry(result_details_11)
panel_34 = Panel(filter_46)
filter_48 = StreamFilter(Gate=null_34.NullFlags, Stream0=trim_28, Stream1=flatten(results_1_transformation_data_4))
filter_49 = StreamFilter(Gate=null_35.NullFlags, Stream0=trim_27, Stream1=flatten(results_1_indexes_furniture_var_16))
addition_5 = Addition(A=nr_of_rooms_of_this_type_7, B=Slider(0, range=0..1))
filter_50 = StreamFilter(Gate=null_36.NullFlags, Stream0=trim_30, Stream1=flatten(graft_26))
filter_51 = StreamFilter(Gate=null_37.NullFlags, Stream0=trim_29, Stream1=flatten(graft_25))
panel_35 = Panel("""0
1""")
panel_36 = Panel("""2
3""")
filter_52 = StreamFilter(Gate=null_38.NullFlags, Stream0=trim_31, Stream1=flatten(graft_29))
panel_37 = Panel("""2
3""")
filter_53 = StreamFilter(Gate=null_39.NullFlags, Stream0=trim_32, Stream1=flatten(graft_30))
score_13 = Data(result_score_8)
score_14 = Data(result_score_7)
score_15 = Data(result_score_9)
trim_33 = TrimTree(Tree=results_1_indexes_furniture_var_17, Depth=addition_5)
trim_34 = TrimTree(Tree=results_1_transformation_data_5, Depth=addition_5)
wall_index = ClusterInput()
room_11 = Curve(room_10)
room_diff_6 = Curve(room_diff_5)
room_diff_7 = Curve(room_diff_2)
item_35 = ListItem(List=score_14, Index=filter_51, Wrap=True)
item_36 = ListItem(List=score_15, Index=filter_49, Wrap=True)
trim_35 = TrimTree(Tree=graft_31, Depth=addition_5)
trim_36 = TrimTree(Tree=graft_32, Depth=addition_5)
clean_35 = CleanTree(RemoveNulls=True, RemoveInvalid=True, RemoveEmpty=False, Tree=flatten(trim_35))
clean_36 = CleanTree(RemoveNulls=True, RemoveInvalid=True, RemoveEmpty=False, Tree=flatten(trim_36))
clean_37 = CleanTree(RemoveNulls=True, RemoveInvalid=True, RemoveEmpty=False, Tree=flatten(trim_34))
trim_37 = TrimTree(Tree=graft_33, Depth=addition_5)
trim_38 = TrimTree(Tree=graft_34, Depth=addition_5)
clean_38 = CleanTree(RemoveNulls=True, RemoveInvalid=True, RemoveEmpty=False, Tree=flatten(trim_38))
indexes_furniture_var_9 = Data(filter_52)
item_37 = ListItem(List=score_13, Index=indexes_furniture_var_9, Wrap=True)
panel_38 = Panel(item_37)
clean_39 = CleanTree(RemoveNulls=True, RemoveInvalid=True, RemoveEmpty=False, Tree=flatten(trim_37))
clean_40 = CleanTree(RemoveNulls=True, RemoveInvalid=True, RemoveEmpty=False, Tree=flatten(trim_33))
wall_index_2 = Data(wall_index)
entwine_3 = Entwine(Branch00=panel_35, Branch01=panel_37, Branch02=panel_36, FlattenInputs=True)

# ----
# Furniture Data
# KITCHEN
furniture_piece = Data(block_0_3)
xy = XYPlane(Origin=Point(0, 0, 0))
rectangle = Rectangle(Plane=xy, XSize=Domain(-1, 1), YSize=Domain(-2, 2), Radius=0)  # -> Rectangle, Length
guideline = ListItem(List=furniture_piece, Index=Slider(1, range=0..1), Wrap=True)
big_rectangle = ListItem(List=furniture_piece, Index=Slider(4, range=0..10), Wrap=True)
small_rectangle = ListItem(List=furniture_piece, Index=Slider(5, range=0..10), Wrap=True)
details = ListItem(List=furniture_piece, Index=Slider(6, range=0..10), Wrap=True)
importance_13 = ListItem(List=furniture_piece, Index=Slider(2, range=0..10), Wrap=True)
big_bb = Curve(big_rectangle)
small_bb = Curve(small_rectangle)
wall_crv = Curve(guideline)
detsils_7 = Geometry(details)
wall_crv_2 = Curve(wall_crv)
big_bb_2 = Curve(big_bb)
small_bb_2 = Curve(small_bb)
flip = FlipCurve(Curve=big_bb_2, Guide=rectangle.Rectangle)  # -> Curve, Flag
flip_2 = FlipCurve(Curve=small_bb_2, Guide=rectangle.Rectangle)  # -> Curve, Flag
area = Area(Geometry=big_bb_2)  # -> Area, Centroid
explode_6 = Explode(Curve=big_bb, Recursive=True)  # -> Segments, Vertices
explode_7 = Explode(Curve=flip.Curve, Recursive=True)  # -> Segments, Vertices
explode_8 = Explode(Curve=flip_2.Curve, Recursive=True)  # -> Segments, Vertices
graft_35 = GraftTree(Tree=wall_index_2, IncludeEmptyLists=True, IncludeNullItems=True)
lng_12 = ListLength(List=explode_7.Segments)
curvepoint_2 = PointOnCurve(explode_8.Segments, parameter=0.5)
curvepoint_3 = PointOnCurve(explode_7.Segments, parameter=0.5)
item_38 = ListItem(List=explode_6.Segments, Index=entwine_3, Wrap=True)
series = Series(Start=0, Step=1, Count=lng_12)
crv_cp_5 = CurveClosestPoint(Point=curvepoint_3, Curve=item_38)  # -> Point, Parameter, Distance
crv_cp_6 = CurveClosestPoint(Point=curvepoint_2, Curve=item_38)  # -> Point, Parameter, Distance
sort_18 = SortList(Keys=crv_cp_6.Distance, ValuesA=explode_8.Segments, ValuesB=series)  # -> Keys, ValuesA, ValuesB
sort_19 = SortList(Keys=crv_cp_5.Distance, ValuesA=explode_7.Segments, ValuesB=series)  # -> Keys, ValuesA, ValuesB
item_39 = ListItem(List=sort_18.ValuesB, Index=0, Wrap=True)  # -> Item, Item1
item_40 = ListItem(List=sort_19.ValuesB, Index=0, Wrap=True)  # -> Item, Item1
item_41 = ListItem(List=explode_8.Segments, Index=item_39.Item, Wrap=True)  # -> Item1, Item
item_42 = ListItem(List=explode_7.Segments, Index=item_40.Item, Wrap=True)  # -> Item1, Item
crv_cp_7 = CurveClosestPoint(Point=area.Centroid, Curve=item_42.Item)  # -> Point, Parameter, Distance
vec2pt_2 = Vector2Pt(PointA=crv_cp_7.Point, PointB=area.Centroid, Unitize=False)  # -> Vector, Length
flatten_14 = FlattenTree(Tree=item_41.Item, Path="{0}")
flatten_15 = FlattenTree(Tree=item_41.Item1, Path="{0}")
end_2 = EndPoints(Curve=item_42.Item)  # -> Start, End
rev = Reverse(Vector=item_42.Item)
flatten_16 = FlattenTree(Tree=item_42.Item, Path="{0}")
flatten_17 = FlattenTree(Tree=item_42.Item1, Path="{0}")
crv_width_full = Curve(flatten_16)
crv_depth_full = Curve(flatten_17)
crv_width_rdc = Curve(flatten_14)
crv_depth_rdc = Curve(flatten_15)
pl = ConstructPlane(Origin=end_2.Start, XAxis=item_42.Item, YAxis=vec2pt_2.Vector)
pl_2 = ConstructPlane(Origin=end_2.End, XAxis=rev, YAxis=vec2pt_2.Vector)
len = Length(Curve=crv_width_full)
flatten_18 = FlattenTree(Tree=pl_2, Path="{0}")
flatten_19 = FlattenTree(Tree=pl, Path="{0}")
flatten_20 = FlattenTree(Tree=detsils_7, Path="{0}")
flatten_21 = FlattenTree(Tree=importance_13, Path="{0}")
len_2 = Length(Curve=crv_depth_full)
len_3 = Length(Curve=crv_width_rdc)
len_4 = Length(Curve=flatten_15)
detsils_8 = Geometry(flatten_20)
plane_ending_point = Data(flatten_18)
plane_starting_point = Data(flatten_19)
importance_furniture = Data(flatten_21)
flatten_22 = FlattenTree(Tree=flip.Curve, Path="{0}")
flatten_23 = FlattenTree(Tree=flip_2.Curve, Path="{0}")
depth_full = Number(len_2)
width_rdc = Number(len_3)
depth_rdc = Number(len_4)

null_40 = NullItem(Item=flatten(clean_37))  # -> NullFlags, InvalidFlags, Description
null_41 = NullItem(Item=flatten(clean_40))  # -> NullFlags, InvalidFlags, Description
all_scores_7 = Data(item_37)
explode_9 = Explode(Curve=room_diff_7, Recursive=True)  # -> Segments, Vertices
all_scores_8 = Data(item_35)
all_scores_9 = Data(item_36)
null_42 = NullItem(Item=flatten(clean_36))  # -> NullFlags, InvalidFlags, Description
null_43 = NullItem(Item=flatten(clean_35))  # -> NullFlags, InvalidFlags, Description
null_44 = NullItem(Item=flatten(clean_39))  # -> NullFlags, InvalidFlags, Description
null_45 = NullItem(Item=flatten(clean_38))  # -> NullFlags, InvalidFlags, Description
graft_36 = GraftTree(Tree=all_scores_7, IncludeEmptyLists=True, IncludeNullItems=True)  # -> simplify(Tree)
# kitchen works only for ONE
# SINGLE ROOM AT A TIME
item_43 = ListItem(List=explode_9.Segments, Index=Slider(7, range=0..10), Wrap=True)
graft_37 = GraftTree(Tree=all_scores_8, IncludeEmptyLists=True, IncludeNullItems=True)  # -> simplify(Tree)
filter_54 = StreamFilter(Gate=null_40.NullFlags, Stream0=trim_34, Stream1=flatten(results_1_transformation_data_5))
graft_38 = GraftTree(Tree=all_scores_9, IncludeEmptyLists=True, IncludeNullItems=True)  # -> simplify(Tree)
filter_55 = StreamFilter(Gate=null_41.NullFlags, Stream0=trim_33, Stream1=flatten(results_1_indexes_furniture_var_17))
shift = ShiftList(List=explode_9.Vertices, Shift=1, Wrap=False)

lng_13 = ListLength(List=furniture_piece)  # -> flatten(Length)
walls_must = BooleanToggle(True)
lng_14 = ListLength(List=lng_13)
panel_39 = Panel(lng_14)

filter_56 = StreamFilter(Gate=null_42.NullFlags, Stream0=trim_36, Stream1=flatten(graft_32))
filter_57 = StreamFilter(Gate=null_43.NullFlags, Stream0=trim_35, Stream1=flatten(graft_31))
lng_15 = ListLength(List=explode_9.Segments)
filter_58 = StreamFilter(Gate=null_44.NullFlags, Stream0=trim_37, Stream1=flatten(graft_33))
filter_59 = StreamFilter(Gate=null_45.NullFlags, Stream0=trim_38, Stream1=flatten(graft_34))
score_16 = Data(result_score_11)
score_17 = Data(result_score_10)
score_18 = Data(result_score_12)
pt_4 = Point(shift)
series_2 = Series(Start=0, Step=1, Count=lng_15)
item_44 = ListItem(List=score_17, Index=filter_57, Wrap=True)
item_45 = ListItem(List=score_18, Index=filter_55, Wrap=True)
indexes_furniture_var_10 = Data(filter_58)
item_46 = ListItem(List=score_16, Index=indexes_furniture_var_10, Wrap=True)
panel_40 = Panel(item_46)
panel_41 = Panel(indexes_furniture_var_9)
all_scores_10 = Data(item_46)
all_scores_11 = Data(item_44)
all_scores_12 = Data(item_45)
# SCORE
merge_17 = Merge(Data1=graft_36, Data2=graft_37, Data3=graft_38)
graft_39 = GraftTree(Tree=all_scores_10, IncludeEmptyLists=True, IncludeNullItems=True)  # -> simplify(Tree)
graft_40 = GraftTree(Tree=all_scores_11, IncludeEmptyLists=True, IncludeNullItems=True)  # -> simplify(Tree)
score_19 = ListItem(List=furniture_piece, Index=Slider(3, range=0..10), Wrap=True)
graft_41 = GraftTree(Tree=all_scores_12, IncludeEmptyLists=True, IncludeNullItems=True)  # -> simplify(Tree)
shift_2 = ShiftList(List=explode_9.Segments, Shift=series_2, Wrap=True)
panel_42 = Panel(importance_13)
clean_41 = CleanTree(RemoveNulls=True, RemoveInvalid=True, RemoveEmpty=False, Tree=merge_17)
panel_43 = Panel(score_19)
equals = Equality(FirstNumber=importance_13, SecondNumber=1)  # -> Equality, Inequality
item_47 = ListItem(List=shift_2, Index=0, Wrap=True)  # -> Item, Item1
ma_15 = MassAddition(Input=clean_41)  # -> Result, PartialResults
item_48 = ListItem(List=item_38, Index=0, Wrap=True)  # -> Item, Item1
trim_39 = TrimTree(Tree=ma_15.Result, Depth=1)
panel_44 = Panel(indexes_furniture_var_10)
multiplication = Multiplication(A=equals.Equality, B=score_19)
len_5 = Length(Curve=item_47.Item)  # -> simplify(Length)
len_6 = Length(Curve=item_47.Item1)  # -> simplify(Length)
len_7 = Length(Curve=item_48.Item1)
len_8 = Length(Curve=item_48.Item)
panel_45 = Panel(all_scores_9)
panel_46 = Panel(len_5)
clean_42 = CleanTree(RemoveNulls=True, RemoveInvalid=True, RemoveEmpty=False, Tree=flatten(trim_39))
# SCORE
merge_18 = Merge(Data1=graft_39, Data2=graft_40, Data3=graft_41)
flatten_24 = FlattenTree(Tree=len_7, Path="{0}")
flatten_25 = FlattenTree(Tree=len_8, Path="{0}")
lng_16 = ListLength(List=flatten_25)
flatten_26 = FlattenTree(Tree=multiplication, Path="{0}")
larger_11 = LargerThan(FirstNumber=len_5, SecondNumber=flatten_25)  # -> LargerThan, simplify(OrEqualTo)
null_46 = NullItem(Item=clean_42)  # -> NullFlags, InvalidFlags, Description
clean_43 = CleanTree(RemoveNulls=True, RemoveInvalid=True, RemoveEmpty=False, Tree=merge_18)
larger_12 = LargerThan(FirstNumber=len_6, SecondNumber=flatten_24)  # -> LargerThan, OrEqualTo
panel_47 = Panel(larger_12.OrEqualTo)
filter_60 = StreamFilter(Gate=null_46.NullFlags, Stream0=trim_39, Stream1=flatten(ma_15.Result))
sort_20 = SortList(Keys=filter_60, ValuesA=filter_49)  # -> Keys, reverse(ValuesA)
sort_21 = SortList(Keys=filter_60, ValuesA=filter_48)  # -> Keys, reverse(ValuesA)
sort_22 = SortList(Keys=filter_60, ValuesA=filter_53)  # -> Keys, reverse(ValuesA)
sort_23 = SortList(Keys=filter_60, ValuesA=filter_51)  # -> reverse(Keys), reverse(ValuesA)
sort_24 = SortList(Keys=filter_60, ValuesA=filter_50)  # -> reverse(simplify(Keys)), reverse(ValuesA)
sort_25 = SortList(Keys=filter_60, ValuesA=filter_52)  # -> reverse(Keys), reverse(ValuesA)
panel_48 = Panel(sort_25.Keys)
sort_26 = SortList(Keys=flatten_26)  # -> Keys, ValuesA
panel_49 = Panel(sort_26.Keys)
ma_16 = MassAddition(Input=clean_43)  # -> Result, PartialResults
number_slider_10 = Slider(12, range=0..25)
panel_50 = Panel(flatten_25)
panel_51 = Panel(flatten_24)
number_slider_11 = Slider(4, range=0..19)
and = GateAnd(A=larger_11.OrEqualTo, B=larger_12.OrEqualTo)  # -> simplify(Result)
series_3 = Series(Start=0, Step=1, Count=lng_16)
trim_40 = TrimTree(Tree=ma_16.Result, Depth=1)
number_slider_12 = Slider(0, range=0..25)
item_49 = ListItem(List=sort_26.Keys, Index=0, Wrap=True)
indexes_furniture_var_11 = Data(sort_25.ValuesA)
transformation_data_7 = Data(sort_22.ValuesA)
indexes_furniture_var_12 = Data(sort_23.ValuesA)
transformation_data_8 = Data(sort_24.ValuesA)
panel_52 = Panel(all_scores_12)
clean_44 = CleanTree(RemoveNulls=True, RemoveInvalid=True, RemoveEmpty=False, Tree=flatten(trim_40))
transformation_data_9 = Data(sort_21.ValuesA)
indexes_furniture_var_13 = Data(sort_20.ValuesA)
panel_53 = Panel(and)
panel_54 = Panel(item_49)
panel_55 = Panel(filter_60)
panel_56 = Panel(importance_9)
item_50 = ListItem(List=indexes_furniture_var_11, Index=number_slider_11, Wrap=True)
item_51 = ListItem(List=transformation_data_7, Index=number_slider_11, Wrap=True)
item_52 = ListItem(List=indexes_furniture_var_12, Index=number_slider_11, Wrap=True)
item_53 = ListItem(List=transformation_data_8, Index=number_slider_11, Wrap=True)
score_20 = Data(result_score_8)
detsils_9 = Geometry(result_1_details_9)
item_54 = ListItem(List=indexes_furniture_var_13, Index=number_slider_11, Wrap=True)
item_55 = ListItem(List=transformation_data_9, Index=number_slider_11, Wrap=True)
repeat_33 = RepeatData(Data=item_47.Item1, Length=lng_16)
repeat_34 = RepeatData(Data=item_47.Item, Length=lng_16)
detsils_10 = Geometry(result_1_details_7)
null_47 = NullItem(Item=clean_44)  # -> NullFlags, InvalidFlags, Description
detsils_11 = Geometry(result_1_details_8)
merge_19 = Merge(Data1=Slider(0, range=0..3), Data2=Slider(0, range=0..3), Data3=Slider(0, range=0..3))
merge_20 = Merge(Data1=Slider(1, range=0..3), Data2=Slider(2, range=0..3), Data3=Slider(2, range=0..3))
filter_61 = StreamFilter(Gate=null_47.NullFlags, Stream0=trim_40, Stream1=flatten(ma_16.Result))
sort_27 = SortList(Keys=filter_61, ValuesA=filter_55)  # -> Keys, reverse(ValuesA)
sort_28 = SortList(Keys=filter_61, ValuesA=filter_54)  # -> Keys, reverse(ValuesA)
sort_29 = SortList(Keys=filter_61, ValuesA=filter_59)  # -> Keys, reverse(ValuesA)
sort_30 = SortList(Keys=filter_61, ValuesA=filter_57)  # -> reverse(Keys), reverse(ValuesA)
sort_31 = SortList(Keys=filter_61, ValuesA=filter_56)  # -> reverse(simplify(Keys)), reverse(ValuesA)
sort_32 = SortList(Keys=filter_61, ValuesA=filter_58)  # -> reverse(Keys), reverse(ValuesA)
panel_57 = Panel(sort_32.Keys)
dispatch_7 = Dispatch(List=series_3, DispatchPattern=and)  # -> ListA, ListB
score_21 = ListItem(List=score_20, Index=item_50, Wrap=True)
dispatch_8 = Dispatch(List=repeat_34, DispatchPattern=and)  # -> ListA, ListB
number_slider_13 = Slider(12, range=0..25)
ma_17 = MassAddition()  # -> Result, PartialResults
dispatch_9 = Dispatch(List=repeat_33, DispatchPattern=and)  # -> ListA, ListB
item_56 = ListItem(List=importance_9, Index=item_50, Wrap=True)
item_57 = ListItem(List=detsils_9, Index=item_50, Wrap=True)
item_58 = ListItem(List=detsils_10, Index=item_52, Wrap=True)
number_slider_14 = Slider(4, range=0..19)
graft_42 = GraftTree(Tree=merge_19, IncludeEmptyLists=True, IncludeNullItems=True)
item_59 = ListItem(List=detsils_11, Index=item_54, Wrap=True)
graft_43 = GraftTree(Tree=merge_20, IncludeEmptyLists=True, IncludeNullItems=True)
item_60 = ListItem(List=sort_23.Keys, Index=number_slider_11, Wrap=True)
number_slider_15 = Slider(0, range=0..25)
panel_58 = Panel(score_21)
transformation_data_10 = Data(sort_29.ValuesA)
indexes_furniture_var_14 = Data(sort_32.ValuesA)
transform_8 = Transform(Geometry=item_57, Transform=item_51)
transformation_data_11 = Data(sort_31.ValuesA)
indexes_furniture_var_15 = Data(sort_30.ValuesA)
transform_9 = Transform(Geometry=item_58, Transform=item_53)
panel_59 = Panel(item_60)
indexes_furniture_var_16 = Data(sort_27.ValuesA)
transformation_data_12 = Data(sort_28.ValuesA)
transform_10 = Transform(Geometry=item_59, Transform=item_55)
panel_60 = Panel(dispatch_7.ListA)
panel_61 = Panel(filter_61)
panel_62 = Panel(importance_12)

# ---- group: guiding edge length
flatten_27 = FlattenTree(Tree=item_38, Path="{0}")
len_9 = Length(Curve=flatten_27)
width = Number(len_9)

# ----
item_61 = ListItem(List=flatten_27, Index=Slider(5, range=0..5), Wrap=True)
item_62 = ListItem(List=indexes_furniture_var_14, Index=number_slider_14, Wrap=True)
item_63 = ListItem(List=transformation_data_10, Index=number_slider_14, Wrap=True)
item_64 = ListItem(List=indexes_furniture_var_15, Index=number_slider_14, Wrap=True)
item_65 = ListItem(List=transformation_data_11, Index=number_slider_14, Wrap=True)
score_22 = Data(result_score_11)
detsils_12 = Geometry(result_1_details_12)
item_66 = ListItem(List=indexes_furniture_var_16, Index=number_slider_14, Wrap=True)
item_67 = ListItem(List=transformation_data_12, Index=number_slider_14, Wrap=True)
crv = Curve(dispatch_9.ListA)
crv_2 = Curve(dispatch_8.ListA)
detsils_13 = Geometry(result_1_details_10)
panel_63 = Panel(sort_19.ValuesB)
panel_64 = Panel(item_50)
detsils_14 = Geometry(result_1_details_11)
item_68 = ListItem(Index=0, Wrap=True)
score_23 = ListItem(List=score_22, Index=item_62, Wrap=True)
item_69 = ListItem(List=importance_12, Index=item_62, Wrap=True)
item_70 = ListItem(List=detsils_12, Index=item_62, Wrap=True)
item_71 = ListItem(List=detsils_13, Index=item_64, Wrap=True)
flatten_28 = FlattenTree(Tree=crv, Path="{0}")
flatten_29 = FlattenTree(Tree=dispatch_7.ListA, Path="{0}")
flatten_30 = FlattenTree(Tree=crv_2, Path="{0}")
item_72 = ListItem(List=detsils_14, Index=item_66, Wrap=True)
item_73 = ListItem(List=sort_30.Keys, Index=number_slider_14, Wrap=True)
panel_65 = Panel(score_23)
transform_11 = Transform(Geometry=item_70, Transform=item_63)
transform_12 = Transform(Geometry=item_71, Transform=item_65)
panel_66 = Panel(item_73)
transform_13 = Transform(Geometry=item_72, Transform=item_67)
item_74 = ListItem(List=item_38, Index=0, Wrap=True)  # -> Item, Item1

score_wish_7 = Number(score_wish_6)
score_min_8 = Number(score_min_7)
is_score_3 = Number(filter_61)
larger_13 = LargerThan(FirstNumber=is_score_3, SecondNumber=score_min_8)  # -> LargerThan, OrEqualTo
larger_14 = LargerThan(FirstNumber=is_score_3, SecondNumber=score_wish_7)  # -> LargerThan, OrEqualTo
ma_18 = MassAddition(Input=larger_14.OrEqualTo)  # -> Result, PartialResults
ma_19 = MassAddition(Input=larger_13.LargerThan)  # -> Result, PartialResults
larger_15 = LargerThan(FirstNumber=ma_18.Result, SecondNumber=0)  # -> LargerThan, OrEqualTo
larger_16 = LargerThan(FirstNumber=ma_18.Result, SecondNumber=Slider(1, range=0..1))  # -> LargerThan, OrEqualTo
larger_17 = LargerThan(FirstNumber=ma_19.Result, SecondNumber=0)  # -> LargerThan, OrEqualTo
cull_13 = CullPattern(List=Slider(10, range=0..10), CullPattern=larger_16.LargerThan)
cull_14 = CullPattern(List=Slider(10, range=0..10), CullPattern=larger_15.LargerThan)
cull_15 = CullPattern(List=Slider(80, range=0..100), CullPattern=larger_17.LargerThan)
merge_21 = Merge(Data1=cull_13, Data2=cull_14, Data3=cull_15)
ma_20 = MassAddition(Input=merge_21)  # -> Result, PartialResults
score_24 = Panel(ma_20.Result)

score_wish_8 = Number(score_wish_5)
is_score_4 = Number(filter_60)
score_min_9 = Number(score_min_6)
larger_18 = LargerThan(FirstNumber=is_score_4, SecondNumber=score_min_9)  # -> LargerThan, OrEqualTo
larger_19 = LargerThan(FirstNumber=is_score_4, SecondNumber=score_wish_8)  # -> LargerThan, OrEqualTo
ma_21 = MassAddition(Input=larger_19.OrEqualTo)  # -> Result, PartialResults
ma_22 = MassAddition(Input=larger_18.LargerThan)  # -> Result, PartialResults
larger_20 = LargerThan(FirstNumber=ma_21.Result, SecondNumber=0)  # -> LargerThan, OrEqualTo
larger_21 = LargerThan(FirstNumber=ma_21.Result, SecondNumber=Slider(1, range=0..1))  # -> LargerThan, OrEqualTo
larger_22 = LargerThan(FirstNumber=ma_22.Result, SecondNumber=0)  # -> LargerThan, OrEqualTo
cull_16 = CullPattern(List=Slider(10, range=0..10), CullPattern=larger_21.LargerThan)
cull_17 = CullPattern(List=Slider(10, range=0..10), CullPattern=larger_20.LargerThan)
cull_18 = CullPattern(List=Slider(80, range=0..100), CullPattern=larger_22.LargerThan)
merge_22 = Merge(Data1=cull_16, Data2=cull_17, Data3=cull_18)
ma_23 = MassAddition(Input=merge_22)  # -> Result, PartialResults
score_25 = Panel(ma_23.Result)

ccx = CurveCurve(CurveA=item_74.Item, CurveB=item_74.Item1)  # -> Points, ParamsA, ParamsB
panel_67 = Panel(item_62)
rev_2 = Reverse(Vector=item_74.Item)
panel_68 = Panel(transform_11)
pl_3 = ConstructPlane(Origin=ccx.Points, XAxis=rev_2, YAxis=item_74.Item1)
flatten_31 = FlattenTree(Tree=pl_3, Path="{0}")
item_75 = ListItem(List=flatten_31, Index=flatten_29, Wrap=True)
flatten_32 = FlattenTree(Tree=score_19, Path="{0}")
score_furniture = Data(flatten_32)
sort_33 = SortList(Keys=score_furniture, ValuesA=score_furniture)  # -> reverse(Keys), ValuesA
item_76 = ListItem(List=sort_33.Keys, Index=0, Wrap=True)
importance_furniture_2 = ClusterOutput(importance_furniture)
panel_69 = Panel(item_76)
larger_23 = LargerThan(FirstNumber=importance_furniture, SecondNumber=Slider(1, range=0..1))  # -> LargerThan, OrEqualTo
merge_23 = Merge(Data1=transform_8, Data2=transform_9, Data3=transform_10)
dispatch_10 = Dispatch(List=item_76, DispatchPattern=larger_23.LargerThan)  # -> ListA, ListB
score_min_10 = Data(dispatch_10.ListB)
score_max = Data(item_76)
score_max_2 = ClusterOutput(score_max)
score_min_11 = ClusterOutput(score_min_10)
merge_24 = Merge(Data1=transform_11, Data2=transform_12, Data3=transform_13)
previewlw_3 = CustomPreviewLineweights(
    Geometry=merge_23,
    Shader=ColourSwatch(SwatchColor=RGB(255, 255, 255)),
    Thickness=Slider(5.4, range=0..10),
    Absolute=False)
previewlw_4 = CustomPreviewLineweights(
    Geometry=merge_24,
    Shader=ColourSwatch(SwatchColor=RGB(255, 255, 255)),
    Thickness=Slider(5.4, range=0..10),
    Absolute=False)
bedroom_4 = Data(ma_9.Result)
children_4 = Data(ma_23.Result)
kitchen_4 = Data(ma_20.Result)
bath = Data(ma_12.Result)
flatten_33 = FlattenTree(Tree=bedroom_4, Path="{0}")
flatten_34 = FlattenTree(Tree=children_4, Path="{0}")
flatten_35 = FlattenTree(Tree=kitchen_4, Path="{0}")
flatten_36 = FlattenTree(Tree=bath, Path="{0}")

wrap_5 = WrapList(Data=furniture_cluster.living_2)
trim_41 = TrimTree(Tree=wrap_5, Depth=1)
lng_17 = ListLength(List=trim_41)
lng_18 = ListLength(List=flatten(lng_17))
nr_of_blocks_to_place_5 = Panel(lng_18)

null_48 = NullItem(Item=flatten(trim_41))  # -> NullFlags, InvalidFlags, Description
filter_62 = StreamFilter(Gate=null_48.NullFlags, Stream0=trim_41, Stream1=wrap_5)

bang_5 = ExplodeTree(Data=filter_62)  # -> Branch0, Branch1, Branch2
block_0_5 = UnwrapList(WrappedData=bang_5.Branch0)
block_1_5 = UnwrapList(WrappedData=bang_5.Branch1)
block_2_5 = UnwrapList(WrappedData=bang_5.Branch2)

_1_furniture_piece_13 = _1FurniturePiece(room_full=room_6, room_rdc=room_diff_3, walls=room_6, wall_index=pre_setting_select_edge_5, furniture_piece=block_0_5)  # -> result_room_full_2, result_room_rdc_2, result_initial_2, results_1_indexes_furniture_var_3, results_transformation_data_2, result_details_2, result_score_3, importance_furniture_2, score_max_2, score_min_2
initial_13 = Curve(_1_furniture_piece_13.result_initial_2)
room_full_13 = Curve(_1_furniture_piece_13.result_room_full_2)
room_rdc_13 = Curve(_1_furniture_piece_13.result_room_rdc_2)
_1_furniture_piece_14 = _1FurniturePiece(
    room_full=room_full_13,
    room_rdc=room_rdc_13,
    walls=initial_13,
    wall_index=pre_setting_select_edge_4,
    furniture_piece=block_1_5)  # -> result_room_full_2, result_room_rdc_2, result_initial_2, results_1_indexes_furniture_var_3, results_transformation_data_2, result_details_2, result_score_3, importance_furniture_2, score_max_2, score_min_2
room_full_14 = Curve(_1_furniture_piece_14.result_room_full_2)
room_rdc_14 = Curve(_1_furniture_piece_14.result_room_rdc_2)
initial_14 = Curve(_1_furniture_piece_14.result_initial_2)
_1_furniture_piece_15 = _1FurniturePiece(
    room_full=room_full_14,
    room_rdc=room_rdc_14,
    walls=initial_14,
    wall_index=pre_setting_select_edge_6,
    furniture_piece=block_2_5)  # -> result_room_full_2, result_room_rdc_2, result_initial_2, results_1_indexes_furniture_var_3, results_transformation_data_2, result_details_2, result_score_3, importance_furniture_2, score_max_2, score_min_2
result_score_13 = Data(_1_furniture_piece_14.result_score_3)
result_score_14 = Data(_1_furniture_piece_13.result_score_3)
result_details_13 = Geometry(_1_furniture_piece_14.result_details_2)
result_details_14 = Geometry(_1_furniture_piece_13.result_details_2)
room_full_15 = Curve(_1_furniture_piece_15.result_room_full_2)
room_rdc_15 = Curve(_1_furniture_piece_15.result_room_rdc_2)
initial_15 = Curve(_1_furniture_piece_15.result_initial_2)
result_score_15 = Data(_1_furniture_piece_15.result_score_3)
result_details_15 = Geometry(_1_furniture_piece_15.result_details_2)
results_transformation_data_13 = Data(_1_furniture_piece_14.results_transformation_data_2)
results_transformation_data_14 = Data(_1_furniture_piece_13.results_transformation_data_2)
results_1_indexes_furniture_var_18 = Data(_1_furniture_piece_14.results_1_indexes_furniture_var_3)
results_1_indexes_furniture_var_19 = Data(_1_furniture_piece_13.results_1_indexes_furniture_var_3)
results_transformation_data_15 = Data(_1_furniture_piece_15.results_transformation_data_2)
results_1_indexes_furniture_var_20 = Data(_1_furniture_piece_15.results_1_indexes_furniture_var_3)

num_7 = Number([_1_furniture_piece_13.score_max_2, _1_furniture_piece_14.score_max_2])
num_8 = Number([_1_furniture_piece_13.score_min_2, _1_furniture_piece_14.score_min_2])
ma_24 = MassAddition(Input=num_7)  # -> Result, PartialResults
ma_25 = MassAddition(Input=num_8)  # -> Result, PartialResults
score_wish_9 = Number(ma_24.Result)
score_min_12 = Number(ma_25.Result)

trim_42 = TrimTree(Tree=results_1_indexes_furniture_var_18, Depth=1)
list_length_options_tree_9 = ListLength(List=trim_42)
trim_43 = TrimTree(Tree=results_1_indexes_furniture_var_20, Depth=1)
list_length_options_tree_10 = ListLength(List=trim_43)

# ---- group: repeat data step1
data_14 = Data(list_length_options_tree_9)
flatten_37 = FlattenTree(Tree=data_14, Path="{0}")
clean_45 = CleanTree(RemoveNulls=True, RemoveInvalid=True, RemoveEmpty=False, Tree=flatten_37)
null_49 = NullItem(Item=clean_45)  # -> NullFlags, InvalidFlags, Description
repeat_35 = RepeatData(Data=results_1_indexes_furniture_var_19, Length=data_14)
repeat_36 = RepeatData(Data=results_transformation_data_14, Length=data_14)
filter_63 = StreamFilter(Gate=null_49.NullFlags, Stream0=repeat_35, Stream1=results_1_indexes_furniture_var_19)
filter_64 = StreamFilter(Gate=null_49.NullFlags, Stream0=repeat_36, Stream1=results_transformation_data_14)
graft_44 = GraftTree(Tree=filter_63, IncludeEmptyLists=True, IncludeNullItems=True)  # -> simplify(Tree)
graft_45 = GraftTree(Tree=filter_64, IncludeEmptyLists=True, IncludeNullItems=True)  # -> simplify(Tree)

# ----
panel_70 = Panel(repeat_35)

# ---- group: repeat data step1
data_15 = Data(list_length_options_tree_10)
flatten_38 = FlattenTree(Tree=data_15, Path="{0}")
clean_46 = CleanTree(RemoveNulls=True, RemoveInvalid=True, RemoveEmpty=False, Tree=flatten_38)
null_50 = NullItem(Item=clean_46)  # -> NullFlags, InvalidFlags, Description
repeat_37 = RepeatData(Data=results_1_indexes_furniture_var_18, Length=data_15)
repeat_38 = RepeatData(Data=results_transformation_data_13, Length=data_15)
filter_65 = StreamFilter(Gate=null_50.NullFlags, Stream0=repeat_37, Stream1=results_1_indexes_furniture_var_18)
filter_66 = StreamFilter(Gate=null_50.NullFlags, Stream0=repeat_38, Stream1=results_transformation_data_13)
graft_46 = GraftTree(Tree=filter_65, IncludeEmptyLists=True, IncludeNullItems=True)  # -> simplify(Tree)
graft_47 = GraftTree(Tree=filter_66, IncludeEmptyLists=True, IncludeNullItems=True)  # -> simplify(Tree)

# ---- group: repeat data step2
data_16 = Data(list_length_options_tree_10)
flatten_39 = FlattenTree(Tree=data_16, Path="{0}")
clean_47 = CleanTree(RemoveNulls=True, RemoveInvalid=True, RemoveEmpty=False, Tree=flatten_39)
null_51 = NullItem(Item=clean_47)  # -> NullFlags, InvalidFlags, Description
repeat_39 = RepeatData(Data=graft_44, Length=data_16)
repeat_40 = RepeatData(Data=graft_45, Length=data_16)
filter_67 = StreamFilter(Gate=null_51.NullFlags, Stream0=repeat_39, Stream1=graft_44)
filter_68 = StreamFilter(Gate=null_51.NullFlags, Stream0=repeat_40, Stream1=graft_45)
graft_48 = GraftTree(Tree=filter_67, IncludeEmptyLists=True, IncludeNullItems=True)  # -> simplify(Tree)
graft_49 = GraftTree(Tree=filter_68, IncludeEmptyLists=True, IncludeNullItems=True)  # -> simplify(Tree)

# ----
repeat_41 = RepeatData(Data=graft_44, Length=data_16)  # -> simplify(graft(Data))
repeat_42 = RepeatData(Data=graft_45, Length=data_16)  # -> simplify(graft(Data))
null_52 = NullItem(Item=data_16)  # -> NullFlags, InvalidFlags, Description
filter_69 = StreamFilter(Gate=null_52.NullFlags, Stream0=repeat_41, Stream1=graft_44)
filter_70 = StreamFilter(Gate=null_52.NullFlags, Stream0=repeat_42, Stream1=graft_45)
importance_14 = Data(_1_furniture_piece_14.importance_furniture_2)
importance_15 = Data(_1_furniture_piece_15.importance_furniture_2)
result_1_details_13 = Geometry(result_details_13)
results_1_indexes_furniture_var_21 = Data(results_1_indexes_furniture_var_20)
result_1_details_14 = Geometry(result_details_15)
results_1_transformation_data_6 = Data(results_transformation_data_15)
importance_16 = Data(_1_furniture_piece_13.importance_furniture_2)
result_1_details_15 = Geometry(result_details_14)
panel_71 = Panel(filter_69)
trim_44 = TrimTree(Tree=results_1_indexes_furniture_var_21, Depth=addition)
trim_45 = TrimTree(Tree=results_1_transformation_data_6, Depth=addition)
trim_46 = TrimTree(Tree=graft_46, Depth=addition)
trim_47 = TrimTree(Tree=graft_47, Depth=addition)
clean_48 = CleanTree(RemoveNulls=True, RemoveInvalid=True, RemoveEmpty=False, Tree=flatten(trim_46))
clean_49 = CleanTree(RemoveNulls=True, RemoveInvalid=True, RemoveEmpty=False, Tree=flatten(trim_47))
clean_50 = CleanTree(RemoveNulls=True, RemoveInvalid=True, RemoveEmpty=False, Tree=flatten(trim_45))
trim_48 = TrimTree(Tree=graft_48, Depth=addition)
trim_49 = TrimTree(Tree=graft_49, Depth=addition)
clean_51 = CleanTree(RemoveNulls=True, RemoveInvalid=True, RemoveEmpty=False, Tree=flatten(trim_49))
clean_52 = CleanTree(RemoveNulls=True, RemoveInvalid=True, RemoveEmpty=False, Tree=flatten(trim_48))
clean_53 = CleanTree(RemoveNulls=True, RemoveInvalid=True, RemoveEmpty=False, Tree=flatten(trim_44))
null_53 = NullItem(Item=flatten(clean_50))  # -> NullFlags, InvalidFlags, Description
null_54 = NullItem(Item=flatten(clean_53))  # -> NullFlags, InvalidFlags, Description
null_55 = NullItem(Item=flatten(clean_49))  # -> NullFlags, InvalidFlags, Description
null_56 = NullItem(Item=flatten(clean_48))  # -> NullFlags, InvalidFlags, Description
null_57 = NullItem(Item=flatten(clean_52))  # -> NullFlags, InvalidFlags, Description
null_58 = NullItem(Item=flatten(clean_51))  # -> NullFlags, InvalidFlags, Description
filter_71 = StreamFilter(Gate=null_53.NullFlags, Stream0=trim_45, Stream1=flatten(results_1_transformation_data_6))
filter_72 = StreamFilter(Gate=null_54.NullFlags, Stream0=trim_44, Stream1=flatten(results_1_indexes_furniture_var_21))
filter_73 = StreamFilter(Gate=null_55.NullFlags, Stream0=trim_47, Stream1=flatten(graft_47))
filter_74 = StreamFilter(Gate=null_56.NullFlags, Stream0=trim_46, Stream1=flatten(graft_46))
filter_75 = StreamFilter(Gate=null_57.NullFlags, Stream0=trim_48, Stream1=flatten(graft_48))
filter_76 = StreamFilter(Gate=null_58.NullFlags, Stream0=trim_49, Stream1=flatten(graft_49))
score_26 = Data(result_score_14)
score_27 = Data(result_score_13)
score_28 = Data(result_score_15)
item_77 = ListItem(List=score_27, Index=filter_74, Wrap=True)
item_78 = ListItem(List=score_28, Index=filter_72, Wrap=True)
indexes_furniture_var_17 = Data(filter_75)
item_79 = ListItem(List=score_26, Index=indexes_furniture_var_17, Wrap=True)
panel_72 = Panel(item_79)
all_scores_13 = Data(item_79)
all_scores_14 = Data(item_77)
all_scores_15 = Data(item_78)
graft_50 = GraftTree(Tree=all_scores_13, IncludeEmptyLists=True, IncludeNullItems=True)  # -> simplify(Tree)
graft_51 = GraftTree(Tree=all_scores_14, IncludeEmptyLists=True, IncludeNullItems=True)  # -> simplify(Tree)
graft_52 = GraftTree(Tree=all_scores_15, IncludeEmptyLists=True, IncludeNullItems=True)  # -> simplify(Tree)
panel_73 = Panel(indexes_furniture_var_17)
merge_25 = Merge(Data1=graft_50, Data2=graft_51, Data3=graft_52)
clean_54 = CleanTree(RemoveNulls=True, RemoveInvalid=True, RemoveEmpty=False, Tree=merge_25)
ma_26 = MassAddition(Input=clean_54)  # -> Result, PartialResults
panel_74 = Panel(all_scores_15)
trim_50 = TrimTree(Tree=ma_26.Result, Depth=1)
clean_55 = CleanTree(RemoveNulls=True, RemoveInvalid=True, RemoveEmpty=False, Tree=flatten(trim_50))
null_59 = NullItem(Item=clean_55)  # -> NullFlags, InvalidFlags, Description
filter_77 = StreamFilter(Gate=null_59.NullFlags, Stream0=trim_50, Stream1=flatten(ma_26.Result))
sort_34 = SortList(Keys=filter_77, ValuesA=filter_72)  # -> Keys, reverse(ValuesA)
sort_35 = SortList(Keys=filter_77, ValuesA=filter_71)  # -> Keys, reverse(ValuesA)
sort_36 = SortList(Keys=filter_77, ValuesA=filter_76)  # -> Keys, reverse(ValuesA)
sort_37 = SortList(Keys=filter_77, ValuesA=filter_74)  # -> reverse(Keys), reverse(ValuesA)
sort_38 = SortList(Keys=filter_77, ValuesA=filter_73)  # -> reverse(simplify(Keys)), reverse(ValuesA)
sort_39 = SortList(Keys=filter_77, ValuesA=filter_75)  # -> reverse(Keys), reverse(ValuesA)
panel_75 = Panel(sort_39.Keys)
detsils_15 = Geometry(result_1_details_13)
indexes_furniture_var_18 = Data(sort_37.ValuesA)
transformation_data_13 = Data(sort_38.ValuesA)
indexes_furniture_var_19 = Data(sort_39.ValuesA)
transformation_data_14 = Data(sort_36.ValuesA)
indexes_furniture_var_20 = Data(sort_34.ValuesA)
transformation_data_15 = Data(sort_35.ValuesA)
panel_76 = Panel(filter_77)
panel_77 = Panel(importance_16)
item_80 = ListItem(List=indexes_furniture_var_19, Index=number_slider_2, Wrap=True)
item_81 = ListItem(List=transformation_data_14, Index=number_slider_2, Wrap=True)
item_82 = ListItem(List=indexes_furniture_var_18, Index=number_slider_2, Wrap=True)
item_83 = ListItem(List=transformation_data_13, Index=number_slider_2, Wrap=True)
score_29 = Data(result_score_14)
detsils_16 = Geometry(result_1_details_15)
item_84 = ListItem(List=indexes_furniture_var_20, Index=number_slider_2, Wrap=True)
item_85 = ListItem(List=transformation_data_15, Index=number_slider_2, Wrap=True)
detsils_17 = Geometry(result_1_details_14)
score_30 = ListItem(List=score_29, Index=item_80, Wrap=True)
item_86 = ListItem(List=detsils_15, Index=item_82, Wrap=True)
item_87 = ListItem(List=importance_16, Index=item_80, Wrap=True)
item_88 = ListItem(List=detsils_16, Index=item_80, Wrap=True)
item_89 = ListItem(List=detsils_17, Index=item_84, Wrap=True)
item_90 = ListItem(List=sort_37.Keys, Index=number_slider_2, Wrap=True)
panel_78 = Panel(score_30)

score_wish_10 = Number(score_wish_9)
score_min_13 = Number(score_min_12)
is_score_5 = Number(filter_77)
larger_24 = LargerThan(FirstNumber=is_score_5, SecondNumber=score_min_13)  # -> LargerThan, OrEqualTo
larger_25 = LargerThan(FirstNumber=is_score_5, SecondNumber=score_wish_10)  # -> LargerThan, OrEqualTo
ma_27 = MassAddition(Input=larger_25.OrEqualTo)  # -> Result, PartialResults
ma_28 = MassAddition(Input=larger_24.LargerThan)  # -> Result, PartialResults
larger_26 = LargerThan(FirstNumber=ma_27.Result, SecondNumber=0)  # -> LargerThan, OrEqualTo
larger_27 = LargerThan(FirstNumber=ma_27.Result, SecondNumber=Slider(1, range=0..1))  # -> LargerThan, OrEqualTo
larger_28 = LargerThan(FirstNumber=ma_28.Result, SecondNumber=0)  # -> LargerThan, OrEqualTo
cull_19 = CullPattern(List=Slider(10, range=0..10), CullPattern=larger_27.LargerThan)
cull_20 = CullPattern(List=Slider(10, range=0..10), CullPattern=larger_26.LargerThan)
cull_21 = CullPattern(List=Slider(80, range=0..100), CullPattern=larger_28.LargerThan)
merge_26 = Merge(Data1=cull_19, Data2=cull_20, Data3=cull_21)
ma_29 = MassAddition(Input=merge_26)  # -> Result, PartialResults
score_31 = Panel(ma_29.Result)

transform_14 = Transform(Geometry=item_88, Transform=item_81)
transform_15 = Transform(Geometry=item_86, Transform=item_83)
panel_79 = Panel(item_90)
transform_16 = Transform(Geometry=item_89, Transform=item_85)
panel_80 = Panel(item_80)
panel_81 = Panel(transform_14)
merge_27 = Merge(Data1=transform_14, Data2=transform_15, Data3=transform_16)
previewlw_5 = CustomPreviewLineweights(
    Geometry=merge_27,
    Shader=ColourSwatch(SwatchColor=RGB(255, 255, 255)),
    Thickness=Slider(5.4, range=0..10),
    Absolute=False)
living_2 = Data(ma_29.Result)
flatten_40 = FlattenTree(Tree=living_2, Path="{0}")
merge_28 = Merge(Data1=flatten_33, Data2=flatten_34, Data3=flatten_40, Data4=flatten_35, Data5=flatten_36)
panel_82 = Panel(merge_28)
scores = ClusterOutput(merge_28)

# ==== cluster FurnitureCluster
apartment_type = ClusterInput()
apartment_type_2 = Data(apartment_type)
equals = Equality(FirstNumber=apartment_type_2, SecondNumber="1")  # -> Equality, Inequality
equals_2 = Equality(FirstNumber=apartment_type_2, SecondNumber="3")  # -> Equality, Inequality
equals_3 = Equality(FirstNumber=apartment_type_2, SecondNumber="2")  # -> Equality, Inequality
larger = LargerThan(FirstNumber=apartment_type_2, SecondNumber="4")  # -> LargerThan, OrEqualTo
placementint = Panel("""0
2
3""")
program = Panel("Kitchen")
placementint_2 = Panel("3")
importance = Panel("1")
score = Panel("20")
placementint_3 = Panel("2")
program_2 = Panel("Dining")
placementint_4 = Panel("""1
2
3""")
importance_2 = Panel("1")
score_2 = Panel("20")
program_3 = Panel("Bed_StorageThree")
importance_3 = Panel("2")
score_3 = Panel("3")
program_4 = Panel("Bed_StorageTwo")
placementint_5 = Panel("2")
placementint_6 = Panel("2")
importance_4 = Panel("2")
program_5 = Panel("Kitchen")
placementint_7 = Panel("3")
importance_5 = Panel("1")
importance_6 = Panel("2")
score_4 = Panel("2")
program_6 = Panel("Bed_StorageOne")
score_5 = Panel("1")
score_6 = Panel("20")
program_7 = Panel("Kitchen")
placementint_8 = Panel("""0
1""")
importance_7 = Panel("1")
score_7 = Panel("20")
program_8 = Panel("Kitchen")
placementint_9 = Panel("""2
3""")
importance_8 = Panel("1")
score_8 = Panel("20")
program_9 = Panel("Bed")
placementint_10 = Panel("""2
3""")
importance_9 = Panel("1")
score_9 = Panel("20")
placementint_11 = Panel("2")
program_10 = Panel("Bed_StorageThree")
importance_10 = Panel("2")
score_10 = Panel("3")
program_11 = Panel("Bed_StorageTwo")
placementint_12 = Panel("2")
placementint_13 = Panel("2")
importance_11 = Panel("2")
importance_12 = Panel("2")
score_11 = Panel("2")
program_12 = Panel("Bed_StorageOne")
score_12 = Panel("1")
program_13 = Panel("Bath")
placementint_14 = Panel("2")
importance_13 = Panel("1")
program_14 = Panel("Bed")
placementint_15 = Panel("""1
2
3""")
importance_14 = Panel("1")
program_15 = Panel("Bed")
placementint_16 = Panel("""2
3""")
importance_15 = Panel("1")
score_13 = Panel("20")
program_16 = Panel("Bath")
placementint_17 = Panel("2")
importance_16 = Panel("1")
score_14 = Panel("20")
score_15 = Panel("20")
score_16 = Panel("20")
program_17 = Panel("Bath")
placementint_18 = Panel("2")
importance_17 = Panel("1")
program_18 = Panel("Kitchen")
placementint_19 = Panel("3")
importance_18 = Panel("1")
score_17 = Panel("20")
program_19 = Panel("Bed")
placementint_20 = Panel("""2
3""")
importance_19 = Panel("1")
score_18 = Panel("20")
placementint_21 = Panel("2")
program_20 = Panel("Living")
placementint_22 = Panel("""1
2
3""")
importance_20 = Panel("1")
score_19 = Panel("20")
score_20 = Panel("20")
program_21 = Panel("Kitchen")
placementint_23 = Panel("""0
1""")
importance_21 = Panel("1")
score_21 = Panel("20")
program_22 = Panel("Kitchen")
placementint_24 = Panel("""1
2""")
importance_22 = Panel("1")
program_23 = Panel("Bed_StorageThree")
importance_23 = Panel("2")
score_22 = Panel("3")
score_23 = Panel("20")
program_24 = Panel("Bed_StorageTwo")
placementint_25 = Panel("2")
placementint_26 = Panel("2")
importance_24 = Panel("2")
program_25 = Panel("Bed_StorageTwo")
placementint_27 = Panel("2")
placementint_28 = Panel("2")
importance_25 = Panel("2")
importance_26 = Panel("2")
score_24 = Panel("2")
program_26 = Panel("Bed_StorageOne")
score_25 = Panel("1")
importance_27 = Panel("2")
score_26 = Panel("2")
program_27 = Panel("Bed_StorageOne")
score_27 = Panel("1")
program_28 = Panel("Bath")
placementint_29 = Panel("2")
importance_28 = Panel("1")
program_29 = Panel("Bed")
placementint_30 = Panel("""1
2
3""")
importance_29 = Panel("1")
score_28 = Panel("20")
program_30 = Panel("Bath")
placementint_31 = Panel("2")
importance_30 = Panel("1")
score_29 = Panel("20")
score_30 = Panel("20")
program_31 = Panel("Bed")
placementint_32 = Panel("""2
3""")
importance_31 = Panel("1")
score_31 = Panel("20")
program_32 = Panel("Bath")
placementint_33 = Panel("2")
importance_32 = Panel("1")
program_33 = Panel("Bed")
placementint_34 = Panel("""2
3""")
importance_33 = Panel("1")
score_32 = Panel("20")
score_33 = Panel("20")
program_34 = Panel("Living")
placementint_35 = Panel("""0
1
2
3""")
importance_34 = Panel("1")
score_34 = Panel("20")
program_35 = Panel("Bed_StorageTwo")
placementint_36 = Panel("2")
placementint_37 = Panel("2")
importance_35 = Panel("2")
program_36 = Panel("Dining")
placementint_38 = Panel("""1
2
3""")
importance_36 = Panel("1")
importance_37 = Panel("2")
score_35 = Panel("2")
program_37 = Panel("Bed_StorageOne")
score_36 = Panel("1")
score_37 = Panel("20")
program_38 = Panel("Bath")
placementint_39 = Panel("2")
importance_38 = Panel("1")
program_39 = Panel("Bed")
placementint_40 = Panel("""1
2
3""")
importance_39 = Panel("1")
program_40 = Panel("Bed")
placementint_41 = Panel("""2
3""")
importance_40 = Panel("1")
score_38 = Panel("20")
program_41 = Panel("Bath")
placementint_42 = Panel("2")
importance_41 = Panel("1")
score_39 = Panel("20")
score_40 = Panel("20")
score_41 = Panel("20")
program_42 = Panel("Bath")
placementint_43 = Panel("2")
importance_42 = Panel("1")
program_43 = Panel("Living")
program_44 = Panel("Living")
placementint_44 = Panel("""0
1
2
3""")
importance_43 = Panel("1")
score_42 = Panel("20")
program_45 = Panel("Living")
placementint_45 = Panel("""0
1
2
3""")
importance_44 = Panel("1")
score_43 = Panel("20")
placementint_46 = Panel("""0
1
2
3""")
importance_45 = Panel("1")
score_44 = Panel("20")
score_45 = Panel("20")
program_46 = Panel("Bath")
placementint_47 = Panel("2")
importance_46 = Panel("1")
program_47 = Panel("Bed")
placementint_48 = Panel("""1
2
3""")
importance_47 = Panel("1")
program_48 = Panel("Bed")
placementint_49 = Panel("""1
2
3""")
importance_48 = Panel("1")
score_46 = Panel("20")
program_49 = Panel("Bed")
placementint_50 = Panel("""0
1
2
3""")
importance_49 = Panel("1")
program_50 = Panel("Bed")
placementint_51 = Panel("""2
3""")
importance_50 = Panel("1")
score_47 = Panel("20")
score_48 = Panel("20")
program_51 = Panel("Bath")
placementint_52 = Panel("2")
importance_51 = Panel("1")
score_49 = Panel("20")
score_50 = Panel("20")
score_51 = Panel("20")
program_52 = Panel("Dining")
placementint_53 = Panel("""0
1
2
3""")
importance_52 = Panel("1")
score_52 = Panel("20")
program_53 = Panel("Bath")
placementint_54 = Panel("2")
importance_53 = Panel("1")
program_54 = Panel("Bed")
score_53 = Panel("20")
placementint_55 = Panel("""2
3""")
importance_54 = Panel("1")
score_54 = Panel("20")
program_55 = Panel("Living")
placementint_56 = Panel("""0
1
2
3""")
importance_55 = Panel("1")
score_55 = Panel("20")
program_56 = Panel("Living")
placementint_57 = Panel("""0
1
2
3""")
importance_56 = Panel("1")
score_56 = Panel("20")
program_57 = Panel("Bed")
placementint_58 = Panel("""0
3""")
importance_57 = Panel("1")
program_58 = Panel("Bed")
placementint_59 = Panel("""0
3""")
importance_58 = Panel("1")
score_57 = Panel("20")
score_58 = Panel("20")
program_59 = Panel("Dining")
placementint_60 = Panel("""1
2
3""")
importance_59 = Panel("1")
score_59 = Panel("20")
program_60 = Panel("Kitchen")
placementint_61 = Panel("1")
importance_60 = Panel("1")
score_60 = Panel("20")
program_61 = Panel("Kitchen")
placementint_62 = Panel("""2
3""")
importance_61 = Panel("1")
score_61 = Panel("20")
program_62 = Panel("Kitchen")
placementint_63 = Panel("""1
2""")
importance_62 = Panel("1")
score_62 = Panel("20")

# ---- group: Prepare and Sort
txt_name = Text(program)
geo = Geometry(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)
geo_2 = Geometry(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)
geo_3 = Geometry([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])
int_placement = Integer(placementint_2)

# ----
int_importance = Integer(importance)
num_score = Number(score)

# ---- group: Prepare and Sort
txt_name_2 = Text(program_2)
geo_4 = Geometry(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)
geo_5 = Geometry(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)
geo_6 = Geometry([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])
int_placement_2 = Integer(placementint_4)

txt_name_3 = Text(program_5)
geo_7 = Geometry(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)
geo_8 = Geometry([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])
int_placement_3 = Integer(placementint_7)
geo_9 = Geometry(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)

txt_name_4 = Text(program_7)
geo_10 = Geometry(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)
geo_11 = Geometry(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)
geo_12 = Geometry([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])
int_placement_4 = Integer(placementint_8)

txt_name_5 = Text(program_8)
geo_13 = Geometry(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)
geo_14 = Geometry(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)
geo_15 = Geometry([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])
int_placement_5 = Integer(placementint_9)

txt_name_6 = Text(program_9)
geo_16 = Geometry(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)
geo_17 = Geometry(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)
geo_18 = Geometry([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])
int_placement_6 = Integer(placementint_10)

txt_name_7 = Text(program_13)
geo_19 = Geometry(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)
geo_20 = Geometry([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])
int_placement_7 = Integer(placementint_14)
geo_21 = Geometry(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)

txt_name_8 = Text(program_14)
geo_22 = Geometry(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)
geo_23 = Geometry([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])
int_placement_8 = Integer(placementint_15)
geo_24 = Geometry(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)

txt_name_9 = Text(program_15)
geo_25 = Geometry(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)
geo_26 = Geometry([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])
int_placement_9 = Integer(placementint_16)
geo_27 = Geometry(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)

# ----
int_importance_2 = Integer(importance_2)

# ---- group: Prepare and Sort
txt_name_10 = Text(program_16)
geo_28 = Geometry(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)
geo_29 = Geometry(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)
geo_30 = Geometry([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])
int_placement_10 = Integer(placementint_17)

# ----
int_importance_3 = Integer(importance_5)
num_score_2 = Number(score_2)
int_importance_4 = Integer(importance_7)
int_importance_5 = Integer(importance_8)

# ---- group: Prepare and Sort
txt_name_11 = Text(program_17)
geo_31 = Geometry(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)
geo_32 = Geometry([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])
int_placement_11 = Integer(placementint_18)
geo_33 = Geometry(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)

txt_name_12 = Text(program_18)
geo_34 = Geometry(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)
geo_35 = Geometry([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])
int_placement_12 = Integer(placementint_19)
geo_36 = Geometry(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)

# ----
num_score_3 = Number(score_6)

# ---- group: Prepare and Sort
txt_name_13 = Text(program_20)
geo_37 = Geometry(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)
geo_38 = Geometry(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)
geo_39 = Geometry([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])
int_placement_13 = Integer(placementint_22)

txt_name_14 = Text(program_19)
geo_40 = Geometry(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)
geo_41 = Geometry([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])
int_placement_14 = Integer(placementint_20)
geo_42 = Geometry(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)

txt_name_15 = Text(program_21)
geo_43 = Geometry(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)
geo_44 = Geometry(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)
geo_45 = Geometry([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])
int_placement_15 = Integer(placementint_23)

txt_name_16 = Text(program_22)
geo_46 = Geometry(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)
geo_47 = Geometry([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])
int_placement_16 = Integer(placementint_24)
geo_48 = Geometry(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)

# ----
num_score_4 = Number(score_7)
num_score_5 = Number(score_8)
int_importance_6 = Integer(importance_9)

# ---- group: Prepare and Sort
txt_name_17 = Text(program_28)
geo_49 = Geometry(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)
geo_50 = Geometry([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])
int_placement_17 = Integer(placementint_29)
geo_51 = Geometry(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)

txt_name_18 = Text(program_29)
geo_52 = Geometry(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)
geo_53 = Geometry([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])
int_placement_18 = Integer(placementint_30)
geo_54 = Geometry(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)

txt_name_19 = Text(program_31)
geo_55 = Geometry(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)
geo_56 = Geometry(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)
geo_57 = Geometry([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])
int_placement_19 = Integer(placementint_32)

txt_name_20 = Text(program_30)
geo_58 = Geometry(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)
geo_59 = Geometry(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)
geo_60 = Geometry([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])
int_placement_20 = Integer(placementint_31)

# ----
num_score_6 = Number(score_9)
int_importance_7 = Integer(importance_13)

# ---- group: Prepare and Sort
geo_61 = Geometry([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])
geo_62 = Geometry(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)
txt_name_21 = Text(program_4)
geo_63 = Geometry(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)
int_placement_21 = Integer(placementint_5)

# ----
int_importance_8 = Integer(importance_14)
int_importance_9 = Integer(importance_15)
int_importance_10 = Integer(importance_16)

# ---- group: Prepare and Sort
geo_64 = Geometry(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)
geo_65 = Geometry(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)
geo_66 = Geometry([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])
txt_name_22 = Text(program_6)
int_placement_22 = Integer(placementint_6)

txt_name_23 = Text(program_32)
geo_67 = Geometry(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)
geo_68 = Geometry([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])
int_placement_23 = Integer(placementint_33)
geo_69 = Geometry(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)

txt_name_24 = Text(program_33)
geo_70 = Geometry(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)
geo_71 = Geometry([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])
geo_72 = Geometry(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)
int_placement_24 = Integer(placementint_34)

txt_name_25 = Text(program_34)
geo_73 = Geometry(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)
geo_74 = Geometry(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)
geo_75 = Geometry([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])
int_placement_25 = Integer(placementint_35)

geo_76 = Geometry(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)
geo_77 = Geometry(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)
geo_78 = Geometry([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])
txt_name_26 = Text(program_39)
int_placement_26 = Integer(placementint_40)

geo_79 = Geometry(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)
geo_80 = Geometry(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)
geo_81 = Geometry([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])
txt_name_27 = Text(program_10)
int_placement_27 = Integer(placementint_11)

geo_82 = Geometry(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)
geo_83 = Geometry(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)
geo_84 = Geometry([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])
txt_name_28 = Text(program_11)
int_placement_28 = Integer(placementint_12)

geo_85 = Geometry(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)
geo_86 = Geometry(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)
geo_87 = Geometry([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])
txt_name_29 = Text(program_12)
int_placement_29 = Integer(placementint_13)

geo_88 = Geometry(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)
geo_89 = Geometry(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)
geo_90 = Geometry([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])
txt_name_30 = Text(program_45)
int_placement_30 = Integer(placementint_45)

geo_91 = Geometry(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)
geo_92 = Geometry(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)
geo_93 = Geometry([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])
txt_name_31 = Text(program_43)
int_placement_31 = Integer(placementint_46)

geo_94 = Geometry(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)
geo_95 = Geometry(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)
geo_96 = Geometry([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])
txt_name_32 = Text(program_44)
int_placement_32 = Integer(placementint_44)

# ----
num_score_7 = Number(score_13)

# ---- group: Prepare and Sort
txt_name_33 = Text(program_3)
int_placement_33 = Integer(placementint_3)
geo_97 = Geometry([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])
geo_98 = Geometry(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)
geo_99 = Geometry(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)

# ----
num_score_8 = Number(score_15)
num_score_9 = Number(score_16)
num_score_10 = Number(score_14)
int_importance_11 = Integer(importance_17)

# ---- group: Prepare and Sort
txt_name_34 = Text(program_36)
geo_100 = Geometry(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)
geo_101 = Geometry([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])
geo_102 = Geometry(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)
int_placement_34 = Integer(placementint_38)

# ----
int_importance_12 = Integer(importance_18)
int_importance_13 = Integer(importance_19)

# ---- group: Prepare and Sort
txt_name_35 = Text(program_38)
geo_103 = Geometry(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)
geo_104 = Geometry([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])
int_placement_35 = Integer(placementint_39)
geo_105 = Geometry(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)

# ----
int_importance_14 = Integer(importance_20)
int_importance_15 = Integer(importance_21)
int_importance_16 = Integer(importance_22)

# ---- group: Prepare and Sort
txt_name_36 = Text(program_40)
geo_106 = Geometry(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)
geo_107 = Geometry([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])
int_placement_36 = Integer(placementint_41)
geo_108 = Geometry(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)

txt_name_37 = Text(program_41)
geo_109 = Geometry(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)
geo_110 = Geometry(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)
geo_111 = Geometry([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])
int_placement_37 = Integer(placementint_42)

# ----
num_score_11 = Number(score_17)
num_score_12 = Number(score_18)
num_score_13 = Number(score_20)
num_score_14 = Number(score_5)
num_score_15 = Number(score_19)
num_score_16 = Number(score_21)
int_importance_17 = Integer(importance_28)
num_score_17 = Number(score_40)
num_score_18 = Number(score_10)
num_score_19 = Number(score_12)
num_score_20 = Number(score_45)
int_importance_18 = Integer(importance_29)
importance_63 = Integer(importance_4)
int_importance_19 = Integer(importance_30)
num_score_21 = Number(score_11)

# ---- group: Prepare and Sort
geo_112 = Geometry(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)
geo_113 = Geometry(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)
geo_114 = Geometry([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])
txt_name_38 = Text(program_48)
int_placement_38 = Integer(placementint_49)

# ----
num_score_22 = Number(score_43)
num_score_23 = Number(score_44)

# ---- group: Prepare and Sort
txt_name_39 = Text(program_42)
geo_115 = Geometry(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)
geo_116 = Geometry([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])
int_placement_39 = Integer(placementint_43)
geo_117 = Geometry(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)

# ----
int_importance_20 = Integer(importance_31)
num_score_24 = Number(score_3)
num_score_25 = Number(score_4)
importance_64 = Integer(importance_10)
importance_65 = Integer(importance_11)

# ---- group: Prepare and Sort
geo_118 = Geometry(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)
geo_119 = Geometry(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)
geo_120 = Geometry([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])
txt_name_40 = Text(program_47)
int_placement_40 = Integer(placementint_48)

geo_121 = Geometry(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)
geo_122 = Geometry(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)
geo_123 = Geometry([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])
txt_name_41 = Text(program_24)
int_placement_41 = Integer(placementint_25)

geo_124 = Geometry(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)
geo_125 = Geometry(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)
geo_126 = Geometry([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])
txt_name_42 = Text(program_26)
int_placement_42 = Integer(placementint_26)

geo_127 = Geometry(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)
geo_128 = Geometry(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)
geo_129 = Geometry([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])
txt_name_43 = Text(program_49)
int_placement_43 = Integer(placementint_50)

geo_130 = Geometry(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)
geo_131 = Geometry(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)
geo_132 = Geometry([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])
txt_name_44 = Text(program_23)
int_placement_44 = Integer(placementint_21)

geo_133 = Geometry(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)
geo_134 = Geometry(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)
geo_135 = Geometry([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])
txt_name_45 = Text(program_25)
int_placement_45 = Integer(placementint_27)

geo_136 = Geometry(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)
geo_137 = Geometry(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)
geo_138 = Geometry([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])
txt_name_46 = Text(program_27)
int_placement_46 = Integer(placementint_28)

geo_139 = Geometry(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)
geo_140 = Geometry(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)
geo_141 = Geometry([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])
txt_name_47 = Text(program_55)
int_placement_47 = Integer(placementint_56)

# ----
num_score_26 = Number(score_23)
num_score_27 = Number(score_28)

# ---- group: Prepare and Sort
geo_142 = Geometry(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)
geo_143 = Geometry([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])
geo_144 = Geometry(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)
txt_name_48 = Text(program_56)
int_placement_48 = Integer(placementint_57)

# ----
num_score_28 = Number(score_30)
num_score_29 = Number(score_29)
num_score_30 = Number(score_31)
int_importance_21 = Integer(importance_32)
int_importance_22 = Integer(importance_33)

# ---- group: Prepare and Sort
txt_name_49 = Text(program_46)
geo_145 = Geometry(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)
geo_146 = Geometry([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])
int_placement_49 = Integer(placementint_47)
geo_147 = Geometry(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)

# ----
int_importance_23 = Integer(importance_34)

# ---- group: Prepare and Sort
txt_name_50 = Text(program_50)
geo_148 = Geometry(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)
geo_149 = Geometry(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)
geo_150 = Geometry([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])
int_placement_50 = Integer(placementint_51)

txt_name_51 = Text(program_51)
geo_151 = Geometry(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)
geo_152 = Geometry(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)
geo_153 = Geometry([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])
int_placement_51 = Integer(placementint_52)

# ----
importance_66 = Integer(importance_3)
num_score_31 = Number(score_32)
num_score_32 = Number(score_33)
int_importance_24 = Integer(importance_43)
int_importance_25 = Integer(importance_39)
int_importance_26 = Integer(importance_12)
int_importance_27 = Integer(importance_44)
int_importance_28 = Integer(importance_45)
num_score_33 = Number(score_34)
int_importance_29 = Integer(importance_36)
num_score_34 = Number(score_50)
num_score_35 = Number(score_46)
num_score_36 = Number(score_25)
int_importance_30 = Integer(importance_38)
num_score_37 = Number(score_51)
num_score_38 = Number(score_22)
num_score_39 = Number(score_27)

# ---- group: Prepare and Sort
txt_name_52 = Text(program_52)
geo_154 = Geometry(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)
geo_155 = Geometry([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])
int_placement_52 = Integer(placementint_53)
geo_156 = Geometry(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)

# ----
int_importance_31 = Integer(importance_40)
num_score_40 = Number(score_24)
int_importance_32 = Integer(importance_41)
num_score_41 = Number(score_26)

# ---- group: Prepare and Sort
geo_157 = Geometry(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)
geo_158 = Geometry(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)
geo_159 = Geometry([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])
txt_name_53 = Text(program_58)
int_placement_53 = Integer(placementint_59)

# ----
num_score_42 = Number(score_55)

# ---- group: Prepare and Sort
txt_name_54 = Text(program_53)
geo_160 = Geometry(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)
geo_161 = Geometry([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])
int_placement_54 = Integer(placementint_54)
geo_162 = Geometry(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)

# ----
num_score_43 = Number(score_37)
importance_67 = Integer(importance_24)

# ---- group: Prepare and Sort
txt_name_55 = Text(program_54)
geo_163 = Geometry(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)
geo_164 = Geometry(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)
geo_165 = Geometry([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])
int_placement_55 = Integer(placementint_55)

# ----
importance_68 = Integer(importance_23)
importance_69 = Integer(importance_25)

# ---- group: Prepare and Sort
geo_166 = Geometry(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)
geo_167 = Geometry(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)
geo_168 = Geometry([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])
txt_name_56 = Text(program_57)
int_placement_56 = Integer(placementint_58)

geo_169 = Geometry(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)
geo_170 = Geometry(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)
geo_171 = Geometry([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])
txt_name_57 = Text(program_35)
int_placement_57 = Integer(placementint_36)

geo_172 = Geometry(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)
geo_173 = Geometry(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)
geo_174 = Geometry([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])
txt_name_58 = Text(program_37)
int_placement_58 = Integer(placementint_37)

# ----
num_score_44 = Number(score_56)
num_score_45 = Number(score_38)
int_importance_33 = Integer(importance_6)
num_score_46 = Number(score_41)
num_score_47 = Number(score_39)
int_importance_34 = Integer(importance_42)
num_score_48 = Number(score_42)
int_importance_35 = Integer(importance_47)
int_importance_36 = Integer(importance_48)
int_importance_37 = Integer(importance_26)
int_importance_38 = Integer(importance_49)
int_importance_39 = Integer(importance_27)
int_importance_40 = Integer(importance_55)
num_score_49 = Number(score_58)
num_score_50 = Number(score_57)
num_score_51 = Number(score_36)
int_importance_41 = Integer(importance_56)
int_importance_42 = Integer(importance_46)
int_importance_43 = Integer(importance_50)
num_score_52 = Number(score_35)
int_importance_44 = Integer(importance_51)
importance_70 = Integer(importance_35)
num_score_53 = Number(score_48)
num_score_54 = Number(score_47)
int_importance_45 = Integer(importance_52)
num_score_55 = Number(score_49)
int_importance_46 = Integer(importance_53)

# ---- group: Prepare and Sort
txt_name_59 = Text(program_59)
geo_175 = Geometry(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)
geo_176 = Geometry(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)
geo_177 = Geometry([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])
int_placement_59 = Integer(placementint_60)

# ----
int_importance_47 = Integer(importance_54)
num_score_56 = Number(score_52)

# ---- group: Prepare and Sort
txt_name_60 = Text(program_60)
geo_178 = Geometry(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)
geo_179 = Geometry(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)
geo_180 = Geometry([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])
int_placement_60 = Integer(placementint_61)

# ----
num_score_57 = Number(score_53)
int_importance_48 = Integer(importance_57)
int_importance_49 = Integer(importance_58)
int_importance_50 = Integer(importance_37)
num_score_58 = Number(score_54)

# ---- group: Prepare and Sort
txt_name_61 = Text(program_61)
geo_181 = Geometry(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)
geo_182 = Geometry(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)
geo_183 = Geometry([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])
int_placement_61 = Integer(placementint_62)

txt_name_62 = Text(program_62)
geo_184 = Geometry(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)
geo_185 = Geometry([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])
int_placement_62 = Integer(placementint_63)
geo_186 = Geometry(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)

# ----
int_importance_51 = Integer(importance_59)
int_importance_52 = Integer(importance_60)
num_score_59 = Number(score_59)
num_score_60 = Number(score_60)
int_importance_53 = Integer(importance_61)
int_importance_54 = Integer(importance_62)
num_score_61 = Number(score_61)
num_score_62 = Number(score_62)
explode = Explode(Curve=geo, Recursive=True)  # -> Segments, Vertices
explode_2 = Explode(Curve=geo_4, Recursive=True)  # -> Segments, Vertices
explode_3 = Explode(Curve=geo_7, Recursive=True)  # -> Segments, Vertices
explode_4 = Explode(Curve=geo_13, Recursive=True)  # -> Segments, Vertices

# ---- group: Prepare and Sort
explode_5 = Explode(Curve=geo_98, Recursive=True)  # -> Segments, Vertices
item = ListItem(List=explode_5.Segments, Index=int_placement_33, Wrap=True)
previewlw = CustomPreviewLineweights(Geometry=item, Shader=ColourSwatch(SwatchColor=RGB(33, 33, 33)), Thickness=Slider(6, range=0..10), Absolute=False)

explode_6 = Explode(Curve=geo_62, Recursive=True)  # -> Segments, Vertices
item_2 = ListItem(List=explode_6.Segments, Index=int_placement_21, Wrap=True)
previewlw_2 = CustomPreviewLineweights(Geometry=item_2, Shader=ColourSwatch(SwatchColor=RGB(33, 33, 33)), Thickness=Slider(6, range=0..10), Absolute=False)

# ----
explode_7 = Explode(Curve=geo_16, Recursive=True)  # -> Segments, Vertices

# ---- group: Prepare and Sort
explode_8 = Explode(Curve=geo_64, Recursive=True)  # -> Segments, Vertices
item_3 = ListItem(List=explode_8.Segments, Index=int_placement_22, Wrap=True)
previewlw_3 = CustomPreviewLineweights(Geometry=item_3, Shader=ColourSwatch(SwatchColor=RGB(33, 33, 33)), Thickness=Slider(6, range=0..10), Absolute=False)

# ----
explode_9 = Explode(Curve=geo_19, Recursive=True)  # -> Segments, Vertices
explode_10 = Explode(Curve=geo_28, Recursive=True)  # -> Segments, Vertices
explode_11 = Explode(Curve=geo_25, Recursive=True)  # -> Segments, Vertices

# ---- group: Prepare and Sort
explode_12 = Explode(Curve=geo_79, Recursive=True)  # -> Segments, Vertices
item_4 = ListItem(List=explode_12.Segments, Index=int_placement_27, Wrap=True)
previewlw_4 = CustomPreviewLineweights(Geometry=item_4, Shader=ColourSwatch(SwatchColor=RGB(33, 33, 33)), Thickness=Slider(6, range=0..10), Absolute=False)

# ----
# Studio
explode_13 = Explode(Curve=geo_22, Recursive=True)  # -> Segments, Vertices

# ---- group: Prepare and Sort
explode_14 = Explode(Curve=geo_82, Recursive=True)  # -> Segments, Vertices
item_5 = ListItem(List=explode_14.Segments, Index=int_placement_28, Wrap=True)
previewlw_5 = CustomPreviewLineweights(Geometry=item_5, Shader=ColourSwatch(SwatchColor=RGB(33, 33, 33)), Thickness=Slider(6, range=0..10), Absolute=False)

# ----
number_slider = Slider(6, range=0..10)
explode_15 = Explode(Curve=geo_31, Recursive=True)  # -> Segments, Vertices
explode_16 = Explode(Curve=geo_34, Recursive=True)  # -> Segments, Vertices
explode_17 = Explode(Curve=geo_40, Recursive=True)  # -> Segments, Vertices
explode_18 = Explode(Curve=geo_43, Recursive=True)  # -> Segments, Vertices
explode_19 = Explode(Curve=geo_46, Recursive=True)  # -> Segments, Vertices

# ---- group: Prepare and Sort
explode_20 = Explode(Curve=geo_85, Recursive=True)  # -> Segments, Vertices
item_6 = ListItem(List=explode_20.Segments, Index=int_placement_29, Wrap=True)
previewlw_6 = CustomPreviewLineweights(Geometry=item_6, Shader=ColourSwatch(SwatchColor=RGB(33, 33, 33)), Thickness=Slider(6, range=0..10), Absolute=False)

# ----
explode_21 = Explode(Curve=geo_37, Recursive=True)  # -> Segments, Vertices
explode_22 = Explode(Curve=geo_49, Recursive=True)  # -> Segments, Vertices
explode_23 = Explode(Curve=geo_58, Recursive=True)  # -> Segments, Vertices

# ---- group: Prepare and Sort
explode_24 = Explode(Curve=geo_130, Recursive=True)  # -> Segments, Vertices
item_7 = ListItem(List=explode_24.Segments, Index=int_placement_44, Wrap=True)
previewlw_7 = CustomPreviewLineweights(Geometry=item_7, Shader=ColourSwatch(SwatchColor=RGB(33, 33, 33)), Thickness=Slider(6, range=0..10), Absolute=False)

# ----
# 1 Bed
explode_25 = Explode(Curve=geo_52, Recursive=True)  # -> Segments, Vertices
explode_26 = Explode(Curve=geo_55, Recursive=True)  # -> Segments, Vertices
explode_27 = Explode(Curve=geo_70, Recursive=True)  # -> Segments, Vertices

# ---- group: Prepare and Sort
explode_28 = Explode(Curve=geo_121, Recursive=True)  # -> Segments, Vertices
item_8 = ListItem(List=explode_28.Segments, Index=int_placement_41, Wrap=True)
previewlw_8 = CustomPreviewLineweights(Geometry=item_8, Shader=ColourSwatch(SwatchColor=RGB(33, 33, 33)), Thickness=Slider(6, range=0..10), Absolute=False)

explode_29 = Explode(Curve=geo_133, Recursive=True)  # -> Segments, Vertices
item_9 = ListItem(List=explode_29.Segments, Index=int_placement_45, Wrap=True)
previewlw_9 = CustomPreviewLineweights(Geometry=item_9, Shader=ColourSwatch(SwatchColor=RGB(33, 33, 33)), Thickness=Slider(6, range=0..10), Absolute=False)

explode_30 = Explode(Curve=geo_124, Recursive=True)  # -> Segments, Vertices
item_10 = ListItem(List=explode_30.Segments, Index=int_placement_42, Wrap=True)
previewlw_10 = CustomPreviewLineweights(Geometry=item_10, Shader=ColourSwatch(SwatchColor=RGB(33, 33, 33)), Thickness=Slider(6, range=0..10), Absolute=False)

explode_31 = Explode(Curve=geo_136, Recursive=True)  # -> Segments, Vertices
item_11 = ListItem(List=explode_31.Segments, Index=int_placement_46, Wrap=True)
previewlw_11 = CustomPreviewLineweights(Geometry=item_11, Shader=ColourSwatch(SwatchColor=RGB(33, 33, 33)), Thickness=Slider(6, range=0..10), Absolute=False)

# ----
explode_32 = Explode(Curve=geo_73, Recursive=True)  # -> Segments, Vertices
explode_33 = Explode(Curve=geo_100, Recursive=True)  # -> Segments, Vertices
explode_34 = Explode(Curve=geo_106, Recursive=True)  # -> Segments, Vertices
explode_35 = Explode(Curve=geo_103, Recursive=True)  # -> Segments, Vertices
explode_36 = Explode(Curve=geo_109, Recursive=True)  # -> Segments, Vertices
number_slider_2 = Slider(6, range=0..10)
# 2 Bed
explode_37 = Explode(Curve=geo_76, Recursive=True)  # -> Segments, Vertices

# ---- group: Prepare and Sort
explode_38 = Explode(Curve=geo_169, Recursive=True)  # -> Segments, Vertices
item_12 = ListItem(List=explode_38.Segments, Index=int_placement_57, Wrap=True)
previewlw_12 = CustomPreviewLineweights(Geometry=item_12, Shader=ColourSwatch(SwatchColor=RGB(33, 33, 33)), Thickness=Slider(6, range=0..10), Absolute=False)

# ----
explode_39 = Explode(Curve=geo_115, Recursive=True)  # -> Segments, Vertices
explode_40 = Explode(Curve=geo_94, Recursive=True)  # -> Segments, Vertices
explode_41 = Explode(Curve=geo_91, Recursive=True)  # -> Segments, Vertices

# ---- group: Prepare and Sort
explode_42 = Explode(Curve=geo_172, Recursive=True)  # -> Segments, Vertices
item_13 = ListItem(List=explode_42.Segments, Index=int_placement_58, Wrap=True)
previewlw_13 = CustomPreviewLineweights(Geometry=item_13, Shader=ColourSwatch(SwatchColor=RGB(33, 33, 33)), Thickness=Slider(6, range=0..10), Absolute=False)

# ----
explode_43 = Explode(Curve=geo_88, Recursive=True)  # -> Segments, Vertices
explode_44 = Explode(Curve=geo_148, Recursive=True)  # -> Segments, Vertices
explode_45 = Explode(Curve=geo_145, Recursive=True)  # -> Segments, Vertices
explode_46 = Explode(Curve=geo_151, Recursive=True)  # -> Segments, Vertices
explode_47 = Explode(Curve=geo_67, Recursive=True)  # -> Segments, Vertices
explode_48 = Explode(Curve=geo_113, Recursive=True)  # -> Segments, Vertices
explode_49 = Explode(Curve=geo_118, Recursive=True)  # -> Segments, Vertices
# 3+ Bed
explode_50 = Explode(Curve=geo_127, Recursive=True)  # -> Segments, Vertices
explode_51 = Explode(Curve=geo_163, Recursive=True)  # -> Segments, Vertices
explode_52 = Explode(Curve=geo_154, Recursive=True)  # -> Segments, Vertices
explode_53 = Explode(Curve=geo_160, Recursive=True)  # -> Segments, Vertices
explode_54 = Explode(Curve=geo_139, Recursive=True)  # -> Segments, Vertices
explode_55 = Explode(Curve=geo_144, Recursive=True)  # -> Segments, Vertices
explode_56 = Explode(Curve=geo_158, Recursive=True)  # -> Segments, Vertices
explode_57 = Explode(Curve=geo_166, Recursive=True)  # -> Segments, Vertices
item_14 = ListItem(List=explode.Segments, Index=int_placement, Wrap=True)
explode_58 = Explode(Curve=geo_175, Recursive=True)  # -> Segments, Vertices
explode_59 = Explode(Curve=geo_178, Recursive=True)  # -> Segments, Vertices
explode_60 = Explode(Curve=geo_181, Recursive=True)  # -> Segments, Vertices
explode_61 = Explode(Curve=geo_184, Recursive=True)  # -> Segments, Vertices
item_15 = ListItem(List=explode_2.Segments, Index=int_placement_2, Wrap=True)
item_16 = ListItem(List=explode_3.Segments, Index=int_placement_3, Wrap=True)
explode_62 = Explode(Curve=geo_10, Recursive=True)  # -> Segments, Vertices
item_17 = ListItem(List=explode_4.Segments, Index=int_placement_5, Wrap=True)
item_18 = ListItem(List=explode_7.Segments, Index=int_placement_6, Wrap=True)
item_19 = ListItem(List=explode_9.Segments, Index=int_placement_7, Wrap=True)
item_20 = ListItem(List=explode_10.Segments, Index=int_placement_10, Wrap=True)
item_21 = ListItem(List=explode_11.Segments, Index=int_placement_9, Wrap=True)
item_22 = ListItem(List=explode_13.Segments, Index=int_placement_8, Wrap=True)
item_23 = ListItem(List=explode_15.Segments, Index=int_placement_11, Wrap=True)
item_24 = ListItem(List=explode_16.Segments, Index=int_placement_12, Wrap=True)
swatch = ColourSwatch(SwatchColor=RGB(33, 33, 33))
item_25 = ListItem(List=explode_17.Segments, Index=int_placement_14, Wrap=True)
item_26 = ListItem(List=explode_18.Segments, Index=int_placement_15, Wrap=True)
item_27 = ListItem(List=explode_19.Segments, Index=int_placement_16, Wrap=True)
item_28 = ListItem(List=explode_21.Segments, Index=int_placement_13, Wrap=True)
item_29 = ListItem(List=explode_22.Segments, Index=int_placement_17, Wrap=True)
item_30 = ListItem(List=explode_23.Segments, Index=int_placement_20, Wrap=True)
item_31 = ListItem(List=explode_25.Segments, Index=int_placement_18, Wrap=True)
item_32 = ListItem(List=explode_26.Segments, Index=int_placement_19, Wrap=True)
item_33 = ListItem(List=explode_27.Segments, Index=int_placement_24, Wrap=True)
item_34 = ListItem(List=explode_32.Segments, Index=int_placement_25, Wrap=True)
item_35 = ListItem(List=explode_33.Segments, Index=int_placement_34, Wrap=True)
item_36 = ListItem(List=explode_34.Segments, Index=int_placement_36, Wrap=True)
item_37 = ListItem(List=explode_35.Segments, Index=int_placement_35, Wrap=True)
item_38 = ListItem(List=explode_36.Segments, Index=int_placement_37, Wrap=True)
swatch_2 = ColourSwatch(SwatchColor=RGB(33, 33, 33))
item_39 = ListItem(List=explode_37.Segments, Index=int_placement_26, Wrap=True)
item_40 = ListItem(List=explode_39.Segments, Index=int_placement_39, Wrap=True)
item_41 = ListItem(List=explode_40.Segments, Index=int_placement_32, Wrap=True)
item_42 = ListItem(List=explode_41.Segments, Index=int_placement_31, Wrap=True)
item_43 = ListItem(List=explode_43.Segments, Index=int_placement_30, Wrap=True)
item_44 = ListItem(List=explode_44.Segments, Index=int_placement_50, Wrap=True)
item_45 = ListItem(List=explode_45.Segments, Index=int_placement_49, Wrap=True)
item_46 = ListItem(List=explode_46.Segments, Index=int_placement_51, Wrap=True)
item_47 = ListItem(List=explode_47.Segments, Index=int_placement_23, Wrap=True)
item_48 = ListItem(List=explode_48.Segments, Index=int_placement_38, Wrap=True)
item_49 = ListItem(List=explode_49.Segments, Index=int_placement_40, Wrap=True)
item_50 = ListItem(List=explode_50.Segments, Index=int_placement_43, Wrap=True)
item_51 = ListItem(List=explode_51.Segments, Index=int_placement_55, Wrap=True)
item_52 = ListItem(List=explode_52.Segments, Index=int_placement_52, Wrap=True)
item_53 = ListItem(List=explode_53.Segments, Index=int_placement_54, Wrap=True)
item_54 = ListItem(List=explode_54.Segments, Index=int_placement_47, Wrap=True)
item_55 = ListItem(List=explode_55.Segments, Index=int_placement_48, Wrap=True)
item_56 = ListItem(List=explode_56.Segments, Index=int_placement_53, Wrap=True)
item_57 = ListItem(List=explode_57.Segments, Index=int_placement_56, Wrap=True)
item_58 = ListItem(List=explode_58.Segments, Index=int_placement_59, Wrap=True)
item_59 = ListItem(List=explode_59.Segments, Index=int_placement_60, Wrap=True)
item_60 = ListItem(List=explode_60.Segments, Index=int_placement_61, Wrap=True)
item_61 = ListItem(List=explode_61.Segments, Index=int_placement_62, Wrap=True)
previewlw_14 = CustomPreviewLineweights(Geometry=item_14, Shader=ColourSwatch(SwatchColor=RGB(33, 33, 33)), Thickness=Slider(6, range=0..10), Absolute=False)
item_62 = ListItem(List=explode_62.Segments, Index=int_placement_4, Wrap=True)
previewlw_15 = CustomPreviewLineweights(Geometry=item_15, Shader=ColourSwatch(SwatchColor=RGB(33, 33, 33)), Thickness=Slider(6, range=0..10), Absolute=False)
previewlw_16 = CustomPreviewLineweights(Geometry=item_16, Shader=ColourSwatch(SwatchColor=RGB(33, 33, 33)), Thickness=Slider(6, range=0..10), Absolute=False)
previewlw_17 = CustomPreviewLineweights(Geometry=item_17, Shader=ColourSwatch(SwatchColor=RGB(33, 33, 33)), Thickness=Slider(6, range=0..10), Absolute=False)
previewlw_18 = CustomPreviewLineweights(Geometry=item_18, Shader=ColourSwatch(SwatchColor=RGB(33, 33, 33)), Thickness=Slider(6, range=0..10), Absolute=False)
previewlw_19 = CustomPreviewLineweights(Geometry=item_19, Shader=ColourSwatch(SwatchColor=RGB(33, 33, 33)), Thickness=Slider(6, range=0..10), Absolute=False)
previewlw_20 = CustomPreviewLineweights(Geometry=item_20, Shader=ColourSwatch(SwatchColor=RGB(33, 33, 33)), Thickness=Slider(6, range=0..10), Absolute=False)
previewlw_21 = CustomPreviewLineweights(Geometry=item_21, Shader=ColourSwatch(SwatchColor=RGB(33, 33, 33)), Thickness=Slider(6, range=0..10), Absolute=False)
previewlw_22 = CustomPreviewLineweights(Geometry=item_22, Shader=ColourSwatch(SwatchColor=RGB(33, 33, 33)), Thickness=Slider(6, range=0..10), Absolute=False)
previewlw_23 = CustomPreviewLineweights(Geometry=item_23, Shader=ColourSwatch(SwatchColor=RGB(33, 33, 33)), Thickness=Slider(6, range=0..10), Absolute=False)
previewlw_24 = CustomPreviewLineweights(Geometry=item_24, Shader=ColourSwatch(SwatchColor=RGB(33, 33, 33)), Thickness=Slider(6, range=0..10), Absolute=False)
previewlw_25 = CustomPreviewLineweights(Geometry=item_25, Shader=ColourSwatch(SwatchColor=RGB(33, 33, 33)), Thickness=Slider(6, range=0..10), Absolute=False)
previewlw_26 = CustomPreviewLineweights(Geometry=item_26, Shader=ColourSwatch(SwatchColor=RGB(33, 33, 33)), Thickness=Slider(6, range=0..10), Absolute=False)
previewlw_27 = CustomPreviewLineweights(Geometry=item_27, Shader=ColourSwatch(SwatchColor=RGB(33, 33, 33)), Thickness=Slider(6, range=0..10), Absolute=False)
previewlw_28 = CustomPreviewLineweights(Geometry=item_28, Shader=ColourSwatch(SwatchColor=RGB(33, 33, 33)), Thickness=Slider(6, range=0..10), Absolute=False)
previewlw_29 = CustomPreviewLineweights(Geometry=item_29, Shader=ColourSwatch(SwatchColor=RGB(33, 33, 33)), Thickness=Slider(6, range=0..10), Absolute=False)
previewlw_30 = CustomPreviewLineweights(Geometry=item_30, Shader=ColourSwatch(SwatchColor=RGB(33, 33, 33)), Thickness=Slider(6, range=0..10), Absolute=False)
previewlw_31 = CustomPreviewLineweights(Geometry=item_31, Shader=ColourSwatch(SwatchColor=RGB(33, 33, 33)), Thickness=Slider(6, range=0..10), Absolute=False)
previewlw_32 = CustomPreviewLineweights(Geometry=item_32, Shader=ColourSwatch(SwatchColor=RGB(33, 33, 33)), Thickness=Slider(6, range=0..10), Absolute=False)
previewlw_33 = CustomPreviewLineweights(Geometry=item_36, Shader=ColourSwatch(SwatchColor=RGB(33, 33, 33)), Thickness=Slider(6, range=0..10), Absolute=False)
previewlw_34 = CustomPreviewLineweights(Geometry=item_47, Shader=ColourSwatch(SwatchColor=RGB(33, 33, 33)), Thickness=Slider(6, range=0..10), Absolute=False)
previewlw_35 = CustomPreviewLineweights(Geometry=item_34, Shader=ColourSwatch(SwatchColor=RGB(33, 33, 33)), Thickness=Slider(6, range=0..10), Absolute=False)
previewlw_36 = CustomPreviewLineweights(Geometry=item_35, Shader=ColourSwatch(SwatchColor=RGB(33, 33, 33)), Thickness=Slider(6, range=0..10), Absolute=False)
previewlw_37 = CustomPreviewLineweights(Geometry=item_37, Shader=ColourSwatch(SwatchColor=RGB(33, 33, 33)), Thickness=Slider(6, range=0..10), Absolute=False)
previewlw_38 = CustomPreviewLineweights(Geometry=item_38, Shader=ColourSwatch(SwatchColor=RGB(33, 33, 33)), Thickness=Slider(6, range=0..10), Absolute=False)
previewlw_39 = CustomPreviewLineweights(Geometry=item_39, Shader=ColourSwatch(SwatchColor=RGB(33, 33, 33)), Thickness=Slider(6, range=0..10), Absolute=False)
previewlw_40 = CustomPreviewLineweights(Geometry=item_40, Shader=ColourSwatch(SwatchColor=RGB(33, 33, 33)), Thickness=Slider(6, range=0..10), Absolute=False)
previewlw_41 = CustomPreviewLineweights(Geometry=item_41, Shader=ColourSwatch(SwatchColor=RGB(33, 33, 33)), Thickness=Slider(6, range=0..10), Absolute=False)
previewlw_42 = CustomPreviewLineweights(Geometry=item_42, Shader=ColourSwatch(SwatchColor=RGB(33, 33, 33)), Thickness=Slider(6, range=0..10), Absolute=False)
previewlw_43 = CustomPreviewLineweights(Geometry=item_43, Shader=ColourSwatch(SwatchColor=RGB(33, 33, 33)), Thickness=Slider(6, range=0..10), Absolute=False)
previewlw_44 = CustomPreviewLineweights(
    Geometry=[item_51, item_44],
    Shader=ColourSwatch(SwatchColor=RGB(33, 33, 33)),
    Thickness=Slider(6, range=0..10),
    Absolute=False)
previewlw_45 = CustomPreviewLineweights(Geometry=item_45, Shader=ColourSwatch(SwatchColor=RGB(33, 33, 33)), Thickness=Slider(6, range=0..10), Absolute=False)
previewlw_46 = CustomPreviewLineweights(Geometry=item_46, Shader=ColourSwatch(SwatchColor=RGB(33, 33, 33)), Thickness=Slider(6, range=0..10), Absolute=False)
previewlw_47 = CustomPreviewLineweights(Geometry=item_48, Shader=ColourSwatch(SwatchColor=RGB(33, 33, 33)), Thickness=Slider(6, range=0..10), Absolute=False)
previewlw_48 = CustomPreviewLineweights(Geometry=item_49, Shader=ColourSwatch(SwatchColor=RGB(33, 33, 33)), Thickness=Slider(6, range=0..10), Absolute=False)
previewlw_49 = CustomPreviewLineweights(Geometry=item_50, Shader=ColourSwatch(SwatchColor=RGB(33, 33, 33)), Thickness=Slider(6, range=0..10), Absolute=False)
previewlw_50 = CustomPreviewLineweights(Geometry=item_52, Shader=ColourSwatch(SwatchColor=RGB(33, 33, 33)), Thickness=Slider(6, range=0..10), Absolute=False)
previewlw_51 = CustomPreviewLineweights(Geometry=item_53, Shader=ColourSwatch(SwatchColor=RGB(33, 33, 33)), Thickness=Slider(6, range=0..10), Absolute=False)
previewlw_52 = CustomPreviewLineweights(Geometry=item_54, Shader=ColourSwatch(SwatchColor=RGB(33, 33, 33)), Thickness=Slider(6, range=0..10), Absolute=False)
previewlw_53 = CustomPreviewLineweights(Geometry=item_55, Shader=ColourSwatch(SwatchColor=RGB(33, 33, 33)), Thickness=Slider(6, range=0..10), Absolute=False)
previewlw_54 = CustomPreviewLineweights(Geometry=item_56, Shader=ColourSwatch(SwatchColor=RGB(33, 33, 33)), Thickness=Slider(6, range=0..10), Absolute=False)
previewlw_55 = CustomPreviewLineweights(Geometry=item_57, Shader=ColourSwatch(SwatchColor=RGB(33, 33, 33)), Thickness=Slider(6, range=0..10), Absolute=False)
previewlw_56 = CustomPreviewLineweights(Geometry=item_58, Shader=ColourSwatch(SwatchColor=RGB(33, 33, 33)), Thickness=Slider(6, range=0..10), Absolute=False)
previewlw_57 = CustomPreviewLineweights(Geometry=item_59, Shader=ColourSwatch(SwatchColor=RGB(33, 33, 33)), Thickness=Slider(6, range=0..10), Absolute=False)
previewlw_58 = CustomPreviewLineweights(Geometry=item_60, Shader=ColourSwatch(SwatchColor=RGB(33, 33, 33)), Thickness=Slider(6, range=0..10), Absolute=False)
previewlw_59 = CustomPreviewLineweights(Geometry=item_61, Shader=ColourSwatch(SwatchColor=RGB(33, 33, 33)), Thickness=Slider(6, range=0..10), Absolute=False)
previewlw_60 = CustomPreviewLineweights(Geometry=item_62, Shader=ColourSwatch(SwatchColor=RGB(33, 33, 33)), Thickness=Slider(6, range=0..10), Absolute=False)
int_placement_63 = Integer(int_placement)
int_importance_55 = Integer(int_importance)
geo_187 = Geometry(geo_3)
txt_name_63 = Text(txt_name)
num_score_63 = Number(num_score)
geo_188 = Geometry(geo)
geo_189 = Geometry(geo_2)
int_placement_64 = Integer(int_placement_56)
int_importance_56 = Integer(int_importance_48)
geo_190 = Geometry(geo_168)
txt_name_64 = Text(txt_name_56)
num_score_64 = Number(num_score_49)
geo_191 = Geometry(geo_166)
geo_192 = Geometry(geo_167)
explode_63 = Explode(Curve=geo_188, Recursive=True)  # -> Segments, Vertices
int_placement_65 = Integer(int_placement_13)
int_importance_57 = Integer(int_importance_14)
geo_193 = Geometry(geo_39)
txt_name_65 = Text(txt_name_13)
num_score_65 = Number(num_score_15)
geo_194 = Geometry(geo_37)
geo_195 = Geometry(geo_38)
txt_name_66 = Text(txt_name_2)
int_placement_66 = Integer(int_placement_2)
int_importance_58 = Integer(int_importance_2)
geo_196 = Geometry(geo_4)
geo_197 = Geometry(geo_5)
geo_198 = Geometry(geo_6)
num_score_66 = Number(num_score_2)
int_placement_67 = Integer(int_placement_53)
int_importance_59 = Integer(int_importance_49)
geo_199 = Geometry(geo_159)
txt_name_67 = Text(txt_name_53)
num_score_67 = Number(num_score_50)
geo_200 = Geometry(geo_158)
geo_201 = Geometry(geo_157)
int_placement_68 = Integer(int_placement_57)
int_importance_60 = Integer(int_importance_50)
geo_202 = Geometry(geo_171)
txt_name_68 = Text(txt_name_57)
num_score_68 = Number(num_score_52)
geo_203 = Geometry(geo_169)
geo_204 = Geometry(geo_170)
merge = Merge()  # -> flatten(Result)
int_placement_69 = Integer(int_placement_48)
int_importance_61 = Integer(int_importance_41)
geo_205 = Geometry(geo_143)
txt_name_69 = Text(txt_name_47)
int_placement_70 = Integer(int_placement_47)
int_importance_62 = Integer(int_importance_40)
geo_206 = Geometry(geo_139)
geo_207 = Geometry(geo_140)
geo_208 = Geometry(geo_141)
txt_name_70 = Text(txt_name_48)
num_score_69 = Number(num_score_44)
geo_209 = Geometry(geo_144)
geo_210 = Geometry(geo_142)
num_score_70 = Number(num_score_42)
txt_name_71 = Text(txt_name_43)
int_placement_71 = Integer(int_placement_43)
int_importance_63 = Integer(int_importance_38)
geo_211 = Geometry(geo_127)
geo_212 = Geometry(geo_128)
geo_213 = Geometry(geo_129)
num_score_71 = Number(num_score_37)
merge_2 = Merge()  # -> flatten(Result)
int_placement_72 = Integer(int_placement_25)
int_importance_64 = Integer(int_importance_23)
geo_214 = Geometry(geo_75)
txt_name_72 = Text(txt_name_25)
num_score_72 = Number(num_score_33)
geo_215 = Geometry(geo_73)
geo_216 = Geometry(geo_74)
txt_name_73 = Text(txt_name_55)
int_placement_73 = Integer(int_placement_55)
int_importance_65 = Integer(int_importance_47)
num_score_73 = Number(num_score_58)
geo_217 = Geometry(geo_163)
geo_218 = Geometry(geo_164)
geo_219 = Geometry(geo_165)
txt_name_74 = Text(txt_name_50)
int_placement_74 = Integer(int_placement_50)
int_importance_66 = Integer(int_importance_43)
num_score_74 = Number(num_score_8)
geo_220 = Geometry(geo_148)
geo_221 = Geometry(geo_149)
geo_222 = Geometry(geo_150)
int_placement_75 = Integer(int_placement_58)
int_importance_67 = Integer(importance_70)
geo_223 = Geometry(geo_174)
int_placement_76 = Integer(int_placement_34)
int_importance_68 = Integer(int_importance_29)
geo_224 = Geometry(geo_101)
txt_name_75 = Text(txt_name_58)
num_score_75 = Number(num_score_51)
geo_225 = Geometry(geo_172)
geo_226 = Geometry(geo_173)
txt_name_76 = Text(txt_name_34)
num_score_76 = Number(num_score_43)
geo_227 = Geometry(geo_100)
geo_228 = Geometry(geo_102)
merge_3 = Merge()  # -> flatten(Result)
geo_229 = Geometry(geo_161)
geo_230 = Geometry(geo_146)
txt_name_77 = Text(txt_name_54)
int_placement_77 = Integer(int_placement_54)
int_importance_69 = Integer(int_importance_46)
num_score_77 = Number(num_score_57)
geo_231 = Geometry(geo_160)
geo_232 = Geometry(geo_162)
txt_name_78 = Text(txt_name_49)
int_placement_78 = Integer(int_placement_49)
int_importance_70 = Integer(int_importance_42)
num_score_78 = Number(num_score_53)
geo_233 = Geometry(geo_145)
geo_234 = Geometry(geo_147)
explode_64 = Explode(Curve=geo_191, Recursive=True)  # -> Segments, Vertices
geo_235 = Geometry(geo_153)
txt_name_79 = Text(txt_name_51)
int_placement_79 = Integer(int_placement_51)
int_importance_71 = Integer(int_importance_44)
num_score_79 = Number(num_score_55)
geo_236 = Geometry(geo_151)
geo_237 = Geometry(geo_152)
geo_238 = Geometry(geo_183)
geo_239 = Geometry(geo_185)
item_63 = ListItem(List=explode_63.Segments, Index=int_placement_63, Wrap=True)
txt_name_80 = Text(txt_name_61)
int_placement_80 = Integer(int_placement_61)
int_importance_72 = Integer(int_importance_53)
num_score_80 = Number(num_score_61)
geo_240 = Geometry(geo_181)
geo_241 = Geometry(geo_182)
txt_name_81 = Text(txt_name_62)
int_placement_81 = Integer(int_placement_62)
int_importance_73 = Integer(int_importance_54)
num_score_81 = Number(num_score_62)
geo_242 = Geometry(geo_184)
geo_243 = Geometry(geo_186)
int_placement_82 = Integer(int_placement_11)
int_importance_74 = Integer(int_importance_11)
geo_244 = Geometry(geo_32)
int_placement_83 = Integer(int_placement_7)
int_importance_75 = Integer(int_importance_7)
geo_245 = Geometry(geo_20)
txt_name_82 = Text(txt_name_11)
num_score_82 = Number(num_score_11)
geo_246 = Geometry(geo_31)
geo_247 = Geometry(geo_33)
txt_name_83 = Text(txt_name_7)
num_score_83 = Number(num_score_7)
geo_248 = Geometry(geo_19)
geo_249 = Geometry(geo_21)
geo_250 = Geometry(geo_180)
txt_name_84 = Text(txt_name_60)
int_placement_84 = Integer(int_placement_60)
int_importance_76 = Integer(int_importance_52)
num_score_84 = Number(num_score_60)
geo_251 = Geometry(geo_178)
geo_252 = Geometry(geo_179)
explode_65 = Explode(Curve=geo_194, Recursive=True)  # -> Segments, Vertices
int_placement_85 = Integer(int_placement_10)
int_importance_77 = Integer(int_importance_10)
geo_253 = Geometry(geo_30)
txt_name_85 = Text(txt_name_10)
num_score_85 = Number(num_score_10)
geo_254 = Geometry(geo_28)
geo_255 = Geometry(geo_29)
explode_66 = Explode(Curve=geo_196, Recursive=True)  # -> Segments, Vertices
explode_67 = Explode(Curve=geo_200, Recursive=True)  # -> Segments, Vertices
explode_68 = Explode(Curve=geo_203, Recursive=True)  # -> Segments, Vertices
number_slider_3 = Slider(3, range=0..10)
explode_69 = Explode(Curve=geo_206, Recursive=True)  # -> Segments, Vertices
explode_70 = Explode(Curve=geo_209, Recursive=True)  # -> Segments, Vertices
explode_71 = Explode(Curve=geo_211, Recursive=True)  # -> Segments, Vertices
group = Group(Geometry=geo_187)
explode_72 = Explode(Curve=geo_215, Recursive=True)  # -> Segments, Vertices
explode_73 = Explode(Curve=geo_227, Recursive=True)  # -> Segments, Vertices
explode_74 = Explode(Curve=geo_225, Recursive=True)  # -> Segments, Vertices
explode_75 = Explode(Curve=geo_217, Recursive=True)  # -> Segments, Vertices
explode_76 = Explode(Curve=geo_220, Recursive=True)  # -> Segments, Vertices
item_64 = ListItem(List=explode_64.Segments, Index=int_placement_64, Wrap=True)
explode_77 = Explode(Curve=geo_231, Recursive=True)  # -> Segments, Vertices
explode_78 = Explode(Curve=geo_233, Recursive=True)  # -> Segments, Vertices
explode_79 = Explode(Curve=geo_236, Recursive=True)  # -> Segments, Vertices
join = JoinCurves(Curves=item_63, Preserve=False)
int_placement_86 = Integer(int_placement_52)
int_importance_78 = Integer(int_importance_45)
geo_256 = Geometry(geo_156)
geo_257 = Geometry(geo_155)
explode_80 = Explode(Curve=geo_240, Recursive=True)  # -> Segments, Vertices
explode_81 = Explode(Curve=geo_242, Recursive=True)  # -> Segments, Vertices
txt_name_86 = Text(txt_name_52)
num_score_86 = Number(num_score_56)
geo_258 = Geometry(geo_154)
explode_82 = Explode(Curve=geo_246, Recursive=True)  # -> Segments, Vertices
explode_83 = Explode(Curve=geo_248, Recursive=True)  # -> Segments, Vertices
relay = Relay()
item_65 = ListItem(List=explode_65.Segments, Index=int_placement_65, Wrap=True)
item_66 = ListItem(List=explode_66.Segments, Index=int_placement_66, Wrap=True)
explode_84 = Explode(Curve=geo_251, Recursive=True)  # -> Segments, Vertices
explode_85 = Explode(Curve=geo_254, Recursive=True)  # -> Segments, Vertices
item_67 = ListItem(List=explode_67.Segments, Index=int_placement_67, Wrap=True)
item_68 = ListItem(List=explode_68.Segments, Index=int_placement_68, Wrap=True)
group_2 = Group(Geometry=geo_190)
item_69 = ListItem(List=explode_69.Segments, Index=int_placement_70, Wrap=True)
item_70 = ListItem(List=explode_70.Segments, Index=int_placement_69, Wrap=True)
txt_name_87 = Text(txt_name_44)
int_placement_87 = Integer(int_placement_44)
int_importance_79 = Integer(importance_68)
geo_259 = Geometry(geo_130)
geo_260 = Geometry(geo_131)
geo_261 = Geometry(geo_132)
num_score_87 = Number(num_score_38)
item_71 = ListItem(List=explode_71.Segments, Index=Slider(2, range=0..10), Wrap=True)
item_72 = ListItem(List=explode_72.Segments, Index=int_placement_72, Wrap=True)
item_73 = ListItem(List=explode_73.Segments, Index=int_placement_76, Wrap=True)
item_74 = ListItem(List=explode_74.Segments, Index=int_placement_75, Wrap=True)
item_75 = ListItem(List=explode_75.Segments, Index=int_placement_73, Wrap=True)
item_76 = ListItem(List=explode_76.Segments, Index=int_placement_74, Wrap=True)
group_3 = Group(Geometry=geo_193)
group_4 = Group(Geometry=geo_198)
geo_262 = Geometry(geo_135)
geo_263 = Geometry(geo_138)
txt_name_88 = Text(txt_name_45)
int_placement_88 = Integer(int_placement_45)
int_importance_80 = Integer(int_importance_39)
num_score_88 = Number(num_score_41)
geo_264 = Geometry(geo_133)
geo_265 = Geometry(geo_134)
txt_name_89 = Text(txt_name_46)
int_placement_89 = Integer(int_placement_46)
int_importance_81 = Integer(importance_69)
num_score_89 = Number(num_score_39)
geo_266 = Geometry(geo_136)
geo_267 = Geometry(geo_137)
join_2 = JoinCurves(Curves=item_64, Preserve=False)
group_5 = Group(Geometry=geo_199)
group_6 = Group(Geometry=geo_202)
item_77 = ListItem(List=explode_77.Segments, Index=int_placement_77, Wrap=True)
item_78 = ListItem(List=explode_78.Segments, Index=int_placement_78, Wrap=True)
txt_name_90 = Text(txt_name_31)
int_placement_90 = Integer(int_placement_31)
int_importance_82 = Integer(int_importance_28)
geo_268 = Geometry(geo_91)
geo_269 = Geometry(geo_92)
geo_270 = Geometry(geo_93)
txt_name_91 = Text(txt_name_30)
int_placement_91 = Integer(int_placement_30)
int_importance_83 = Integer(int_importance_27)
geo_271 = Geometry(geo_88)
geo_272 = Geometry(geo_89)
geo_273 = Geometry(geo_90)
num_score_90 = Number(num_score_23)
num_score_91 = Number(num_score_22)
item_79 = ListItem(List=explode_79.Segments, Index=int_placement_79, Wrap=True)
int_placement_92 = Integer(int_placement_32)
int_importance_84 = Integer(int_importance_24)
geo_274 = Geometry(geo_96)
txt_name_92 = Text(txt_name_32)
num_score_92 = Number(num_score_20)
geo_275 = Geometry(geo_94)
geo_276 = Geometry(geo_95)
group_7 = Group(Geometry=geo_208)
group_8 = Group(Geometry=geo_205)
item_80 = ListItem(List=explode_80.Segments, Index=int_placement_80, Wrap=True)
item_81 = ListItem(List=explode_81.Segments, Index=int_placement_81, Wrap=True)
merge_4 = Merge(
    Data1=txt_name_63,
    Data2=flatten(join),
    Data3=int_importance_55,
    Data4=num_score_63,
    Data5=geo_188,
    Data6=geo_189,
    Data7=group)
item_82 = ListItem(List=explode_82.Segments, Index=int_placement_82, Wrap=True)
item_83 = ListItem(List=explode_83.Segments, Index=int_placement_83, Wrap=True)
group_9 = Group(Geometry=geo_213)
explode_86 = Explode(Curve=geo_258, Recursive=True)  # -> Segments, Vertices
join_3 = JoinCurves(Curves=item_65, Preserve=False)
item_84 = ListItem(List=explode_84.Segments, Index=int_placement_84, Wrap=True)
join_4 = JoinCurves(Curves=item_66, Preserve=False)
item_85 = ListItem(List=explode_85.Segments, Index=int_placement_85, Wrap=True)
group_10 = Group(Geometry=geo_214)
group_11 = Group(Geometry=geo_224)
join_5 = JoinCurves(Curves=item_67, Preserve=False)
join_6 = JoinCurves(Curves=item_68, Preserve=False)
group_12 = Group(Geometry=geo_223)
group_13 = Group(Geometry=geo_219)
group_14 = Group(Geometry=geo_222)
group_15 = Group(Geometry=geo_229)
group_16 = Group(Geometry=geo_230)
join_7 = JoinCurves(Curves=item_69, Preserve=False)
join_8 = JoinCurves(Curves=item_70, Preserve=False)
join_9 = JoinCurves(Curves=item_71, Preserve=False)
group_17 = Group(Geometry=geo_235)
int_placement_93 = Integer(int_placement_15)
int_importance_85 = Integer(int_importance_15)
geo_277 = Geometry(geo_45)
int_placement_94 = Integer(int_placement_16)
int_importance_86 = Integer(int_importance_16)
geo_278 = Geometry(geo_47)
txt_name_93 = Text(txt_name_15)
num_score_93 = Number(num_score_16)
geo_279 = Geometry(geo_43)
geo_280 = Geometry(geo_44)
txt_name_94 = Text(txt_name_16)
num_score_94 = Number(num_score_26)
geo_281 = Geometry(geo_46)
geo_282 = Geometry(geo_48)
join_10 = JoinCurves(Curves=item_72, Preserve=False)
explode_87 = Explode(Curve=geo_259, Recursive=True)  # -> Segments, Vertices
group_18 = Group(Geometry=geo_238)
group_19 = Group(Geometry=geo_239)
join_11 = JoinCurves(Curves=item_73, Preserve=False)
group_20 = Group(Geometry=geo_244)
group_21 = Group(Geometry=geo_245)
int_placement_95 = Integer(int_placement_12)
int_importance_87 = Integer(int_importance_12)
geo_283 = Geometry(geo_35)
txt_name_95 = Text(txt_name_12)
num_score_95 = Number(num_score_12)
geo_284 = Geometry(geo_34)
geo_285 = Geometry(geo_36)
join_12 = JoinCurves(Curves=item_74, Preserve=False)
join_13 = JoinCurves(Curves=item_75, Preserve=False)
join_14 = JoinCurves(Curves=item_76, Preserve=False)
group_22 = Group(Geometry=geo_250)
group_23 = Group(Geometry=geo_253)
explode_88 = Explode(Curve=geo_264, Recursive=True)  # -> Segments, Vertices
explode_89 = Explode(Curve=geo_266, Recursive=True)  # -> Segments, Vertices
join_15 = JoinCurves(Curves=item_77, Preserve=False)
join_16 = JoinCurves(Curves=item_78, Preserve=False)
merge_5 = Merge(
    Data1=txt_name_64,
    Data2=flatten(join_2),
    Data3=int_importance_56,
    Data4=num_score_64,
    Data5=geo_191,
    Data6=geo_192,
    Data7=group_2)
explode_90 = Explode(Curve=geo_271, Recursive=True)  # -> Segments, Vertices
explode_91 = Explode(Curve=geo_268, Recursive=True)  # -> Segments, Vertices
join_17 = JoinCurves(Curves=item_79, Preserve=False)
explode_92 = Explode(Curve=geo_275, Recursive=True)  # -> Segments, Vertices
join_18 = JoinCurves(Curves=item_80, Preserve=False)
join_19 = JoinCurves(Curves=item_81, Preserve=False)
join_20 = JoinCurves(Curves=item_82, Preserve=False)
join_21 = JoinCurves(Curves=item_83, Preserve=False)
txt_name_96 = Text(txt_name_4)
int_placement_96 = Integer(int_placement_4)
int_importance_88 = Integer(int_importance_4)
geo_286 = Geometry(geo_10)
geo_287 = Geometry(geo_11)
geo_288 = Geometry(geo_12)
txt_name_97 = Text(txt_name_5)
int_placement_97 = Integer(int_placement_5)
int_importance_89 = Integer(int_importance_5)
geo_289 = Geometry(geo_13)
geo_290 = Geometry(geo_14)
geo_291 = Geometry(geo_15)
num_score_96 = Number(num_score_4)
num_score_97 = Number(num_score_5)
item_86 = ListItem(List=explode_86.Segments, Index=int_placement_86, Wrap=True)
join_22 = JoinCurves(Curves=item_84, Preserve=False)
merge_6 = Merge(
    Data1=txt_name_65,
    Data2=flatten(join_3),
    Data3=int_importance_57,
    Data4=num_score_65,
    Data5=geo_194,
    Data6=geo_195,
    Data7=group_3)
join_23 = JoinCurves(Curves=item_85, Preserve=False)
txt_name_98 = Text(txt_name_3)
int_placement_98 = Integer(int_placement_3)
int_importance_90 = Integer(int_importance_3)
geo_292 = Geometry(geo_7)
geo_293 = Geometry(geo_9)
geo_294 = Geometry(geo_8)
merge_7 = Merge(
    Data1=txt_name_66,
    Data2=flatten(join_4),
    Data3=int_importance_58,
    Data4=num_score_66,
    Data5=geo_196,
    Data6=geo_197,
    Data7=group_4)
num_score_98 = Number(num_score_3)
merge_8 = Merge(
    Data1=txt_name_67,
    Data2=flatten(join_5),
    Data3=int_importance_59,
    Data4=num_score_67,
    Data5=geo_200,
    Data6=geo_201,
    Data7=group_5)
merge_9 = Merge(
    Data1=txt_name_68,
    Data2=flatten(join_6),
    Data3=int_importance_60,
    Data4=num_score_68,
    Data5=geo_203,
    Data6=geo_204,
    Data7=group_6)
merge_10 = Merge(
    Data1=txt_name_69,
    Data2=flatten(join_7),
    Data3=int_importance_62,
    Data4=num_score_70,
    Data5=geo_206,
    Data6=geo_207,
    Data7=group_7)
merge_11 = Merge(
    Data1=txt_name_70,
    Data2=flatten(join_8),
    Data3=int_importance_61,
    Data4=num_score_69,
    Data5=geo_209,
    Data6=geo_210,
    Data7=group_8)
merge_12 = Merge(
    Data1=txt_name_71,
    Data2=flatten(join_9),
    Data3=int_importance_63,
    Data4=num_score_71,
    Data5=geo_211,
    Data6=geo_212,
    Data7=group_9)
explode_93 = Explode(Curve=geo_279, Recursive=True)  # -> Segments, Vertices
explode_94 = Explode(Curve=geo_281, Recursive=True)  # -> Segments, Vertices
item_87 = ListItem(List=explode_87.Segments, Index=int_placement_87, Wrap=True)
merge_13 = Merge(
    Data1=txt_name_72,
    Data2=flatten(join_10),
    Data3=int_importance_64,
    Data4=num_score_72,
    Data5=geo_215,
    Data6=geo_216,
    Data7=group_10)
merge_14 = Merge(
    Data1=txt_name_76,
    Data2=flatten(join_11),
    Data3=int_importance_68,
    Data4=num_score_76,
    Data5=geo_227,
    Data6=geo_228,
    Data7=group_11)
explode_95 = Explode(Curve=geo_284, Recursive=True)  # -> Segments, Vertices
group_24 = Group(Geometry=geo_257)
merge_15 = Merge(
    Data1=txt_name_75,
    Data2=flatten(join_12),
    Data3=int_importance_67,
    Data4=num_score_75,
    Data5=geo_225,
    Data6=geo_226,
    Data7=group_12)
merge_16 = Merge(
    Data1=txt_name_73,
    Data2=flatten(join_13),
    Data3=int_importance_65,
    Data4=num_score_73,
    Data5=geo_217,
    Data6=geo_218,
    Data7=group_13)
merge_17 = Merge(
    Data1=txt_name_74,
    Data2=flatten(join_14),
    Data3=int_importance_66,
    Data4=num_score_74,
    Data5=geo_220,
    Data6=geo_221,
    Data7=group_14)
item_88 = ListItem(List=explode_88.Segments, Index=int_placement_88, Wrap=True)
item_89 = ListItem(List=explode_89.Segments, Index=int_placement_89, Wrap=True)
merge_18 = Merge(
    Data1=txt_name_77,
    Data2=flatten(join_15),
    Data3=int_importance_69,
    Data4=num_score_77,
    Data5=geo_231,
    Data6=geo_232,
    Data7=group_15)
merge_19 = Merge(
    Data1=txt_name_78,
    Data2=flatten(join_16),
    Data3=int_importance_70,
    Data4=num_score_78,
    Data5=geo_233,
    Data6=geo_234,
    Data7=group_16)
item_90 = ListItem(List=explode_90.Segments, Index=int_placement_91, Wrap=True)
item_91 = ListItem(List=explode_91.Segments, Index=int_placement_90, Wrap=True)
merge_20 = Merge(
    Data1=txt_name_79,
    Data2=flatten(join_17),
    Data3=int_importance_71,
    Data4=num_score_79,
    Data5=geo_236,
    Data6=geo_237,
    Data7=group_17)
item_92 = ListItem(List=explode_92.Segments, Index=int_placement_92, Wrap=True)
merge_21 = Merge(
    Data1=txt_name_80,
    Data2=flatten(join_18),
    Data3=int_importance_72,
    Data4=num_score_80,
    Data5=geo_240,
    Data6=geo_241,
    Data7=group_18)
merge_22 = Merge(
    Data1=txt_name_81,
    Data2=flatten(join_19),
    Data3=int_importance_73,
    Data4=num_score_81,
    Data5=geo_242,
    Data6=geo_243,
    Data7=group_19)
join_24 = JoinCurves(Curves=item_86, Preserve=False)
merge_23 = Merge(
    Data1=txt_name_82,
    Data2=flatten(join_20),
    Data3=int_importance_74,
    Data4=num_score_82,
    Data5=geo_246,
    Data6=geo_247,
    Data7=group_20)
merge_24 = Merge(
    Data1=txt_name_83,
    Data2=flatten(join_21),
    Data3=int_importance_75,
    Data4=num_score_83,
    Data5=geo_248,
    Data6=geo_249,
    Data7=group_21)
explode_96 = Explode(Curve=geo_286, Recursive=True)  # -> Segments, Vertices
explode_97 = Explode(Curve=geo_289, Recursive=True)  # -> Segments, Vertices
merge_25 = Merge(
    Data1=txt_name_84,
    Data2=flatten(join_22),
    Data3=int_importance_76,
    Data4=num_score_84,
    Data5=geo_251,
    Data6=geo_252,
    Data7=group_22)
group_25 = Group(Geometry=geo_261)
merge_26 = Merge(
    Data1=txt_name_85,
    Data2=flatten(join_23),
    Data3=int_importance_77,
    Data4=num_score_85,
    Data5=geo_254,
    Data6=geo_255,
    Data7=group_23)
explode_98 = Explode(Curve=geo_292, Recursive=True)  # -> Segments, Vertices
group_26 = Group(Geometry=geo_262)
group_27 = Group(Geometry=geo_263)
geo_295 = Geometry(geo_177)
txt_name_99 = Text(txt_name_59)
int_placement_99 = Integer(int_placement_59)
int_importance_91 = Integer(int_importance_51)
num_score_99 = Number(num_score_59)
geo_296 = Geometry(geo_175)
geo_297 = Geometry(geo_176)
group_28 = Group(Geometry=geo_273)
group_29 = Group(Geometry=geo_270)
entwine = Entwine(Branch00=merge_7, FlattenInputs=True)
item_93 = ListItem(List=explode_93.Segments, Index=int_placement_93, Wrap=True)
item_94 = ListItem(List=explode_94.Segments, Index=int_placement_94, Wrap=True)
group_30 = Group(Geometry=geo_274)
join_25 = JoinCurves(Curves=item_87, Preserve=False)
entwine_2 = Entwine(Branch00=merge_4, FlattenInputs=True)
item_95 = ListItem(List=explode_95.Segments, Index=int_placement_95, Wrap=True)
join_26 = JoinCurves(Curves=item_88, Preserve=False)
join_27 = JoinCurves(Curves=item_89, Preserve=False)
join_28 = JoinCurves(Curves=item_90, Preserve=False)
join_29 = JoinCurves(Curves=item_91, Preserve=False)
join_30 = JoinCurves(Curves=item_92, Preserve=False)
entwine_3 = Entwine(Branch00=merge_14, FlattenInputs=True)
item_96 = ListItem(List=explode_96.Segments, Index=int_placement_96, Wrap=True)
item_97 = ListItem(List=explode_97.Segments, Index=int_placement_97, Wrap=True)
merge_27 = Merge(
    Data1=txt_name_86,
    Data2=flatten(join_24),
    Data3=int_importance_78,
    Data4=num_score_86,
    Data5=geo_258,
    Data6=geo_256,
    Data7=group_24)
group_31 = Group(Geometry=geo_277)
group_32 = Group(Geometry=geo_278)
item_98 = ListItem(List=explode_98.Segments, Index=int_placement_98, Wrap=True)
group_33 = Group(Geometry=geo_283)
explode_99 = Explode(Curve=geo_296, Recursive=True)  # -> Segments, Vertices
join_31 = JoinCurves(Curves=item_93, Preserve=False)
join_32 = JoinCurves(Curves=item_94, Preserve=False)
merge_28 = Merge(
    Data1=txt_name_87,
    Data2=flatten(join_25),
    Data3=int_importance_79,
    Data4=num_score_87,
    Data5=geo_259,
    Data6=geo_260,
    Data7=group_25)
join_33 = JoinCurves(Curves=item_95, Preserve=False)
group_34 = Group(Geometry=geo_288)
group_35 = Group(Geometry=geo_291)
group_36 = Group(Geometry=geo_294)
entwine_4 = Entwine(Branch00=merge_6, FlattenInputs=True)
merge_29 = Merge(
    Data1=txt_name_88,
    Data2=flatten(join_26),
    Data3=int_importance_80,
    Data4=num_score_88,
    Data5=geo_264,
    Data6=geo_265,
    Data7=group_26)
merge_30 = Merge(
    Data1=txt_name_89,
    Data2=flatten(join_27),
    Data3=int_importance_81,
    Data4=num_score_89,
    Data5=geo_266,
    Data6=geo_267,
    Data7=group_27)
entwine_5 = Entwine(Branch00=merge_5, Branch01=merge_8, FlattenInputs=True)
merge_31 = Merge(
    Data1=txt_name_91,
    Data2=flatten(join_28),
    Data3=int_importance_83,
    Data4=num_score_91,
    Data5=geo_271,
    Data6=geo_272,
    Data7=group_28)
merge_32 = Merge(
    Data1=txt_name_90,
    Data2=flatten(join_29),
    Data3=int_importance_82,
    Data4=num_score_90,
    Data5=geo_268,
    Data6=geo_269,
    Data7=group_29)
merge_33 = Merge(
    Data1=txt_name_92,
    Data2=flatten(join_30),
    Data3=int_importance_84,
    Data4=num_score_92,
    Data5=geo_275,
    Data6=geo_276,
    Data7=group_30)
join_34 = JoinCurves(Curves=item_96, Preserve=False)
join_35 = JoinCurves(Curves=item_97, Preserve=False)
entwine_6 = Entwine(Branch00=merge_10, Branch01=merge_11, FlattenInputs=True)
join_36 = JoinCurves(Curves=item_98, Preserve=False)
entwine_7 = Entwine(Branch00=merge_9, Branch01=merge_15, FlattenInputs=True)
entwine_8 = Entwine(Branch00=merge_13, FlattenInputs=True)
entwine_9 = Entwine(Branch00=merge_19, FlattenInputs=True)  # -> simplify(Result)
item_99 = ListItem(List=explode_99.Segments, Index=int_placement_99, Wrap=True)
entwine_10 = Entwine(Branch00=merge_20, FlattenInputs=True)  # -> simplify(Result)
entwine_11 = Entwine(Branch00=merge_27, FlattenInputs=True)
entwine_12 = Entwine(Branch00=merge_18, FlattenInputs=True)  # -> simplify(Result)
merge_34 = Merge(
    Data1=txt_name_93,
    Data2=flatten(join_31),
    Data3=int_importance_85,
    Data4=num_score_93,
    Data5=geo_279,
    Data6=geo_280,
    Data7=group_31)
merge_35 = Merge(
    Data1=txt_name_94,
    Data2=flatten(join_32),
    Data3=int_importance_86,
    Data4=num_score_94,
    Data5=geo_281,
    Data6=geo_282,
    Data7=group_32)
_1_kitchen = Data(entwine_2)
entwine_13 = Entwine(Branch00=merge_24, FlattenInputs=True)  # -> simplify(Result)
entwine_14 = Entwine(Branch00=merge_26, FlattenInputs=True)  # -> simplify(Result)
merge_36 = Merge(
    Data1=txt_name_95,
    Data2=flatten(join_33),
    Data3=int_importance_87,
    Data4=num_score_95,
    Data5=geo_284,
    Data6=geo_285,
    Data7=group_33)
entwine_15 = Entwine(Branch00=merge_23, FlattenInputs=True)  # -> simplify(Result)
group_37 = Group(Geometry=geo_295)
entwine_16 = Entwine(Branch00=merge_12, Branch01=merge_16, Branch02=merge_17, FlattenInputs=True)
merge_37 = Merge(
    Data1=txt_name_96,
    Data2=flatten(join_34),
    Data3=int_importance_88,
    Data4=num_score_96,
    Data5=geo_286,
    Data6=geo_287,
    Data7=group_34)
merge_38 = Merge(
    Data1=txt_name_97,
    Data2=flatten(join_35),
    Data3=int_importance_89,
    Data4=num_score_97,
    Data5=geo_289,
    Data6=geo_290,
    Data7=group_35)
entwine_17 = Entwine(Branch00=merge_21, Branch01=merge_22, Branch02=merge_25, FlattenInputs=True)
merge_39 = Merge(
    Data1=txt_name_98,
    Data2=flatten(join_36),
    Data3=int_importance_90,
    Data4=num_score_98,
    Data5=geo_292,
    Data6=geo_293,
    Data7=group_36)
join_37 = JoinCurves(Curves=item_99, Preserve=False)
dispatch = Dispatch(List=_1_kitchen, DispatchPattern=equals.Equality)  # -> ListA, ListB
merge_40 = Merge(
    Data1=txt_name_99,
    Data2=flatten(join_37),
    Data3=int_importance_91,
    Data4=num_score_99,
    Data5=geo_296,
    Data6=geo_297,
    Data7=group_37)
entwine_18 = Entwine(Branch0X=entwine_12, Branch1X=entwine_9, Branch2X=entwine_10, FlattenInputs=False)
entwine_19 = Entwine(Branch00=merge_28, Branch01=merge_29, Branch02=merge_30, FlattenInputs=True)
entwine_20 = Entwine(Branch0X=entwine_4, Branch1X=entwine, FlattenInputs=False)  # -> simplify(Result)
entwine_21 = Entwine(Branch0X=entwine_15, Branch1X=entwine_13, Branch2X=entwine_14, FlattenInputs=False)
_2_bath = Data(entwine_18)
entwine_22 = Entwine(Branch0X=entwine_6, Branch1X=entwine_11, FlattenInputs=False)  # -> simplify(Result)
entwine_23 = Entwine(Branch0X=entwine_8, Branch1X=entwine_3, FlattenInputs=False)  # -> simplify(Result)
entwine_24 = Entwine(Branch00=merge_31, Branch01=merge_32, Branch02=merge_33, FlattenInputs=True)
entwine_25 = Entwine(Branch0X=entwine_16, Branch1X=entwine_19, FlattenInputs=False)  # -> simplify(Result)
entwine_26 = Entwine(Branch0X=entwine_5, Branch1X=entwine_7, FlattenInputs=False)  # -> simplify(Result)
entwine_27 = Entwine(Branch00=merge_34, Branch01=merge_35, Branch02=merge_36, FlattenInputs=True)
entwine_28 = Entwine(Branch00=merge_40, FlattenInputs=True)
dispatch_2 = Dispatch(List=_2_bath, DispatchPattern=equals_3.Equality)  # -> ListA, ListB
entwine_29 = Entwine(Branch00=entwine_12, FlattenInputs=True)
entwine_30 = Entwine(Branch00=merge_37, Branch01=merge_38, Branch02=merge_39, FlattenInputs=True)
_1_living = Data(entwine_20)
_2_living = Data(entwine_23)
dispatch_3 = Dispatch(List=_1_living, DispatchPattern=equals.Equality)  # -> ListA, ListB
_2_kitchen = Data(entwine_27)
entwine_31 = Entwine(Branch0X=entwine_24, Branch1X=entwine_28, FlattenInputs=False)  # -> simplify(Result)
dispatch_4 = Dispatch(List=_2_living, DispatchPattern=equals_3.Equality)  # -> ListA, ListB
_3_bath = Data(entwine_18)
_3_kitchen = Data(entwine_30)
_1_bath = Data(entwine_21)
dispatch_5 = Dispatch(List=_2_kitchen, DispatchPattern=equals_3.Equality)  # -> ListA, ListB
dispatch_6 = Dispatch(List=_3_bath, DispatchPattern=equals_2.Equality)  # -> ListA, ListB
dispatch_7 = Dispatch(List=_1_bath, DispatchPattern=equals.Equality)  # -> ListA, ListB
_3_living = Data(entwine_31)
dispatch_8 = Dispatch(List=_3_kitchen, DispatchPattern=equals_2.Equality)  # -> ListA, ListB
_3_bed_storage_secondary = Data()  # disabled
dispatch_9 = Dispatch(List=_3_living, DispatchPattern=equals_2.Equality)  # -> ListA, ListB
_4_children = Data(entwine_26)
_3_bed_bed_secondary = Data()  # disabled
_4_bedroom = Data(entwine_25)
_4_living = Data(entwine_22)
_4_kitchen = Data(entwine_17)
_4_bath = Data(entwine_18)
_4_wc = Data(entwine_29)
studio_kitchen = Data()  # disabled
_3_bed_storage = Data()  # disabled
_1_bed_storage = Data(merge_2)  # disabled
_1_bed_kitchen = Data(merge_3)  # disabled
_3_bed_kitchen = Data()  # disabled
studio_dining = Data()  # disabled
studio_bath_1 = Data()  # disabled
studio_bath_2 = Data()  # disabled
studio_bath_3 = Data()  # disabled
studio_living = Data()  # disabled
_1_bed_living = Data()  # disabled
_3_bed_dining = Data()  # disabled
_1_bed_dining = Data()  # disabled
_1_bed_bath_1 = Data()  # disabled
_1_bed_bath_2 = Data()  # disabled
_1_bed_bath_3 = Data()  # disabled
_3_bed_bath_1 = Data()  # disabled
_3_bed_bath_2 = Data()  # disabled
_3_bed_bath_3 = Data()  # disabled
_3_bed_living = Data()  # disabled
studio_bed = Data()  # disabled
_1_bed_bed = Data(relay)  # disabled
_3_bed_bed = Data()  # disabled
dispatch_10 = Dispatch(List=_4_bath, DispatchPattern=larger.OrEqualTo)  # -> ListA, ListB
dispatch_11 = Dispatch(List=_4_living, DispatchPattern=larger.OrEqualTo)  # -> ListA, ListB
dispatch_12 = Dispatch(List=_4_kitchen, DispatchPattern=larger.OrEqualTo)  # -> ListA, ListB
merge_41 = Merge(Data1=dispatch_12.ListA, Data2=dispatch_8.ListA, Data3=dispatch_5.ListA, Data4=dispatch.ListA)
merge_42 = Merge(Data1=dispatch_10.ListA, Data2=dispatch_6.ListA, Data3=dispatch_2.ListA, Data4=dispatch_7.ListA)
merge_43 = Merge(Data1=dispatch_11.ListA, Data2=dispatch_9.ListA, Data3=dispatch_4.ListA, Data4=dispatch_3.ListA)
clean = CleanTree(RemoveNulls=True, RemoveInvalid=True, RemoveEmpty=True, Tree=merge_43)
clean_2 = CleanTree(RemoveNulls=True, RemoveInvalid=True, RemoveEmpty=True, Tree=merge_42)
clean_3 = CleanTree(RemoveNulls=True, RemoveInvalid=True, RemoveEmpty=True, Tree=merge_41)
panel = Panel(clean_2)
children = Data(_4_children)
bedroom = Data(_4_bedroom)
living = Data(clean)
kitchen = Data(clean_3)
bath = Data(clean_2)
wc = Data(_4_wc)
bedroom_2 = ClusterOutput(bedroom)
kitchen_2 = ClusterOutput(kitchen)
bath_2 = ClusterOutput(bath)
wc_2 = ClusterOutput(wc)
living_2 = ClusterOutput(living)
children_2 = ClusterOutput(children)

# ==== cluster Cluster
door_width = ClusterInput()
pt_door = ClusterInput()
room = ClusterInput()
door_width_2 = Number(door_width)
pt_door_2 = Point(pt_door)
room_2 = Curve(room)
flatten = FlattenTree(Tree=pt_door_2, Path="{0}")
neg = Negative(Value=door_width_2)
dom = ConstructDomain(DomainStart=neg, DomainEnd=door_width_2)
crv_cp = CurveClosestPoint(Point=flatten, Curve=room_2)  # -> Point, Parameter, Distance
explode = Explode(Curve=room_2, Recursive=True)  # -> Segments, Vertices
panel = Panel("-0.4 To 0.4")
smaller = SmallerThan(FirstNumber=crv_cp.Distance, SecondNumber=0.12)  # -> SmallerThan, OrEqualTo
cull = CullPattern(List=flatten, CullPattern=smaller.SmallerThan)
crv_cp_2 = CurveClosestPoint(Point=cull, Curve=explode.Segments)  # -> Point, Parameter, Distance
area = Area(Geometry=room_2)  # -> Area, Centroid
sort = SortList(Keys=crv_cp_2.Distance, ValuesA=explode.Segments)  # -> Keys, ValuesA
item = ListItem(List=sort.ValuesA, Index=0, Wrap=True)
crv_cp_3 = CurveClosestPoint(Point=area.Centroid, Curve=item)  # -> Point, Parameter, Distance
ln = Line(StartPoint=area.Centroid, EndPoint=crv_cp_3.Point)
amp = Amplitude(Vector=ln, Amplitude=Slider(0.45, range=0..1))
rev = Reverse(Vector=amp)
pl = ConstructPlane(Origin=cull, XAxis=item, YAxis=rev)
rectangle = Rectangle(Plane=pl, XSize=dom, YSize=dom, Radius=0)  # -> Rectangle, Length
move = Move(Geometry=rectangle.Rectangle, Motion=rev)  # -> Geometry, Transform
door_area = Curve(move.Geometry)
door_area_2 = ClusterOutput(door_area)

# ==== cluster _1FurniturePiece
furniture_piece = ClusterInput()
wall_index = ClusterInput()
wall_index_2 = Data(wall_index)

# ----
# Furniture Data
furniture_piece_2 = Data(furniture_piece)
xy = XYPlane(Origin=Point(0, 0, 0))
rectangle = Rectangle(Plane=xy, XSize=Domain(-1, 1), YSize=Domain(-2, 2), Radius=0)  # -> Rectangle, Length
small_rectangle = ListItem(List=furniture_piece_2, Index=Slider(5, range=0..10), Wrap=True)
details = ListItem(List=furniture_piece_2, Index=Slider(6, range=0..10), Wrap=True)
guideline = ListItem(List=furniture_piece_2, Index=Slider(1, range=0..1), Wrap=True)
big_rectangle = ListItem(List=furniture_piece_2, Index=Slider(4, range=0..10), Wrap=True)
importance = ListItem(List=furniture_piece_2, Index=Slider(2, range=0..10), Wrap=True)
wall_crv = Curve(guideline)
big_bb = Curve(big_rectangle)
small_bb = Curve(small_rectangle)
detsils = Geometry(details)
wall_crv_2 = Curve(wall_crv)
big_bb_2 = Curve(big_bb)
small_bb_2 = Curve(small_bb)
flip = FlipCurve(Curve=big_bb_2, Guide=rectangle.Rectangle)  # -> Curve, Flag
flip_2 = FlipCurve(Curve=small_bb_2, Guide=rectangle.Rectangle)  # -> Curve, Flag
area = Area(Geometry=big_bb_2)  # -> Area, Centroid
explode = Explode(Curve=big_bb, Recursive=True)  # -> Segments, Vertices
explode_2 = Explode(Curve=flip.Curve, Recursive=True)  # -> Segments, Vertices
explode_3 = Explode(Curve=flip_2.Curve, Recursive=True)  # -> Segments, Vertices
graft = GraftTree(Tree=wall_index_2, IncludeEmptyLists=True, IncludeNullItems=True)
curvepoint = PointOnCurve(explode_3.Segments, parameter=0.5)
lng = ListLength(List=explode_2.Segments)
curvepoint_2 = PointOnCurve(explode_2.Segments, parameter=0.5)
item = ListItem(List=explode.Segments, Index=graft, Wrap=True)
series = Series(Start=0, Step=1, Count=lng)
crv_cp = CurveClosestPoint(Point=curvepoint_2, Curve=item)  # -> Point, Parameter, Distance
crv_cp_2 = CurveClosestPoint(Point=curvepoint, Curve=item)  # -> Point, Parameter, Distance
sort = SortList(Keys=crv_cp_2.Distance, ValuesA=explode_3.Segments, ValuesB=series)  # -> Keys, ValuesA, ValuesB
sort_2 = SortList(Keys=crv_cp.Distance, ValuesA=explode_2.Segments, ValuesB=series)  # -> Keys, ValuesA, ValuesB
item_2 = ListItem(List=sort.ValuesB, Index=0, Wrap=True)  # -> Item, Item1
item_3 = ListItem(List=sort_2.ValuesB, Index=0, Wrap=True)  # -> Item, Item1
item_4 = ListItem(List=explode_3.Segments, Index=item_2.Item, Wrap=True)  # -> Item1, Item
item_5 = ListItem(List=explode_2.Segments, Index=item_3.Item, Wrap=True)  # -> Item1, Item
crv_cp_3 = CurveClosestPoint(Point=area.Centroid, Curve=item_5.Item)  # -> Point, Parameter, Distance
vec2pt = Vector2Pt(PointA=crv_cp_3.Point, PointB=area.Centroid, Unitize=False)  # -> Vector, Length
flatten = FlattenTree(Tree=item_4.Item, Path="{0}")
flatten_2 = FlattenTree(Tree=item_4.Item1, Path="{0}")
end = EndPoints(Curve=item_5.Item)  # -> Start, End
rev = Reverse(Vector=item_5.Item)
flatten_3 = FlattenTree(Tree=item_5.Item, Path="{0}")
flatten_4 = FlattenTree(Tree=item_5.Item1, Path="{0}")
crv_width_full = Curve(flatten_3)
crv_depth_full = Curve(flatten_4)
crv_width_rdc = Curve(flatten)
crv_depth_rdc = Curve(flatten_2)
pl = ConstructPlane(Origin=end.Start, XAxis=item_5.Item, YAxis=vec2pt.Vector)
pl_2 = ConstructPlane(Origin=end.End, XAxis=rev, YAxis=vec2pt.Vector)
len = Length(Curve=crv_width_full)
flatten_5 = FlattenTree(Tree=detsils, Path="{0}")
flatten_6 = FlattenTree(Tree=pl, Path="{0}")
flatten_7 = FlattenTree(Tree=pl_2, Path="{0}")
flatten_8 = FlattenTree(Tree=importance, Path="{0}")
detsils_2 = Geometry(flatten_5)
len_2 = Length(Curve=crv_depth_full)
len_3 = Length(Curve=crv_width_rdc)
len_4 = Length(Curve=flatten_2)
plane_ending_point = Data(flatten_7)
plane_starting_point = Data(flatten_6)
importance_furniture = Data(flatten_8)
flatten_9 = FlattenTree(Tree=flip.Curve, Path="{0}")
flatten_10 = FlattenTree(Tree=flip_2.Curve, Path="{0}")
depth_full = Number(len_2)
width_rdc = Number(len_3)
depth_rdc = Number(len_4)

lng_2 = ListLength(List=furniture_piece_2)  # -> flatten(Length)
walls_must = BooleanToggle(True)
lng_3 = ListLength(List=lng_2)
panel = Panel(lng_3)

number_slider = Slider(6, range=0..7)
room_full = ClusterInput()
room_rdc = ClusterInput()
walls = ClusterInput()

walls_2 = Curve(walls)
room_full_2 = Curve(room_full)
room_rdc_2 = Curve(room_rdc)

tbranch = TreeBranch(Tree=room_full_2, Path=number_slider, MaintainPaths=True, SplitTree=False)
tbranch_2 = TreeBranch(Tree=room_rdc_2, Path=number_slider, MaintainPaths=True, SplitTree=False)
srf = Surface(tbranch)
score = ListItem(List=furniture_piece_2, Index=Slider(3, range=0..10), Wrap=True)
flatten_11 = FlattenTree(Tree=room_full_2, Path="{0}")
panel_2 = Panel(importance)
lng_4 = ListLength(List=room_rdc_2)
number_slider_2 = Slider(0, range=0..5)
panel_3 = Panel(score)
equals = Equality(FirstNumber=importance, SecondNumber=1)  # -> Equality, Inequality
larger = LargerThan(FirstNumber=lng_4, SecondNumber=1)  # -> LargerThan, OrEqualTo
srf_2 = Surface(room_full_2)
multiplication = Multiplication(A=equals.Equality, B=score)
ma = MassAddition(Input=flatten(larger.LargerThan))  # -> Result, PartialResults
swatch = ColourSwatch(SwatchColor=RGB(255, 255, 255))
merge = Merge(Data1=Slider(0, range=0..8), Data2=Slider(6, range=0..10))
larger_2 = LargerThan(FirstNumber=ma.Result, SecondNumber=0)  # -> LargerThan, OrEqualTo
flatten_12 = FlattenTree(Tree=multiplication, Path="{0}")
panel_4 = Panel(room_rdc_2)
join = TextJoin(Text=merge, Join=";")
sort_3 = SortList(Keys=flatten_12)  # -> Keys, ValuesA
panel_5 = Panel(sort_3.Keys)
tbranch_3 = TreeBranch(Tree=room_full_2, Path=join, MaintainPaths=True, SplitTree=False)
tbranch_4 = TreeBranch(Tree=room_rdc_2, Path=join, MaintainPaths=True, SplitTree=False)
item_6 = ListItem(List=sort_3.Keys, Index=0, Wrap=True)
panel_6 = Panel(item_6)
merge_2 = Merge(Data1=Slider(0, range=0..3), Data2=Slider(0, range=0..3), Data3=Slider(0, range=0..3))
merge_3 = Merge(Data1=Slider(1, range=0..3), Data2=Slider(2, range=0..3), Data3=Slider(2, range=0..3))
lng_5 = ListLength(List=furniture_piece_2)  # -> flatten(Length)
graft_2 = GraftTree(Tree=merge_2, IncludeEmptyLists=True, IncludeNullItems=True)
graft_3 = GraftTree(Tree=merge_3, IncludeEmptyLists=True, IncludeNullItems=True)
lng_6 = ListLength(List=lng_5)

# ---- group: guiding edge length
flatten_13 = FlattenTree(Tree=item, Path="{0}")
len_5 = Length(Curve=flatten_13)
width = Number(len_5)

# ----
panel_7 = Panel(sort_2.ValuesB)
flatten_14 = FlattenTree(Tree=score, Path="{0}")
score_furniture = Data(flatten_14)
sort_4 = SortList(Keys=score_furniture, ValuesA=score_furniture)  # -> reverse(Keys), ValuesA
item_7 = ListItem(List=sort_4.Keys, Index=0, Wrap=True)
importance_furniture_2 = ClusterOutput(importance_furniture)
panel_8 = Panel(item_7)
larger_3 = LargerThan(FirstNumber=importance_furniture, SecondNumber=Slider(1, range=0..1))  # -> LargerThan, OrEqualTo
dispatch = Dispatch(List=item_7, DispatchPattern=larger_3.LargerThan)  # -> ListA, ListB
score_min = Data(dispatch.ListB)
score_max = Data(item_7)
score_max_2 = ClusterOutput(score_max)
score_min_2 = ClusterOutput(score_min)

subdivs_count = Slider(14, range=0..20)
number_slider_3 = Slider(0.1, range=0..0.1)

division = Division(A=1, B=subdivs_count)
number_slider_4 = Slider(1, range=0..5)
number_slider_5 = Slider(10, range=0..10)
detsils_3 = Geometry(detsils_2)
panel_9 = Panel(detsils_3)
number_slider_6 = Slider(7, range=0..7)
number_slider_7 = Slider(0, range=0..7)
number_slider_8 = Slider(1, range=0..10)
larger_4 = LargerThan(SecondNumber=0)  # -> LargerThan, OrEqualTo
number_slider_9 = Slider(5, range=0..6)  # disabled
detsils_4 = Geometry(detsils_2)
result_score = Data(score_furniture)
sort_5 = SortList(Keys=result_score)  # -> reverse(Keys), ValuesA
swatch_2 = ColourSwatch(SwatchColor=RGB(196, 196, 196))  # disabled
item_8 = ListItem(List=sort_5.Keys, Index=0, Wrap=True)
importance_2 = Data(importance_furniture)
result_details = Geometry(detsils_4)
result_score_2 = Data(score_furniture)
result_details_2 = ClusterOutput(result_details)
result_score_3 = ClusterOutput(result_score_2)

# ----
# 1. Wall Length Check
# check with walls are wide enough to fit this one furniture at all
# if needed, leave only edges that are actually walls (for most furniture you better place stuff along the wall)
rectangle_2 = Rectangle(Plane=PlaneXY(0, 0, 0), XSize=Domain(-1, 1), YSize=Domain(-2, 2), Radius=0)  # -> Rectangle, Length
flip_3 = FlipCurve(Curve=room_rdc_2, Guide=rectangle_2.Rectangle)  # -> simplify(Curve), Flag
lng_7 = ListLength(List=room_full_2)
explode_4 = Explode(Curve=flip_3.Curve, Recursive=True)  # -> Segments, Vertices
larger_5 = LargerThan(FirstNumber=lng_7, SecondNumber=1)  # -> LargerThan, OrEqualTo
trim = TrimTree(Tree=explode_4.Segments, Depth=1)
ma_2 = MassAddition(Input=flatten(larger_5.LargerThan))  # -> Result, PartialResults
larger_6 = LargerThan(FirstNumber=ma_2.Result, SecondNumber=0)  # -> LargerThan, OrEqualTo
width_2 = Number(width)
lng_8 = ListLength(List=width_2)

or = GateOr(A=larger_6.LargerThan, B=larger_2.LargerThan)

filter = StreamFilter(Gate=or, Stream0=explode_4.Segments, Stream1=trim)
curvepoint_3 = PointOnCurve(filter, parameter=0.5)
crv_cp_4 = CurveClosestPoint(Point=curvepoint_3, Curve=walls_2)  # -> Point, Parameter, Distance
smaller = SmallerThan(FirstNumber=crv_cp_4.Distance, SecondNumber=0.01)  # -> SmallerThan, OrEqualTo
cull = CullPattern(List=filter, CullPattern=smaller.SmallerThan)
filter_2 = StreamFilter(Gate=walls_must, Stream0=filter, Stream1=cull)
lng_9 = ListLength(List=filter_2)
repeat = RepeatData(Data=room_full_2, Length=lng_9)
edges_for_checking = Curve(simplify(filter_2))
repeat_2 = RepeatData(Data=walls_2, Length=lng_9)
repeat_3 = RepeatData(Data=flip_3.Curve, Length=lng_9)
graft_4 = GraftTree(Tree=repeat, IncludeEmptyLists=True, IncludeNullItems=True)
graft_5 = GraftTree(Tree=edges_for_checking, IncludeEmptyLists=True, IncludeNullItems=True)
graft_6 = GraftTree(Tree=repeat_2, IncludeEmptyLists=True, IncludeNullItems=True)
graft_7 = GraftTree(Tree=repeat_3, IncludeEmptyLists=True, IncludeNullItems=True)
repeat_4 = RepeatData(Data=graft_5, Length=lng_6)
repeat_5 = RepeatData(Data=graft_4, Length=lng_6)
repeat_6 = RepeatData(Data=graft_6, Length=lng_6)
repeat_7 = RepeatData(Data=graft_7, Length=lng_6)
len_6 = Length(Curve=repeat_4)
larger_7 = LargerThan(FirstNumber=len_6, SecondNumber=width_2)  # -> LargerThan, OrEqualTo
cull_2 = CullPattern(List=repeat_5, CullPattern=larger_7.LargerThan)
cull_3 = CullPattern(List=repeat_6, CullPattern=larger_7.LargerThan)
cull_4 = CullPattern(List=repeat_4, CullPattern=larger_7.LargerThan)
cull_5 = CullPattern(List=repeat_7, CullPattern=larger_7.LargerThan)
room_rdc_3 = Curve(simplify(cull_5))
trim_2 = TrimTree(Tree=room_rdc_3, Depth=1)

# ---- group: filter funtiture index for later
series_2 = Series(Start=0, Step=1, Count=lng_3)
cull_6 = CullPattern(List=series_2, CullPattern=larger_7.LargerThan)
indexes_furniture_var = Data(simplify(cull_6))

# ----
initial = Curve(simplify(cull_3))
room_full_3 = Curve(simplify(cull_2))
walls_long_enough = Curve(simplify(cull_4))

panel_10 = Panel(initial)

trim_3 = TrimTree(Tree=initial, Depth=1)
trim_4 = TrimTree(Tree=room_full_3, Depth=1)
trim_5 = TrimTree(Tree=walls_long_enough, Depth=1)
null = NullItem(Item=flatten(trim_4))  # -> NullFlags, InvalidFlags, Description
trim_6 = TrimTree(Tree=indexes_furniture_var, Depth=1)
item_9 = ListItem(List=null.NullFlags, Index=0, Wrap=True)
filter_3 = StreamFilter(Gate=item_9, Stream0=trim_2, Stream1=flatten(room_rdc_3))  # -> simplify(graft(Stream))
filter_4 = StreamFilter(Gate=item_9, Stream0=trim_3, Stream1=flatten(initial))  # -> simplify(graft(Stream))
filter_5 = StreamFilter(Gate=item_9, Stream0=trim_4, Stream1=flatten(room_full_3))  # -> simplify(graft(Stream))
filter_6 = StreamFilter(Gate=item_9, Stream0=trim_5, Stream1=flatten(walls_long_enough))  # -> simplify(graft(Stream))
filter_7 = StreamFilter(Gate=item_9, Stream0=trim_6, Stream1=flatten(indexes_furniture_var))  # -> simplify(graft(Stream))

room_rdc_4 = Curve(filter_3)
room_full_4 = Curve(filter_5)
walls_long_enough_2 = Curve(filter_6)
indexes_furniture_var_2 = Data(filter_7)
initial_2 = Curve(filter_4)

panel_11 = Panel(filter_4)

crv_depth_full_2 = Curve(crv_depth_full)
room_full_5 = Curve(room_full_4)
walls_long_enough_3 = Curve(walls_long_enough_2)
indexes_furniture_var_3 = Data(indexes_furniture_var_2)
room_rdc_5 = Curve(room_rdc_4)
detsils_5 = Geometry(flatten_5)
plane_ending_point_2 = Data(flatten_7)
big_bb_3 = Curve(flatten_9)
plane_starting_point_2 = Data(flatten_6)
small_bb_3 = Curve(flatten_10)
crv_width_rdc_2 = Curve(crv_width_rdc)
crv_width_full_2 = Curve(crv_width_full)
crv_depth_rdc_2 = Curve(crv_depth_rdc)

panel_12 = Panel(indexes_furniture_var_3)
explode_5 = Explode(Curve=room_full_5, Recursive=True)  # -> Segments, Vertices
len_7 = Length(Curve=explode_5.Segments)
panel_13 = Panel(len_7)
previewlw = CustomPreviewLineweights(
    Geometry=walls_long_enough_3,
    Shader=ColourSwatch(SwatchColor=RGB(0, 0, 0)),
    Thickness=Slider(12, range=0..100),
    Absolute=False)
initial_3 = Curve(initial_2)

# ----
# 2. Room Depth check
# make rays from a wall (with length of full object and reduced object).
# Then check which part of the wall has enough "free depth" in front of it.
item_10 = ListItem(List=crv_depth_full_2, Index=indexes_furniture_var_3, Wrap=True)
item_11 = ListItem(List=crv_depth_rdc_2, Index=indexes_furniture_var_3, Wrap=True)
item_12 = ListItem(List=crv_width_rdc_2, Index=indexes_furniture_var_3, Wrap=True)
item_13 = ListItem(List=detsils_5, Index=indexes_furniture_var_3, Wrap=True)
item_14 = ListItem(List=plane_starting_point_2, Index=indexes_furniture_var_3, Wrap=True)
item_15 = ListItem(List=plane_ending_point_2, Index=indexes_furniture_var_3, Wrap=True)
item_16 = ListItem(List=crv_width_full_2, Index=indexes_furniture_var_3, Wrap=True)
item_17 = ListItem(List=big_bb_3, Index=indexes_furniture_var_3, Wrap=True)
item_18 = ListItem(List=small_bb_3, Index=indexes_furniture_var_3, Wrap=True)
number_slider_10 = Slider(0.03, range=0..0.1)
curvepoint_4 = PointOnCurve(walls_long_enough_3, parameter=0.5)
len_8 = Length(Curve=item_10)
len_9 = Length(Curve=item_11)
offset = OffsetCurve(Curve=walls_long_enough_3, Distance=expr("-x", number_slider_10), Corners=1)
plane_starting_point_3 = Data(item_14)
plane_ending_point_3 = Data(item_15)
big_bb_4 = Curve(item_17)
small_bb_4 = Curve(item_18)
multiplication_2 = Multiplication(A=number_slider_10, B=Slider(1, range=0..2))
ext = ExtendCurve(Curve=offset, Type=0, Start=expr("-x", multiplication_2), End=expr("-x", multiplication_2))
crv_cp_5 = CurveClosestPoint(Point=curvepoint_4, Curve=offset)  # -> Point, Parameter, Distance
vec2pt_2 = Vector2Pt(PointA=curvepoint_4, PointB=crv_cp_5.Point, Unitize=False)  # -> Vector, Length
series_3 = Series(Start=0, Step=division, Count=subdivs_count)
shatter = Shatter(Curve=reparameterize(ext), Parameters=series_3)
curvepoint_5 = PointOnCurve(shatter, parameter=0.5)
len_10 = Length(Curve=shatter)
room_full_6 = Curve(room_full_5)

panel_14 = Panel(len_8)
panel_15 = Panel(len_9)

depth_full_2 = Number(len_8)
depth_rdc_2 = Number(len_9)
room_rdc_6 = Curve(room_rdc_5)

panel_16 = Panel(depth_full_2)

line = LineSDL(Start=curvepoint_5, Direction=vec2pt_2.Vector, Length=depth_full_2)
line_2 = LineSDL(Start=curvepoint_5, Direction=vec2pt_2.Vector, Length=depth_rdc_2)
colom = CollisionOneMany(Collider=line_2, Obstacles=room_rdc_6)  # -> Collision, Index
colom_2 = CollisionOneMany(Collider=line, Obstacles=room_full_6)  # -> Collision, Index
not = GateNot(A=colom_2.Collision)
not_2 = GateNot(A=colom.Collision)
cull_7 = CullPattern(List=shatter, CullPattern=not)
cull_8 = CullPattern(List=shatter, CullPattern=not_2)

tbranch_5 = TreeBranch(Tree=simplify(ext), Path=number_slider_4, MaintainPaths=True, SplitTree=False)
panel_17 = Panel(item_12)
tbranch_6 = TreeBranch(Tree=simplify(line), Path=number_slider_4, MaintainPaths=True, SplitTree=False)
tbranch_7 = TreeBranch(Tree=room_full_6, Path=number_slider_4, MaintainPaths=True, SplitTree=False)
# BEDROOM
colom_3 = CollisionOneMany(Collider=tbranch_6, Obstacles=tbranch_7)  # -> Collision, Index

fitting_wall_full = Curve(simplify(cull_7))
vec = Vector(simplify(vec2pt_2.Vector))
fitting_wall_reduced = Curve(simplify(cull_8))

panel_18 = Panel(colom_2.Collision)

fitting_wall_reduced_2 = Curve(fitting_wall_reduced)
crv_width_full_3 = Curve(item_16)
crv_width_rdc_3 = Curve(item_12)
fitting_wall_full_2 = Curve(fitting_wall_full)

# ----
# full space
# 3. Reduce crv if needed
# reduced space
# check from where the placement can actually start
join_2 = JoinCurves(Curves=fitting_wall_reduced_2, Preserve=False)
join_3 = JoinCurves(Curves=fitting_wall_full_2, Preserve=False)
len_11 = Length(Curve=crv_width_full_3)
flip_4 = FlipCurve(Curve=crv_width_full_3, Guide=rectangle_2.Rectangle)  # -> Curve, Flag
flip_5 = FlipCurve(Curve=crv_width_rdc_3, Guide=rectangle_2.Rectangle)  # -> Curve, Flag
sort_6 = SortList(Keys=join_2, ValuesA=join_2)  # -> Keys, reverse(ValuesA)
sort_7 = SortList(Keys=join_3, ValuesA=join_3)  # -> Keys, reverse(ValuesA)
item_19 = ListItem(List=sort_6.ValuesA, Index=0, Wrap=True)
item_20 = ListItem(List=sort_7.ValuesA, Index=0, Wrap=True)
end_2 = EndPoints(Curve=flip_4.Curve)  # -> Start, End
end_3 = EndPoints(Curve=item_20)  # -> Start, End
crv_cp_6 = CurveClosestPoint(Point=end_2.Start, Curve=flip_5.Curve)  # -> Point, Parameter, Distance
crv_cp_7 = CurveClosestPoint(Point=end_2.End, Curve=flip_5.Curve)  # -> Point, Parameter, Distance
crv_cp_8 = CurveClosestPoint(Point=end_3.Start, Curve=item_19)  # -> Point, Parameter, Distance
crv_cp_9 = CurveClosestPoint(Point=end_3.End, Curve=item_19)  # -> Point, Parameter, Distance
subtraction = Subtraction(A=crv_cp_8.Distance, B=crv_cp_6.Distance)
subtraction_2 = Subtraction(A=crv_cp_9.Distance, B=crv_cp_7.Distance)
larger_8 = LargerThan(FirstNumber=subtraction, SecondNumber="0")  # -> LargerThan, OrEqualTo
larger_9 = LargerThan(FirstNumber=subtraction_2, SecondNumber="0")  # -> LargerThan, OrEqualTo
dispatch_2 = Dispatch(List=subtraction, DispatchPattern=larger_8.LargerThan)  # -> ListA, ListB
dispatch_3 = Dispatch(List="0", DispatchPattern=larger_8.LargerThan)  # -> ListA, ListB
dispatch_4 = Dispatch(List=subtraction_2, DispatchPattern=larger_9.LargerThan)  # -> ListA, ListB
dispatch_5 = Dispatch(List="0", DispatchPattern=larger_9.LargerThan)  # -> ListA, ListB
merge_4 = Merge(Data1=simplify(dispatch_2.ListA), Data2=simplify(dispatch_3.ListB))
merge_5 = Merge(Data1=simplify(dispatch_4.ListA), Data2=simplify(dispatch_5.ListB))
multiplication_3 = Multiplication(A=merge_5, B=-1)
multiplication_4 = Multiplication(A=merge_4, B=-1)
panel_19 = Panel(dispatch_2.ListA)
ext_2 = ExtendCurve(Curve=item_20, Type=0, Start=multiplication_4, End=multiplication_3)
final_fitting_curve = Curve(ext_2)

len_12 = Length(Curve=item_20)
panel_20 = Panel(len_12)
panel_21 = Panel(multiplication_4)
panel_22 = Panel(final_fitting_curve)

# ----
# 4. again check the length
room_rdc_7 = Curve(room_rdc_6)
final_fitting_curve_2 = Curve(final_fitting_curve)
vec_2 = Vector(vec)
width_3 = Number(len_11)
factor_to_include_alternative_positionin = Slider(1.4, range=0..10)  # "factor to include alternative positioning"
indexes_furniture_var_4 = Data(indexes_furniture_var_3)
plane_starting_point_4 = Data(plane_starting_point_3)
plane_ending_point_4 = Data(plane_ending_point_3)
big_bb_5 = Curve(big_bb_4)
small_bb_5 = Curve(small_bb_4)
room_full_7 = Curve(room_full_5)
len_13 = Length(Curve=final_fitting_curve_2)
larger_10 = LargerThan(FirstNumber=len_13, SecondNumber=width_3)  # -> LargerThan, OrEqualTo
panel_23 = Panel(larger_10.LargerThan)
division_2 = Division(A=len_13, B=width_3)
cull_9 = CullPattern(List=indexes_furniture_var_4, CullPattern=larger_10.LargerThan)
cull_10 = CullPattern(List=plane_starting_point_4, CullPattern=larger_10.LargerThan)
cull_11 = CullPattern(List=plane_ending_point_4, CullPattern=larger_10.LargerThan)
cull_12 = CullPattern(List=big_bb_5, CullPattern=larger_10.LargerThan)
cull_13 = CullPattern(List=small_bb_5, CullPattern=larger_10.LargerThan)
cull_14 = CullPattern(List=final_fitting_curve_2, CullPattern=larger_10.LargerThan)
larger_11 = LargerThan(FirstNumber=division_2, SecondNumber=factor_to_include_alternative_positionin)  # -> LargerThan, OrEqualTo
cull_15 = CullPattern(List=vec_2, CullPattern=larger_10.LargerThan)
cull_16 = CullPattern(List=room_full_7, CullPattern=larger_10.LargerThan)
cull_17 = CullPattern(List=room_rdc_7, CullPattern=larger_10.LargerThan)
room_rdc_8 = Curve(cull_17)
room_full_8 = Curve(cull_16)
walls_long_enough_4 = Curve(cull_14)
vec_3 = Vector(cull_15)
include_end_plane = Boolean(larger_11.LargerThan)
plane_starting_point_5 = Data(cull_10)
plane_ending_point_5 = Data(cull_11)
small_bb_6 = Curve(cull_13)
big_bb_6 = Curve(cull_12)

cull_18 = CullPattern(List=initial_3, CullPattern=larger_10.LargerThan)
initial_4 = Curve(cull_18)

room_full_9 = Curve(room_full_8)
indexes_furniture_var_5 = Data(cull_9)
plane_starting_point_6 = Data(plane_starting_point_5)
plane_ending_point_6 = Data(plane_ending_point_5)
big_bb_7 = Curve(big_bb_6)
small_bb_7 = Curve(small_bb_6)

# ----
# **
# if the line is not reallz long, just make one placement option
# 5a.Placement
final_fitting_curve_3 = Curve(walls_long_enough_4)
vec_4 = Vector(vec_3)
include_end_plane_2 = Boolean(include_end_plane)
rev_2 = Reverse(Vector=vec_4)
num = Number(number_slider_10)
amp = Amplitude(Vector=rev_2, Amplitude=num)
move = Move(Geometry=final_fitting_curve_3, Motion=amp)  # -> Geometry, Transform
rev_3 = Reverse(Vector=move.Geometry)
end_4 = EndPoints(Curve=move.Geometry)  # -> Start, End
pl_3 = ConstructPlane(Origin=end_4.Start, XAxis=move.Geometry, YAxis=vec_4)
pl_4 = ConstructPlane(Origin=end_4.End, XAxis=rev_3, YAxis=vec_4)
big_bb_8 = Orient(Geometry=big_bb_7, Source=plane_starting_point_6, Target=pl_3)  # -> Geometry, Transform
big_bb_9 = Orient(Geometry=big_bb_7, Source=plane_ending_point_6, Target=pl_4)  # -> Geometry, Transform
cull_19 = CullPattern(List=big_bb_9.Geometry, CullPattern=include_end_plane_2)
small_bb_8 = Orient(Geometry=small_bb_7, Source=plane_starting_point_6, Target=pl_3)  # -> Geometry, Transform
small_bb_9 = Orient(Geometry=small_bb_7, Source=plane_ending_point_6, Target=pl_4)  # -> Geometry, Transform
cull_20 = CullPattern(List=small_bb_9.Geometry, CullPattern=include_end_plane_2)
cull_21 = CullPattern(List=small_bb_9.Transform, CullPattern=include_end_plane_2)
cull_22 = CullPattern(List=room_rdc_8, CullPattern=include_end_plane_2)
cull_23 = CullPattern(List=initial_4, CullPattern=include_end_plane_2)
initial_5 = Curve(initial_4)
room_rdc_9 = Curve(room_rdc_8)
room_rdc_10 = Curve(cull_22)
initial_6 = Curve(cull_23)
transformation_data_1 = Data(big_bb_8.Transform)
transformation_data_2 = Data(cull_21)

# ----
# here a wall may fail
panel_24 = Panel(final_fitting_curve_3)
cull_24 = CullPattern(List=room_full_9, CullPattern=include_end_plane_2)
cull_25 = CullPattern(List=indexes_furniture_var_5, CullPattern=include_end_plane_2)

# ----
# Variants tree
trim_7 = TrimTree(Tree=simplify(cull_24), Depth=1)
trim_8 = TrimTree(Tree=simplify(indexes_furniture_var_5), Depth=1)
trim_9 = TrimTree(Tree=simplify(cull_25), Depth=1)
trim_10 = TrimTree(Tree=simplify(transformation_data_1), Depth=1)
trim_11 = TrimTree(Tree=simplify(transformation_data_2), Depth=1)
trim_12 = TrimTree(Tree=simplify(big_bb_8.Geometry), Depth=1)
trim_13 = TrimTree(Tree=simplify(cull_19), Depth=1)
trim_14 = TrimTree(Tree=simplify(small_bb_8.Geometry), Depth=1)
trim_15 = TrimTree(Tree=simplify(cull_20), Depth=1)
trim_16 = TrimTree(Tree=simplify(room_rdc_9), Depth=1)
trim_17 = TrimTree(Tree=simplify(room_rdc_10), Depth=1)
trim_18 = TrimTree(Tree=simplify(room_full_9), Depth=1)
trim_19 = TrimTree(Tree=simplify(initial_5), Depth=1)
trim_20 = TrimTree(Tree=simplify(initial_6), Depth=1)
rooms_cnt = ListLength(List=flatten_11)
larger_12 = LargerThan(FirstNumber=rooms_cnt, SecondNumber=1)  # -> LargerThan, OrEqualTo
filter_8 = StreamFilter(Gate=larger_12.LargerThan, Stream0=flatten(room_full_9), Stream1=trim_18)
filter_9 = StreamFilter(Gate=larger_12.LargerThan, Stream0=flatten(cull_24), Stream1=trim_7)
filter_10 = StreamFilter(Gate=larger_12.LargerThan, Stream0=flatten(indexes_furniture_var_5), Stream1=trim_8)
filter_11 = StreamFilter(Gate=larger_12.LargerThan, Stream0=flatten(cull_25), Stream1=trim_9)
filter_12 = StreamFilter(Gate=larger_12.LargerThan, Stream0=flatten(transformation_data_1), Stream1=trim_10)
filter_13 = StreamFilter(Gate=larger_12.LargerThan, Stream0=flatten(transformation_data_2), Stream1=trim_11)
filter_14 = StreamFilter(Gate=larger_12.LargerThan, Stream0=flatten(big_bb_8.Geometry), Stream1=trim_12)
filter_15 = StreamFilter(Gate=larger_12.LargerThan, Stream0=flatten(cull_19), Stream1=trim_13)
filter_16 = StreamFilter(Gate=larger_12.LargerThan, Stream0=flatten(small_bb_8.Geometry), Stream1=trim_14)
filter_17 = StreamFilter(Gate=larger_12.LargerThan, Stream0=flatten(cull_20), Stream1=trim_15)
filter_18 = StreamFilter(Gate=larger_12.LargerThan, Stream0=flatten(room_rdc_9), Stream1=trim_16)
filter_19 = StreamFilter(Gate=larger_12.LargerThan, Stream0=flatten(room_rdc_10), Stream1=trim_17)
filter_20 = StreamFilter(Gate=larger_12.LargerThan, Stream0=flatten(initial_5), Stream1=trim_19)
filter_21 = StreamFilter(Gate=larger_12.LargerThan, Stream0=flatten(initial_6), Stream1=trim_20)
merge_6 = Merge(Data1=filter_8, Data2=filter_9)
merge_7 = Merge(Data1=filter_10, Data2=filter_11)
merge_8 = Merge(Data1=filter_12, Data2=filter_13)
merge_9 = Merge(Data1=filter_14, Data2=filter_15)
merge_10 = Merge(Data1=filter_16, Data2=filter_17)
merge_11 = Merge(Data1=filter_18, Data2=filter_19)
merge_12 = Merge(Data1=filter_20, Data2=filter_21)
indexes_furniture_var_6 = Data(merge_7)
transformation_data = Data(merge_8)
bb_full = Data(merge_9)
bb_reduced = Data(merge_10)
room_full_10 = Curve(merge_6)
initial_7 = Curve(merge_12)

trim_21 = TrimTree(Tree=simplify(final_fitting_curve_3), Depth=1)
data = Data(trim_21)
room_reduced = Curve(merge_11)
tbranch_8 = TreeBranch(Tree=room_full_10, Path=number_slider_6, MaintainPaths=True, SplitTree=False)
tbranch_9 = TreeBranch(Tree=initial_7, Path=number_slider_6, MaintainPaths=True, SplitTree=False)
tbranch_10 = TreeBranch(Tree=bb_full, Path=number_slider_6, MaintainPaths=True, SplitTree=False)
tbranch_11 = TreeBranch(Tree=bb_reduced, Path=number_slider_6, MaintainPaths=True, SplitTree=False)

# ----
# 5b. Prepare Contours
graft_8 = GraftTree(Tree=room_full_10, IncludeEmptyLists=True, IncludeNullItems=True)
graft_9 = GraftTree(Tree=bb_reduced, IncludeEmptyLists=True, IncludeNullItems=True)
graft_10 = GraftTree(Tree=room_reduced, IncludeEmptyLists=True, IncludeNullItems=True)
graft_11 = GraftTree(Tree=bb_full, IncludeEmptyLists=True, IncludeNullItems=True)
graft_12 = GraftTree(Tree=initial_7, IncludeEmptyLists=True, IncludeNullItems=True)
graft_13 = GraftTree(Tree=indexes_furniture_var_6, IncludeEmptyLists=True, IncludeNullItems=True)
graft_14 = GraftTree(Tree=transformation_data, IncludeEmptyLists=True, IncludeNullItems=True)
room_full_11 = Curve(graft_8)
bb_rdc = Curve(graft_9)
room_rdc_11 = Curve(graft_10)
bb_full_2 = Data(graft_11)
rdiff = RegionDifference(CurvesA=room_rdc_11, CurvesB=bb_full_2)
rdiff_2 = RegionDifference(CurvesA=room_full_11, CurvesB=bb_rdc)

room_full_12 = Curve(simplify(rdiff_2))
room_rdc_12 = Curve(simplify(rdiff))
initial_8 = Curve(simplify(graft_12))
indexes_furniture_var_7 = Data(graft_13)
transformation_data_3 = Data(graft_14)

tbranch_12 = TreeBranch(Tree=room_full_12, Path=number_slider_7, MaintainPaths=True, SplitTree=False)
tbranch_13 = TreeBranch(Tree=room_rdc_12, Path=number_slider_7, MaintainPaths=True, SplitTree=False)
transformation_data_4 = Data(transformation_data_3)
indexes_furniture_var_8 = Data(indexes_furniture_var_7)
results_1_indexes_furniture_var = Data(indexes_furniture_var_8)
results_1_transformation_data = Data(transformation_data_4)
nulls_in_empty = NullsInEmptyBranches(DataWithEmptyBranches=results_1_indexes_furniture_var)  # -> simplify(DataWithNulls)
nulls_in_empty_2 = NullsInEmptyBranches(DataWithEmptyBranches=results_1_transformation_data)  # -> simplify(DataWithNulls)
results_1_indexes_furniture_var_2 = Data(nulls_in_empty)
results_transformation_data = Data(nulls_in_empty_2)
result_initial = Curve(initial_8)
result_initial_2 = ClusterOutput(result_initial)
results_transformation_data_2 = ClusterOutput(results_transformation_data)
results_1_indexes_furniture_var_3 = ClusterOutput(results_1_indexes_furniture_var_2)

# ----
# Clean Up
boundary = BoundarySurfaces(Edges=room_rdc_12)
boundary_2 = BoundarySurfaces(Edges=room_full_12)
graft_15 = GraftTree(IncludeEmptyLists=True, IncludeNullItems=True)
area_2 = Area(Geometry=boundary)  # -> Area, Centroid
area_3 = Area(Geometry=boundary_2)  # -> Area, Centroid
larger_13 = LargerThan(FirstNumber=area_2.Area, SecondNumber=Slider(2, range=0..10))  # -> LargerThan, OrEqualTo
larger_14 = LargerThan(FirstNumber=area_3.Area, SecondNumber=Slider(2, range=0..10))  # -> LargerThan, OrEqualTo
cull_26 = CullPattern(List=boundary, CullPattern=larger_13.LargerThan)
cull_27 = CullPattern(List=boundary_2, CullPattern=larger_14.LargerThan)
lng_10 = ListLength(List=cull_27)
lng_11 = ListLength(List=cull_26)
larger_15 = LargerThan(FirstNumber=lng_10, SecondNumber="1")  # -> LargerThan, OrEqualTo
larger_16 = LargerThan(FirstNumber=lng_11, SecondNumber="1")  # -> LargerThan, OrEqualTo
ma_3 = MassAddition(Input=flatten(larger_15.LargerThan))  # -> Result, PartialResults
ma_4 = MassAddition(Input=flatten(larger_16.LargerThan))  # -> Result, PartialResults
graft_16 = GraftTree(Tree=cull_26, IncludeEmptyLists=True, IncludeNullItems=True)
larger_17 = LargerThan(FirstNumber=ma_3.Result, SecondNumber=0)  # -> LargerThan, OrEqualTo
graft_17 = GraftTree(Tree=cull_27, IncludeEmptyLists=True, IncludeNullItems=True)
larger_18 = LargerThan(FirstNumber=ma_4.Result, SecondNumber=0)  # -> LargerThan, OrEqualTo

flatten_15 = FlattenTree(Tree=graft_16, Path="{0}")

# ----
# Offset instead of Srf Split
clean = CleanTree(RemoveNulls=True, RemoveInvalid=True, RemoveEmpty=False, Tree=graft_16)
wires = BrepWireframe(Brep=clean, Density=-1)
number_slider_11 = Slider(2, range=0..10)
number_slider_12 = Slider(0.3, range=0..10)
join_4 = JoinCurves(Curves=wires, Preserve=False)
polyoffset = PolylineOffset(
    Polylines=join_4,
    Distance=number_slider_12,
    Plane=Plane(origin=(0, 0, 0), x=(0, 0, 0), y=(0, 0, 0)),
    Tolerance=0.01,
    ClosedFillet=number_slider_11,
    OpenFillet=number_slider_11,
    Miter=2)  # -> Contour, Holes
area_4 = Area(Geometry=polyoffset.Holes)  # -> Area, Centroid
sort_8 = SortList(Keys=area_4.Area, ValuesA=polyoffset.Holes)  # -> Keys, ValuesA
item_21 = ListItem(List=reverse(sort_8.ValuesA), Index=0, Wrap=True)
clean_2 = CleanTree(RemoveNulls=True, RemoveInvalid=True, RemoveEmpty=False, Tree=item_21)
polyoffset_2 = PolylineOffset(
    Polylines=clean_2,
    Distance=number_slider_12,
    Plane=Plane(origin=(0, 0, 0), x=(0, 0, 0), y=(0, 0, 0)),
    Tolerance=0.01,
    ClosedFillet=number_slider_11,
    OpenFillet=number_slider_11,
    Miter=2)  # -> Contour, Holes
data_2 = Data(simplify(polyoffset_2.Contour))

item_22 = ListItem(List=flatten(graft_16), Index=number_slider_8, Wrap=True)
item_23 = ListItem(List=flatten(graft_17), Index=number_slider_8, Wrap=True)
item_24 = ListItem(List=flatten_15, Index=Slider(0, range=0..10), Wrap=True)

# ----
# Offset instead of Srf Split
clean_3 = CleanTree(RemoveNulls=True, RemoveInvalid=True, RemoveEmpty=False, Tree=graft_17)
wires_2 = BrepWireframe(Brep=clean_3, Density=-1)
number_slider_13 = Slider(2, range=0..10)
number_slider_14 = Slider(0.3, range=0..10)
join_5 = JoinCurves(Curves=wires_2, Preserve=False)
polyoffset_3 = PolylineOffset(
    Polylines=join_5,
    Distance=number_slider_14,
    Plane=Plane(origin=(0, 0, 0), x=(0, 0, 0), y=(0, 0, 0)),
    Tolerance=0.01,
    ClosedFillet=number_slider_13,
    OpenFillet=number_slider_13,
    Miter=2)  # -> Contour, Holes
area_5 = Area(Geometry=polyoffset_3.Holes)  # -> Area, Centroid
sort_9 = SortList(Keys=area_5.Area, ValuesA=polyoffset_3.Holes)  # -> Keys, ValuesA
item_25 = ListItem(List=reverse(sort_9.ValuesA), Index=0, Wrap=True)

clean_4 = CleanTree(RemoveNulls=True, RemoveInvalid=True, RemoveEmpty=False, Tree=item_25)

polyoffset_4 = PolylineOffset(
    Polylines=clean_4,
    Distance=number_slider_14,
    Plane=Plane(origin=(0, 0, 0), x=(0, 0, 0), y=(0, 0, 0)),
    Tolerance=0.01,
    ClosedFillet=number_slider_13,
    OpenFillet=number_slider_13,
    Miter=2)  # -> Contour, Holes
data_3 = Data(simplify(polyoffset_4.Contour))

trim_22 = TrimTree(Tree=data_3, Depth=1)
trim_23 = TrimTree(Tree=data_2, Depth=1)
filter_22 = StreamFilter(Gate=larger_18.LargerThan, Stream0=data_2, Stream1=trim_23)
filter_23 = StreamFilter(Gate=larger_17.LargerThan, Stream0=data_3, Stream1=trim_22)

boundary_3 = BoundarySurfaces(Edges=data_3)  # disabled
panel_25 = Panel(wires_2)
item_26 = ListItem(List=flatten(boundary_3), Index=number_slider_9, Wrap=True)  # disabled
preview = CustomPreview(Geometry=item_26, Material=swatch_2)  # disabled
result_room_full = Curve(filter_23)
result_room_rdc = Curve(filter_22)
result_room_full_2 = ClusterOutput(result_room_full)
result_room_rdc_2 = ClusterOutput(result_room_rdc)

# ==== cluster Simplify
crv = ClusterInput()
crv_2 = Curve(crv)

# ----
# Simplify
explode = Explode(Curve=crv_2, Recursive=True)  # -> Segments, Vertices
crv_cp = CurveClosestPoint(Point=explode.Vertices, Curve=crv_2)  # -> Point, Parameter, Distance
eval = EvaluateCurve(Curve=crv_2, Parameter=crv_cp.Parameter)  # -> Point, Tangent, Angle
deg = Degrees(Radians=eval.Angle)
smaller = SmallerThan(FirstNumber=deg, SecondNumber="45")  # -> SmallerThan, OrEqualTo
panel = Panel(deg)
dispatch = Dispatch(List=explode.Vertices, DispatchPattern=smaller.SmallerThan)  # -> ListA, ListB
pline = PolyLine(Vertices=dispatch.ListB, Closed=True)

crv_3 = Curve(pline)
crv_4 = ClusterOutput(crv_3)
