# Grasshopper definition generate_docs.gh (Grasshopper 1.0.7)

python = GhPythonScript()  # -> out, a
# ---------- python: Python ----------
import Grasshopper as gh
from Grasshopper.Kernel import IGH_Component
import System.IO as io
import System
import os

def create_component_documentation():
    """
    Iterates through all loaded Grasshopper components and generates
    a Markdown documentation file with details about each one.
    """
    # --- CONFIGURATION ---
    # Set the desired output path for the Markdown file.
    desktop_path = System.Environment.GetFolderPath(System.Environment.SpecialFolder.UserProfile) + "/Downloads/"
    file_name = "grasshopper_components.md"
    file_path = os.path.join(desktop_path, file_name)
    # --- END CONFIGURATION ---

    try:
        # Use a StringBuilder for efficient string concatenation
        md_builder = System.Text.StringBuilder()
        md_builder.AppendLine("# Grasshopper Component Documentation")
        md_builder.AppendLine("An automatically generated list of all available components, their parameters, and descriptions.")
        
        server = gh.Instances.ComponentServer
        
        component_groups = {}
        for proxy in server.ObjectProxies:
            if proxy.Obsolete or proxy.Desc is None:
                continue
            
            category_path = proxy.Desc.Category
            if proxy.Desc.SubCategory and proxy.Desc.SubCategory != "None":
                 category_path += " > " + proxy.Desc.SubCategory

            if not category_path:
                continue

            if category_path not in component_groups:
                component_groups[category_path] = []
            
            component_groups[category_path].Add(proxy)

        sorted_categories = sorted(component_groups.keys())

        for category in sorted_categories:
            md_builder.AppendLine("\n***\n")
            md_builder.AppendLine("## Category: " + category)
            
            sorted_proxies = sorted(component_groups[category], key=lambda p: p.Desc.Name)

            for proxy in sorted_proxies:
                component = proxy.CreateInstance()
                if not component:
                    continue
                
                # --- Final Correction ---
                # Ensure the created object is a standard component with parameters.
                # If not, skip it to prevent errors.
                if not isinstance(component, IGH_Component):
                    continue

                # --- COMPONENT DETAILS ---
                md_builder.AppendLine("\n### " + proxy.Desc.Name)
                md_builder.AppendLine("**Nickname:** `" + proxy.Desc.NickName + "`")
                md_builder.AppendLine("**Description:** " + (proxy.Desc.Description or "No description available."))
                md_builder.AppendLine("**GUID:** `" + str(proxy.Guid) + "`")
                
                # --- INPUT PARAMETERS ---
                md_builder.AppendLine("\n**Inputs:**")
                if component.Params.Input:
                    for param in component.Params.Input:
                        param_type = param.TypeName or "Untyped"
                        md_builder.AppendLine("- **`{0}` ({1}):** {2}".format(param.NickName, param_type, param.Description or "No description."))
                else:
                    md_builder.AppendLine("- *This component has no inputs.*")

                # --- OUTPUT PARAMETERS ---
                md_builder.AppendLine("\n**Outputs:**")
                if component.Params.Output:
                    for param in component.Params.Output:
                        param_type = param.TypeName or "Untyped"
                        md_builder.AppendLine("- **`{0}` ({1}):** {2}".format(param.NickName, param_type, param.Description or "No description."))
                else:
                    md_builder.AppendLine("- *This component has no outputs.*")

        io.File.WriteAllText(file_path, md_builder.ToString())
        
        return "Successfully created documentation at: " + file_path

    except Exception as e:
        import traceback
        return "An error occurred: " + str(e) + "\n" + traceback.format_exc()

# --- Execution ---
a = create_component_documentation()
# ---------- end python ----------
panel = Panel(python.a)
