# Grasshopper definition buildings in plots.ghx (Grasshopper 1.0.7)

number_slider = Slider(200, range=0..200)
crv = Curve(<curve referenced from the Rhino model>)
explode = Explode(Curve=crv, Recursive=True)  # -> Segments, Vertices
ext = ExtendCurve(Curve=explode.Segments, Type=0, Start=number_slider, End=number_slider)
srfsplit = SurfaceSplit(Surface=crv, Curves=ext)
rectangle = Rectangle(Plane=PlaneXY(0, 0, 0), XSize=Domain(-1, 1), YSize=Domain(-2, 2), Radius=0)  # -> Rectangle, Length
flip = FlipCurve(Curve=srfsplit, Guide=rectangle.Rectangle)  # -> Curve, Flag
build_depth = Slider(15.94, range=5..18)
bld_num = Slider(7, range=4..20)
offset = OffsetCurve(Curve=flip.Curve, Distance="-5", Corners=1)
offset_2 = OffsetCurve(Curve=offset, Distance=expr("-x", build_depth), Corners=1)
divide = DivideCurve(Curve=offset, Count=bld_num, Kinks=False)  # -> Points, Tangents, Parameters
crv_cp = CurveClosestPoint(Point=divide.Points, Curve=offset_2)  # -> Point, Parameter, Distance
ln = Line(StartPoint=divide.Points, EndPoint=crv_cp.Point)
ext_2 = ExtendCurve(Curve=ln, Type=0, Start="3", End="3")
boundary = BoundarySurfaces(Edges=flatten([offset_2, offset]))
storeys = Slider(11, range=2..15)
srfsplit_2 = SurfaceSplit(Surface=boundary, Curves=flatten(ext_2))
multiplication = Multiplication(A=storeys, B="3")
Z = UnitZ(Factor=multiplication)
cull = CullPattern(List=srfsplit_2, CullPattern=[False, True])
extr = Extrude(Base=cull, Direction=Z)
preview = CustomPreview(
    Geometry=extr,
    Material={diffuse=RGB(221, 160, 221), emission=RGB(66, 48, 66), shine=0.5, specular=RGB(255, 255, 255), transparency=0})
